# Grasshopper definition 21_0130_StudioDefinition.gh (Grasshopper 1.0.7)
# plug-ins: Human

# ----
# Weather File
panel = Panel("http://climate.onebuilding.org/WMO_Region_4_North_and_Central_America/USA_United_States_of_America/WA_Washington/USA_WA_Seattle-King.County.Intl.AP-Boeing.Field.727935_TMY3.zip")
downloadepw = LBDownloadWeather(weather_URL=panel)  # -> epw_file, stat_file, ddy_file; plug-in component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

# ----
# Simulation Inputs
# Simulation Folder Name:
# Run Simulation
# Simulation Name:
# .sql Filepath:
panel_2 = Panel("C:\IDL\StudioTool\Simulation\Results")
concat = Concatenate(FragmentA=panel_2, FragmentB="\", FragmentC="1zone_run1", FragmentD="\OpenStudio\run\eplusout.sql")
panel_3 = Panel(concat)
runsimulation = BooleanToggle(False)

# ----
# Glazing
north_wwr = Slider(0.49, range=0..1)
north_shade_depth_in = Slider(27, range=0..100)
south_wwr = Slider(0.51, range=0..1)
south_shade_depth_in = Slider(54, range=0..100)
east_wwr = Slider(0.39, range=0..1)
east_shade_depth_in = Slider(100, range=0..100)
west_wwr = Slider(0.21, range=0..1)
west_shade_depth_in = Slider(34, range=0..100)
glazing = ValueList({"Aluminum Double", "Aluminum Triple", "Wood Double", "Wood Triple"}, selected="Wood Double")
east_shgc = ValueList({"Low SHGC": 0.25, "High SHGC": 0.60}, selected="High SHGC")
north_shgc = ValueList({"Low SHGC": 0.25, "High SHGC": 0.60}, selected="High SHGC")
south_shgc = ValueList({"Low SHGC": 0.25, "High SHGC": 0.60}, selected="High SHGC")
west_shgc = ValueList({"Low SHGC": 0.25, "High SHGC": 0.60}, selected="High SHGC")

# ----
# Set Zone Program
bldgprograms = HBBuildingPrograms({"LargeOffice", "MediumOffice", "SmallOffice", "MidriseApartment", "HighriseApartment", "Retail", "StripMall", "PrimarySchool", "SecondarySchool", "SmallHotel", "LargeHotel", "Hospital", "Outpatient", "Laboratory", "Warehouse", "SuperMarket", "FullServiceRestaurant", "QuickServiceRestaurant", "Courthouse", "LargeDataCenterHighITE", "LargeDataCenterLowITE", "SmallDataCenterHighITE", "SmallDataCenterLowITE"}, selected="MidriseApartment")
searchprog = HBSearchPrograms(bldg_prog=bldgprograms)  # -> room_prog; plug-in component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
list = ItemSelector(
    searchprog,
    {"2013::MidriseApartment::Apartment", "2013::MidriseApartment::Corridor", "2013::MidriseApartment::Office"}, selected="2013::MidriseApartment::Apartment")

# ----
# Simulation Outputs
# Output Folder Name:
# Run Output:
savecsv = BooleanToggle(False)
concat_2 = Concatenate(FragmentA=panel_2, FragmentB="\", FragmentC="1zone_run1", FragmentD=".csv")
panel_4 = Panel(concat_2)

adiabaticcrvfromrhino = Curve(<curve referenced from the Rhino model>)
outsidecrvfromrhino = Curve([<curve referenced from the Rhino model> x4])

adiabaticcrvfromrhino_2 = Curve(<curve referenced from the Rhino model>)
outsidecrvfromrhino_2 = Curve([<curve referenced from the Rhino model> x3])

adiabaticcrvfromrhino_3 = Curve()
outsidecrvfromrhino_3 = Curve()

adiabaticcrvfromrhino_4 = Curve()
outsidecrvfromrhino_4 = Curve()

adiabaticcrvfromrhino_5 = Curve()

# ----
# Massing
# Geometry
height = Panel("13")

inputs = Inputs(
    _0_0_3=outsidecrvfromrhino,
    _0_1_3=outsidecrvfromrhino_2,
    _0_2_3=outsidecrvfromrhino_3,
    _0_3_3=outsidecrvfromrhino_4,
    _0_0_4=adiabaticcrvfromrhino,
    _0_1_4=adiabaticcrvfromrhino_2,
    _0_2_4=adiabaticcrvfromrhino_3,
    _0_3_4=adiabaticcrvfromrhino_4,
    _0_4=adiabaticcrvfromrhino_5,
    _0_0_6="ZONE1",
    _0_1_6="ZONE2",
    _0_2_6="ZONE3",
    _0_3_6="ZONE4",
    _0_4_2="ZONE5",
    _0_0_5=north_wwr,
    _0_1_5=south_wwr,
    _0_2_5=east_wwr,
    _0_3_5=west_wwr,
    _0_0=north_shgc,
    _0_1=south_shgc,
    _0_2=east_shgc,
    _0_3=west_shgc,
    _0_0_2=north_shade_depth_in,
    _0_1_2=south_shade_depth_in,
    _0_2_2=east_shade_depth_in,
    _0_3_2=west_shade_depth_in,
    F=height)  # -> n_facade_area_csv, window_area_n_s_e_w_2, s_facade_area_csv, e_facade_area_csv, w_facade_area_csv, opaque_area_n_s_e_w_2, R, _0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
building = GhPythonScript()  # -> out, a
# ---------- building: Python ----------
import studio2021
reload(studio2021)
from studio2021.datastructures import Building

import rhinoscriptsyntax as rs

b = Building()
print(b)
# ---------- end building ----------
building_2 = GhPythonScript(
    znames=inputs.R,
    ceilings=inputs.T_2,
    fan=inputs.n_facade_area_csv,
    fas=inputs.s_facade_area_csv,
    fae=inputs.e_facade_area_csv,
    faw=inputs.w_facade_area_csv,
    wa=inputs.window_area_n_s_e_w_2,
    oa=inputs.opaque_area_n_s_e_w_2,
    wwr_n=inputs._0,
    wwr_s=inputs._1,
    wwr_e=inputs._2,
    wwr_w=inputs._3,
    shgc_n=inputs._0_5,
    shgc_s=inputs._1_2,
    shgc_e=inputs._2_2,
    shgc_w=inputs._3_2,
    shd_n=inputs._0_6,
    shd_s=inputs._1_3,
    shd_e=inputs._2_3,
    shd_w=inputs._3_3,
    ew_n=inputs.T_6,
    ew_s=inputs.T_7,
    ew_e=inputs.T_4,
    ew_w=inputs.T_5,
    aw=inputs.T,
    fs=inputs.T_3)  # -> out, b; inputs znames: tree, ceilings: tree, fan: tree, fas: tree, fae: tree, faw: tree, wa: tree, oa: tree, ew_n: tree, ew_s: tree, ew_e: tree, ew_w: tree, aw: tree, fs: tree
# ---------- building_2: Python ----------
from studio2021.datastructures import Building

import rhinoscriptsyntax as rs

b = Building()

num_zones = znames.BranchCount

b.zones = {i: znames.Branch(i)[0] for i in range(num_zones)}

# ceiling - - -
# @Teresa: Are these branches representing zones?
for i in range(ceilings.BranchCount):
    srf = ceilings.Branch(i)
    if len(srf) > 0:
        p = rs.SurfacePoints(srf[0])
        p = [p[0], p[2], p[3], p[1]]
        b.ceil[b.zones[i]] = p

# exterior walls - - -
# @Teresa: Are these branches representing zones?

# north - 
for i in range(ew_n.BranchCount):
    srf = ew_n.Branch(i)
    if len(srf) > 0:
        p = rs.SurfacePoints(srf[0])
        p = [p[0], p[2], p[3], p[1]]
        b.ew['n'][b.zones[i]] = p

# south - 
for i in range(ew_s.BranchCount):
    srf = ew_s.Branch(i)
    if len(srf) > 0:
        p = rs.SurfacePoints(srf[0])
        p = [p[0], p[2], p[3], p[1]]
        b.ew['s'][b.zones[i]] = p

# east - 
for i in range(ew_e.BranchCount):
    srf = ew_e.Branch(i)
    if len(srf) > 0:
        p = rs.SurfacePoints(srf[0])
        p = [p[0], p[2], p[3], p[1]]
        b.ew['e'][b.zones[i]] = p

# west - 
for i in range(ew_w.BranchCount):
    srf = ew_w.Branch(i)
    if len(srf) > 0:
        p = rs.SurfacePoints(srf[0])
        p = [p[0], p[2], p[3], p[1]]
        b.ew['w'][b.zones[i]] = p

# adiabatic walls - - -
# @Teresa: Are these branches representing zones?
 
for i in range(aw.BranchCount):
    srf = aw.Branch(i)
    if len(srf) > 0:
        p = rs.SurfacePoints(srf[0])
        p = [p[0], p[2], p[3], p[1]]
        b.adia_w[b.zones[i]] = p

# floor surfaces - - -
# @Teresa: Are these branches representing zones?
 
for i in range(fs.BranchCount):
    srf = fs.Branch(i)
    if len(srf) > 0:
        p = rs.SurfacePoints(srf[0])
        p = [p[0], p[2], p[3], p[1]]
        b.floor[b.zones[i]] = p

# facade areas north - - - 
for i in range(fan.BranchCount):
    fa = fan.Branch(i)
    if fa:
        b.fa['n'][b.zones[i]] = fa[0]

# facade areas south - - - 
for i in range(fas.BranchCount):
    fa = fas.Branch(i)
    if fa:
        b.fa['s'][b.zones[i]] = fa[0]

# facade areas east - - - 
for i in range(fae.BranchCount):
    fa = fae.Branch(i)
    if fa:
        b.fa['e'][b.zones[i]] = fa[0]        

# facade areas west - - - 
for i in range(faw.BranchCount):
    fa = faw.Branch(i)
    if fa:
        b.fa['w'][b.zones[i]] = fa[0]
        
# window areas - - -
#TODO: @Prteston: How is wa ordered? NSEW? NSWE?
for i in range(wa.BranchCount):
    wa_ = (wa.Branch(i))
    if wa:
        if i == 0:
            b.wa['n'] = wa_[0]
        if i == 1:
            b.wa['s'] = wa_[0]
        if i == 2:
            b.wa['e'] = wa_[0]
        if i == 3:
            b.wa['w'] = wa_[0]

# opaque areas - - -
#TODO: @Prteston: How is wa ordered? NSEW? NSWE?
for i in range(oa.BranchCount):
    oa_ = (oa.Branch(i))
    if oa:
        if i == 0:
            b.oa['n'] = oa_[0]
        if i == 1:
            b.oa['s'] = oa_[0]
        if i == 2:
            b.oa['e'] = oa_[0]
        if i == 3:
            b.oa['w'] = oa_[0]

# wwr - - -
b.wwr['n'] = wwr_n
b.wwr['s'] = wwr_s
b.wwr['e'] = wwr_e
b.wwr['w'] = wwr_w

# shgc - - -
b.shgc['n'] = shgc_n
b.shgc['s'] = shgc_s
b.shgc['e'] = shgc_e
b.shgc['w'] = shgc_w

# shade depth - - -
b.shd['n'] = shd_n
b.shd['s'] = shd_s
b.shd['e'] = shd_e
b.shd['w'] = shd_w
# ---------- end building_2 ----------
tree_from_building = GhPythonScript(building=building_2.b)  # -> out, a
# ---------- tree_from_building: Python ----------
__author__ = "tmendeze"

import rhinoscriptsyntax as rs
import ghpythonlib.treehelpers as th

ew_w = building.ew['s']
zones = [building.zones[i] for i in building.zones]

tree = [[] for _ in range(len(zones))]
for i, zone in enumerate(zones):
    if zone in ew_w:
        tree[i].append(rs.AddSrfPt(ew_w[zone]))
        #tree[i].append(zone)

print(tree)

a = th.list_to_tree(tree, source=[])
# ---------- end tree_from_building ----------
panel_5 = Panel(building_2.out)
panel_6 = Panel(tree_from_building.a)
panel_7 = Panel(tree_from_building.out)
embodiedcalc = EmbodiedCalc(cluster_input=building.a)
buildingresult = GhPythonScript(X=embodiedcalc)  # -> Out, A

# ----
# Construction Options
# Construction Name:
insulation_thickness_in = Slider(1, range=0..12)
interior_finish = ValueList({"Gyp", "Exposed CLT", "CLT Gyp"}, selected="Gyp")
exterior_wall_framing = ValueList({"2x4 Metal Studs", "CLT", "Concrete", "2x4 Wood Studs"}, selected="CLT")
facade_cladding = ValueList({"Brick", "Fiber Cement", "Metal Panel", "Wood", "Stone"}, selected="Fiber Cement")
cont_ext_insulation = ValueList({"Rigid", "Fiberglass"}, selected="Rigid")

cluster = Cluster(
    name_6="1zone_run1",
    height=height,
    n_wwr=north_wwr,
    n_shgc=north_shgc,
    n_shade_depth=north_shade_depth_in,
    s_wwr=south_wwr,
    s_shgc=south_shgc,
    s_shade_depth=south_shade_depth_in,
    e_wwr=east_wwr,
    e_shgc=east_shgc,
    e_shade_depth=east_shade_depth_in,
    name=facade_cladding,
    w_wwr=west_wwr,
    w_shgc=west_shgc,
    w_shade_depth=west_shade_depth_in,
    floor_area=inputs.zone_floor_area,
    north_facade_area=inputs.n_facade_area_csv,
    south_facade_area=inputs.s_facade_area_csv,
    east_facade_area=inputs.e_facade_area_csv,
    west_facade_area=inputs.w_facade_area_csv,
    save=savecsv,
    path=panel_4,
    name_2=exterior_wall_framing,
    name_3=cont_ext_insulation,
    B=insulation_thickness_in,
    name_4=interior_finish,
    geo_3=inputs.T,
    G=inputs.T,
    T=inputs.R,
    name_5="1zone_run1",
    program=list,
    geo_2=inputs.T_3,
    G_3=inputs.T_3,
    epw_file=downloadepw.epw_file,
    geo=inputs.T_2,
    G_2=inputs.T_2,
    sql=panel_3,
    folder=panel_2,
    write=runsimulation,
    run=runsimulation,
    depth=inputs._0_6,
    ratio_3=inputs._0,
    geo_7=inputs.T_6,
    shgc_2=inputs._0_5,
    G_6=inputs.T_6,
    depth_2=inputs._1_3,
    geo_6=inputs.T_7,
    ratio=inputs._1,
    shgc=inputs._1_2,
    G_5=inputs.T_7,
    glazing_name=glazing,
    depth_4=inputs._2_3,
    ratio_4=inputs._2,
    geo_5=inputs.T_4,
    shgc_4=inputs._2_2,
    G_7=inputs.T_4,
    depth_3=inputs._3_3,
    geo_4=inputs.T_5,
    ratio_2=inputs._3,
    shgc_3=inputs._3_2,
    G_4=inputs.T_5)  # -> r_val_ip, R, u_value

panel_8 = Panel(cluster.R)

# ----
# Wall Assembly
# R-Value
panel_9 = Panel(cluster.r_val_ip)

# ----
# U-Value
panel_10 = Panel(cluster.u_value)

# ==== cluster Inputs
_0_0 = ClusterInput()
_0_1 = ClusterInput()
_0_2 = ClusterInput()
_0_3 = ClusterInput()
_0_0_2 = ClusterInput()
_0_1_2 = ClusterInput()
_0_2_2 = ClusterInput()
_0_3_2 = ClusterInput()
_0_0_3 = ClusterInput()
_0_1_3 = ClusterInput()
_0_2_3 = ClusterInput()
_0_3_3 = ClusterInput()
_0_0_4 = ClusterInput()
_0_1_4 = ClusterInput()
_0_2_4 = ClusterInput()
_0_3_4 = ClusterInput()
_0_4 = ClusterInput()
_0_0_5 = ClusterInput()
_0_1_5 = ClusterInput()
_0_2_5 = ClusterInput()
_0_3_5 = ClusterInput()
_0_0_6 = ClusterInput()
_0_1_6 = ClusterInput()
_0_2_6 = ClusterInput()
_0_3_6 = ClusterInput()
_0_4_2 = ClusterInput()

# ----
# Gathers all zone information
# to create massing
shgc = Entwine(Branch00=_0_0, Branch01=_0_1, Branch02=_0_2, Branch03=_0_3, FlattenInputs=True)  # -> simplify(Result)
shadedepth = Entwine(Branch00=_0_0_2, Branch01=_0_1_2, Branch02=_0_2_2, Branch03=_0_3_2, FlattenInputs=True)  # -> simplify(Result)
outsidecrv = Entwine(Branch00=_0_0_3, Branch01=_0_1_3, Branch02=_0_2_3, Branch03=_0_3_3, FlattenInputs=True)  # -> simplify(Result)
adiabaticcrv = Entwine(Branch00=_0_0_4, Branch01=_0_1_4, Branch02=_0_2_4, Branch03=_0_3_4, Branch04=_0_4, FlattenInputs=True)  # -> simplify(Result)
wwr = Entwine(Branch00=_0_0_5, Branch01=_0_1_5, Branch02=_0_2_5, Branch03=_0_3_5, FlattenInputs=True)  # -> simplify(Result)
zone = Entwine(Branch00=_0_0_6, Branch01=_0_1_6, Branch02=_0_2_6, Branch03=_0_3_6, Branch04=_0_4_2, FlattenInputs=True)  # -> simplify(Result)

n_s_e_w_wwr = ExplodeTree(Data=wwr)  # -> Branch0, Branch1, Branch2, Branch3
R = ClusterOutput(zone)
n_s_e_w_shgc = ExplodeTree(Data=shgc)  # -> Branch0, Branch1, Branch2, Branch3
convert_shade_depth_from_ft_to_m = Multiplication(A=shadedepth, B=0.0254)
_0 = ClusterOutput(n_s_e_w_wwr.Branch0)
_1 = ClusterOutput(n_s_e_w_wwr.Branch1)
_2 = ClusterOutput(n_s_e_w_wwr.Branch2)
_3 = ClusterOutput(n_s_e_w_wwr.Branch3)
_0_5 = ClusterOutput(n_s_e_w_shgc.Branch0)
_1_2 = ClusterOutput(n_s_e_w_shgc.Branch1)
_2_2 = ClusterOutput(n_s_e_w_shgc.Branch2)
_3_2 = ClusterOutput(n_s_e_w_shgc.Branch3)
n_s_e_w_shade_depth_m = ExplodeTree(Data=convert_shade_depth_from_ft_to_m)  # -> Branch0, Branch1, Branch2, Branch3
_0_6 = ClusterOutput(n_s_e_w_shade_depth_m.Branch0)
_1_3 = ClusterOutput(n_s_e_w_shade_depth_m.Branch1)
_2_3 = ClusterOutput(n_s_e_w_shade_depth_m.Branch2)
_3_3 = ClusterOutput(n_s_e_w_shade_depth_m.Branch3)
F = ClusterInput()

# ----
# Massing 1: Creates mass from rhino curves
# and floor to ceiling ht
Z = UnitZ(Factor=F)
extr = Extrude(AdiabaticCrv=adiabaticcrv, Direction=Z)  # -> simplify(AdiabaticSrf)
boundary = BoundarySurfaces(FloorCrvs=[outsidecrv, adiabaticcrv])  # -> simplify(Surfaces)
extr_2 = Extrude(OutsideCrv=outsidecrv, Direction=Z)  # -> simplify(OutsideSrf)
move = Move(Geometry=boundary, Motion=Z)  # -> simplify(CeilingSrf), Transform
area = Area(Geometry=boundary)  # -> ZoneFloorArea, Centroid

extr_3 = Extrude(Base=boundary, Direction=Z)
debrep = DeconstructBrep(Brep=extr_3)  # -> simplify(Faces), Edges, Vertices
match = MatchTree(Tree=debrep.Faces, Guide=extr_2)
area_2 = Area(Geometry=match)  # -> Area, Centroid
brep = Brep(match)

# ----
# Selects faces from Massing 2 that match Massing 1 for exterior walls
area_3 = Area(Geometry=extr_2)  # -> Area, Centroid
srf = Surface([brep, extr_2])
mindex = MemberIndex(Set=area_2.Centroid, Member=area_3.Centroid)  # -> Index, Count
trim = TrimTree(Tree=mindex.Index, Depth=1)
item = ListItem(List=srf, Index=trim, Wrap=True)
clean = CleanTree(RemoveNulls=True, RemoveInvalid=True, RemoveEmpty=True, Tree=item)  # -> simplify(Tree)
facen = FaceNormals(Mesh=clean)  # -> Centers, Normals
cullpt = CullDuplicates(Points=facen.Normals, Tolerance=0.1, CullMode=3)  # -> Points, Indices, Valence
devec = DeconstructVector(Vector=cullpt.Points)  # -> XComponent, YComponent, ZComponent

zone_floor_area = ClusterOutput(area.ZoneFloorArea)

area_4 = Area(Geometry=move.CeilingSrf)  # -> Area, Centroid
mindex_2 = MemberIndex(Set=area_2.Centroid, Member=area_4.Centroid)  # -> Index, Count
srf_2 = Surface([brep, move.CeilingSrf])
trim_2 = TrimTree(Tree=mindex_2.Index, Depth=1)
item_2 = ListItem(List=srf_2, Index=trim_2, Wrap=True)
final_ceiling = CleanTree(RemoveNulls=True, RemoveInvalid=True, RemoveEmpty=False, Tree=item_2)  # -> simplify(Tree)

area_5 = Area(Geometry=extr)  # -> Area, Centroid
srf_3 = Surface([brep, extr])
mindex_3 = MemberIndex(Set=area_2.Centroid, Member=area_5.Centroid)  # -> Index, Count
trim_3 = TrimTree(Tree=mindex_3.Index, Depth=1)
item_3 = ListItem(List=srf_3, Index=trim_3, Wrap=True)
final_interior_wall = CleanTree(RemoveNulls=True, RemoveInvalid=True, RemoveEmpty=False, Tree=item_3)  # -> simplify(Tree)

# ----
# Logic to allow facades to rotate up to
# 44.9 degrees from cardinal directions.
# Creat North exterior wall surface
# Create South exterior wall surface
# Create East exterior wall surface
# Create West exterior wall surface
panel = Panel("1")
larger = LargerThan(FirstNumber=devec.XComponent, SecondNumber="-0.707")  # -> LargerThan, OrEqualTo
smaller = SmallerThan(FirstNumber=devec.YComponent, SecondNumber="-0.707")  # -> SmallerThan, OrEqualTo
larger_2 = LargerThan(FirstNumber=devec.YComponent, SecondNumber="-1")  # -> LargerThan, OrEqualTo
smaller_2 = SmallerThan(FirstNumber=devec.YComponent, SecondNumber=panel)  # -> SmallerThan, OrEqualTo
larger_3 = LargerThan(FirstNumber=devec.YComponent, SecondNumber="0.707")  # -> LargerThan, OrEqualTo
smaller_3 = SmallerThan(FirstNumber=devec.XComponent, SecondNumber=panel)  # -> SmallerThan, OrEqualTo
smaller_4 = SmallerThan(FirstNumber=devec.XComponent, SecondNumber="0.707")  # -> SmallerThan, OrEqualTo
smaller_5 = SmallerThan(FirstNumber=devec.YComponent, SecondNumber="0.707")  # -> SmallerThan, OrEqualTo
larger_4 = LargerThan(FirstNumber=devec.YComponent, SecondNumber="-0.707")  # -> LargerThan, OrEqualTo
larger_5 = LargerThan(FirstNumber=devec.XComponent, SecondNumber="0.707")  # -> LargerThan, OrEqualTo
larger_6 = LargerThan(FirstNumber=devec.XComponent, SecondNumber="-1")  # -> LargerThan, OrEqualTo
smaller_6 = SmallerThan(FirstNumber=devec.XComponent, SecondNumber="-0.707")  # -> SmallerThan, OrEqualTo
and = GateAnd(A=larger.LargerThan, B=smaller_4.SmallerThan)
and_2 = GateAnd(A=larger_2.OrEqualTo, B=smaller.SmallerThan)
and_3 = GateAnd(A=larger_3.LargerThan, B=smaller_2.OrEqualTo)
and_4 = GateAnd(A=larger_5.LargerThan, B=smaller_3.OrEqualTo)
and_5 = GateAnd(A=larger_4.OrEqualTo, B=smaller_5.SmallerThan)
and_6 = GateAnd(A=larger_6.OrEqualTo, B=smaller_6.SmallerThan)
and_7 = GateAnd(A=and, B=and_3)
and_8 = GateAnd(A=and, B=and_2)
and_9 = GateAnd(A=and_5, B=and_6)
and_10 = GateAnd(A=and_4, B=and_5)
cull = CullPattern(List=graft(clean), CullPattern=and_8)
cull_2 = CullPattern(List=graft(clean), CullPattern=and_9)
cull_3 = CullPattern(List=graft(clean), CullPattern=and_10)
cull_4 = CullPattern(List=graft(clean), CullPattern=and_7)
pshift = ShiftPaths(Data=cull, Offset=-2)
pshift_2 = ShiftPaths(Data=cull_2, Offset=-2)
pshift_3 = ShiftPaths(Data=cull_4, Offset=-2)
pshift_4 = ShiftPaths(Data=cull_3, Offset=-2)
south_exterior_wall_final = CleanTree(RemoveNulls=True, RemoveInvalid=True, RemoveEmpty=True, Tree=pshift)
north_exterior_wall_final = CleanTree(RemoveNulls=True, RemoveInvalid=True, RemoveEmpty=True, Tree=pshift_3)
east_exterior_wall_final = CleanTree(RemoveNulls=True, RemoveInvalid=True, RemoveEmpty=True, Tree=pshift_4)
west_exterior_wall_final = CleanTree(RemoveNulls=True, RemoveInvalid=True, RemoveEmpty=True, Tree=pshift_2)

# ----
# Extract N, S, E, and W
# facade areas
area_6 = Area(Geometry=south_exterior_wall_final)  # -> Area, Centroid
area_7 = Area(Geometry=east_exterior_wall_final)  # -> Area, Centroid
area_8 = Area(Geometry=pshift_3)  # -> Area, Centroid
area_9 = Area(Geometry=west_exterior_wall_final)  # -> Area, Centroid
ma = MassAddition(Input=area_8.Area)  # -> NFacadeAreaCsv, PartialResults
ma_2 = MassAddition(Input=area_6.Area)  # -> SFacadeAreaCsv, PartialResults
ma_3 = MassAddition(Input=area_9.Area)  # -> WFacadeAreaCsv, PartialResults
ma_4 = MassAddition(Input=area_7.Area)  # -> EFacadeAreaCsv, PartialResults

n_facade_area_csv = ClusterOutput(ma.NFacadeAreaCsv)
s_facade_area_csv = ClusterOutput(ma_2.SFacadeAreaCsv)
e_facade_area_csv = ClusterOutput(ma_4.EFacadeAreaCsv)
w_facade_area_csv = ClusterOutput(ma_3.WFacadeAreaCsv)
T = ClusterOutput(final_interior_wall)
T_2 = ClusterOutput(final_ceiling)

srf_4 = Surface([brep, boundary])
area_10 = Area(Geometry=boundary)  # -> Area, Centroid
mindex_4 = MemberIndex(Set=area_2.Centroid, Member=area_10.Centroid)  # -> Index, Count
trim_4 = TrimTree(Tree=mindex_4.Index, Depth=1)
item_4 = ListItem(List=srf_4, Index=trim_4, Wrap=True)
final_floor_surface = CleanTree(RemoveNulls=True, RemoveInvalid=True, RemoveEmpty=False, Tree=item_4)  # -> simplify(Tree)

clean_2 = CleanTree(RemoveNulls=True, RemoveInvalid=True, RemoveEmpty=True, Tree=flatten(ma.NFacadeAreaCsv))
clean_3 = CleanTree(RemoveNulls=True, RemoveInvalid=True, RemoveEmpty=True, Tree=flatten(ma_4.EFacadeAreaCsv))
clean_4 = CleanTree(RemoveNulls=True, RemoveInvalid=True, RemoveEmpty=True, Tree=flatten(ma_2.SFacadeAreaCsv))
clean_5 = CleanTree(RemoveNulls=True, RemoveInvalid=True, RemoveEmpty=True, Tree=flatten(ma_3.WFacadeAreaCsv))
T_3 = ClusterOutput(final_floor_surface)
n_total_facade = MassAddition(Input=flatten(clean_2))  # -> Result, PartialResults
s_total_facade = MassAddition(Input=flatten(clean_4))  # -> Result, PartialResults
w_total_facade = MassAddition(Input=flatten(clean_5))  # -> Result, PartialResults
e_total_facade = MassAddition(Input=flatten(clean_3))  # -> Result, PartialResults
e_window_area = Multiplication(A=w_total_facade.Result, B=n_s_e_w_wwr.Branch3)
s_window_area = Multiplication(A=s_total_facade.Result, B=n_s_e_w_wwr.Branch1)
n_window_area = Multiplication(A=n_total_facade.Result, B=n_s_e_w_wwr.Branch0)
e_window_area_2 = Multiplication(A=e_total_facade.Result, B=n_s_e_w_wwr.Branch2)
n_opaque_area = Subtraction(A=n_total_facade.Result, B=n_window_area)
n_opaque_area_2 = Subtraction(A=w_total_facade.Result, B=e_window_area)
n_opaque_area_3 = Subtraction(A=s_total_facade.Result, B=s_window_area)
n_opaque_area_4 = Subtraction(A=e_total_facade.Result, B=e_window_area_2)
window_area_n_s_e_w = Entwine(Branch00=n_window_area, Branch01=s_window_area, Branch02=e_window_area_2, Branch03=e_window_area, FlattenInputs=True)  # -> simplify(Window_area_nSEW)
opaque_area_n_s_e_w = Entwine(Branch00=n_opaque_area, Branch01=n_opaque_area_3, Branch02=n_opaque_area_4, Branch03=n_opaque_area_2, FlattenInputs=True)  # -> simplify(Opaque_area_nSEW)
window_area_n_s_e_w_2 = ClusterOutput(window_area_n_s_e_w)
opaque_area_n_s_e_w_2 = ClusterOutput(opaque_area_n_s_e_w)
T_4 = ClusterOutput(east_exterior_wall_final)
T_5 = ClusterOutput(west_exterior_wall_final)
T_6 = ClusterOutput(north_exterior_wall_final)
T_7 = ClusterOutput(south_exterior_wall_final)

# ==== cluster Cluster

name = ClusterInput()
name_2 = ClusterInput()
name_3 = ClusterInput()
name_4 = ClusterInput()
panel = Panel("Ext. Framing")
panel_2 = Panel("Interior Finish")
importmaterial = GhPythonScript(material_name=name_2)  # -> r_per_in, embodied_carbon, type, thickness_in, thickness_m, conductivity, density, sp_heat, r_value
# ---------- importmaterial: Python ----------
__author__ = "preston"

import rhinoscriptsyntax as rs
import sys

studiopath = "/Users/preston/Documents/GitHub/studio2021/src"
sys.path.append(studiopath)
import studio2021

from studio2021.functions import read_materials

material = read_materials(material_name)

print(material.keys())

r_per_in = material["r_per_in"]
embodied_carbon = material["embodied_carbon"]
type = material["type"]
density = material["density"]
sp_heat = material["sp_heat"]
thickness_in = material["thickness_in"]
thickness_m = material["thickness_m"]
r_value = material["r_value"]
conductivity = material["conductivity"]
# ---------- end importmaterial ----------
importmaterial_2 = GhPythonScript(material_name=name)  # -> r_per_in, embodied_carbon, type, thickness_in, thickness_m, conductivity, density, sp_heat, r_value; same code as importmaterial
panel_3 = Panel("Cont. Ext. Insulation")
importmaterial_3 = GhPythonScript(material_name=name_3)  # -> r_per_in, embodied_carbon, type, thickness_in, thickness_m, conductivity, density, sp_heat, r_value; same code as importmaterial
importmaterial_4 = GhPythonScript(material_name=name_4)  # -> r_per_in, embodied_carbon, type, thickness_in, thickness_m, conductivity, density, sp_heat, r_value; same code as importmaterial
panel_4 = Panel("Facade Cladding")
B = ClusterInput()
multiplication = Multiplication(A="0.0254", B=B)
opaquematnomass = HBOpaqueMaterialNoMass(name="Exterior Air Film", r_value=Slider(0.17, range=0..1))  # -> mat; plug-in component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
opaquemat = HBOpaqueMaterial(
    name=name,
    thickness=importmaterial_2.thickness_m,
    conductivity=importmaterial_2.conductivity,
    density=importmaterial_2.density,
    spec_heat=importmaterial_2.sp_heat)  # -> mat; plug-in component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
opaquematnomass_2 = HBOpaqueMaterialNoMass(name="Air Gap", r_value=Slider(1, range=0..1))  # -> mat; plug-in component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
opaquemat_2 = HBOpaqueMaterial(
    name=name_2,
    thickness=importmaterial.thickness_m,
    conductivity=importmaterial.conductivity,
    density=importmaterial.density,
    spec_heat=importmaterial.sp_heat)  # -> mat; plug-in component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
opaquemat_3 = HBOpaqueMaterial(
    name=name_3,
    thickness=multiplication,
    conductivity=importmaterial_3.conductivity,
    density=importmaterial_3.density,
    spec_heat=importmaterial_3.sp_heat)  # -> mat; plug-in component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
opaquematnomass_3 = HBOpaqueMaterialNoMass(name="Interior Air Film", r_value=Slider(0.68, range=0..1))  # -> mat; plug-in component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
opaquemat_4 = HBOpaqueMaterial(
    name=name_4,
    thickness=importmaterial_4.thickness_m,
    conductivity=importmaterial_4.conductivity,
    density=importmaterial_4.density,
    spec_heat=importmaterial_4.sp_heat)  # -> mat; plug-in component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
txt = Text("Structural ")
concat = Concatenate(FragmentA=txt, FragmentB=name_2)
case = TextCase(Text=name, Culture=127)  # -> UpperCase, LowerCase
concat_2 = Concatenate(JoinSeparator=" ")
concat_3 = Concatenate(FragmentA=concat, FragmentB=case.LowerCase, JoinSeparator=" with ")
opaqueconstr = HBOpaqueConstruction(
    name=concat_3,
    materials=[opaquematnomass, opaquemat, opaquematnomass_2, opaquemat_2, opaquemat_3, opaquemat_4, opaquematnomass_3])  # -> constr; plug-in component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
exteriorsubset = HBExteriorConstructionSubset(exterior_wall=opaqueconstr)  # -> exterior_set; plug-in component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
decnstrmat = HBDeconstructMaterial(mat=opaqueconstr)  # -> values, attr_names, r_val_si, r_val_ip; plug-in component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
pane_glazing_system = Text(" pane glazing system")
concat_4 = Concatenate(FragmentA=concat_3, FragmentC=concat_2, JoinSeparator=" + ")
r_val_ip = ClusterOutput(decnstrmat.r_val_ip)
concat_5 = Concatenate(FragmentA=concat_4, FragmentC=pane_glazing_system)
R = ClusterOutput(concat_5)
constructionset = HBConstructionSet(name=concat_5, exterior_subset=exteriorsubset)  # -> constr_set; plug-in component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

geo = ClusterInput()
geo_2 = ClusterInput()
geo_3 = ClusterInput()
G = ClusterInput()
G_2 = ClusterInput()
G_3 = ClusterInput()

face = HBFace(geo=geo, name="RoofCeiling", type="RoofCeiling", bc="Adiabatic")  # -> report, faces; plug-in component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
match = MatchTree(Tree=face.faces, Guide=G_2)

face_2 = HBFace(geo=geo_3, name="Adiabatic Wall", type="Wall", bc="Adiabatic")  # -> report, faces; plug-in component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
match_2 = MatchTree(Tree=face_2.faces, Guide=G)

face_3 = HBFace(geo=geo_2, name="Floor", type="Floor", bc="Adiabatic")  # -> report, faces; plug-in component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
match_3 = MatchTree(Tree=face_3.faces, Guide=G_3)

name_5 = ClusterInput()
epw_file = ClusterInput()
folder = ClusterInput()
write = ClusterInput()
run = ClusterInput()
sql = ClusterInput()

glazing_name = ClusterInput()
importglazing = GhPythonScript(glazing_name=glazing_name)  # -> frame_type, glass_type, u_value, t_vis, embodied_carbon_metric, embodied_carbon_imperial
# ---------- importglazing: Python ----------
__author__ = "preston"

import rhinoscriptsyntax as rs
import sys

studiopath = "/Users/preston/Documents/GitHub/studio2021/src"
sys.path.append(studiopath)
import studio2021

from studio2021.functions import read_glazing

glazing = read_glazing(glazing_name)

print(glazing.keys())

frame_type = glazing['frame_type']
glass_type = glazing['glass_type']
u_value = glazing['u_value']
t_vis = glazing['t_vis']
embodied_carbon_metric = glazing['embodied_carbon_metric']
embodied_carbon_imperial = glazing['embodied_carbon_imperial']
# ---------- end importglazing ----------
u_value = ClusterOutput(importglazing.u_value)
geo_4 = ClusterInput()
geo_5 = ClusterInput()
geo_6 = ClusterInput()
geo_7 = ClusterInput()
G_4 = ClusterInput()
G_5 = ClusterInput()
G_6 = ClusterInput()
G_7 = ClusterInput()
ratio = ClusterInput()
ratio_2 = ClusterInput()
ratio_3 = ClusterInput()
ratio_4 = ClusterInput()
shgc = ClusterInput()
shgc_2 = ClusterInput()
shgc_3 = ClusterInput()
shgc_4 = ClusterInput()
depth = ClusterInput()
depth_2 = ClusterInput()
depth_3 = ClusterInput()
depth_4 = ClusterInput()

face_4 = HBFace(geo=geo_4, name="Exposed Wall", type="Wall", bc="Outdoors")  # -> report, simplify(faces); plug-in component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
match_4 = MatchTree(Tree=face_4.faces, Guide=G_4)
aperturesbyratio = HBAperturesByRatio(hb_objs=match_4, ratio=flatten(ratio_2))  # -> report, hb_objs; plug-in component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
windowmat = HBWindowMaterial(
    name="AluminumDoublePane",
    u_factor=flatten(importglazing.u_value),
    shgc=flatten(shgc_3),
    t_vis=flatten(importglazing.t_vis))  # -> mat; plug-in component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
windowconstr = HBWindowConstruction(name="WGlass", materials=windowmat)  # -> constr; plug-in component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
applywindowconstr = HBApplyWindowConstruction(hb_objs=aperturesbyratio.hb_objs, constr=windowconstr)  # -> hb_objs; plug-in component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
louvershades = HBLouverShades(hb_objs=applywindowconstr, depth=flatten(depth_3), vertical=True)  # -> report, hb_objs; plug-in component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

face_5 = HBFace(geo=geo_5, name="Exposed Wall", type="Wall", bc="Outdoors")  # -> report, simplify(faces); plug-in component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
match_5 = MatchTree(Tree=face_5.faces, Guide=G_7)
aperturesbyratio_2 = HBAperturesByRatio(hb_objs=match_5, ratio=flatten(ratio_4))  # -> report, hb_objs; plug-in component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
windowmat_2 = HBWindowMaterial(
    name="AluminumDoublePane",
    u_factor=flatten(importglazing.u_value),
    shgc=flatten(shgc_4),
    t_vis=flatten(importglazing.t_vis))  # -> mat; plug-in component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
windowconstr_2 = HBWindowConstruction(name="EGlass", materials=windowmat_2)  # -> constr; plug-in component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
applywindowconstr_2 = HBApplyWindowConstruction(hb_objs=aperturesbyratio_2.hb_objs, constr=windowconstr_2)  # -> hb_objs; plug-in component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
louvershades_2 = HBLouverShades(hb_objs=applywindowconstr_2, depth=flatten(depth_4), vertical=True)  # -> report, hb_objs; plug-in component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

face_6 = HBFace(geo=geo_6, name="Exposed Wall", type="Wall", bc="Outdoors")  # -> report, simplify(faces); plug-in component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
match_6 = MatchTree(Tree=face_6.faces, Guide=G_5)
aperturesbyratio_3 = HBAperturesByRatio(hb_objs=match_6, ratio=flatten(ratio))  # -> report, hb_objs; plug-in component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
windowmat_3 = HBWindowMaterial(
    name="AluminumDoublePane",
    u_factor=flatten(importglazing.u_value),
    shgc=flatten(shgc),
    t_vis=flatten(importglazing.t_vis))  # -> mat; plug-in component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
windowconstr_3 = HBWindowConstruction(name="SGlass", materials=windowmat_3)  # -> constr; plug-in component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
applywindowconstr_3 = HBApplyWindowConstruction(hb_objs=aperturesbyratio_3.hb_objs, constr=windowconstr_3)  # -> hb_objs; plug-in component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
louvershades_3 = HBLouverShades(hb_objs=applywindowconstr_3, depth=flatten(depth_2))  # -> report, hb_objs; plug-in component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

face_7 = HBFace(geo=geo_7, name="Exposed Wall", type="Wall", bc="Outdoors")  # -> report, simplify(faces); plug-in component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
match_7 = MatchTree(Tree=face_7.faces, Guide=G_6)
aperturesbyratio_4 = HBAperturesByRatio(hb_objs=match_7, ratio=flatten(ratio_3))  # -> report, hb_objs; plug-in component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
windowmat_4 = HBWindowMaterial(
    name="AluminumDoublePane",
    u_factor=flatten(importglazing.u_value),
    shgc=flatten(shgc_2),
    t_vis=flatten(importglazing.t_vis))  # -> mat; plug-in component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
windowconstr_4 = HBWindowConstruction(name="NGlass", materials=windowmat_4)  # -> constr; plug-in component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
applywindowconstr_4 = HBApplyWindowConstruction(hb_objs=aperturesbyratio_4.hb_objs, constr=windowconstr_4)  # -> hb_objs; plug-in component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
louvershades_4 = HBLouverShades(hb_objs=applywindowconstr_4, depth=flatten(depth))  # -> report, hb_objs; plug-in component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

n_s_e_w_exterior_walls = Merge(Data1=louvershades_4.hb_objs, Data2=louvershades_3.hb_objs, Data3=louvershades_2.hb_objs, Data4=louvershades.hb_objs)
remove_empy_zones = CleanTree(RemoveNulls=True, RemoveInvalid=True, RemoveEmpty=True, Tree=n_s_e_w_exterior_walls)

clean = CleanTree(RemoveNulls=True, RemoveInvalid=True, RemoveEmpty=True, Tree=[remove_empy_zones, match_2, match_3, match])
tstat = TreeStatistics(Tree=clean)  # -> Paths, Length, Count
T = ClusterInput()
zone_names = TreeBranch(Tree=simplify(T), Path=tstat.Paths, MaintainPaths=True)
program = ClusterInput()
room = HBRoom(faces=clean, name=zone_names, program=program, conditioned=True)  # -> report, room; plug-in component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

clean_2 = CleanTree(RemoveNulls=True, RemoveInvalid=True, RemoveEmpty=False, Tree=room.room)  # -> flatten(Tree)
applyconstrset = HBApplyConstructionSet(rooms=clean_2, constr_set=constructionset)  # -> rooms; plug-in component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

# ----
# Heating, Cooling, & Vent Set Points
applysetpointvals = HBApplySetpointValues(room_or_program=flatten(applyconstrset))  # -> report, mod_obj; plug-in component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
applyloadvals = HBApplyLoadValues(room_or_program=flatten(applysetpointvals.mod_obj))  # -> report, mod_obj; plug-in component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

model = HBModel(rooms=flatten(applyloadvals.mod_obj), name=name_5)  # -> report, model; plug-in component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

# ----
# Energy Simulation
toggle = BooleanToggle(True)
simoutput = HBSimulationOutput(zone_energy_use=toggle, hvac_energy_use=toggle, gains_and_losses=toggle)  # -> report, sim_output; plug-in component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
simpar = HBSimulationParameter(output=simoutput.sim_output, timestep=6)  # -> sim_par; plug-in component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
modeltoosm = HBModelToOSM(model=model.model, epw_file=epw_file, sim_par=simpar, folder=folder, write=write, run=run)  # -> report, jsons, osw, osm, idf, sql, zsz, rdd, html; plug-in component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
roomenergyresult = HBReadRoomEnergyResult(sql=sql)  # -> cooling, heating, lighting, electric_equip, gas_equip, fan_electric, pump_electric, people_gain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; plug-in component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

# ----
# Chart Results
number_slider = Slider(1, range=0..100)
legendpar = LBLegendParameters(min=Slider(0, range=0..100), max=number_slider)  # -> leg_par; plug-in component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
monthlychart = LBMonthlyChart(data=roomenergyresult.lighting)  # -> report, data_mesh, data_lines, legend, borders, labels, y_title, title; plug-in component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
hourlyplot = LBHourlyPlot(data=flatten(roomenergyresult.solar_gain), legend_par=legendpar)  # -> report, mesh, legend, borders, labels, title; plug-in component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

# ----
# Zone Visualize Results
number_slider_2 = Slider(1, range=1..31)
number_slider_3 = Slider(1, range=1..12)
analysisperiod = LBAnalysisPeriod(
    start_month=number_slider_3,
    start_day=number_slider_2,
    start_hour=0,
    end_month=number_slider_3,
    end_day=Slider(31, range=1..31))  # -> period, hoys, dates; plug-in component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
colorrooms = HBColorRooms(
    data=flatten(roomenergyresult.solar_gain),
    rooms_model=flatten(applyloadvals.mod_obj),
    norm_by_flr=Toggle(True),
    period=analysisperiod.period,
    legend_par=legendpar)  # -> report, mesh, wire_frame, legend, title, rooms, colors, values; plug-in component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
vizquick = HBVizualizeQuick(hb_objs=flatten(colorrooms.rooms))  # -> geo; plug-in component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
preview = CustomPreview(Geometry=[colorrooms.legend, colorrooms.wire_frame], Material=ColourSwatch(SwatchColor=RGB(0, 0, 0)))
preview_2 = CustomPreview(Geometry=vizquick, Material=colorrooms.colors)

# ----
# Label Rooms
faceenergyattr = HBFaceEnergyAttributes({"Construction": "properties.energy.construction.display_name", "Materials": "properties.energy.construction.layers", "R-Value": "properties.energy.construction.r_value", "U-Value": "properties.energy.construction.u_value", "U-Factor": "properties.energy.construction.u_factor", "Solar Transmitance [Unshaded]": "properties.energy.construction.solar_transmittance", "Solar Reflectance [Outside]": "properties.energy.construction.outside_solar_reflectance", "Solar Reflectance [Inside]": "properties.energy.construction.inside_solar_reflectance", "Fraction Area Operable": "properties.energy.vent_opening.fraction_area_operable", "Fraction Height Operable": "properties.energy.vent_opening.fraction_height_operable", "Discharge Coefficient": "properties.energy.vent_opening.discharge_coefficient", "Cross Ventilation": "properties.energy.vent_opening.wind_cross_vent"}, selected="Construction")
roomenergyattr = HBRoomEnergyAttributes({"Program": "properties.energy.program_type.display_name", "Construction Set": "properties.energy.construction_set.display_name", "Is Conditioned": "properties.energy.is_conditioned", "People per Area [ppl/m2]": "properties.energy.people.people_per_area", "Area per Person [m2/ppl]": "properties.energy.people.area_per_person", "Lighting per Area [W/m2]": "properties.energy.lighting.watts_per_area", "Electric Equipment per Area [W/m2]": "properties.energy.electric_equipment.watts_per_area", "Gas Equipment per Area [W/m2]": "properties.energy.gas_equipment.watts_per_area", "Infiltration per Exterior Area [m3/s-m2]": "properties.energy.infiltration.flow_per_exterior_area", "Ventilation per Person [m3/s-ppl]": "properties.energy.ventilation.flow_per_person"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}, selected="Ventilation per Person [m3/s-ppl]")
list = ItemSelector(applyloadvals.mod_obj, {"Room: ZONE1", "Room: ZONE2"}, selected="Room: ZONE1")
vizbytype = HBVisualizeByType(rooms=applyloadvals.mod_obj)  # -> walls, interior_walls, roofs, ceilings, exterior_floors, interior_floors, air_walls, apertures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; plug-in component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
labelrooms = HBLabelRooms(rooms_model=flatten(list), attribute=roomenergyattr)  # -> label_text, base_pts, labels, wire_frame; plug-in component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
lablefaces = HBLabelFaces(hb_objs=flatten(list), attribute=faceenergyattr)  # -> label_text, base_pts, labels, wire_frame; plug-in component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

# ----
# Write to Excel
n_shade_depth = ClusterInput()
name_6 = ClusterInput()
height = ClusterInput()
n_wwr = ClusterInput()
n_shgc = ClusterInput()
s_wwr = ClusterInput()
s_shgc = ClusterInput()
s_shade_depth = ClusterInput()
e_wwr = ClusterInput()
e_shgc = ClusterInput()
e_shade_depth = ClusterInput()
w_wwr = ClusterInput()
w_shgc = ClusterInput()
w_shade_depth = ClusterInput()
floor_area = ClusterInput()
north_facade_area = ClusterInput()
south_facade_area = ClusterInput()
east_facade_area = ClusterInput()
west_facade_area = ClusterInput()
save = ClusterInput()
path = ClusterInput()
writetoexcel = WriteToExcel(
    T_10=name_6,
    T=height,
    T_6=decnstrmat.r_val_ip,
    T_3=importglazing.u_value,
    T_2=n_wwr,
    T_4=n_shgc,
    T_5=n_shade_depth,
    T_8=s_wwr,
    T_9=s_shgc,
    T_7=s_shade_depth,
    T_13=e_wwr,
    T_11=e_shgc,
    T_12=e_shade_depth,
    T_15=w_wwr,
    T_16=w_shgc,
    T_14=w_shade_depth,
    D=floor_area,
    data_si_3=roomenergyresult.cooling,
    data_si_4=roomenergyresult.heating,
    data_si_2=roomenergyresult.lighting,
    data_si=roomenergyresult.electric_equip,
    D_5=north_facade_area,
    D_3=south_facade_area,
    D_2=east_facade_area,
    D_4=west_facade_area,
    save=save,
    path=path)

# ==== cluster EmbodiedCalc
cluster_input = ClusterInput()
crv = Curve(<curve referenced from the Rhino model>)
crv_2 = Curve(<curve referenced from the Rhino model>)
# Use Teresa's input for embodied carbon calcs
# You get:
# 
# - Transparent versus opaque areas
# -
north_wwr = Slider(0.38, range=0..1)
span = Slider(10, range=0..10)
# Figure out the structure calcs
span_2 = Slider(10, range=0..10)
number_slider = Slider(10, range=0..10)
panel = Panel("0")
frames = GhPythonScript(polyline=crv_2, span_x=span, span_y=span_2, h=number_slider)  # -> out, cols, beams
# ---------- frames: Python ----------
__author__ = "tmendeze"
__version__ = "2020.11.05"

import rhinoscriptsyntax as rs

a, b, c, d, _ = rs.PolylineVertices(polyline)
ab = rs.Distance(a, b)
ad = rs.Distance(a, d)


numx = int(ab/span_x) + 1
numy = int(ad/span_y) + 1

print(ab, ad)
print(numx, numy)


pts = []
pts_ = []
for i in range(numx):
    temp = []
    temp_ = []
    for j in range(numy):
        pt = rs.AddPoint(a[0] + (i * span_x), a[1] + (j * span_y), a[2])
        pt_ = rs.AddPoint(a[0] + (i * span_x), a[1] + (j * span_y), a[2] + h)
        temp.append(pt)
        temp_.append(pt_)
    pts.append(temp)
    pts_.append(temp_)

cols = []
beams = []
for i in range(numx):
    for j in range(numy):
        cols.append(rs.AddLine(pts[i][j], pts_[i][j]))
        beams.append(rs.AddLine(pts_[-i][-j], pts_[-i][-j - 1]))
        beams.append(rs.AddLine(pts_[-i][-j], pts_[-i - 1][-j]))
# ---------- end frames ----------
envelope = GhPythonScript(wwr=north_wwr, h=number_slider)  # -> out, e, geo
# ---------- envelope: Python ----------
__author__ = "tmendeze"
__version__ = "2020.11.05"

import rhinoscriptsyntax as rs
from studio2021.datastructures import BaseWall
from studio2021.datastructures import BaseWindow
from studio2021.datastructures import Envelope


# Plot envelope +++++++++++++++++++++++++++++++++++++++
a, b, c, d = rs.SurfacePoints(surface)

#a = pts[index]
#b = pts[index +1]
#c = (b[0], b[1], b[2] + h)
#d = (a[0], a[1], a[2] + h)

rec = rs.AddPolyline((a, b, c, d, a))

if wwr > 0:
    cpt = rs.CurveAreaCentroid(rec)[0]
    print(cpt)
    va = rs.VectorScale(rs.VectorCreate(cpt, a), 1 - wwr)
    vb = rs.VectorScale(rs.VectorCreate(cpt, b), 1 - wwr)
    vc = rs.VectorScale(rs.VectorCreate(cpt, c), 1 - wwr)
    vd = rs.VectorScale(rs.VectorCreate(cpt, d), 1 - wwr)
    a_ = rs.VectorAdd(a, va)
    b_ = rs.VectorAdd(b, vb)
    c_ = rs.VectorAdd(c, vc)
    d_ = rs.VectorAdd(d, vd)
    rec_ = rs.AddPolyline((a_, b_, c_, d_, a_))
    wall_guid = rs.AddPlanarSrf([rec, rec_])
    print(wall_guid)
    win_guid = rs.AddPlanarSrf(rec_)
    if wwr == 1.:
        wall_guid = None
        win_guid = rs.AddPlanarSrf(rec_)
else:
    wall_guid = rs.AddPlanarSrf(rec)
    win_guid = None
geo = wall_guid

# +++++++++++++++++++++++++++++++++++++++++++++++++++++

# Compute envelope kgco2e +++++++++++++++++++++++++++++

wall, window = None, None
if wall_guid:
    wall_area = rs.SurfaceArea(wall_guid)[0]
    wall = BaseWall(wall_area)
    wall.layers = {'finish':{'kgco2e_ft2': 2.},
                   'insulation':{'kgco2e_ft2': .3}
                  }
              
if win_guid:
    win_area = rs.SurfaceArea(win_guid)[0]
    win_perimeter = rs.CurveLength(rec_)
    window = BaseWindow(win_area, win_perimeter)
    window.layers = {'glass1': {'kgco2e_ft2': 3.},
                     'glass2': {'kgco2e_ft2': 3.}}
    window.profile_kgco2e_ft = 3.

e = Envelope(wwr, wall, window)

print(e.embodied)

# +++++++++++++++++++++++++++++++++++++++++++++++++++++
# ---------- end envelope ----------
envelope_2 = GhPythonScript(polyline=crv_2, index="2", wwr=Slider(0.87, range=0..1), h=number_slider)  # -> out, e, geo; inputs index: Int32
# ---------- envelope_2: Python ----------
__author__ = "tmendeze"
__version__ = "2020.11.05"

import rhinoscriptsyntax as rs
from studio2021.datastructures import BaseWall
from studio2021.datastructures import BaseWindow
from studio2021.datastructures import Envelope


# Plot envelope +++++++++++++++++++++++++++++++++++++++
pts = rs.PolylineVertices(polyline)
a = pts[index]
b = pts[index +1]
c = (b[0], b[1], b[2] + h)
d = (a[0], a[1], a[2] + h)

rec = rs.AddPolyline((a, b, c, d, a))
if wwr > 0:
    cpt = rs.CurveAreaCentroid(rec)[0]
    va = rs.VectorScale(rs.VectorCreate(cpt, a), 1 - wwr)
    vb = rs.VectorScale(rs.VectorCreate(cpt, b), 1 - wwr)
    vc = rs.VectorScale(rs.VectorCreate(cpt, c), 1 - wwr)
    vd = rs.VectorScale(rs.VectorCreate(cpt, d), 1 - wwr)
    a_ = rs.VectorAdd(a, va)
    b_ = rs.VectorAdd(b, vb)
    c_ = rs.VectorAdd(c, vc)
    d_ = rs.VectorAdd(d, vd)
    rec_ = rs.AddPolyline((a_, b_, c_, d_, a_))
    wall_guid = rs.AddPlanarSrf([rec, rec_])
    win_guid = rs.AddPlanarSrf(rec_)
    if wwr == 1.:
        wall_guid = None
        win_guid = rs.AddPlanarSrf(rec_)
else:
    wall_guid = rs.AddPlanarSrf(rec)
    win_guid = None
geo = wall_guid

# +++++++++++++++++++++++++++++++++++++++++++++++++++++

# Compute envelope kgco2e +++++++++++++++++++++++++++++

wall, window = None, None
if wall_guid:
    wall_area = rs.SurfaceArea(wall_guid)[0]
    wall = BaseWall(wall_area)
    wall.layers = {'finish':{'kgco2e_ft2': 2.},
                   'insulation':{'kgco2e_ft2': .3}
                  }
              
if win_guid:
    win_area = rs.SurfaceArea(win_guid)[0]
    win_perimeter = rs.CurveLength(rec_)
    window = BaseWindow(win_area, win_perimeter)
    window.layers = {'glass1': {'kgco2e_ft2': 3.},
                     'glass2': {'kgco2e_ft2': 3.}}
    window.profile_kgco2e_ft = 3.

e = Envelope(wwr, wall, window)

print(e.embodied)

# +++++++++++++++++++++++++++++++++++++++++++++++++++++
# ---------- end envelope_2 ----------
envelope_3 = GhPythonScript(polyline=crv_2, index="1", wwr=Slider(0.34, range=0..1), h=number_slider)  # -> out, e, geo; inputs index: Int32; same code as envelope_2
envelope_4 = GhPythonScript(polyline=crv_2, index="3", wwr=Slider(0.3, range=0..1), h=number_slider)  # -> out, e, geo; inputs index: Int32; same code as envelope_2
len = Length(Curve=frames.cols)
len_2 = Length(Curve=frames.beams)
geo = Geometry(envelope_2.geo)
geo_2 = Geometry(envelope_3.geo)
geo_3 = Geometry(envelope_4.geo)
# Outputs:
# - monthly energy data
# - envelope & struct & glazing embodied data (3 numbers)
# - operational + embodied over 50 years
geo_4 = Geometry(envelope.geo)
panel_2 = Panel(envelope_2.out)
panel_3 = Panel(envelope_4.out)
panel_4 = Panel(envelope_3.out)
ma = MassAddition(Input=len_2)  # -> Result, PartialResults
ma_2 = MassAddition(Input=len)  # -> Result, PartialResults
panel_5 = Panel(envelope.out)
structure = GhPythonScript(polyline=crv_2, span=span, col_length=ma_2.Result, beam_length=ma.Result)  # -> out, s, geo
# ---------- structure: Python ----------
__author__ = "tmendeze"
__version__ = "2020.11.05"

import rhinoscriptsyntax as rs
from studio2021.datastructures import Structure 


area = rs.CurveArea(polyline)[0]
s = Structure(area, span, col_length, beam_length)
print(s.embodied)
# ---------- end structure ----------
panel_6 = Panel(structure.out)
geo_5 = Geometry(structure.geo)
building = GhPythonScript(envelopes=[envelope.e, envelope_3.e, envelope_2.e, envelope_4.e], structure=structure.s, num=Slider(6, range=0..10))  # -> out, embodied; inputs envelopes: list
# ---------- building: Python ----------
__author__ = "tmendeze"
__version__ = "2020.11.05"

envelope_e = 0
for e in envelopes:
    envelope_e += e.embodied
    print(e.embodied)

structure_e = structure.embodied

embodied = envelope_e + structure_e
print(structure_e)
# ---------- end building ----------
panel_7 = Panel(building.embodied)
cluster_output = ClusterOutput()

# ==== cluster WriteToExcel
data_si = ClusterInput()
data_si_2 = ClusterInput()
data_si_3 = ClusterInput()
data_si_4 = ClusterInput()
toip = LBToIP(data_si=data_si)  # -> data_ip; plug-in component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
toip_2 = LBToIP(data_si=data_si_3)  # -> data_ip; plug-in component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
toip_3 = LBToIP(data_si=data_si_2)  # -> data_ip; plug-in component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
toip_4 = LBToIP(data_si=data_si_4)  # -> data_ip; plug-in component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
xdata = LBDeconstructData(data=toip)  # -> flatten(header), values; plug-in component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
xdata_2 = LBDeconstructData(data=toip_2)  # -> flatten(header), values; plug-in component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
xdata_3 = LBDeconstructData(data=toip_3)  # -> flatten(header), values; plug-in component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
D = ClusterInput()
xdata_4 = LBDeconstructData(data=toip_4)  # -> flatten(header), values; plug-in component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
ma = MassAddition(Input=flatten(D))  # -> Result, PartialResults
bang = ExplodeTree(Data=xdata_2.values)  # -> Branch0, Branch1, Branch2, Branch3, Branch4
bang_2 = ExplodeTree(Data=D)  # -> Branch0, Branch1, Branch2, Branch3, Branch4
input = ClusterInput()
panel = Panel(",,,,,,,,,,,,,,,,,,,,,,,,,,,,,,,,")
T = ClusterInput()
T_2 = ClusterInput()
T_3 = ClusterInput()
bang_3 = ExplodeTree(Data=xdata.values)  # -> Branch0, Branch1, Branch2, Branch3, Branch4
T_4 = ClusterInput()
T_5 = ClusterInput()
T_6 = ClusterInput()
T_7 = ClusterInput()
T_8 = ClusterInput()
T_9 = ClusterInput()
T_10 = ClusterInput()
bang_4 = ExplodeTree(Data=xdata_4.values)  # -> Branch0, Branch1, Branch2, Branch3, Branch4
concat = Concatenate(FragmentA=ma.Result, FragmentB=",")
T_11 = ClusterInput()
T_12 = ClusterInput()
T_13 = ClusterInput()
bang_5 = ExplodeTree(Data=xdata_3.values)  # -> Branch0, Branch1, Branch2, Branch3, Branch4
T_14 = ClusterInput()
T_15 = ClusterInput()
T_16 = ClusterInput()
concat_2 = Concatenate(FragmentA=bang_2.Branch0, FragmentB=",")
D_2 = ClusterInput()
concat_3 = Concatenate(FragmentA=bang_2.Branch1, FragmentB=",")
concat_4 = Concatenate(FragmentA=bang_2.Branch2, FragmentB=",")
join = TextJoin(Text=["Wall Assembly R Value,", T_6, ",,,,,,,,,,,,,,,,,,,,,,,,,,,,,,,,"])
join_2 = TextJoin(Text=["U Value window,", T_3, ",,,,,,,,,,,,,,,,,,,,,,,,,,,,,,,,"])
join_3 = TextJoin(Text=["N Shade depth,", T_5, ",,,,,,,,,,,,,,,,,,,,,,,,,,,,,,,,"])
concat_5 = Concatenate(FragmentA=bang_2.Branch3, FragmentB=",")
join_4 = TextJoin(Text=["N WWR,", T_2, ",,,,,,,,,,,,,,,,,,,,,,,,,,,,,,,,"])
concat_6 = Concatenate(FragmentA=bang_2.Branch4, FragmentB=",")
D_3 = ClusterInput()
join_5 = TextJoin(Text=["N SHGC,", T_4, ",,,,,,,,,,,,,,,,,,,,,,,,,,,,,,,,"])
D_4 = ClusterInput()
join_6 = TextJoin(Text=["Height (ft),", T, ",,,,,,,,,,,,,,,,,,,,,,,,,,,,,,,,"])
join_7 = TextJoin(Text=["S Shade depth,", T_7, ",,,,,,,,,,,,,,,,,,,,,,,,,,,,,,,,"])
join_8 = TextJoin(Text=["S WWR,", T_8, ",,,,,,,,,,,,,,,,,,,,,,,,,,,,,,,,"])
join_9 = TextJoin(Text=["S SHGC,", T_9, ",,,,,,,,,,,,,,,,,,,,,,,,,,,,,,,,"])
D_5 = ClusterInput()
join_10 = TextJoin(Text=[T_10, panel])
join_11 = TextJoin(Text=["Seattle", panel])
join_12 = TextJoin(Text=["E Shade depth,", T_12, ",,,,,,,,,,,,,,,,,,,,,,,,,,,,,,,,"])
panel_2 = Panel("Time, Cooling Engery (kWh) Zone1, Cooling Engery (kBtu) Zone2, Cooling Engery (kBtu) Zone3, Cooling Engery (kBtu) Zone4, Cooling Engery (kBtu) Zone5, Heating Engery (kBtu) Zone1, Heating Engery (kBtu) Zone2, Heating Engery (kBtu) Zone3, Heating Engery (kBtu) Zone4, Heating Engery (kBtu) Zone5, Electric Light Engery (kBtu) Zone1, Electric Light (kBtu) Zone2, Electric Light Energy (kBtu) Zone3, Electric Light Energy (kBtu) Zone4, Electric Light Energy (kBtu) Zone5, Equipment Engery (kBtu) Zone1, Equipment Engery (kBtu) Zone2, Equipment Engery (kBtu) Zone3, Equipment Engery (kBtu) Zone4, Equipment Engery (kBtu) Zone5,")
join_13 = TextJoin(Text=["E WWR,", T_13, ",,,,,,,,,,,,,,,,,,,,,,,,,,,,,,,,"])
ma_2 = MassAddition(Input=bang.Branch0)  # -> Result, PartialResults
join_14 = TextJoin(Text=["E SHGC,", T_11, ",,,,,,,,,,,,,,,,,,,,,,,,,,,,,,,,"])
ma_3 = MassAddition(Input=bang.Branch1)  # -> Result, PartialResults
join_15 = TextJoin(Text=["W Shade depth,", T_14, ",,,,,,,,,,,,,,,,,,,,,,,,,,,,,,,,"])
ma_4 = MassAddition(Input=bang.Branch2)  # -> Result, PartialResults
ma_5 = MassAddition(Input=bang.Branch3)  # -> Result, PartialResults
join_16 = TextJoin(Text=["W WWR,", T_15, ",,,,,,,,,,,,,,,,,,,,,,,,,,,,,,,,"])
ma_6 = MassAddition(Input=bang.Branch4)  # -> Result, PartialResults
join_17 = TextJoin(Text=["W SHGC,", T_16, ",,,,,,,,,,,,,,,,,,,,,,,,,,,,,,,,"])
ma_7 = MassAddition(Input=bang_3.Branch0)  # -> Result, PartialResults
ma_8 = MassAddition(Input=bang_3.Branch1)  # -> Result, PartialResults
ma_9 = MassAddition(Input=bang_3.Branch2)  # -> Result, PartialResults
ma_10 = MassAddition(Input=bang_3.Branch3)  # -> Result, PartialResults
ma_11 = MassAddition(Input=bang_3.Branch4)  # -> Result, PartialResults
ma_12 = MassAddition(Input=bang_4.Branch0)  # -> Result, PartialResults
ma_13 = MassAddition(Input=bang_4.Branch1)  # -> Result, PartialResults
analysisperiod = LBAnalysisPeriod(start_month=1, start_day=1, start_hour=0)  # -> period, hoys, flatten(dates); plug-in component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
ma_14 = MassAddition(Input=bang_4.Branch2)  # -> Result, PartialResults
ma_15 = MassAddition(Input=bang_4.Branch3)  # -> Result, PartialResults
ma_16 = MassAddition(Input=bang_4.Branch4)  # -> Result, PartialResults
ma_17 = MassAddition(Input=bang_5.Branch0)  # -> Result, PartialResults
ma_18 = MassAddition(Input=bang_5.Branch1)  # -> Result, PartialResults
panel_3 = Panel(D_5)
ma_19 = MassAddition(Input=bang_5.Branch2)  # -> Result, PartialResults
ma_20 = MassAddition(Input=bang_5.Branch3)  # -> Result, PartialResults
ma_21 = MassAddition(Input=bang_5.Branch4)  # -> Result, PartialResults
entwine = Entwine(
    Branch00=concat_2,
    Branch01=concat_3,
    Branch02=concat_4,
    Branch03=concat_5,
    Branch04=concat_6,
    Branch05=concat,
    FlattenInputs=True)  # -> flatten(Result)
bang_6 = ExplodeTree(Data=D_2)  # -> Branch0, Branch1, Branch2, Branch3
bang_7 = ExplodeTree(Data=D_3)  # -> Branch0, Branch1, Branch2, Branch3
bang_8 = ExplodeTree(Data=D_4)  # -> Branch0, Branch1, Branch2, Branch3
bang_9 = ExplodeTree(Data=D_5)  # -> Branch0, Branch1, Branch2, Branch3
division = Division(A=ma_2.Result, B=bang_2.Branch0)
division_2 = Division(A=ma_4.Result, B=bang_2.Branch2)
division_3 = Division(A=ma_3.Result, B=bang_2.Branch1)
division_4 = Division(A=ma_5.Result, B=bang_2.Branch3)
division_5 = Division(A=ma_6.Result, B=bang_2.Branch4)
ma_22 = MassAddition(Input=flatten([ma_2.Result, ma_12.Result, ma_17.Result, ma_7.Result]))  # -> Result, PartialResults
division_6 = Division(A=ma_7.Result, B=bang_2.Branch0)
division_7 = Division(A=ma_9.Result, B=bang_2.Branch2)
division_8 = Division(A=ma_8.Result, B=bang_2.Branch1)
ma_23 = MassAddition(Input=flatten([bang.Branch3, bang_4.Branch3, bang_3.Branch3]))  # -> Result, PartialResults
division_9 = Division(A=ma_10.Result, B=bang_2.Branch3)
ma_24 = MassAddition(Input=flatten([ma_4.Result, bang_4.Branch2, bang_5.Branch2, bang_3.Branch2]))  # -> Result, PartialResults
division_10 = Division(A=ma_11.Result, B=bang_2.Branch4)
division_11 = Division(A=ma_12.Result, B=bang_2.Branch0)
division_12 = Division(A=ma_14.Result, B=bang_2.Branch2)
division_13 = Division(A=ma_13.Result, B=bang_2.Branch1)
ma_25 = MassAddition(Input=flatten([bang.Branch4, bang_4.Branch4, bang_5.Branch4, bang_3.Branch4]))  # -> Result, PartialResults
ma_26 = MassAddition(Input=flatten([ma_3.Result, ma_13.Result, ma_18.Result, ma_8.Result]))  # -> Result, PartialResults
division_14 = Division(A=ma_15.Result, B=bang_2.Branch3)
division_15 = Division(A=ma_16.Result, B=bang_2.Branch4)
division_16 = Division(A=ma_21.Result, B=bang_2.Branch4)
division_17 = Division(A=ma_17.Result, B=bang_2.Branch0)
division_18 = Division(A=ma_19.Result, B=bang_2.Branch2)
division_19 = Division(A=ma_18.Result, B=bang_2.Branch1)
division_20 = Division(A=ma_20.Result, B=bang_2.Branch3)
concat_7 = Concatenate(FragmentA=division_2, FragmentB=",")  # -> flatten(Result)
concat_8 = Concatenate(FragmentA=division_4, FragmentB=",")  # -> flatten(Result)
concat_9 = Concatenate(FragmentA=division_3, FragmentB=",")  # -> flatten(Result)
concat_10 = Concatenate(FragmentA=division, FragmentB=",")  # -> flatten(Result)
concat_11 = Concatenate(FragmentA=division_5, FragmentB=",")  # -> flatten(Result)
join_18 = TextJoin(Text=["Floor Area (ft2),", entwine])
entwine_2 = Entwine(
    Branch00=analysisperiod.dates,
    Branch01=bang.Branch0,
    Branch02=bang.Branch1,
    Branch03=bang.Branch2,
    Branch04=bang.Branch3,
    Branch05=bang.Branch4,
    Branch06=bang_4.Branch0,
    Branch07=bang_4.Branch1,
    Branch08=bang_4.Branch2,
    Branch09=bang_4.Branch3,
    Branch010=bang_4.Branch4,
    Branch011=bang_5.Branch0,
    Branch012=bang_5.Branch1,
    Branch013=bang_5.Branch2,
    Branch014=bang_5.Branch3,
    Branch015=bang_5.Branch4,
    Branch016=bang_3.Branch0,
    Branch017=bang_3.Branch1,
    Branch018=bang_3.Branch2,
    Branch019=bang_3.Branch3,
    Branch020=bang_3.Branch4,
    FlattenInputs=True)  # -> simplify(Result)
concat_12 = Concatenate(FragmentA=bang_6.Branch1, FragmentB=",")  # -> flatten(Result)
concat_13 = Concatenate(FragmentA=bang_6.Branch0, FragmentB=",")  # -> flatten(Result)
concat_14 = Concatenate(FragmentA=bang_6.Branch3, FragmentB=",")  # -> flatten(Result)
concat_15 = Concatenate(FragmentA=bang_6.Branch2, FragmentB=",")  # -> flatten(Result)
concat_16 = Concatenate(FragmentA=bang_7.Branch1, FragmentB=",")  # -> flatten(Result)
concat_17 = Concatenate(FragmentA=bang_7.Branch0, FragmentB=",")  # -> flatten(Result)
concat_18 = Concatenate(FragmentA=division_7, FragmentB=",")  # -> flatten(Result)
concat_19 = Concatenate(FragmentA=bang_7.Branch3, FragmentB=",")  # -> flatten(Result)
concat_20 = Concatenate(FragmentA=bang_8.Branch1, FragmentB=",")  # -> flatten(Result)
concat_21 = Concatenate(FragmentA=bang_7.Branch2, FragmentB=",")  # -> flatten(Result)
concat_22 = Concatenate(FragmentA=bang_8.Branch0, FragmentB=",")  # -> flatten(Result)
concat_23 = Concatenate(FragmentA=bang_8.Branch3, FragmentB=",")  # -> flatten(Result)
concat_24 = Concatenate(FragmentA=division_9, FragmentB=",")  # -> flatten(Result)
concat_25 = Concatenate(FragmentA=bang_8.Branch2, FragmentB=",")  # -> flatten(Result)
concat_26 = Concatenate(FragmentA=division_8, FragmentB=",")  # -> flatten(Result)
concat_27 = Concatenate(FragmentA=division_6, FragmentB=",")  # -> flatten(Result)
concat_28 = Concatenate(FragmentA=division_10, FragmentB=",")  # -> flatten(Result)
concat_29 = Concatenate(FragmentA=division_12, FragmentB=",")  # -> flatten(Result)
concat_30 = Concatenate(FragmentA=bang_9.Branch1, FragmentB=",")  # -> flatten(Result)
concat_31 = Concatenate(FragmentA=bang_9.Branch0, FragmentB=",")  # -> flatten(Result)
concat_32 = Concatenate(FragmentA=bang_9.Branch3, FragmentB=",")  # -> flatten(Result)
concat_33 = Concatenate(FragmentA=division_14, FragmentB=",")  # -> flatten(Result)
concat_34 = Concatenate(FragmentA=bang_9.Branch2, FragmentB=",")  # -> flatten(Result)
division_21 = Division(A=ma_22.Result, B=bang_2.Branch0)
concat_35 = Concatenate(FragmentA=division_13, FragmentB=",")  # -> flatten(Result)
concat_36 = Concatenate(FragmentA=division_11, FragmentB=",")  # -> flatten(Result)
division_22 = Division(A=ma_25.Result, B=bang_2.Branch4)
concat_37 = Concatenate(FragmentA=division_15, FragmentB=",")  # -> flatten(Result)
concat_38 = Concatenate(FragmentA=division_18, FragmentB=",")  # -> flatten(Result)
division_23 = Division(A=ma_23.Result, B=bang_2.Branch3)
concat_39 = Concatenate(FragmentA=division_20, FragmentB=",")  # -> flatten(Result)
concat_40 = Concatenate(FragmentA=division_19, FragmentB=",")  # -> flatten(Result)
division_24 = Division(A=ma_24.Result, B=bang_2.Branch2)
division_25 = Division(A=ma_26.Result, B=bang_2.Branch1)
concat_41 = Concatenate(FragmentA=division_17, FragmentB=",")  # -> flatten(Result)
concat_42 = Concatenate(FragmentA=division_16, FragmentB=",")  # -> flatten(Result)
concat_43 = Concatenate(FragmentA=division_21, FragmentB=",")  # -> flatten(Result)
merge = Merge(Data1=panel_2, Data2=entwine_2)
concat_44 = Concatenate(FragmentA=division_25, FragmentB=",")  # -> flatten(Result)
concat_45 = Concatenate(FragmentA=division_24, FragmentB=",")  # -> flatten(Result)
concat_46 = Concatenate(FragmentA=division_22, FragmentB=",")  # -> flatten(Result)
concat_47 = Concatenate(FragmentA=division_23, FragmentB=",")  # -> flatten(Result)
ma_27 = MassAddition(Input=flatten([bang_6.Branch0, bang_6.Branch1, bang_6.Branch2, bang_6.Branch3]))  # -> Result, PartialResults
ma_28 = MassAddition(Input=flatten([ma_2.Result, ma_3.Result, ma_4.Result, ma_5.Result, ma_6.Result]))  # -> Result, PartialResults
ma_29 = MassAddition(Input=flatten([ma_17.Result, ma_18.Result, ma_19.Result, ma_20.Result, ma_21.Result]))  # -> Result, PartialResults
ma_30 = MassAddition(Input=flatten([bang_7.Branch0, bang_7.Branch1, bang_7.Branch2, bang_7.Branch3]))  # -> Result, PartialResults
ma_31 = MassAddition(Input=flatten([ma_7.Result, ma_8.Result, ma_9.Result, ma_10.Result, ma_11.Result]))  # -> Result, PartialResults
ma_32 = MassAddition(Input=flatten([bang_8.Branch0, bang_8.Branch1, bang_8.Branch2, bang_8.Branch3]))  # -> Result, PartialResults
ma_33 = MassAddition(Input=flatten([ma_12.Result, ma_13.Result, ma_14.Result, ma_15.Result, ma_16.Result]))  # -> Result, PartialResults
ma_34 = MassAddition(Input=flatten([ma_28.Result, ma_33.Result, ma_29.Result, ma_31.Result]))  # -> Result, PartialResults
division_26 = Division(A=ma_34.Result, B=ma.Result)
concat_48 = Concatenate(FragmentA=division_26, FragmentB=",")  # -> flatten(Result)
ma_35 = MassAddition(Input=flatten([bang_9.Branch0, bang_9.Branch1, bang_9.Branch2, bang_9.Branch3]))  # -> Result, PartialResults
flip = FlipMatrix(Data=entwine_2)
division_27 = Division(A=ma_29.Result, B=ma.Result)
concat_49 = Concatenate(FragmentA=ma_27.Result, FragmentB=",")  # -> flatten(Result)
division_28 = Division(A=ma_28.Result, B=ma.Result)
division_29 = Division(A=ma_33.Result, B=ma.Result)
concat_50 = Concatenate(FragmentA=ma_30.Result, FragmentB=",")  # -> flatten(Result)
concat_51 = Concatenate(FragmentA=ma_32.Result, FragmentB=",")  # -> flatten(Result)
concat_52 = Concatenate(FragmentA=ma_35.Result, FragmentB=",")  # -> flatten(Result)
join_19 = TextJoin(Text=["Total EUI (kBtu/sf/year),", concat_43, concat_44, concat_45, concat_47, concat_46, concat_48])
division_30 = Division(A=ma_31.Result, B=ma.Result)
concat_53 = Concatenate(FragmentA=division_27, FragmentB=",")  # -> flatten(Result)
concat_54 = Concatenate(FragmentA=division_28, FragmentB=",")  # -> flatten(Result)
join_20 = TextJoin(Text=["Cooling EUI (kBtu/sf/year),", concat_10, concat_9, concat_7, concat_8, concat_11, concat_54])
join_21 = TextJoin(Text=flip, Join=",")
concat_55 = Concatenate(FragmentA=division_29, FragmentB=",")  # -> flatten(Result)
join_22 = TextJoin(Text=["East Facade Area (ft2),", concat_13, concat_12, concat_15, concat_14, concat_49])
join_23 = TextJoin(Text=["Heating EUI (kBtu/sf/year),", concat_36, concat_35, concat_29, concat_33, concat_37, concat_55])
join_24 = TextJoin(Text=["South Facade Area (ft2),", concat_17, concat_16, concat_21, concat_19, concat_50])
join_25 = TextJoin(Text=["West Facade Area (ft2),", concat_22, concat_20, concat_25, concat_23, concat_51])
join_26 = TextJoin(Text=["Lighting EUI (kBtu/sf/year),", concat_41, concat_40, concat_38, concat_39, concat_42, concat_53])
join_27 = TextJoin(Text=["North Facade Area (ft2),", concat_31, concat_30, concat_34, concat_32, concat_52])
concat_56 = Concatenate(FragmentA=division_30, FragmentB=",")  # -> flatten(Result)
join_28 = TextJoin(Text=["Equip EUI (kBtu/sf/year),", concat_27, concat_26, concat_18, concat_24, concat_28, concat_56])
save = ClusterInput()
path = ClusterInput()
entwine_3 = Entwine(
    Branch00=join_10,
    Branch01=join_11,
    Branch02=panel,
    Branch03=join_6,
    Branch04=join,
    Branch05=join_2,
    Branch06=panel,
    Branch07=join_4,
    Branch08=join_5,
    Branch09=join_3,
    Branch010=join_8,
    Branch011=join_9,
    Branch012=join_7,
    Branch013=join_13,
    Branch014=join_14,
    Branch015=join_12,
    Branch016=join_16,
    Branch017=join_17,
    Branch018=join_15,
    Branch019=panel,
    Branch020=", Zone1, Zone2, Zone3, Zone4,Zone5,Total,,,,,,,,,,,,,,,,,,",
    Branch021=join_18,
    Branch022=join_20,
    Branch023=join_23,
    Branch024=join_26,
    Branch025=join_28,
    Branch026=join_19,
    Branch027=panel,
    Branch028=", Zone1, Zone2, Zone3, Zone4,Total,,,,,,,,,,,,,,,,,,",
    Branch029=join_27,
    Branch030=join_24,
    Branch031=join_22,
    Branch032=join_25,
    Branch033=panel,
    Branch034=panel_2,
    Branch035=join_21,
    FlattenInputs=True)  # -> flatten(Result)
c_script = CSharpScript(save=save, path=path, data=entwine_3)  # inputs save: Boolean, path: String, data: list of String
# ---------- c_script: C# ----------
    if(save){
      var fileinfo = new System.IO.FileInfo(path);
      if(!fileinfo.Directory.Exists){
        fileinfo.Directory.Create();
      }

      var sw = fileinfo.CreateText();
      for(int i = 0; i < data.Count; i++){
        string row = data[i];
        if(i < data.Count - 1){
          sw.WriteLine(row);
        }else{
          sw.Write(row);
        }
      }
      sw.Flush();
      sw.Close();
    }
# ---------- end c_script ----------
panel_4 = Panel(entwine_3)
