# Grasshopper definition 21_0203_TiME.gh (Grasshopper 1.0.7)
# plug-ins: Human

# ----
# Glazing
north_shade_depth_in = Slider(27, range=0..100)
north_wwr = Slider(0.49, range=0..1)
south_wwr = Slider(0.51, range=0..1)
south_shade_depth_in = Slider(54, range=0..100)
east_wwr = Slider(0.39, range=0..1)
east_shade_depth_in = Slider(100, range=0..100)
west_wwr = Slider(0.21, range=0..1)
west_shade_depth_in = Slider(34, range=0..100)
glazing = ValueList({"Aluminum Double", "Aluminum Triple", "Wood Double", "Wood Triple"}, selected="Wood Double")
east_shgc = ValueList({"Low SHGC": 0.25, "High SHGC": 0.60}, selected="High SHGC")
north_shgc = ValueList({"Low SHGC": 0.25, "High SHGC": 0.60}, selected="High SHGC")
south_shgc = ValueList({"Low SHGC": 0.25, "High SHGC": 0.60}, selected="High SHGC")
west_shgc = ValueList({"Low SHGC": 0.25, "High SHGC": 0.60}, selected="High SHGC")

# ----
# Weather File
panel = Panel("http://climate.onebuilding.org/WMO_Region_4_North_and_Central_America/USA_United_States_of_America/WA_Washington/USA_WA_Seattle-King.County.Intl.AP-Boeing.Field.727935_TMY3.zip")
downloadepw = LBDownloadWeather(weather_URL=panel)  # -> epw_file, stat_file, ddy_file; plug-in component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

# ----
# Simulation Inputs
# Simulation Folder Name:
# Run Simulation
# Simulation Name:
# .sql Filepath:
panel_2 = Panel("1zone_run1")
panel_3 = Panel("C:\IDL\StudioTool\Simulation\Results")
concat = Concatenate(FragmentA=panel_3, FragmentB="\", FragmentC=panel_2, FragmentD="\OpenStudio\run\eplusout.sql")
panel_4 = Panel(concat)
runsimulation = BooleanToggle(False)

# ----
# Set Zone Program
bldgprograms = HBBuildingPrograms({"LargeOffice", "MediumOffice", "SmallOffice", "MidriseApartment", "HighriseApartment", "Retail", "StripMall", "PrimarySchool", "SecondarySchool", "SmallHotel", "LargeHotel", "Hospital", "Outpatient", "Laboratory", "Warehouse", "SuperMarket", "FullServiceRestaurant", "QuickServiceRestaurant", "Courthouse", "LargeDataCenterHighITE", "LargeDataCenterLowITE", "SmallDataCenterHighITE", "SmallDataCenterLowITE"}, selected="MidriseApartment")
searchprog = HBSearchPrograms(bldg_prog=bldgprograms)  # -> room_prog; plug-in component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
list = ItemSelector(
    searchprog,
    {"2013::MidriseApartment::Apartment", "2013::MidriseApartment::Corridor", "2013::MidriseApartment::Office"}, selected="2013::MidriseApartment::Apartment")

# ----
# Simulation Outputs
# Output Folder Name:
# Run Output:
savecsv = BooleanToggle(False)
concat_2 = Concatenate(FragmentA=panel_3, FragmentB="\", FragmentC=panel_2, FragmentD=".csv")
panel_5 = Panel(concat_2)

adiabaticcrvfromrhino = Curve(<curve referenced from the Rhino model>)
outsidecrvfromrhino = Curve([<curve referenced from the Rhino model> x4])

adiabaticcrvfromrhino_2 = Curve(<curve referenced from the Rhino model>)
outsidecrvfromrhino_2 = Curve([<curve referenced from the Rhino model> x3])

adiabaticcrvfromrhino_3 = Curve()
outsidecrvfromrhino_3 = Curve()

adiabaticcrvfromrhino_4 = Curve()
outsidecrvfromrhino_4 = Curve()

adiabaticcrvfromrhino_5 = Curve()

# ----
# Massing
# Geometry
height = Panel("13")

inputs = Inputs(
    _0_0_3=outsidecrvfromrhino,
    _0_1_3=outsidecrvfromrhino_2,
    _0_2_3=outsidecrvfromrhino_3,
    _0_3_3=outsidecrvfromrhino_4,
    _0_0_4=adiabaticcrvfromrhino,
    _0_1_4=adiabaticcrvfromrhino_2,
    _0_2_4=adiabaticcrvfromrhino_3,
    _0_3_4=adiabaticcrvfromrhino_4,
    _0_4=adiabaticcrvfromrhino_5,
    _0_0_6="ZONE1",
    _0_1_6="ZONE2",
    _0_2_6="ZONE3",
    _0_3_6="ZONE4",
    _0_4_2="ZONE5",
    _0_0_5=north_wwr,
    _0_1_5=south_wwr,
    _0_2_5=east_wwr,
    _0_3_5=west_wwr,
    _0_0=north_shgc,
    _0_1=south_shgc,
    _0_2=east_shgc,
    _0_3=west_shgc,
    _0_0_2=north_shade_depth_in,
    _0_1_2=south_shade_depth_in,
    _0_2_2=east_shade_depth_in,
    _0_3_2=west_shade_depth_in,
    F=height)  # -> n_facade_area_csv, window_area_n_s_e_w_2, s_facade_area_csv, e_facade_area_csv, w_facade_area_csv, opaque_area_n_s_e_w_2, R, R_2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
panel_6 = Panel(inputs.e_facade_area_csv)
cluster = Cluster(
    geo_3=inputs.T,
    G=inputs.T,
    T=inputs.R,
    program=list,
    geo_2=inputs.T_3,
    G_3=inputs.T_3,
    epw_file=downloadepw.epw_file,
    geo=inputs.T_2,
    G_2=inputs.T_2,
    sql=panel_4,
    folder=panel_3,
    write=runsimulation,
    run=runsimulation,
    depth=inputs.R_4,
    ratio_2=inputs.R_2,
    geo_7=inputs.T_6,
    shgc_2=inputs.R_3,
    G_6=inputs.T_6,
    geo_6=inputs.T_7,
    G_5=inputs.T_7,
    glazing_name=glazing,
    geo_5=inputs.T_4,
    G_7=inputs.T_4,
    geo_4=inputs.T_5,
    G_4=inputs.T_5)  # -> r_val_ip, R, u_value; disabled

# ----
# Construction Options
# Construction Name:
panel_7 = Panel(cluster.R)
insulation_thickness_in = Slider(1, range=0..12)
interior_finish = ValueList({"Gyp", "Exposed CLT", "CLT Gyp"}, selected="Gyp")
exterior_wall_framing = ValueList({"2x4 Metal Studs", "CLT", "Concrete", "2x4 Wood Studs"}, selected="CLT")
facade_cladding = ValueList({"Brick", "Fiber Cement", "Metal Panel", "Wood", "Stone"}, selected="Fiber Cement")
cont_ext_insulation = ValueList({"Rigid", "Fiberglass"}, selected="Rigid")

# ----
# U-Value
panel_8 = Panel(cluster.u_value)

# ----
# Wall Assembly
# R-Value
panel_9 = Panel(cluster.r_val_ip)

building = GhPythonScript(
    znames=inputs.R,
    ceiling_surfaces=inputs.T_2,
    wwr=inputs.R_2,
    shade_gc=inputs.R_3,
    shade_depth=inputs.R_4,
    exterior_walls_n=inputs.T_6,
    exterior_walls_s=inputs.T_7,
    exterior_walls_e=inputs.T_4,
    exterior_walls_w=inputs.T_5,
    adiabatic_walls=inputs.T,
    floor_surfaces=inputs.T_3,
    facade_cladding=facade_cladding,
    external_insulation=cont_ext_insulation,
    insulation_thickness=insulation_thickness_in,
    ewall_framing=exterior_wall_framing,
    int_finish=interior_finish,
    glazing_system=glazing,
    simulation_name=panel_2,
    zone_program=list,
    weather_file=downloadepw.epw_file,
    sql_path=panel_4,
    simulation_folder=panel_5,
    run_simulation=runsimulation)  # -> out, b; inputs znames: tree, ceiling_surfaces: tree, wwr: tree, shade_gc: tree, shade_depth: tree, exterior_walls_n: tree, exterior_walls_s: tree, exterior_walls_e: tree, exterior_walls_w: tree, adiabatic_walls: tree, floor_surfaces: tree
# ---------- building: Python ----------
from studio2021.datastructures import Building
import rhinoscriptsyntax as rs

data = {'znames': znames,
        'ceiling_surfaces': ceiling_surfaces,
        'exterior_walls_n': exterior_walls_n,
        'exterior_walls_s': exterior_walls_s,
        'exterior_walls_e': exterior_walls_e,
        'exterior_walls_w': exterior_walls_w,
        'adiabatic_walls': adiabatic_walls,
        'floor_surfaces': floor_surfaces,
        'wwr':wwr,
        'shade_gc':shade_gc,
        'shade_depth':shade_depth,
        'facade_cladding':facade_cladding,
        'external_insulation':external_insulation,
        'insulation_thickness':insulation_thickness,
        'ewall_framing':ewall_framing,
        'int_finish':int_finish,
        'glazing_system':glazing_system,
        'simulation_name': simulation_name,
        'zone_program': zone_program,
        'weather_file': weather_file,
        'sql_path': sql_path,
        'simulation_folder': simulation_folder,
        'run_simulation': run_simulation,        
        }


b = Building.from_gh_data(data)
# ---------- end building ----------
trees_from_building = GhPythonScript(building=building.b)  # -> out, zones, ceiling_surfaces, facade_area_n, facade_area_s, facade_area_e, facade_area_w, window_areas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
# ---------- trees_from_building: Python ----------
import rhinoscriptsyntax as rs
import ghpythonlib.treehelpers as th

data = building.to_gh_data()

facade_area_n           = data['facade_areas']['n']
facade_area_s           = data['facade_areas']['s']
facade_area_e           = data['facade_areas']['e']
facade_area_w           = data['facade_areas']['w']
exterior_walls_n        = data['exterior_walls']['n']
exterior_walls_s        = data['exterior_walls']['s']
exterior_walls_e        = data['exterior_walls']['e']
exterior_walls_w        = data['exterior_walls']['w']
adiabatic_walls         = data['adiabatic_walls']
floor_surfaces          = data['floor_surfaces']
ceiling_surfaces        = data['ceiling_surfaces']
window_areas            = data['window_areas']
opaque_areas            = data['opaque_areas']
shade_gc                = data['shade_gc']
shade_depth             = data['shade_depth']
facade_cladding         = data['facade_cladding']
facade_cladding         = data['facade_cladding']
external_insulation     = data['external_insulation'] 
insulation_thickness    = data['insulation_thickness']
ewall_framing           = data['ewall_framing']
int_finish              = data['int_finish']
glazing_system          = data['glazing_system']
simulation_name         = data['simulation_name']
zone_program            = data['zone_program']
weather_file            = data['weather_file']
sql_path                = data['sql_path']
simulation_folder       = data['simulation_folder']
run_simulation          = data['run_simulation'] 

print(run_simulation)
# ---------- end trees_from_building ----------

# ==== cluster Inputs
_0_0 = ClusterInput()
_0_1 = ClusterInput()
_0_2 = ClusterInput()
_0_3 = ClusterInput()
_0_0_2 = ClusterInput()
_0_1_2 = ClusterInput()
_0_2_2 = ClusterInput()
_0_3_2 = ClusterInput()
_0_0_3 = ClusterInput()
_0_1_3 = ClusterInput()
_0_2_3 = ClusterInput()
_0_3_3 = ClusterInput()
_0_0_4 = ClusterInput()
_0_1_4 = ClusterInput()
_0_2_4 = ClusterInput()
_0_3_4 = ClusterInput()
_0_4 = ClusterInput()
_0_0_5 = ClusterInput()
_0_1_5 = ClusterInput()
_0_2_5 = ClusterInput()
_0_3_5 = ClusterInput()
_0_0_6 = ClusterInput()
_0_1_6 = ClusterInput()
_0_2_6 = ClusterInput()
_0_3_6 = ClusterInput()
_0_4_2 = ClusterInput()

# ----
# Gathers all zone information
# to create massing
shgc = Entwine(Branch00=_0_0, Branch01=_0_1, Branch02=_0_2, Branch03=_0_3, FlattenInputs=True)  # -> simplify(Result)
shadedepth = Entwine(Branch00=_0_0_2, Branch01=_0_1_2, Branch02=_0_2_2, Branch03=_0_3_2, FlattenInputs=True)  # -> simplify(Result)
outsidecrv = Entwine(Branch00=_0_0_3, Branch01=_0_1_3, Branch02=_0_2_3, Branch03=_0_3_3, FlattenInputs=True)  # -> simplify(Result)
adiabaticcrv = Entwine(Branch00=_0_0_4, Branch01=_0_1_4, Branch02=_0_2_4, Branch03=_0_3_4, Branch04=_0_4, FlattenInputs=True)  # -> simplify(Result)
wwr = Entwine(Branch00=_0_0_5, Branch01=_0_1_5, Branch02=_0_2_5, Branch03=_0_3_5, FlattenInputs=True)  # -> simplify(Result)
zone = Entwine(Branch00=_0_0_6, Branch01=_0_1_6, Branch02=_0_2_6, Branch03=_0_3_6, Branch04=_0_4_2, FlattenInputs=True)  # -> simplify(Result)

R = ClusterOutput(zone)
convert_shade_depth_from_ft_to_m = Multiplication(A=shadedepth, B=0.0254)
R_2 = ClusterOutput(wwr)
R_3 = ClusterOutput(shgc)
R_4 = ClusterOutput(convert_shade_depth_from_ft_to_m)
F = ClusterInput()
join = JoinCurves(Curves=[outsidecrv, adiabaticcrv], Preserve=False)  # -> simplify(Curves)

# ----
# Massing 1: Creates mass from rhino curves
# and floor to ceiling ht
Z = UnitZ(Factor=F)
boundary = BoundarySurfaces(FloorCrvs=join)  # -> simplify(Surfaces)
extr = Extrude(AdiabaticCrv=adiabaticcrv, Direction=Z)  # -> simplify(AdiabaticSrf)
extr_2 = Extrude(OutsideCrv=outsidecrv, Direction=Z)  # -> simplify(OutsideSrf)
move = Move(Geometry=boundary, Motion=Z)  # -> simplify(CeilingSrf), Transform
area = Area(Geometry=boundary)  # -> ZoneFloorArea, Centroid

extr_3 = Extrude(Base=boundary, Direction=Z)
debrep = DeconstructBrep(Brep=extr_3)  # -> simplify(Faces), Edges, Vertices
match = MatchTree(Tree=debrep.Faces, Guide=extr_2)
area_2 = Area(Geometry=match)  # -> Area, Centroid
brep = Brep(match)

# ----
# Selects faces from Massing 2 that match Massing 1 for exterior walls
area_3 = Area(Geometry=extr_2)  # -> Area, Centroid
srf = Surface([brep, extr_2])
mindex = MemberIndex(Set=area_2.Centroid, Member=area_3.Centroid)  # -> Index, Count
trim = TrimTree(Tree=mindex.Index, Depth=1)
item = ListItem(List=srf, Index=trim, Wrap=True)
clean = CleanTree(RemoveNulls=True, RemoveInvalid=True, RemoveEmpty=True, Tree=item)  # -> simplify(Tree)
facen = FaceNormals(Mesh=clean)  # -> Centers, Normals
cullpt = CullDuplicates(Points=facen.Normals, Tolerance=0.1, CullMode=3)  # -> Points, Indices, Valence
devec = DeconstructVector(Vector=cullpt.Points)  # -> XComponent, YComponent, ZComponent

zone_floor_area = ClusterOutput(area.ZoneFloorArea)

area_4 = Area(Geometry=move.CeilingSrf)  # -> Area, Centroid
mindex_2 = MemberIndex(Set=area_2.Centroid, Member=area_4.Centroid)  # -> Index, Count
srf_2 = Surface([brep, move.CeilingSrf])
trim_2 = TrimTree(Tree=mindex_2.Index, Depth=1)
item_2 = ListItem(List=srf_2, Index=trim_2, Wrap=True)
final_ceiling = CleanTree(RemoveNulls=True, RemoveInvalid=True, RemoveEmpty=False, Tree=item_2)  # -> simplify(Tree)

area_5 = Area(Geometry=extr)  # -> Area, Centroid
srf_3 = Surface([brep, extr])
mindex_3 = MemberIndex(Set=area_2.Centroid, Member=area_5.Centroid)  # -> Index, Count
trim_3 = TrimTree(Tree=mindex_3.Index, Depth=1)
item_3 = ListItem(List=srf_3, Index=trim_3, Wrap=True)
final_interior_wall = CleanTree(RemoveNulls=True, RemoveInvalid=True, RemoveEmpty=False, Tree=item_3)  # -> simplify(Tree)

# ----
# Logic to allow facades to rotate up to
# 44.9 degrees from cardinal directions.
# Creat North exterior wall surface
# Create South exterior wall surface
# Create East exterior wall surface
# Create West exterior wall surface
panel = Panel("1")
larger = LargerThan(FirstNumber=devec.XComponent, SecondNumber="-0.707")  # -> LargerThan, OrEqualTo
smaller = SmallerThan(FirstNumber=devec.YComponent, SecondNumber="-0.707")  # -> SmallerThan, OrEqualTo
larger_2 = LargerThan(FirstNumber=devec.YComponent, SecondNumber="-1")  # -> LargerThan, OrEqualTo
smaller_2 = SmallerThan(FirstNumber=devec.YComponent, SecondNumber=panel)  # -> SmallerThan, OrEqualTo
larger_3 = LargerThan(FirstNumber=devec.YComponent, SecondNumber="0.707")  # -> LargerThan, OrEqualTo
smaller_3 = SmallerThan(FirstNumber=devec.XComponent, SecondNumber=panel)  # -> SmallerThan, OrEqualTo
smaller_4 = SmallerThan(FirstNumber=devec.XComponent, SecondNumber="0.707")  # -> SmallerThan, OrEqualTo
smaller_5 = SmallerThan(FirstNumber=devec.YComponent, SecondNumber="0.707")  # -> SmallerThan, OrEqualTo
larger_4 = LargerThan(FirstNumber=devec.YComponent, SecondNumber="-0.707")  # -> LargerThan, OrEqualTo
larger_5 = LargerThan(FirstNumber=devec.XComponent, SecondNumber="0.707")  # -> LargerThan, OrEqualTo
larger_6 = LargerThan(FirstNumber=devec.XComponent, SecondNumber="-1")  # -> LargerThan, OrEqualTo
smaller_6 = SmallerThan(FirstNumber=devec.XComponent, SecondNumber="-0.707")  # -> SmallerThan, OrEqualTo
and = GateAnd(A=larger.LargerThan, B=smaller_4.SmallerThan)
and_2 = GateAnd(A=larger_2.OrEqualTo, B=smaller.SmallerThan)
and_3 = GateAnd(A=larger_3.LargerThan, B=smaller_2.OrEqualTo)
and_4 = GateAnd(A=larger_5.LargerThan, B=smaller_3.OrEqualTo)
and_5 = GateAnd(A=larger_4.OrEqualTo, B=smaller_5.SmallerThan)
and_6 = GateAnd(A=larger_6.OrEqualTo, B=smaller_6.SmallerThan)
and_7 = GateAnd(A=and, B=and_3)
and_8 = GateAnd(A=and, B=and_2)
and_9 = GateAnd(A=and_5, B=and_6)
and_10 = GateAnd(A=and_4, B=and_5)
cull = CullPattern(List=graft(clean), CullPattern=and_8)
cull_2 = CullPattern(List=graft(clean), CullPattern=and_9)
cull_3 = CullPattern(List=graft(clean), CullPattern=and_10)
cull_4 = CullPattern(List=graft(clean), CullPattern=and_7)
pshift = ShiftPaths(Data=cull, Offset=-2)
pshift_2 = ShiftPaths(Data=cull_2, Offset=-2)
pshift_3 = ShiftPaths(Data=cull_4, Offset=-2)
pshift_4 = ShiftPaths(Data=cull_3, Offset=-2)
south_exterior_wall_final = CleanTree(RemoveNulls=True, RemoveInvalid=True, RemoveEmpty=True, Tree=pshift)
north_exterior_wall_final = CleanTree(RemoveNulls=True, RemoveInvalid=True, RemoveEmpty=True, Tree=pshift_3)
east_exterior_wall_final = CleanTree(RemoveNulls=True, RemoveInvalid=True, RemoveEmpty=True, Tree=pshift_4)
west_exterior_wall_final = CleanTree(RemoveNulls=True, RemoveInvalid=True, RemoveEmpty=True, Tree=pshift_2)

# ----
# Extract N, S, E, and W
# facade areas
area_6 = Area(Geometry=south_exterior_wall_final)  # -> Area, Centroid
area_7 = Area(Geometry=east_exterior_wall_final)  # -> Area, Centroid
area_8 = Area(Geometry=pshift_3)  # -> Area, Centroid
area_9 = Area(Geometry=west_exterior_wall_final)  # -> Area, Centroid
ma = MassAddition(Input=area_8.Area)  # -> NFacadeAreaCsv, PartialResults
ma_2 = MassAddition(Input=area_6.Area)  # -> SFacadeAreaCsv, PartialResults
ma_3 = MassAddition(Input=area_9.Area)  # -> WFacadeAreaCsv, PartialResults
ma_4 = MassAddition(Input=area_7.Area)  # -> EFacadeAreaCsv, PartialResults

n_facade_area_csv = ClusterOutput(ma.NFacadeAreaCsv)
s_facade_area_csv = ClusterOutput(ma_2.SFacadeAreaCsv)
e_facade_area_csv = ClusterOutput(ma_4.EFacadeAreaCsv)
w_facade_area_csv = ClusterOutput(ma_3.WFacadeAreaCsv)
T = ClusterOutput(final_interior_wall)
T_2 = ClusterOutput(final_ceiling)

srf_4 = Surface([brep, boundary])
area_10 = Area(Geometry=boundary)  # -> Area, Centroid
mindex_4 = MemberIndex(Set=area_2.Centroid, Member=area_10.Centroid)  # -> Index, Count
trim_4 = TrimTree(Tree=mindex_4.Index, Depth=1)
item_4 = ListItem(List=srf_4, Index=trim_4, Wrap=True)
final_floor_surface = CleanTree(RemoveNulls=True, RemoveInvalid=True, RemoveEmpty=False, Tree=item_4)  # -> simplify(Tree)

clean_2 = CleanTree(RemoveNulls=True, RemoveInvalid=True, RemoveEmpty=True, Tree=flatten(ma.NFacadeAreaCsv))
clean_3 = CleanTree(RemoveNulls=True, RemoveInvalid=True, RemoveEmpty=True, Tree=flatten(ma_4.EFacadeAreaCsv))
clean_4 = CleanTree(RemoveNulls=True, RemoveInvalid=True, RemoveEmpty=True, Tree=flatten(ma_2.SFacadeAreaCsv))
clean_5 = CleanTree(RemoveNulls=True, RemoveInvalid=True, RemoveEmpty=True, Tree=flatten(ma_3.WFacadeAreaCsv))
T_3 = ClusterOutput(final_floor_surface)
n_total_facade = MassAddition(Input=flatten(clean_2))  # -> Result, PartialResults
s_total_facade = MassAddition(Input=flatten(clean_4))  # -> Result, PartialResults
w_total_facade = MassAddition(Input=flatten(clean_5))  # -> Result, PartialResults
e_total_facade = MassAddition(Input=flatten(clean_3))  # -> Result, PartialResults
n_window_area = Multiplication(A=n_total_facade.Result)
e_window_area = Multiplication(A=w_total_facade.Result)
s_window_area = Multiplication(A=s_total_facade.Result)
e_window_area_2 = Multiplication(A=e_total_facade.Result)
n_opaque_area = Subtraction(A=n_total_facade.Result, B=n_window_area)
n_opaque_area_2 = Subtraction(A=w_total_facade.Result, B=e_window_area)
n_opaque_area_3 = Subtraction(A=s_total_facade.Result, B=s_window_area)
n_opaque_area_4 = Subtraction(A=e_total_facade.Result, B=e_window_area_2)
window_area_n_s_e_w = Entwine(Branch00=n_window_area, Branch01=s_window_area, Branch02=e_window_area_2, Branch03=e_window_area, FlattenInputs=True)  # -> simplify(Window_area_nSEW)
opaque_area_n_s_e_w = Entwine(Branch00=n_opaque_area, Branch01=n_opaque_area_3, Branch02=n_opaque_area_4, Branch03=n_opaque_area_2, FlattenInputs=True)  # -> simplify(Opaque_area_nSEW)
window_area_n_s_e_w_2 = ClusterOutput(window_area_n_s_e_w)
opaque_area_n_s_e_w_2 = ClusterOutput(opaque_area_n_s_e_w)
T_4 = ClusterOutput(east_exterior_wall_final)
T_5 = ClusterOutput(west_exterior_wall_final)
T_6 = ClusterOutput(north_exterior_wall_final)
T_7 = ClusterOutput(south_exterior_wall_final)

# ==== cluster Cluster

name = ClusterInput()
name_2 = ClusterInput()
name_3 = ClusterInput()
name_4 = ClusterInput()
panel = Panel("Ext. Framing")
panel_2 = Panel("Interior Finish")
importmaterial = GhPythonScript(material_name=name_2)  # -> r_per_in, embodied_carbon, type, thickness_in, thickness_m, conductivity, density, sp_heat, r_value
# ---------- importmaterial: Python ----------
__author__ = "preston"

import rhinoscriptsyntax as rs
import sys

studiopath = "/Users/preston/Documents/GitHub/studio2021/src"
sys.path.append(studiopath)
import studio2021

from studio2021.functions import read_materials

material = read_materials(material_name)

print(material.keys())

r_per_in = material["r_per_in"]
embodied_carbon = material["embodied_carbon"]
type = material["type"]
density = material["density"]
sp_heat = material["sp_heat"]
thickness_in = material["thickness_in"]
thickness_m = material["thickness_m"]
r_value = material["r_value"]
conductivity = material["conductivity"]
# ---------- end importmaterial ----------
panel_3 = Panel("Cont. Ext. Insulation")
importmaterial_2 = GhPythonScript(material_name=name_3)  # -> r_per_in, embodied_carbon, type, thickness_in, thickness_m, conductivity, density, sp_heat, r_value; same code as importmaterial
importmaterial_3 = GhPythonScript(material_name=name_4)  # -> r_per_in, embodied_carbon, type, thickness_in, thickness_m, conductivity, density, sp_heat, r_value; same code as importmaterial
panel_4 = Panel("Facade Cladding")
importmaterial_4 = GhPythonScript(material_name=name)  # -> r_per_in, embodied_carbon, type, thickness_in, thickness_m, conductivity, density, sp_heat, r_value; same code as importmaterial
B = ClusterInput()
multiplication = Multiplication(A="0.0254", B=B)
opaquematnomass = HBOpaqueMaterialNoMass(name="Exterior Air Film", r_value=Slider(0.17, range=0..1))  # -> mat; plug-in component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
opaquemat = HBOpaqueMaterial(
    name=name,
    thickness=importmaterial_4.thickness_m,
    conductivity=importmaterial_4.conductivity,
    density=importmaterial_4.density,
    spec_heat=importmaterial_4.sp_heat)  # -> mat; plug-in component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
opaquematnomass_2 = HBOpaqueMaterialNoMass(name="Air Gap", r_value=Slider(1, range=0..1))  # -> mat; plug-in component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
opaquemat_2 = HBOpaqueMaterial(
    name=name_2,
    thickness=importmaterial.thickness_m,
    conductivity=importmaterial.conductivity,
    density=importmaterial.density,
    spec_heat=importmaterial.sp_heat)  # -> mat; plug-in component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
opaquemat_3 = HBOpaqueMaterial(
    name=name_3,
    thickness=multiplication,
    conductivity=importmaterial_2.conductivity,
    density=importmaterial_2.density,
    spec_heat=importmaterial_2.sp_heat)  # -> mat; plug-in component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
opaquematnomass_3 = HBOpaqueMaterialNoMass(name="Interior Air Film", r_value=Slider(0.68, range=0..1))  # -> mat; plug-in component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
opaquemat_4 = HBOpaqueMaterial(
    name=name_4,
    thickness=importmaterial_3.thickness_m,
    conductivity=importmaterial_3.conductivity,
    density=importmaterial_3.density,
    spec_heat=importmaterial_3.sp_heat)  # -> mat; plug-in component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
txt = Text("Structural ")
concat = Concatenate(FragmentA=txt, FragmentB=name_2)
case = TextCase(Text=name, Culture=127)  # -> UpperCase, LowerCase
concat_2 = Concatenate(JoinSeparator=" ")
concat_3 = Concatenate(FragmentA=concat, FragmentB=case.LowerCase, JoinSeparator=" with ")
opaqueconstr = HBOpaqueConstruction(
    name=concat_3,
    materials=[opaquematnomass, opaquemat, opaquematnomass_2, opaquemat_2, opaquemat_3, opaquemat_4, opaquematnomass_3])  # -> constr; plug-in component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
exteriorsubset = HBExteriorConstructionSubset(exterior_wall=opaqueconstr)  # -> exterior_set; plug-in component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
decnstrmat = HBDeconstructMaterial(mat=opaqueconstr)  # -> values, attr_names, r_val_si, r_val_ip; plug-in component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
pane_glazing_system = Text(" pane glazing system")
concat_4 = Concatenate(FragmentA=concat_3, FragmentC=concat_2, JoinSeparator=" + ")
r_val_ip = ClusterOutput(decnstrmat.r_val_ip)
concat_5 = Concatenate(FragmentA=concat_4, FragmentC=pane_glazing_system)
R = ClusterOutput(concat_5)
constructionset = HBConstructionSet(name=concat_5, exterior_subset=exteriorsubset)  # -> constr_set; plug-in component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

geo = ClusterInput()
geo_2 = ClusterInput()
geo_3 = ClusterInput()
G = ClusterInput()
G_2 = ClusterInput()
G_3 = ClusterInput()

face = HBFace(geo=geo, name="RoofCeiling", type="RoofCeiling", bc="Adiabatic")  # -> report, faces; plug-in component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
match = MatchTree(Tree=face.faces, Guide=G_2)

face_2 = HBFace(geo=geo_3, name="Adiabatic Wall", type="Wall", bc="Adiabatic")  # -> report, faces; plug-in component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
match_2 = MatchTree(Tree=face_2.faces, Guide=G)

face_3 = HBFace(geo=geo_2, name="Floor", type="Floor", bc="Adiabatic")  # -> report, faces; plug-in component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
match_3 = MatchTree(Tree=face_3.faces, Guide=G_3)

name_5 = ClusterInput()
epw_file = ClusterInput()
folder = ClusterInput()
write = ClusterInput()
run = ClusterInput()
sql = ClusterInput()

glazing_name = ClusterInput()
importglazing = GhPythonScript(glazing_name=glazing_name)  # -> frame_type, glass_type, u_value, t_vis, embodied_carbon_metric, embodied_carbon_imperial
# ---------- importglazing: Python ----------
__author__ = "preston"

import rhinoscriptsyntax as rs
import sys

studiopath = "/Users/preston/Documents/GitHub/studio2021/src"
sys.path.append(studiopath)
import studio2021

from studio2021.functions import read_glazing

glazing = read_glazing(glazing_name)

print(glazing.keys())

frame_type = glazing['frame_type']
glass_type = glazing['glass_type']
u_value = glazing['u_value']
t_vis = glazing['t_vis']
embodied_carbon_metric = glazing['embodied_carbon_metric']
embodied_carbon_imperial = glazing['embodied_carbon_imperial']
# ---------- end importglazing ----------
u_value = ClusterOutput(importglazing.u_value)
geo_4 = ClusterInput()
geo_5 = ClusterInput()
geo_6 = ClusterInput()
geo_7 = ClusterInput()
G_4 = ClusterInput()
G_5 = ClusterInput()
G_6 = ClusterInput()
G_7 = ClusterInput()
ratio = ClusterInput()
ratio_2 = ClusterInput()
ratio_3 = ClusterInput()
ratio_4 = ClusterInput()
shgc = ClusterInput()
shgc_2 = ClusterInput()
shgc_3 = ClusterInput()
shgc_4 = ClusterInput()
depth = ClusterInput()
depth_2 = ClusterInput()
depth_3 = ClusterInput()
depth_4 = ClusterInput()

face_4 = HBFace(geo=geo_4, name="Exposed Wall", type="Wall", bc="Outdoors")  # -> report, simplify(faces); plug-in component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
match_4 = MatchTree(Tree=face_4.faces, Guide=G_4)
aperturesbyratio = HBAperturesByRatio(hb_objs=match_4, ratio=flatten(ratio_3))  # -> report, hb_objs; plug-in component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
windowmat = HBWindowMaterial(
    name="AluminumDoublePane",
    u_factor=flatten(importglazing.u_value),
    shgc=flatten(shgc_3),
    t_vis=flatten(importglazing.t_vis))  # -> mat; plug-in component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
windowconstr = HBWindowConstruction(name="WGlass", materials=windowmat)  # -> constr; plug-in component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
applywindowconstr = HBApplyWindowConstruction(hb_objs=aperturesbyratio.hb_objs, constr=windowconstr)  # -> hb_objs; plug-in component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
louvershades = HBLouverShades(hb_objs=applywindowconstr, depth=flatten(depth_3), vertical=True)  # -> report, hb_objs; plug-in component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

face_5 = HBFace(geo=geo_5, name="Exposed Wall", type="Wall", bc="Outdoors")  # -> report, simplify(faces); plug-in component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
match_5 = MatchTree(Tree=face_5.faces, Guide=G_7)
aperturesbyratio_2 = HBAperturesByRatio(hb_objs=match_5, ratio=flatten(ratio_4))  # -> report, hb_objs; plug-in component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
windowmat_2 = HBWindowMaterial(
    name="AluminumDoublePane",
    u_factor=flatten(importglazing.u_value),
    shgc=flatten(shgc_4),
    t_vis=flatten(importglazing.t_vis))  # -> mat; plug-in component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
windowconstr_2 = HBWindowConstruction(name="EGlass", materials=windowmat_2)  # -> constr; plug-in component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
applywindowconstr_2 = HBApplyWindowConstruction(hb_objs=aperturesbyratio_2.hb_objs, constr=windowconstr_2)  # -> hb_objs; plug-in component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
louvershades_2 = HBLouverShades(hb_objs=applywindowconstr_2, depth=flatten(depth_4), vertical=True)  # -> report, hb_objs; plug-in component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

face_6 = HBFace(geo=geo_6, name="Exposed Wall", type="Wall", bc="Outdoors")  # -> report, simplify(faces); plug-in component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
match_6 = MatchTree(Tree=face_6.faces, Guide=G_5)
aperturesbyratio_3 = HBAperturesByRatio(hb_objs=match_6, ratio=flatten(ratio))  # -> report, hb_objs; plug-in component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
windowmat_3 = HBWindowMaterial(
    name="AluminumDoublePane",
    u_factor=flatten(importglazing.u_value),
    shgc=flatten(shgc),
    t_vis=flatten(importglazing.t_vis))  # -> mat; plug-in component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
windowconstr_3 = HBWindowConstruction(name="SGlass", materials=windowmat_3)  # -> constr; plug-in component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
applywindowconstr_3 = HBApplyWindowConstruction(hb_objs=aperturesbyratio_3.hb_objs, constr=windowconstr_3)  # -> hb_objs; plug-in component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
louvershades_3 = HBLouverShades(hb_objs=applywindowconstr_3, depth=flatten(depth_2))  # -> report, hb_objs; plug-in component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

face_7 = HBFace(geo=geo_7, name="Exposed Wall", type="Wall", bc="Outdoors")  # -> report, simplify(faces); plug-in component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
match_7 = MatchTree(Tree=face_7.faces, Guide=G_6)
aperturesbyratio_4 = HBAperturesByRatio(hb_objs=match_7, ratio=flatten(ratio_2))  # -> report, hb_objs; plug-in component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
windowmat_4 = HBWindowMaterial(
    name="AluminumDoublePane",
    u_factor=flatten(importglazing.u_value),
    shgc=flatten(shgc_2),
    t_vis=flatten(importglazing.t_vis))  # -> mat; plug-in component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
windowconstr_4 = HBWindowConstruction(name="NGlass", materials=windowmat_4)  # -> constr; plug-in component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
applywindowconstr_4 = HBApplyWindowConstruction(hb_objs=aperturesbyratio_4.hb_objs, constr=windowconstr_4)  # -> hb_objs; plug-in component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
louvershades_4 = HBLouverShades(hb_objs=applywindowconstr_4, depth=flatten(depth))  # -> report, hb_objs; plug-in component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

n_s_e_w_exterior_walls = Merge(Data1=louvershades_4.hb_objs, Data2=louvershades_3.hb_objs, Data3=louvershades_2.hb_objs, Data4=louvershades.hb_objs)
remove_empy_zones = CleanTree(RemoveNulls=True, RemoveInvalid=True, RemoveEmpty=True, Tree=n_s_e_w_exterior_walls)

clean = CleanTree(RemoveNulls=True, RemoveInvalid=True, RemoveEmpty=True, Tree=[remove_empy_zones, match_2, match_3, match])
tstat = TreeStatistics(Tree=clean)  # -> Paths, Length, Count
T = ClusterInput()
zone_names = TreeBranch(Tree=simplify(T), Path=tstat.Paths, MaintainPaths=True)
program = ClusterInput()
room = HBRoom(faces=clean, name=zone_names, program=program, conditioned=True)  # -> report, room; plug-in component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

clean_2 = CleanTree(RemoveNulls=True, RemoveInvalid=True, RemoveEmpty=False, Tree=room.room)  # -> flatten(Tree)
applyconstrset = HBApplyConstructionSet(rooms=clean_2, constr_set=constructionset)  # -> rooms; plug-in component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

# ----
# Heating, Cooling, & Vent Set Points
applysetpointvals = HBApplySetpointValues(room_or_program=flatten(applyconstrset))  # -> report, mod_obj; plug-in component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
applyloadvals = HBApplyLoadValues(room_or_program=flatten(applysetpointvals.mod_obj))  # -> report, mod_obj; plug-in component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

model = HBModel(rooms=flatten(applyloadvals.mod_obj), name=name_5)  # -> report, model; plug-in component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

# ----
# Energy Simulation
toggle = BooleanToggle(True)
simoutput = HBSimulationOutput(zone_energy_use=toggle, hvac_energy_use=toggle, gains_and_losses=toggle)  # -> report, sim_output; plug-in component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
simpar = HBSimulationParameter(output=simoutput.sim_output, timestep=6)  # -> sim_par; plug-in component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
modeltoosm = HBModelToOSM(model=model.model, epw_file=epw_file, sim_par=simpar, folder=folder, write=write, run=run)  # -> report, jsons, osw, osm, idf, sql, zsz, rdd, html; plug-in component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
roomenergyresult = HBReadRoomEnergyResult(sql=sql)  # -> cooling, heating, lighting, electric_equip, gas_equip, fan_electric, pump_electric, people_gain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; plug-in component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

# ----
# Chart Results
number_slider = Slider(1, range=0..100)
legendpar = LBLegendParameters(min=Slider(0, range=0..100), max=number_slider)  # -> leg_par; plug-in component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
monthlychart = LBMonthlyChart(data=roomenergyresult.lighting)  # -> report, data_mesh, data_lines, legend, borders, labels, y_title, title; plug-in component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
hourlyplot = LBHourlyPlot(data=flatten(roomenergyresult.solar_gain), legend_par=legendpar)  # -> report, mesh, legend, borders, labels, title; plug-in component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

# ----
# Zone Visualize Results
number_slider_2 = Slider(1, range=1..31)
number_slider_3 = Slider(1, range=1..12)
analysisperiod = LBAnalysisPeriod(
    start_month=number_slider_3,
    start_day=number_slider_2,
    start_hour=0,
    end_month=number_slider_3,
    end_day=Slider(31, range=1..31))  # -> period, hoys, dates; plug-in component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
colorrooms = HBColorRooms(
    data=flatten(roomenergyresult.solar_gain),
    rooms_model=flatten(applyloadvals.mod_obj),
    norm_by_flr=Toggle(True),
    period=analysisperiod.period,
    legend_par=legendpar)  # -> report, mesh, wire_frame, legend, title, rooms, colors, values; plug-in component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
vizquick = HBVizualizeQuick(hb_objs=flatten(colorrooms.rooms))  # -> geo; plug-in component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
preview = CustomPreview(Geometry=[colorrooms.legend, colorrooms.wire_frame], Material=ColourSwatch(SwatchColor=RGB(0, 0, 0)))
preview_2 = CustomPreview(Geometry=vizquick, Material=colorrooms.colors)

# ----
# Label Rooms
faceenergyattr = HBFaceEnergyAttributes({"Construction": "properties.energy.construction.display_name", "Materials": "properties.energy.construction.layers", "R-Value": "properties.energy.construction.r_value", "U-Value": "properties.energy.construction.u_value", "U-Factor": "properties.energy.construction.u_factor", "Solar Transmitance [Unshaded]": "properties.energy.construction.solar_transmittance", "Solar Reflectance [Outside]": "properties.energy.construction.outside_solar_reflectance", "Solar Reflectance [Inside]": "properties.energy.construction.inside_solar_reflectance", "Fraction Area Operable": "properties.energy.vent_opening.fraction_area_operable", "Fraction Height Operable": "properties.energy.vent_opening.fraction_height_operable", "Discharge Coefficient": "properties.energy.vent_opening.discharge_coefficient", "Cross Ventilation": "properties.energy.vent_opening.wind_cross_vent"}, selected="Construction")
roomenergyattr = HBRoomEnergyAttributes({"Program": "properties.energy.program_type.display_name", "Construction Set": "properties.energy.construction_set.display_name", "Is Conditioned": "properties.energy.is_conditioned", "People per Area [ppl/m2]": "properties.energy.people.people_per_area", "Area per Person [m2/ppl]": "properties.energy.people.area_per_person", "Lighting per Area [W/m2]": "properties.energy.lighting.watts_per_area", "Electric Equipment per Area [W/m2]": "properties.energy.electric_equipment.watts_per_area", "Gas Equipment per Area [W/m2]": "properties.energy.gas_equipment.watts_per_area", "Infiltration per Exterior Area [m3/s-m2]": "properties.energy.infiltration.flow_per_exterior_area", "Ventilation per Person [m3/s-ppl]": "properties.energy.ventilation.flow_per_person"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}, selected="Ventilation per Person [m3/s-ppl]")
list = ItemSelector(applyloadvals.mod_obj, {"Room: ZONE1", "Room: ZONE2"}, selected="Room: ZONE1")
vizbytype = HBVisualizeByType(rooms=applyloadvals.mod_obj)  # -> walls, interior_walls, roofs, ceilings, exterior_floors, interior_floors, air_walls, apertures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; plug-in component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
labelrooms = HBLabelRooms(rooms_model=flatten(list), attribute=roomenergyattr)  # -> label_text, base_pts, labels, wire_frame; plug-in component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
lablefaces = HBLabelFaces(hb_objs=flatten(list), attribute=faceenergyattr)  # -> label_text, base_pts, labels, wire_frame; plug-in component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
