# Grasshopper definition 21_0225_TestOutputs_TM.gh (Grasshopper 1.0.7)
# plug-ins: Human

# ----
# Set Zone Program
bldgprograms = HBBuildingPrograms({"LargeOffice", "MediumOffice", "SmallOffice", "MidriseApartment", "HighriseApartment", "Retail", "StripMall", "PrimarySchool", "SecondarySchool", "SmallHotel", "LargeHotel", "Hospital", "Outpatient", "Laboratory", "Warehouse", "SuperMarket", "FullServiceRestaurant", "QuickServiceRestaurant", "Courthouse", "LargeDataCenterHighITE", "LargeDataCenterLowITE", "SmallDataCenterHighITE", "SmallDataCenterLowITE"}, selected="MidriseApartment")
# Wall Assembly
# R-Value
searchprog = HBSearchPrograms(bldg_prog=bldgprograms)  # -> room_prog; plug-in component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
list = ItemSelector(
    searchprog,
    {"2013::MidriseApartment::Apartment", "2013::MidriseApartment::Corridor", "2013::MidriseApartment::Office"}, selected="2013::MidriseApartment::Apartment")

# ----
# Weather File
panel = Panel("http://climate.onebuilding.org/WMO_Region_4_North_and_Central_America/USA_United_States_of_America/WA_Washington/USA_WA_Seattle-King.County.Intl.AP-Boeing.Field.727935_TMY3.zip")
downloadepw = LBDownloadWeather(weather_URL=panel)  # -> epw_file, stat_file, ddy_file; plug-in component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

# ----
# Construction Options
# Construction Name:
cont_ext_insulation = ValueList({"Rigid", "Fiberglass"}, selected="Rigid")
exterior_wall_framing = ValueList({"2x4 Metal Studs", "CLT", "Concrete", "2x4 Wood Studs"}, selected="CLT")
facade_cladding = ValueList({"Brick", "Fiber Cement", "Metal Panel", "Wood", "Stone"}, selected="Fiber Cement")
insulation_thickness_in = Slider(1, range=0..12)
interior_finish = ValueList({"Gyp", "Exposed CLT", "CLT Gyp"}, selected="Gyp")

# ----
# Glazing
south_shgc = ValueList({"Low SHGC": 0.25, "High SHGC": 0.60}, selected="High SHGC")
east_shgc = ValueList({"Low SHGC": 0.25, "High SHGC": 0.60}, selected="High SHGC")
glazing = ValueList({"Aluminum Double", "Aluminum Triple", "Wood Double", "Wood Triple"}, selected="Wood Double")
north_shgc = ValueList({"Low SHGC": 0.25, "High SHGC": 0.60}, selected="High SHGC")
west_shgc = ValueList({"Low SHGC": 0.25, "High SHGC": 0.60}, selected="High SHGC")
south_shade_depth_in = Slider(54, range=0..100)
# U-Value
north_shade_depth_in = Slider(27, range=0..100)
north_wwr = Slider(0.49, range=0..1)
south_wwr = Slider(0.51, range=0..1)
east_wwr = Slider(0.39, range=0..1)
east_shade_depth_in = Slider(100, range=0..100)
west_wwr = Slider(0.21, range=0..1)
west_shade_depth_in = Slider(34, range=0..100)

# ----
# Massing 1
# Retail
# Residential
adiabaticcrvfromrhino = Curve(<curve referenced from the Rhino model>)
outsidecrvfromrhino = Curve([<curve referenced from the Rhino model> x4])
adiabaticcrvfromrhino_2 = Curve(<curve referenced from the Rhino model>)
outsidecrvfromrhino_2 = Curve([<curve referenced from the Rhino model> x3])
outsidecrvfromrhino_3 = Curve([<curve referenced from the Rhino model> x4])

panel_3 = Panel("11")

# ----
# Massing 2
# Retail
# Residential
adiabaticcrvfromrhino_3 = Curve(<curve referenced from the Rhino model>)
adiabaticcrvfromrhino_4 = Curve(<curve referenced from the Rhino model>)
outsidecrvfromrhino_4 = Curve([<curve referenced from the Rhino model> x4])
outsidecrvfromrhino_5 = Curve([<curve referenced from the Rhino model> x3])
outsidecrvfromrhino_6 = Curve([<curve referenced from the Rhino model> x4])
panel_4 = Panel("14")

deconstrprogram = HBDeconstructProgramType(program=list)  # -> people, lighting, electric_equip, gas_equip, infiltration, ventilation, setpoint; plug-in component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
panel_6 = Panel(deconstrprogram.lighting)
lighting = HBLighting()  # -> lighting; plug-in component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

adiabaticcrvfromrhino_5 = Curve([<curve referenced from the Rhino model> x2])
outsidecrvfromrhino_7 = Curve([<curve referenced from the Rhino model> x2])

adiabaticcrvfromrhino_6 = Curve([<curve referenced from the Rhino model> x2])
outsidecrvfromrhino_8 = Curve([<curve referenced from the Rhino model> x2])

adiabaticcrvfromrhino_7 = Curve([<curve referenced from the Rhino model> x2])
outsidecrvfromrhino_9 = Curve([<curve referenced from the Rhino model> x2])

adiabaticcrvfromrhino_8 = Curve([<curve referenced from the Rhino model> x2])
outsidecrvfromrhino_10 = Curve([<curve referenced from the Rhino model> x2])

adiabaticcrvfromrhino_9 = Curve()

# ----
# Massing
# Geometry
height = Panel("14")

modeltoosm = HBModelToOSM()  # -> report, jsons, osw, osm, idf, sql, zsz, rdd, html; plug-in component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
inputs = Inputs(
    _0_0_3=outsidecrvfromrhino_7,
    _0_1_3=outsidecrvfromrhino_9,
    _0_2_3=outsidecrvfromrhino_8,
    _0_3_3=outsidecrvfromrhino_10,
    _0_0_4=adiabaticcrvfromrhino_5,
    _0_1_4=adiabaticcrvfromrhino_7,
    _0_2_4=adiabaticcrvfromrhino_6,
    _0_3_4=adiabaticcrvfromrhino_8,
    _0_4=adiabaticcrvfromrhino_9,
    _0_0_6="ZONE1",
    _0_1_6="ZONE2",
    _0_2_6="ZONE3",
    _0_3_6="ZONE4",
    _0_4_2="ZONE5",
    _0_0_5=north_wwr,
    _0_1_5=south_wwr,
    _0_2_5=east_wwr,
    _0_3_5=west_wwr,
    _0_0=north_shgc,
    _0_1=south_shgc,
    _0_2=east_shgc,
    _0_3=west_shgc,
    _0_0_2=north_shade_depth_in,
    _0_1_2=south_shade_depth_in,
    _0_2_2=east_shade_depth_in,
    _0_3_2=west_shade_depth_in,
    F=height)  # -> n_facade_area_csv, window_area_n_s_e_w_2, s_facade_area_csv, e_facade_area_csv, w_facade_area_csv, opaque_area_n_s_e_w_2, R, _0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

importmaterial = GhPythonScript(material_name=exterior_wall_framing)  # -> r_per_in, embodied_carbon, type, thickness_in, thickness_m, conductivity, density, sp_heat, r_value
# ---------- importmaterial: Python ----------
__author__ = "preston"

import rhinoscriptsyntax as rs
import sys

studiopath = "/Users/preston/Documents/GitHub/studio2021/src"
sys.path.append(studiopath)
import studio2021

from studio2021.functions import read_materials

material = read_materials(material_name)

print(material.keys())

r_per_in = material["r_per_in"]
embodied_carbon = material["embodied_carbon"]
type = material["type"]
density = material["density"]
sp_heat = material["sp_heat"]
thickness_in = material["thickness_in"]
thickness_m = material["thickness_m"]
r_value = material["r_value"]
conductivity = material["conductivity"]
# ---------- end importmaterial ----------
importmaterial_2 = GhPythonScript(material_name=facade_cladding)  # -> r_per_in, embodied_carbon, type, thickness_in, thickness_m, conductivity, density, sp_heat, r_value; same code as importmaterial
importmaterial_3 = GhPythonScript(material_name=cont_ext_insulation)  # -> r_per_in, embodied_carbon, type, thickness_in, thickness_m, conductivity, density, sp_heat, r_value; same code as importmaterial
importmaterial_4 = GhPythonScript(material_name=interior_finish)  # -> r_per_in, embodied_carbon, type, thickness_in, thickness_m, conductivity, density, sp_heat, r_value; same code as importmaterial
panel_7 = Panel("Ext. Framing")
panel_8 = Panel("Interior Finish")
panel_9 = Panel("Cont. Ext. Insulation")
panel_10 = Panel("Facade Cladding")
multiplication = Multiplication(A="0.0254", B=insulation_thickness_in)
opaquemat = HBOpaqueMaterial(
    name=facade_cladding,
    thickness=importmaterial_2.thickness_m,
    conductivity=importmaterial_2.conductivity,
    density=importmaterial_2.density,
    spec_heat=importmaterial_2.sp_heat)  # -> mat; plug-in component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
opaquematnomass = HBOpaqueMaterialNoMass(name="Air Gap", r_value=Slider(1, range=0..1))  # -> mat; plug-in component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
opaquemat_2 = HBOpaqueMaterial(
    name=exterior_wall_framing,
    thickness=importmaterial.thickness_m,
    conductivity=importmaterial.conductivity,
    density=importmaterial.density,
    spec_heat=importmaterial.sp_heat)  # -> mat; plug-in component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
opaquemat_3 = HBOpaqueMaterial(
    name=cont_ext_insulation,
    thickness=multiplication,
    conductivity=importmaterial_3.conductivity,
    density=importmaterial_3.density,
    spec_heat=importmaterial_3.sp_heat)  # -> mat; plug-in component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
opaquemat_4 = HBOpaqueMaterial(
    name=interior_finish,
    thickness=importmaterial_4.thickness_m,
    conductivity=importmaterial_4.conductivity,
    density=importmaterial_4.density,
    spec_heat=importmaterial_4.sp_heat)  # -> mat; plug-in component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
txt = Text("Structural ")
concat = Concatenate(FragmentA=txt, FragmentB=exterior_wall_framing)
case = TextCase(Text=facade_cladding, Culture=127)  # -> UpperCase, LowerCase
concat_2 = Concatenate(JoinSeparator=" ")
concat_3 = Concatenate(FragmentA=concat, FragmentB=case.LowerCase, JoinSeparator=" with ")
opaqueconstr = HBOpaqueConstruction(name=concat_3, materials=[opaquemat, opaquematnomass, opaquemat_2, opaquemat_3, opaquemat_4])  # -> constr; plug-in component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
exteriorsubset = HBExteriorConstructionSubset(exterior_wall=opaqueconstr)  # -> exterior_set; plug-in component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
decnstrmat = HBDeconstructMaterial(mat=opaqueconstr)  # -> values, attr_names, r_val_si, r_val_ip; plug-in component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
concat_4 = Concatenate(FragmentA=concat_3, FragmentC=concat_2, JoinSeparator=" + ")
pane_glazing_system = Text(" pane glazing system")
concat_5 = Concatenate(FragmentA=concat_4, FragmentC=pane_glazing_system)
constructionset = HBConstructionSet(name=concat_5, exterior_subset=exteriorsubset)  # -> constr_set; plug-in component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

face = HBFace(geo=inputs.T, name="Adiabatic Wall", type="Wall", bc="Adiabatic")  # -> report, faces; plug-in component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
match = MatchTree(Tree=face.faces, Guide=inputs.T)

panel_11 = Panel("Adiabatic")
face_2 = HBFace(geo=inputs.T_3, name="Floor", type="Floor", bc="Ground")  # -> report, faces; plug-in component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
match_2 = MatchTree(Tree=face_2.faces, Guide=inputs.T_3)

face_3 = HBFace(geo=inputs.T_2, name="RoofCeiling", type="RoofCeiling", bc="Outdoors")  # -> report, faces; plug-in component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
match_3 = MatchTree(Tree=face_3.faces, Guide=inputs.T_2)

# ----
# Simulation Inputs
# Simulation Folder Name:
# Run Simulation
# Simulation Name:
# .sql Filepath:
panel_13 = Panel("C:\IDL\StudioTool\Simulation\Results")
concat_6 = Concatenate(FragmentA=panel_13, FragmentB="\", FragmentC="massing2_retail", FragmentD="\OpenStudio\run\eplusout.sql")
panel_14 = Panel(concat_6)
runsimulation = BooleanToggle(False)

# ----
# Simulation Outputs
# Output Folder Name:
# Run Output:
savecsv = BooleanToggle(False)
concat_7 = Concatenate(FragmentA=panel_13, FragmentB="\", FragmentC="massing2_retail", FragmentD=".csv")
panel_15 = Panel(concat_7)

importglazing = GhPythonScript(glazing_name=glazing)  # -> frame_type, glass_type, u_value, t_vis, embodied_carbon_metric, embodied_carbon_imperial
# ---------- importglazing: Python ----------
__author__ = "preston"

import rhinoscriptsyntax as rs
import sys

studiopath = "/Users/preston/Documents/GitHub/studio2021/src"
sys.path.append(studiopath)
import studio2021

from studio2021.functions import read_glazing

glazing = read_glazing(glazing_name)

print(glazing.keys())

frame_type = glazing['frame_type']
glass_type = glazing['glass_type']
u_value = glazing['u_value']
t_vis = glazing['t_vis']
embodied_carbon_metric = glazing['embodied_carbon_metric']
embodied_carbon_imperial = glazing['embodied_carbon_imperial']
# ---------- end importglazing ----------

face_4 = HBFace(geo=inputs.T_5, name="Exposed Wall", type="Wall", bc="Outdoors")  # -> report, simplify(faces); plug-in component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
match_4 = MatchTree(Tree=face_4.faces, Guide=inputs.T_5)
aperturesbyratio = HBAperturesByRatio(hb_objs=match_4, ratio=flatten(inputs._3))  # -> report, hb_objs; plug-in component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
windowmat = HBWindowMaterial(
    name="AluminumDoublePane",
    u_factor=flatten(importglazing.u_value),
    shgc=flatten(inputs._3_2),
    t_vis=flatten(importglazing.t_vis))  # -> mat; plug-in component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
windowconstr = HBWindowConstruction(name="WGlass", materials=windowmat)  # -> constr; plug-in component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
applywindowconstr = HBApplyWindowConstruction(hb_objs=aperturesbyratio.hb_objs, constr=windowconstr)  # -> hb_objs; plug-in component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
louvershades = HBLouverShades(hb_objs=applywindowconstr, depth=flatten(inputs._3_3), vertical=True)  # -> report, hb_objs; plug-in component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

face_5 = HBFace(geo=inputs.T_4, name="Exposed Wall", type="Wall", bc="Outdoors")  # -> report, simplify(faces); plug-in component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
match_5 = MatchTree(Tree=face_5.faces, Guide=inputs.T_4)
aperturesbyratio_2 = HBAperturesByRatio(hb_objs=match_5, ratio=flatten(inputs._2))  # -> report, hb_objs; plug-in component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
windowmat_2 = HBWindowMaterial(
    name="AluminumDoublePane",
    u_factor=flatten(importglazing.u_value),
    shgc=flatten(inputs._2_2),
    t_vis=flatten(importglazing.t_vis))  # -> mat; plug-in component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
windowconstr_2 = HBWindowConstruction(name="EGlass", materials=windowmat_2)  # -> constr; plug-in component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
applywindowconstr_2 = HBApplyWindowConstruction(hb_objs=aperturesbyratio_2.hb_objs, constr=windowconstr_2)  # -> hb_objs; plug-in component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
louvershades_2 = HBLouverShades(hb_objs=applywindowconstr_2, depth=flatten(inputs._2_3), vertical=True)  # -> report, hb_objs; plug-in component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

face_6 = HBFace(geo=inputs.T_7, name="Exposed Wall", type="Wall", bc="Outdoors")  # -> report, simplify(faces); plug-in component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
match_6 = MatchTree(Tree=face_6.faces, Guide=inputs.T_7)
aperturesbyratio_3 = HBAperturesByRatio(hb_objs=match_6, ratio=flatten(inputs._1))  # -> report, hb_objs; plug-in component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
windowmat_3 = HBWindowMaterial(
    name="AluminumDoublePane",
    u_factor=flatten(importglazing.u_value),
    shgc=flatten(inputs._1_2),
    t_vis=flatten(importglazing.t_vis))  # -> mat; plug-in component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
windowconstr_3 = HBWindowConstruction(name="SGlass", materials=windowmat_3)  # -> constr; plug-in component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
applywindowconstr_3 = HBApplyWindowConstruction(hb_objs=aperturesbyratio_3.hb_objs, constr=windowconstr_3)  # -> hb_objs; plug-in component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
louvershades_3 = HBLouverShades(hb_objs=applywindowconstr_3, depth=flatten(inputs._1_3))  # -> report, hb_objs; plug-in component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

face_7 = HBFace(geo=inputs.T_6, name="Exposed Wall", type="Wall", bc="Outdoors")  # -> report, simplify(faces); plug-in component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
match_7 = MatchTree(Tree=face_7.faces, Guide=inputs.T_6)
aperturesbyratio_4 = HBAperturesByRatio(hb_objs=match_7, ratio=flatten(inputs._0))  # -> report, hb_objs; plug-in component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
windowmat_4 = HBWindowMaterial(
    name="AluminumDoublePane",
    u_factor=flatten(importglazing.u_value),
    shgc=flatten(inputs._0_5),
    t_vis=flatten(importglazing.t_vis))  # -> mat; plug-in component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
windowconstr_4 = HBWindowConstruction(name="NGlass", materials=windowmat_4)  # -> constr; plug-in component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
applywindowconstr_4 = HBApplyWindowConstruction(hb_objs=aperturesbyratio_4.hb_objs, constr=windowconstr_4)  # -> hb_objs; plug-in component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
louvershades_4 = HBLouverShades(hb_objs=applywindowconstr_4, depth=flatten(inputs._0_6))  # -> report, hb_objs; plug-in component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

n_s_e_w_exterior_walls = Merge(Data1=louvershades_4.hb_objs, Data2=louvershades_3.hb_objs, Data3=louvershades_2.hb_objs, Data4=louvershades.hb_objs)
remove_empy_zones = CleanTree(RemoveNulls=True, RemoveInvalid=True, RemoveEmpty=True, Tree=n_s_e_w_exterior_walls)

clean = CleanTree(RemoveNulls=True, RemoveInvalid=True, RemoveEmpty=True, Tree=[remove_empy_zones, match, match_2, match_3])
tstat = TreeStatistics(Tree=clean)  # -> Paths, Length, Count
zone_names = TreeBranch(Tree=simplify(inputs.R), Path=tstat.Paths, MaintainPaths=True)
room = HBRoom(faces=clean, name=zone_names, program=list, conditioned=True)  # -> report, room; plug-in component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

clean_2 = CleanTree(RemoveNulls=True, RemoveInvalid=True, RemoveEmpty=False, Tree=room.room)  # -> flatten(Tree)
applyconstrset = HBApplyConstructionSet(rooms=clean_2, constr_set=constructionset)  # -> rooms; plug-in component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

# ----
# Heating, Cooling, & Vent Set Points
applysetpointvals = HBApplySetpointValues(room_or_program=flatten(applyconstrset))  # -> report, mod_obj; plug-in component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
applyloadvals = HBApplyLoadValues(room_or_program=flatten(applysetpointvals.mod_obj))  # -> report, mod_obj; plug-in component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

model = HBModel(rooms=flatten(applyloadvals.mod_obj), name="massing2_retail")  # -> report, model; plug-in component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

# ----
# Energy Simulation
toggle = BooleanToggle(True)
simoutput = HBSimulationOutput(zone_energy_use=toggle, hvac_energy_use=toggle, gains_and_losses=toggle)  # -> report, sim_output; plug-in component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
simpar = HBSimulationParameter(output=simoutput.sim_output, timestep=6)  # -> sim_par; plug-in component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
modeltoosm_2 = HBModelToOSM(
    model=model.model,
    epw_file=downloadepw.epw_file,
    sim_par=simpar,
    folder=panel_13,
    write=runsimulation,
    run=runsimulation)  # -> report, jsons, osw, osm, idf, sql, zsz, rdd, html; plug-in component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
roomenergyresult = HBReadRoomEnergyResult(sql=panel_14)  # -> cooling, heating, lighting, electric_equip, gas_equip, fan_electric, pump_electric, people_gain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; plug-in component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

# ----
# Chart Results
number_slider = Slider(1, range=0..100)
legendpar = LBLegendParameters(min=Slider(0, range=0..100), max=number_slider)  # -> leg_par; plug-in component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
monthlychart = LBMonthlyChart(data=roomenergyresult.lighting)  # -> report, data_mesh, data_lines, legend, borders, labels, y_title, title; plug-in component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
hourlyplot = LBHourlyPlot(data=flatten(roomenergyresult.solar_gain), legend_par=legendpar)  # -> report, mesh, legend, borders, labels, title; plug-in component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

# ----
# Zone Visualize Results
number_slider_2 = Slider(1, range=1..31)
number_slider_3 = Slider(1, range=1..12)
analysisperiod = LBAnalysisPeriod(
    start_month=number_slider_3,
    start_day=number_slider_2,
    start_hour=0,
    end_month=number_slider_3,
    end_day=Slider(31, range=1..31))  # -> period, hoys, dates; plug-in component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
colorrooms = HBColorRooms(
    data=flatten(roomenergyresult.solar_gain),
    rooms_model=flatten(applyloadvals.mod_obj),
    norm_by_flr=Toggle(True),
    period=analysisperiod.period,
    legend_par=legendpar)  # -> report, mesh, wire_frame, legend, title, rooms, colors, values; plug-in component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
vizquick = HBVizualizeQuick(hb_objs=flatten(colorrooms.rooms))  # -> geo; plug-in component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
preview = CustomPreview(Geometry=[colorrooms.legend, colorrooms.wire_frame], Material=ColourSwatch(SwatchColor=RGB(0, 0, 0)))
preview_2 = CustomPreview(Geometry=vizquick, Material=colorrooms.colors)

# ----
# Label Rooms
faceenergyattr = HBFaceEnergyAttributes({"Construction": "properties.energy.construction.display_name", "Materials": "properties.energy.construction.layers", "R-Value": "properties.energy.construction.r_value", "U-Value": "properties.energy.construction.u_value", "U-Factor": "properties.energy.construction.u_factor", "Solar Transmitance [Unshaded]": "properties.energy.construction.solar_transmittance", "Solar Reflectance [Outside]": "properties.energy.construction.outside_solar_reflectance", "Solar Reflectance [Inside]": "properties.energy.construction.inside_solar_reflectance", "Fraction Area Operable": "properties.energy.vent_opening.fraction_area_operable", "Fraction Height Operable": "properties.energy.vent_opening.fraction_height_operable", "Discharge Coefficient": "properties.energy.vent_opening.discharge_coefficient", "Cross Ventilation": "properties.energy.vent_opening.wind_cross_vent"}, selected="Construction")
roomenergyattr = HBRoomEnergyAttributes({"Program": "properties.energy.program_type.display_name", "Construction Set": "properties.energy.construction_set.display_name", "Is Conditioned": "properties.energy.is_conditioned", "People per Area [ppl/m2]": "properties.energy.people.people_per_area", "Area per Person [m2/ppl]": "properties.energy.people.area_per_person", "Lighting per Area [W/m2]": "properties.energy.lighting.watts_per_area", "Electric Equipment per Area [W/m2]": "properties.energy.electric_equipment.watts_per_area", "Gas Equipment per Area [W/m2]": "properties.energy.gas_equipment.watts_per_area", "Infiltration per Exterior Area [m3/s-m2]": "properties.energy.infiltration.flow_per_exterior_area", "Ventilation per Person [m3/s-ppl]": "properties.energy.ventilation.flow_per_person"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}, selected="Ventilation per Person [m3/s-ppl]")
list_2 = ItemSelector(applyloadvals.mod_obj, {"Room: ZONE1", "Room: ZONE2", "Room: ZONE3", "Room: ZONE4"}, selected="Room: ZONE1")
labelrooms = HBLabelRooms(rooms_model=flatten(list_2), attribute=roomenergyattr)  # -> label_text, base_pts, labels, wire_frame; plug-in component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
vizbytype = HBVisualizeByType(rooms=applyloadvals.mod_obj)  # -> walls, interior_walls, roofs, ceilings, exterior_floors, interior_floors, air_walls, apertures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; plug-in component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
lablefaces = HBLabelFaces(hb_objs=flatten(list_2), attribute=faceenergyattr)  # -> label_text, base_pts, labels, wire_frame; plug-in component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

# ----
# Write to Excel
writetoexcel = WriteToExcel(
    T_10="massing2_retail",
    T=height,
    T_6=decnstrmat.r_val_ip,
    T_3=importglazing.u_value,
    T_2=north_wwr,
    T_4=north_shgc,
    T_5=north_shade_depth_in,
    T_8=south_wwr,
    T_9=south_shgc,
    T_7=south_shade_depth_in,
    T_13=east_wwr,
    T_11=east_shgc,
    T_12=east_shade_depth_in,
    T_15=west_wwr,
    T_16=west_shgc,
    T_14=west_shade_depth_in,
    D=inputs.zone_floor_area,
    data_si_3=roomenergyresult.cooling,
    data_si_4=roomenergyresult.heating,
    data_si_2=roomenergyresult.lighting,
    data_si=roomenergyresult.electric_equip,
    D_5=inputs.n_facade_area_csv,
    D_3=inputs.s_facade_area_csv,
    D_2=inputs.e_facade_area_csv,
    D_4=inputs.w_facade_area_csv,
    save=savecsv,
    path=panel_15)

# ==== cluster Inputs
_0_0 = ClusterInput()
_0_1 = ClusterInput()
_0_2 = ClusterInput()
_0_3 = ClusterInput()
_0_0_2 = ClusterInput()
_0_1_2 = ClusterInput()
_0_2_2 = ClusterInput()
_0_3_2 = ClusterInput()
_0_0_3 = ClusterInput()
_0_1_3 = ClusterInput()
_0_2_3 = ClusterInput()
_0_3_3 = ClusterInput()
_0_0_4 = ClusterInput()
_0_1_4 = ClusterInput()
_0_2_4 = ClusterInput()
_0_3_4 = ClusterInput()
_0_4 = ClusterInput()
_0_0_5 = ClusterInput()
_0_1_5 = ClusterInput()
_0_2_5 = ClusterInput()
_0_3_5 = ClusterInput()
_0_0_6 = ClusterInput()
_0_1_6 = ClusterInput()
_0_2_6 = ClusterInput()
_0_3_6 = ClusterInput()
_0_4_2 = ClusterInput()

# ----
# Gathers all zone information
# to create massing
shgc = Entwine(Branch00=_0_0, Branch01=_0_1, Branch02=_0_2, Branch03=_0_3, FlattenInputs=True)  # -> simplify(Result)
shadedepth = Entwine(Branch00=_0_0_2, Branch01=_0_1_2, Branch02=_0_2_2, Branch03=_0_3_2, FlattenInputs=True)  # -> simplify(Result)
outsidecrv = Entwine(Branch00=_0_0_3, Branch01=_0_1_3, Branch02=_0_2_3, Branch03=_0_3_3, FlattenInputs=True)  # -> simplify(Result)
adiabaticcrv = Entwine(Branch00=_0_0_4, Branch01=_0_1_4, Branch02=_0_2_4, Branch03=_0_3_4, Branch04=_0_4, FlattenInputs=True)  # -> simplify(Result)
wwr = Entwine(Branch00=_0_0_5, Branch01=_0_1_5, Branch02=_0_2_5, Branch03=_0_3_5, FlattenInputs=True)  # -> simplify(Result)
zone = Entwine(Branch00=_0_0_6, Branch01=_0_1_6, Branch02=_0_2_6, Branch03=_0_3_6, Branch04=_0_4_2, FlattenInputs=True)  # -> simplify(Result)

n_s_e_w_wwr = ExplodeTree(Data=wwr)  # -> Branch0, Branch1, Branch2, Branch3
n_s_e_w_shgc = ExplodeTree(Data=shgc)  # -> Branch0, Branch1, Branch2, Branch3
convert_shade_depth_from_ft_to_m = Multiplication(A=shadedepth, B=0.0254)
R = ClusterOutput(zone)
_0 = ClusterOutput(n_s_e_w_wwr.Branch0)
_1 = ClusterOutput(n_s_e_w_wwr.Branch1)
_2 = ClusterOutput(n_s_e_w_wwr.Branch2)
_3 = ClusterOutput(n_s_e_w_wwr.Branch3)
_0_5 = ClusterOutput(n_s_e_w_shgc.Branch0)
_1_2 = ClusterOutput(n_s_e_w_shgc.Branch1)
_2_2 = ClusterOutput(n_s_e_w_shgc.Branch2)
_3_2 = ClusterOutput(n_s_e_w_shgc.Branch3)
n_s_e_w_shade_depth_m = ExplodeTree(Data=convert_shade_depth_from_ft_to_m)  # -> Branch0, Branch1, Branch2, Branch3
_0_6 = ClusterOutput(n_s_e_w_shade_depth_m.Branch0)
_1_3 = ClusterOutput(n_s_e_w_shade_depth_m.Branch1)
_2_3 = ClusterOutput(n_s_e_w_shade_depth_m.Branch2)
_3_3 = ClusterOutput(n_s_e_w_shade_depth_m.Branch3)
F = ClusterInput()

# ----
# Massing 1: Creates mass from rhino curves
# and floor to ceiling ht
Z = UnitZ(Factor=F)
extr = Extrude(AdiabaticCrv=adiabaticcrv, Direction=Z)  # -> simplify(AdiabaticSrf)
boundary = BoundarySurfaces(FloorCrvs=[outsidecrv, adiabaticcrv])  # -> simplify(Surfaces)
extr_2 = Extrude(OutsideCrv=outsidecrv, Direction=Z)  # -> simplify(OutsideSrf)
move = Move(Geometry=boundary, Motion=Z)  # -> simplify(CeilingSrf), Transform
area = Area(Geometry=boundary)  # -> ZoneFloorArea, Centroid

extr_3 = Extrude(Base=boundary, Direction=Z)
debrep = DeconstructBrep(Brep=extr_3)  # -> simplify(Faces), Edges, Vertices
match = MatchTree(Tree=debrep.Faces, Guide=extr_2)
area_2 = Area(Geometry=match)  # -> Area, Centroid
brep = Brep(match)

# ----
# Selects faces from Massing 2 that match Massing 1 for exterior walls
area_3 = Area(Geometry=extr_2)  # -> Area, Centroid
mindex = MemberIndex(Set=area_2.Centroid, Member=area_3.Centroid)  # -> Index, Count
srf = Surface([brep, extr_2])
trim = TrimTree(Tree=mindex.Index, Depth=1)
item = ListItem(List=srf, Index=trim, Wrap=True)
clean = CleanTree(RemoveNulls=True, RemoveInvalid=True, RemoveEmpty=True, Tree=item)  # -> simplify(Tree)
facen = FaceNormals(Mesh=clean)  # -> Centers, Normals
cullpt = CullDuplicates(Points=facen.Normals, Tolerance=0.1, CullMode=3)  # -> Points, Indices, Valence
devec = DeconstructVector(Vector=cullpt.Points)  # -> XComponent, YComponent, ZComponent

zone_floor_area = ClusterOutput(area.ZoneFloorArea)

area_4 = Area(Geometry=move.CeilingSrf)  # -> Area, Centroid
mindex_2 = MemberIndex(Set=area_2.Centroid, Member=area_4.Centroid)  # -> Index, Count
srf_2 = Surface([brep, move.CeilingSrf])
trim_2 = TrimTree(Tree=mindex_2.Index, Depth=1)
item_2 = ListItem(List=srf_2, Index=trim_2, Wrap=True)
final_ceiling = CleanTree(RemoveNulls=True, RemoveInvalid=True, RemoveEmpty=False, Tree=item_2)  # -> simplify(Tree)

area_5 = Area(Geometry=extr)  # -> Area, Centroid
srf_3 = Surface([brep, extr])
mindex_3 = MemberIndex(Set=area_2.Centroid, Member=area_5.Centroid)  # -> Index, Count
trim_3 = TrimTree(Tree=mindex_3.Index, Depth=1)
item_3 = ListItem(List=srf_3, Index=trim_3, Wrap=True)
final_interior_wall = CleanTree(RemoveNulls=True, RemoveInvalid=True, RemoveEmpty=False, Tree=item_3)  # -> simplify(Tree)

# ----
# Logic to allow facades to rotate up to
# 44.9 degrees from cardinal directions.
# Creat North exterior wall surface
# Create South exterior wall surface
# Create East exterior wall surface
# Create West exterior wall surface
panel = Panel("1")
larger = LargerThan(FirstNumber=devec.XComponent, SecondNumber="-0.707")  # -> LargerThan, OrEqualTo
smaller = SmallerThan(FirstNumber=devec.YComponent, SecondNumber="-0.707")  # -> SmallerThan, OrEqualTo
larger_2 = LargerThan(FirstNumber=devec.YComponent, SecondNumber="-1")  # -> LargerThan, OrEqualTo
smaller_2 = SmallerThan(FirstNumber=devec.YComponent, SecondNumber=panel)  # -> SmallerThan, OrEqualTo
larger_3 = LargerThan(FirstNumber=devec.YComponent, SecondNumber="0.707")  # -> LargerThan, OrEqualTo
smaller_3 = SmallerThan(FirstNumber=devec.XComponent, SecondNumber=panel)  # -> SmallerThan, OrEqualTo
smaller_4 = SmallerThan(FirstNumber=devec.XComponent, SecondNumber="0.707")  # -> SmallerThan, OrEqualTo
smaller_5 = SmallerThan(FirstNumber=devec.YComponent, SecondNumber="0.707")  # -> SmallerThan, OrEqualTo
larger_4 = LargerThan(FirstNumber=devec.YComponent, SecondNumber="-0.707")  # -> LargerThan, OrEqualTo
larger_5 = LargerThan(FirstNumber=devec.XComponent, SecondNumber="0.707")  # -> LargerThan, OrEqualTo
larger_6 = LargerThan(FirstNumber=devec.XComponent, SecondNumber="-1")  # -> LargerThan, OrEqualTo
smaller_6 = SmallerThan(FirstNumber=devec.XComponent, SecondNumber="-0.707")  # -> SmallerThan, OrEqualTo
and = GateAnd(A=larger.LargerThan, B=smaller_4.SmallerThan)
and_2 = GateAnd(A=larger_2.OrEqualTo, B=smaller.SmallerThan)
and_3 = GateAnd(A=larger_3.LargerThan, B=smaller_2.OrEqualTo)
and_4 = GateAnd(A=larger_5.LargerThan, B=smaller_3.OrEqualTo)
and_5 = GateAnd(A=larger_4.OrEqualTo, B=smaller_5.SmallerThan)
and_6 = GateAnd(A=larger_6.OrEqualTo, B=smaller_6.SmallerThan)
and_7 = GateAnd(A=and, B=and_3)
and_8 = GateAnd(A=and, B=and_2)
and_9 = GateAnd(A=and_5, B=and_6)
and_10 = GateAnd(A=and_4, B=and_5)
cull = CullPattern(List=graft(clean), CullPattern=and_8)
cull_2 = CullPattern(List=graft(clean), CullPattern=and_9)
cull_3 = CullPattern(List=graft(clean), CullPattern=and_10)
cull_4 = CullPattern(List=graft(clean), CullPattern=and_7)
pshift = ShiftPaths(Data=cull, Offset=-2)
pshift_2 = ShiftPaths(Data=cull_2, Offset=-2)
pshift_3 = ShiftPaths(Data=cull_4, Offset=-2)
pshift_4 = ShiftPaths(Data=cull_3, Offset=-2)
south_exterior_wall_final = CleanTree(RemoveNulls=True, RemoveInvalid=True, RemoveEmpty=True, Tree=pshift)
north_exterior_wall_final = CleanTree(RemoveNulls=True, RemoveInvalid=True, RemoveEmpty=True, Tree=pshift_3)
east_exterior_wall_final = CleanTree(RemoveNulls=True, RemoveInvalid=True, RemoveEmpty=True, Tree=pshift_4)
west_exterior_wall_final = CleanTree(RemoveNulls=True, RemoveInvalid=True, RemoveEmpty=True, Tree=pshift_2)

# ----
# Extract N, S, E, and W
# facade areas
area_6 = Area(Geometry=south_exterior_wall_final)  # -> Area, Centroid
area_7 = Area(Geometry=east_exterior_wall_final)  # -> Area, Centroid
area_8 = Area(Geometry=pshift_3)  # -> Area, Centroid
area_9 = Area(Geometry=west_exterior_wall_final)  # -> Area, Centroid
ma = MassAddition(Input=area_8.Area)  # -> NFacadeAreaCsv, PartialResults
ma_2 = MassAddition(Input=area_6.Area)  # -> SFacadeAreaCsv, PartialResults
ma_3 = MassAddition(Input=area_9.Area)  # -> WFacadeAreaCsv, PartialResults
ma_4 = MassAddition(Input=area_7.Area)  # -> EFacadeAreaCsv, PartialResults

n_facade_area_csv = ClusterOutput(ma.NFacadeAreaCsv)
s_facade_area_csv = ClusterOutput(ma_2.SFacadeAreaCsv)
e_facade_area_csv = ClusterOutput(ma_4.EFacadeAreaCsv)
w_facade_area_csv = ClusterOutput(ma_3.WFacadeAreaCsv)
T = ClusterOutput(final_interior_wall)
T_2 = ClusterOutput(final_ceiling)

srf_4 = Surface([brep, boundary])
area_10 = Area(Geometry=boundary)  # -> Area, Centroid
mindex_4 = MemberIndex(Set=area_2.Centroid, Member=area_10.Centroid)  # -> Index, Count
trim_4 = TrimTree(Tree=mindex_4.Index, Depth=1)
item_4 = ListItem(List=srf_4, Index=trim_4, Wrap=True)
final_floor_surface = CleanTree(RemoveNulls=True, RemoveInvalid=True, RemoveEmpty=False, Tree=item_4)  # -> simplify(Tree)

clean_2 = CleanTree(RemoveNulls=True, RemoveInvalid=True, RemoveEmpty=True, Tree=flatten(ma.NFacadeAreaCsv))
clean_3 = CleanTree(RemoveNulls=True, RemoveInvalid=True, RemoveEmpty=True, Tree=flatten(ma_4.EFacadeAreaCsv))
clean_4 = CleanTree(RemoveNulls=True, RemoveInvalid=True, RemoveEmpty=True, Tree=flatten(ma_2.SFacadeAreaCsv))
clean_5 = CleanTree(RemoveNulls=True, RemoveInvalid=True, RemoveEmpty=True, Tree=flatten(ma_3.WFacadeAreaCsv))
T_3 = ClusterOutput(final_floor_surface)
n_total_facade = MassAddition(Input=flatten(clean_2))  # -> Result, PartialResults
s_total_facade = MassAddition(Input=flatten(clean_4))  # -> Result, PartialResults
w_total_facade = MassAddition(Input=flatten(clean_5))  # -> Result, PartialResults
e_total_facade = MassAddition(Input=flatten(clean_3))  # -> Result, PartialResults
e_window_area = Multiplication(A=w_total_facade.Result, B=n_s_e_w_wwr.Branch3)
s_window_area = Multiplication(A=s_total_facade.Result, B=n_s_e_w_wwr.Branch1)
n_window_area = Multiplication(A=n_total_facade.Result, B=n_s_e_w_wwr.Branch0)
e_window_area_2 = Multiplication(A=e_total_facade.Result, B=n_s_e_w_wwr.Branch2)
n_opaque_area = Subtraction(A=n_total_facade.Result, B=n_window_area)
n_opaque_area_2 = Subtraction(A=w_total_facade.Result, B=e_window_area)
n_opaque_area_3 = Subtraction(A=s_total_facade.Result, B=s_window_area)
n_opaque_area_4 = Subtraction(A=e_total_facade.Result, B=e_window_area_2)
window_area_n_s_e_w = Entwine(Branch00=n_window_area, Branch01=s_window_area, Branch02=e_window_area_2, Branch03=e_window_area, FlattenInputs=True)  # -> simplify(Window_area_nSEW)
opaque_area_n_s_e_w = Entwine(Branch00=n_opaque_area, Branch01=n_opaque_area_3, Branch02=n_opaque_area_4, Branch03=n_opaque_area_2, FlattenInputs=True)  # -> simplify(Opaque_area_nSEW)
window_area_n_s_e_w_2 = ClusterOutput(window_area_n_s_e_w)
opaque_area_n_s_e_w_2 = ClusterOutput(opaque_area_n_s_e_w)
T_4 = ClusterOutput(east_exterior_wall_final)
T_5 = ClusterOutput(west_exterior_wall_final)
T_6 = ClusterOutput(north_exterior_wall_final)
T_7 = ClusterOutput(south_exterior_wall_final)

# ==== cluster WriteToExcel
data_si = ClusterInput()
data_si_2 = ClusterInput()
data_si_3 = ClusterInput()
data_si_4 = ClusterInput()
division = Division(A=Slider(26.4, range=0..100), B=1000)
toip = LBToIP(data_si=data_si)  # -> data_ip; plug-in component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
toip_2 = LBToIP(data_si=data_si_3)  # -> data_ip; plug-in component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
toip_3 = LBToIP(data_si=data_si_2)  # -> data_ip; plug-in component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
toip_4 = LBToIP(data_si=data_si_4)  # -> data_ip; plug-in component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
xdata = LBDeconstructData(data=toip)  # -> flatten(header), values; plug-in component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
xdata_2 = LBDeconstructData(data=toip_2)  # -> flatten(header), values; plug-in component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
xdata_3 = LBDeconstructData(data=toip_3)  # -> flatten(header), values; plug-in component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
D = ClusterInput()
panel = Panel(", Slab, Columns, Beams, Glazing, Opqaue, Total,,,,,,,,,,,,,,")
# Zone 1 Window, Zone 1 Opaque, Zone 1 Total, Zone 2 Window, Zone 2 Opaque, Zone 2 Total, Zone 3 Window, Zone 3 Opaque, Zone 3 Total, Zone 4 Window, Zone 4 Opaque, Zone 4 Total, Total Window, Total Opaque, Total,,,,
panel_2 = Panel(", Embodied, Operational, Total,,,,,,,,,,,,,,,,,,,,,,,,")
xdata_4 = LBDeconstructData(data=toip_4)  # -> flatten(header), values; plug-in component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
ma = MassAddition(Input=flatten(D))  # -> Result, PartialResults
panel_3 = Panel(ma.Result)
multiplication = Multiplication(A=panel_3, B=division)
join = TextJoin(Text=[multiplication, ","])
input = ClusterInput()
panel_4 = Panel(",,,,,,,,,,,,,,,,,,,,,,,,,,,,,,,,")
T = ClusterInput()
T_2 = ClusterInput()
T_3 = ClusterInput()
T_4 = ClusterInput()
T_5 = ClusterInput()
T_6 = ClusterInput()
T_7 = ClusterInput()
T_8 = ClusterInput()
T_9 = ClusterInput()
T_10 = ClusterInput()
T_11 = ClusterInput()
T_12 = ClusterInput()
T_13 = ClusterInput()
bang = ExplodeTree(Data=xdata_2.values)  # -> Branch0, Branch1, Branch2, Branch3, Branch4
panel_5 = Panel(join)
T_14 = ClusterInput()
bang_2 = ExplodeTree(Data=D)  # -> Branch0, Branch1, Branch2, Branch3, Branch4
T_15 = ClusterInput()
T_16 = ClusterInput()
panel_6 = Panel(", Zone1, Zone2, Zone3, Zone4,Zone5,Total,,,,,,,,,,,,,,,,,,")
bang_3 = ExplodeTree(Data=xdata.values)  # -> Branch0, Branch1, Branch2, Branch3, Branch4
bang_4 = ExplodeTree(Data=xdata_4.values)  # -> Branch0, Branch1, Branch2, Branch3, Branch4
join_2 = TextJoin(Text=["Wall Assembly R Value,", T_6, ",,,,,,,,,,,,,,,,,,,,,,,,,,,,,,,,"])
join_3 = TextJoin(Text=["U Value window,", T_3, ",,,,,,,,,,,,,,,,,,,,,,,,,,,,,,,,"])
join_4 = TextJoin(Text=["N Shade depth,", T_5, ",,,,,,,,,,,,,,,,,,,,,,,,,,,,,,,,"])
join_5 = TextJoin(Text=["N WWR,", T_2, ",,,,,,,,,,,,,,,,,,,,,,,,,,,,,,,,"])
concat = Concatenate(FragmentA=ma.Result, FragmentB=",")
join_6 = TextJoin(Text=["N SHGC,", T_4, ",,,,,,,,,,,,,,,,,,,,,,,,,,,,,,,,"])
bang_5 = ExplodeTree(Data=xdata_3.values)  # -> Branch0, Branch1, Branch2, Branch3, Branch4
join_7 = TextJoin(Text=["Height (ft),", T, ",,,,,,,,,,,,,,,,,,,,,,,,,,,,,,,,"])
join_8 = TextJoin(Text=["S Shade depth,", T_7, ",,,,,,,,,,,,,,,,,,,,,,,,,,,,,,,,"])
join_9 = TextJoin(Text=["S WWR,", T_8, ",,,,,,,,,,,,,,,,,,,,,,,,,,,,,,,,"])
join_10 = TextJoin(Text=["S SHGC,", T_9, ",,,,,,,,,,,,,,,,,,,,,,,,,,,,,,,,"])
join_11 = TextJoin(Text=[T_10, panel_4])
join_12 = TextJoin(Text=["Seattle", panel_4])
join_13 = TextJoin(Text=["E Shade depth,", T_12, ",,,,,,,,,,,,,,,,,,,,,,,,,,,,,,,,"])
join_14 = TextJoin(Text=["E WWR,", T_13, ",,,,,,,,,,,,,,,,,,,,,,,,,,,,,,,,"])
join_15 = TextJoin(Text=["E SHGC,", T_11, ",,,,,,,,,,,,,,,,,,,,,,,,,,,,,,,,"])
join_16 = TextJoin(Text=["Embodied (eq CO2 kg total),", ",,,,,,,,,,,,,,,,,,,,,,,,,,,,,,,,"])
join_17 = TextJoin(Text=["W Shade depth,", T_14, ",,,,,,,,,,,,,,,,,,,,,,,,,,,,,,,,"])
join_18 = TextJoin(Text=["W WWR,", T_15, ",,,,,,,,,,,,,,,,,,,,,,,,,,,,,,,,"])
join_19 = TextJoin(Text=["W SHGC,", T_16, ",,,,,,,,,,,,,,,,,,,,,,,,,,,,,,,,"])
concat_2 = Concatenate(FragmentA=bang_2.Branch0, FragmentB=",")
concat_3 = Concatenate(FragmentA=bang_2.Branch1, FragmentB=",")
concat_4 = Concatenate(FragmentA=bang_2.Branch2, FragmentB=",")
D_2 = ClusterInput()
concat_5 = Concatenate(FragmentA=bang_2.Branch3, FragmentB=",")
concat_6 = Concatenate(FragmentA=bang_2.Branch4, FragmentB=",")
D_3 = ClusterInput()
D_4 = ClusterInput()
D_5 = ClusterInput()
panel_7 = Panel("Time, Cooling Engery (kWh) Zone1, Cooling Engery (kBtu) Zone2, Cooling Engery (kBtu) Zone3, Cooling Engery (kBtu) Zone4, Cooling Engery (kBtu) Zone5, Heating Engery (kBtu) Zone1, Heating Engery (kBtu) Zone2, Heating Engery (kBtu) Zone3, Heating Engery (kBtu) Zone4, Heating Engery (kBtu) Zone5, Electric Light Engery (kBtu) Zone1, Electric Light (kBtu) Zone2, Electric Light Energy (kBtu) Zone3, Electric Light Energy (kBtu) Zone4, Electric Light Energy (kBtu) Zone5, Equipment Engery (kBtu) Zone1, Equipment Engery (kBtu) Zone2, Equipment Engery (kBtu) Zone3, Equipment Engery (kBtu) Zone4, Equipment Engery (kBtu) Zone5,")
ma_2 = MassAddition(Input=bang.Branch0)  # -> Result, PartialResults
ma_3 = MassAddition(Input=bang.Branch1)  # -> Result, PartialResults
ma_4 = MassAddition(Input=bang.Branch2)  # -> Result, PartialResults
ma_5 = MassAddition(Input=bang.Branch3)  # -> Result, PartialResults
ma_6 = MassAddition(Input=bang.Branch4)  # -> Result, PartialResults
ma_7 = MassAddition(Input=bang_3.Branch0)  # -> Result, PartialResults
ma_8 = MassAddition(Input=bang_3.Branch1)  # -> Result, PartialResults
analysisperiod = LBAnalysisPeriod(start_month=1, start_day=1, start_hour=0)  # -> period, hoys, flatten(dates); plug-in component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
multiplication_2 = Multiplication(N=join_5)
ma_9 = MassAddition(Input=bang_3.Branch2)  # -> Result, PartialResults
ma_10 = MassAddition(Input=bang_3.Branch3)  # -> Result, PartialResults
ma_11 = MassAddition(Input=bang_3.Branch4)  # -> Result, PartialResults
ma_12 = MassAddition(Input=bang_4.Branch0)  # -> Result, PartialResults
ma_13 = MassAddition(Input=bang_4.Branch1)  # -> Result, PartialResults
ma_14 = MassAddition(Input=bang_4.Branch2)  # -> Result, PartialResults
ma_15 = MassAddition(Input=bang_4.Branch3)  # -> Result, PartialResults
ma_16 = MassAddition(Input=bang_4.Branch4)  # -> Result, PartialResults
ma_17 = MassAddition(Input=bang_5.Branch0)  # -> Result, PartialResults
ma_18 = MassAddition(Input=bang_5.Branch1)  # -> Result, PartialResults
ma_19 = MassAddition(Input=bang_5.Branch2)  # -> Result, PartialResults
ma_20 = MassAddition(Input=bang_5.Branch3)  # -> Result, PartialResults
panel_8 = Panel(D_5)
ma_21 = MassAddition(Input=bang_5.Branch4)  # -> Result, PartialResults
entwine = Entwine(
    Branch00=concat_2,
    Branch01=concat_3,
    Branch02=concat_4,
    Branch03=concat_5,
    Branch04=concat_6,
    Branch05=concat,
    FlattenInputs=True)  # -> flatten(Result)
bang_6 = ExplodeTree(Data=D_2)  # -> Branch0, Branch1, Branch2, Branch3
bang_7 = ExplodeTree(Data=D_3)  # -> Branch0, Branch1, Branch2, Branch3
bang_8 = ExplodeTree(Data=D_4)  # -> Branch0, Branch1, Branch2, Branch3
bang_9 = ExplodeTree(Data=D_5)  # -> Branch0, Branch1, Branch2, Branch3
division_2 = Division(A=ma_2.Result, B=bang_2.Branch0)
division_3 = Division(A=ma_4.Result, B=bang_2.Branch2)
division_4 = Division(A=ma_3.Result, B=bang_2.Branch1)
division_5 = Division(A=ma_5.Result, B=bang_2.Branch3)
division_6 = Division(A=ma_6.Result, B=bang_2.Branch4)
division_7 = Division(A=ma_7.Result, B=bang_2.Branch0)
division_8 = Division(A=ma_9.Result, B=bang_2.Branch2)
ma_22 = MassAddition(Input=flatten([ma_2.Result, ma_12.Result, ma_17.Result, ma_7.Result]))  # -> Result, PartialResults
division_9 = Division(A=ma_8.Result, B=bang_2.Branch1)
division_10 = Division(A=ma_10.Result, B=bang_2.Branch3)
ma_23 = MassAddition(Input=flatten([bang.Branch3, bang_4.Branch3, bang_3.Branch3]))  # -> Result, PartialResults
ma_24 = MassAddition(Input=flatten([ma_4.Result, bang_4.Branch2, bang_5.Branch2, bang_3.Branch2]))  # -> Result, PartialResults
division_11 = Division(A=ma_11.Result, B=bang_2.Branch4)
division_12 = Division(A=ma_12.Result, B=bang_2.Branch0)
division_13 = Division(A=ma_14.Result, B=bang_2.Branch2)
division_14 = Division(A=ma_13.Result, B=bang_2.Branch1)
division_15 = Division(A=ma_15.Result, B=bang_2.Branch3)
ma_25 = MassAddition(Input=flatten([bang.Branch4, bang_4.Branch4, bang_5.Branch4, bang_3.Branch4]))  # -> Result, PartialResults
division_16 = Division(A=ma_16.Result, B=bang_2.Branch4)
ma_26 = MassAddition(Input=flatten([ma_3.Result, ma_13.Result, ma_18.Result, ma_8.Result]))  # -> Result, PartialResults
division_17 = Division(A=ma_21.Result, B=bang_2.Branch4)
division_18 = Division(A=ma_17.Result, B=bang_2.Branch0)
division_19 = Division(A=ma_19.Result, B=bang_2.Branch2)
division_20 = Division(A=ma_18.Result, B=bang_2.Branch1)
division_21 = Division(A=ma_20.Result, B=bang_2.Branch3)
concat_7 = Concatenate(FragmentA=division_3, FragmentB=",")  # -> flatten(Result)
concat_8 = Concatenate(FragmentA=division_5, FragmentB=",")  # -> flatten(Result)
concat_9 = Concatenate(FragmentA=division_4, FragmentB=",")  # -> flatten(Result)
concat_10 = Concatenate(FragmentA=division_2, FragmentB=",")  # -> flatten(Result)
concat_11 = Concatenate(FragmentA=division_6, FragmentB=",")  # -> flatten(Result)
join_20 = TextJoin(Text=["Floor Area (ft2),", entwine])
entwine_2 = Entwine(
    Branch00=analysisperiod.dates,
    Branch01=bang.Branch0,
    Branch02=bang.Branch1,
    Branch03=bang.Branch2,
    Branch04=bang.Branch3,
    Branch05=bang.Branch4,
    Branch06=bang_4.Branch0,
    Branch07=bang_4.Branch1,
    Branch08=bang_4.Branch2,
    Branch09=bang_4.Branch3,
    Branch010=bang_4.Branch4,
    Branch011=bang_5.Branch0,
    Branch012=bang_5.Branch1,
    Branch013=bang_5.Branch2,
    Branch014=bang_5.Branch3,
    Branch015=bang_5.Branch4,
    Branch016=bang_3.Branch0,
    Branch017=bang_3.Branch1,
    Branch018=bang_3.Branch2,
    Branch019=bang_3.Branch3,
    Branch020=bang_3.Branch4,
    FlattenInputs=True)  # -> simplify(Result)
concat_12 = Concatenate(FragmentA=bang_6.Branch1, FragmentB=",")  # -> flatten(Result)
concat_13 = Concatenate(FragmentA=bang_6.Branch0, FragmentB=",")  # -> flatten(Result)
concat_14 = Concatenate(FragmentA=bang_6.Branch3, FragmentB=",")  # -> flatten(Result)
concat_15 = Concatenate(FragmentA=bang_6.Branch2, FragmentB=",")  # -> flatten(Result)
concat_16 = Concatenate(FragmentA=bang_7.Branch1, FragmentB=",")  # -> flatten(Result)
concat_17 = Concatenate(FragmentA=bang_7.Branch0, FragmentB=",")  # -> flatten(Result)
concat_18 = Concatenate(FragmentA=division_8, FragmentB=",")  # -> flatten(Result)
concat_19 = Concatenate(FragmentA=bang_7.Branch3, FragmentB=",")  # -> flatten(Result)
concat_20 = Concatenate(FragmentA=bang_8.Branch1, FragmentB=",")  # -> flatten(Result)
concat_21 = Concatenate(FragmentA=bang_7.Branch2, FragmentB=",")  # -> flatten(Result)
concat_22 = Concatenate(FragmentA=bang_8.Branch0, FragmentB=",")  # -> flatten(Result)
concat_23 = Concatenate(FragmentA=bang_8.Branch3, FragmentB=",")  # -> flatten(Result)
concat_24 = Concatenate(FragmentA=division_10, FragmentB=",")  # -> flatten(Result)
concat_25 = Concatenate(FragmentA=bang_8.Branch2, FragmentB=",")  # -> flatten(Result)
concat_26 = Concatenate(FragmentA=division_9, FragmentB=",")  # -> flatten(Result)
concat_27 = Concatenate(FragmentA=division_7, FragmentB=",")  # -> flatten(Result)
concat_28 = Concatenate(FragmentA=division_11, FragmentB=",")  # -> flatten(Result)
concat_29 = Concatenate(FragmentA=division_13, FragmentB=",")  # -> flatten(Result)
concat_30 = Concatenate(FragmentA=bang_9.Branch1, FragmentB=",")  # -> flatten(Result)
concat_31 = Concatenate(FragmentA=bang_9.Branch2, FragmentB=",")  # -> flatten(Result)
concat_32 = Concatenate(FragmentA=bang_9.Branch0, FragmentB=",")  # -> flatten(Result)
concat_33 = Concatenate(FragmentA=bang_9.Branch3, FragmentB=",")  # -> flatten(Result)
concat_34 = Concatenate(FragmentA=division_15, FragmentB=",")  # -> flatten(Result)
division_22 = Division(A=ma_22.Result, B=bang_2.Branch0)
concat_35 = Concatenate(FragmentA=division_14, FragmentB=",")  # -> flatten(Result)
concat_36 = Concatenate(FragmentA=division_12, FragmentB=",")  # -> flatten(Result)
division_23 = Division(A=ma_25.Result, B=bang_2.Branch4)
concat_37 = Concatenate(FragmentA=division_16, FragmentB=",")  # -> flatten(Result)
concat_38 = Concatenate(FragmentA=division_19, FragmentB=",")  # -> flatten(Result)
division_24 = Division(A=ma_23.Result, B=bang_2.Branch3)
concat_39 = Concatenate(FragmentA=division_21, FragmentB=",")  # -> flatten(Result)
concat_40 = Concatenate(FragmentA=division_20, FragmentB=",")  # -> flatten(Result)
division_25 = Division(A=ma_24.Result, B=bang_2.Branch2)
division_26 = Division(A=ma_26.Result, B=bang_2.Branch1)
concat_41 = Concatenate(FragmentA=division_18, FragmentB=",")  # -> flatten(Result)
concat_42 = Concatenate(FragmentA=division_17, FragmentB=",")  # -> flatten(Result)
concat_43 = Concatenate(FragmentA=division_22, FragmentB=",")  # -> flatten(Result)
merge = Merge(Data1=panel_7, Data2=entwine_2)
concat_44 = Concatenate(FragmentA=division_26, FragmentB=",")  # -> flatten(Result)
concat_45 = Concatenate(FragmentA=division_25, FragmentB=",")  # -> flatten(Result)
concat_46 = Concatenate(FragmentA=division_23, FragmentB=",")  # -> flatten(Result)
concat_47 = Concatenate(FragmentA=division_24, FragmentB=",")  # -> flatten(Result)
ma_27 = MassAddition(Input=flatten([ma_2.Result, ma_3.Result, ma_4.Result, ma_5.Result, ma_6.Result]))  # -> Result, PartialResults
ma_28 = MassAddition(Input=flatten([ma_17.Result, ma_18.Result, ma_19.Result, ma_20.Result, ma_21.Result]))  # -> Result, PartialResults
ma_29 = MassAddition(Input=flatten([bang_7.Branch0, bang_7.Branch1, bang_7.Branch2, bang_7.Branch3]))  # -> Result, PartialResults
ma_30 = MassAddition(Input=flatten([bang_6.Branch0, bang_6.Branch1, bang_6.Branch2, bang_6.Branch3]))  # -> Result, PartialResults
ma_31 = MassAddition(Input=flatten([ma_7.Result, ma_8.Result, ma_9.Result, ma_10.Result, ma_11.Result]))  # -> Result, PartialResults
ma_32 = MassAddition(Input=flatten([bang_8.Branch0, bang_8.Branch1, bang_8.Branch2, bang_8.Branch3]))  # -> Result, PartialResults
ma_33 = MassAddition(Input=flatten([ma_12.Result, ma_13.Result, ma_14.Result, ma_15.Result, ma_16.Result]))  # -> Result, PartialResults
ma_34 = MassAddition(Input=flatten([ma_27.Result, ma_33.Result, ma_28.Result, ma_31.Result]))  # -> Result, PartialResults
division_27 = Division(A=ma_34.Result, B=ma.Result)
concat_48 = Concatenate(FragmentA=division_27, FragmentB=",")  # -> flatten(Result)
ma_35 = MassAddition(Input=flatten([bang_9.Branch0, bang_9.Branch1, bang_9.Branch2, bang_9.Branch3]))  # -> Result, PartialResults
flip = FlipMatrix(Data=entwine_2)
division_28 = Division(A=ma_28.Result, B=ma.Result)
division_29 = Division(A=ma_27.Result, B=ma.Result)
concat_49 = Concatenate(FragmentA=ma_30.Result, FragmentB=",")  # -> flatten(Result)
division_30 = Division(A=ma_33.Result, B=ma.Result)
concat_50 = Concatenate(FragmentA=ma_29.Result, FragmentB=",")  # -> flatten(Result)
concat_51 = Concatenate(FragmentA=ma_32.Result, FragmentB=",")  # -> flatten(Result)
join_21 = TextJoin(Text=["Total EUI (kBtu/sf/year),", concat_43, concat_44, concat_45, concat_47, concat_46, concat_48])
division_31 = Division(A=ma_31.Result, B=ma.Result)
concat_52 = Concatenate(FragmentA=ma_35.Result, FragmentB=",")  # -> flatten(Result)
concat_53 = Concatenate(FragmentA=division_28, FragmentB=",")  # -> flatten(Result)
concat_54 = Concatenate(FragmentA=division_29, FragmentB=",")  # -> flatten(Result)
join_22 = TextJoin(Text=["Cooling EUI (kBtu/sf/year),", concat_10, concat_9, concat_7, concat_8, concat_11, concat_54])
join_23 = TextJoin(Text=flip, Join=",")
concat_55 = Concatenate(FragmentA=division_30, FragmentB=",")  # -> flatten(Result)
join_24 = TextJoin(Text=["East Facade Area (ft2),", concat_13, concat_12, concat_15, concat_14, concat_49])
join_25 = TextJoin(Text=["West Facade Area (ft2),", concat_22, concat_20, concat_25, concat_23, concat_51])
join_26 = TextJoin(Text=["Heating EUI (kBtu/sf/year),", concat_36, concat_35, concat_29, concat_34, concat_37, concat_55])
join_27 = TextJoin(Text=["South Facade Area (ft2),", concat_17, concat_16, concat_21, concat_19, concat_50])
join_28 = TextJoin(Text=["Lighting EUI (kBtu/sf/year),", concat_41, concat_40, concat_38, concat_39, concat_42, concat_53])
concat_56 = Concatenate(FragmentA=division_31, FragmentB=",")  # -> flatten(Result)
join_29 = TextJoin(Text=["Equip EUI (kBtu/sf/year),", concat_27, concat_26, concat_18, concat_24, concat_28, concat_56])
join_30 = TextJoin(Text=["North Facade Area (ft2),", concat_32, concat_30, concat_31, concat_33, concat_52])
save = ClusterInput()
path = ClusterInput()
number_slider = Slider(1, range=0..1)
ma_36 = MassAddition(Input=bang_5.Branch2)  # -> Result, PartialResults
ma_37 = MassAddition(Input=bang_5.Branch3)  # -> Result, PartialResults
ma_38 = MassAddition(Input=bang_5.Branch4)  # -> Result, PartialResults
division_32 = Division(A=ma_4.Result, B=number_slider)
division_33 = Division(A=ma_3.Result, B=number_slider)
division_34 = Division(A=ma_2.Result, B=number_slider)
division_35 = Division(A=ma_5.Result, B=number_slider)
division_36 = Division(A=ma_6.Result, B=number_slider)
division_37 = Division(A=ma_7.Result, B=number_slider)
division_38 = Division(A=ma_9.Result, B=number_slider)
ma_39 = MassAddition(Input=flatten([ma_2.Result, ma_12.Result, ma_17.Result, ma_7.Result]))  # -> Result, PartialResults
division_39 = Division(A=ma_8.Result, B=number_slider)
ma_40 = MassAddition(Input=flatten([bang.Branch3, bang_4.Branch3, bang_3.Branch3]))  # -> Result, PartialResults
division_40 = Division(A=ma_10.Result, B=number_slider)
ma_41 = MassAddition(Input=flatten([ma_4.Result, bang_4.Branch2, bang_5.Branch2, bang_3.Branch2]))  # -> Result, PartialResults
division_41 = Division(A=ma_11.Result, B=number_slider)
division_42 = Division(A=ma_12.Result, B=number_slider)
division_43 = Division(A=ma_14.Result, B=number_slider)
division_44 = Division(A=ma_13.Result, B=number_slider)
ma_42 = MassAddition(Input=flatten([ma_3.Result, ma_13.Result, ma_18.Result, ma_8.Result]))  # -> Result, PartialResults
division_45 = Division(A=ma_15.Result, B=number_slider)
ma_43 = MassAddition(Input=flatten([bang.Branch4, bang_4.Branch4, bang_5.Branch4, bang_3.Branch4]))  # -> Result, PartialResults
division_46 = Division(A=ma_16.Result, B=number_slider)
division_47 = Division(A=ma_38.Result, B=number_slider)
division_48 = Division(A=ma_17.Result, B=number_slider)
division_49 = Division(A=ma_36.Result, B=number_slider)
division_50 = Division(A=ma_18.Result, B=number_slider)
division_51 = Division(A=ma_37.Result, B=number_slider)
concat_57 = Concatenate(FragmentA=division_32, FragmentB=",")  # -> flatten(Result)
concat_58 = Concatenate(FragmentA=division_35, FragmentB=",")  # -> flatten(Result)
concat_59 = Concatenate(FragmentA=division_33, FragmentB=",")  # -> flatten(Result)
concat_60 = Concatenate(FragmentA=division_34, FragmentB=",")  # -> flatten(Result)
concat_61 = Concatenate(FragmentA=division_36, FragmentB=",")  # -> flatten(Result)
concat_62 = Concatenate(FragmentA=division_38, FragmentB=",")  # -> flatten(Result)
concat_63 = Concatenate(FragmentA=division_40, FragmentB=",")  # -> flatten(Result)
concat_64 = Concatenate(FragmentA=division_39, FragmentB=",")  # -> flatten(Result)
concat_65 = Concatenate(FragmentA=division_37, FragmentB=",")  # -> flatten(Result)
concat_66 = Concatenate(FragmentA=division_41, FragmentB=",")  # -> flatten(Result)
concat_67 = Concatenate(FragmentA=division_43, FragmentB=",")  # -> flatten(Result)
concat_68 = Concatenate(FragmentA=division_45, FragmentB=",")  # -> flatten(Result)
division_52 = Division(A=ma_39.Result, B=number_slider)
concat_69 = Concatenate(FragmentA=division_44, FragmentB=",")  # -> flatten(Result)
concat_70 = Concatenate(FragmentA=division_42, FragmentB=",")  # -> flatten(Result)
division_53 = Division(A=ma_43.Result, B=number_slider)
concat_71 = Concatenate(FragmentA=division_46, FragmentB=",")  # -> flatten(Result)
concat_72 = Concatenate(FragmentA=division_49, FragmentB=",")  # -> flatten(Result)
division_54 = Division(A=ma_40.Result, B=number_slider)
concat_73 = Concatenate(FragmentA=division_51, FragmentB=",")  # -> flatten(Result)
division_55 = Division(A=ma_41.Result, B=number_slider)
concat_74 = Concatenate(FragmentA=division_50, FragmentB=",")  # -> flatten(Result)
division_56 = Division(A=ma_42.Result, B=number_slider)
concat_75 = Concatenate(FragmentA=division_48, FragmentB=",")  # -> flatten(Result)
concat_76 = Concatenate(FragmentA=division_47, FragmentB=",")  # -> flatten(Result)
concat_77 = Concatenate(FragmentA=division_52, FragmentB=",")  # -> flatten(Result)
concat_78 = Concatenate(FragmentA=division_56, FragmentB=",")  # -> flatten(Result)
concat_79 = Concatenate(FragmentA=division_55, FragmentB=",")  # -> flatten(Result)
concat_80 = Concatenate(FragmentA=division_53, FragmentB=",")  # -> flatten(Result)
concat_81 = Concatenate(FragmentA=division_54, FragmentB=",")  # -> flatten(Result)
ma_44 = MassAddition(Input=flatten([ma_2.Result, ma_3.Result, ma_4.Result, ma_5.Result, ma_6.Result]))  # -> Result, PartialResults
ma_45 = MassAddition(Input=flatten([ma_17.Result, ma_18.Result, ma_36.Result, ma_37.Result, ma_38.Result]))  # -> Result, PartialResults
ma_46 = MassAddition(Input=flatten([ma_7.Result, ma_8.Result, ma_9.Result, ma_10.Result, ma_11.Result]))  # -> Result, PartialResults
ma_47 = MassAddition(Input=flatten([ma_12.Result, ma_13.Result, ma_14.Result, ma_15.Result, ma_16.Result]))  # -> Result, PartialResults
ma_48 = MassAddition(Input=flatten([ma_44.Result, ma_46.Result, ma_47.Result, ma_45.Result]))  # -> Result, PartialResults
division_57 = Division(A=ma_48.Result, B=number_slider)
concat_82 = Concatenate(FragmentA=division_57, FragmentB=",")  # -> flatten(Result)
division_58 = Division(A=ma_45.Result, B=number_slider)
division_59 = Division(A=ma_44.Result, B=number_slider)
division_60 = Division(A=ma_47.Result, B=number_slider)
join_31 = TextJoin(Text=["Total EUI (kBtu/year),", concat_77, concat_78, concat_79, concat_81, concat_80, concat_82])
division_61 = Division(A=ma_46.Result, B=number_slider)
concat_83 = Concatenate(FragmentA=division_58, FragmentB=",")  # -> flatten(Result)
concat_84 = Concatenate(FragmentA=division_59, FragmentB=",")  # -> flatten(Result)
join_32 = TextJoin(Text=["Cooling EUI (kBtu/year),", concat_60, concat_59, concat_57, concat_58, concat_61, concat_84])
concat_85 = Concatenate(FragmentA=division_60, FragmentB=",")  # -> flatten(Result)
join_33 = TextJoin(Text=["Heating EUI (kBtu/year),", concat_70, concat_69, concat_67, concat_68, concat_71, concat_85])
join_34 = TextJoin(Text=["Lighting EUI (kBtu/year),", concat_75, concat_74, concat_72, concat_73, concat_76, concat_83])
concat_86 = Concatenate(FragmentA=division_61, FragmentB=",")  # -> flatten(Result)
join_35 = TextJoin(Text=["Equip EUI (kBtu/year),", concat_65, concat_64, concat_62, concat_63, concat_66, concat_86])
number_slider_2 = Slider(3.412, range=0..4)
ma_49 = MassAddition(Input=bang_5.Branch2)  # -> Result, PartialResults
ma_50 = MassAddition(Input=bang_5.Branch3)  # -> Result, PartialResults
ma_51 = MassAddition(Input=bang_5.Branch4)  # -> Result, PartialResults
division_62 = Division(A=ma_4.Result, B=number_slider_2)
division_63 = Division(A=ma_3.Result, B=number_slider_2)
division_64 = Division(A=ma_2.Result, B=number_slider_2)
division_65 = Division(A=ma_5.Result, B=number_slider_2)
division_66 = Division(A=ma_6.Result, B=number_slider_2)
division_67 = Division(A=ma_7.Result, B=number_slider_2)
division_68 = Division(A=ma_9.Result, B=number_slider_2)
ma_52 = MassAddition(Input=flatten([ma_2.Result, ma_12.Result, ma_17.Result, ma_7.Result]))  # -> Result, PartialResults
division_69 = Division(A=ma_8.Result, B=number_slider_2)
ma_53 = MassAddition(Input=flatten([bang.Branch3, bang_4.Branch3, bang_3.Branch3]))  # -> Result, PartialResults
division_70 = Division(A=ma_10.Result, B=number_slider_2)
ma_54 = MassAddition(Input=flatten([ma_4.Result, bang_4.Branch2, bang_5.Branch2, bang_3.Branch2]))  # -> Result, PartialResults
division_71 = Division(A=ma_11.Result, B=number_slider_2)
division_72 = Division(A=ma_12.Result, B=number_slider_2)
division_73 = Division(A=ma_14.Result, B=number_slider_2)
division_74 = Division(A=ma_13.Result, B=number_slider_2)
ma_55 = MassAddition(Input=flatten([ma_3.Result, ma_13.Result, ma_18.Result, ma_8.Result]))  # -> Result, PartialResults
division_75 = Division(A=ma_15.Result, B=number_slider_2)
ma_56 = MassAddition(Input=flatten([bang.Branch4, bang_4.Branch4, bang_5.Branch4, bang_3.Branch4]))  # -> Result, PartialResults
division_76 = Division(A=ma_16.Result, B=number_slider_2)
division_77 = Division(A=ma_51.Result, B=number_slider_2)
division_78 = Division(A=ma_17.Result, B=number_slider_2)
division_79 = Division(A=ma_49.Result, B=number_slider_2)
division_80 = Division(A=ma_18.Result, B=number_slider_2)
division_81 = Division(A=ma_50.Result, B=number_slider_2)
concat_87 = Concatenate(FragmentA=division_62, FragmentB=",")  # -> flatten(Result)
concat_88 = Concatenate(FragmentA=division_65, FragmentB=",")  # -> flatten(Result)
concat_89 = Concatenate(FragmentA=division_63, FragmentB=",")  # -> flatten(Result)
concat_90 = Concatenate(FragmentA=division_64, FragmentB=",")  # -> flatten(Result)
concat_91 = Concatenate(FragmentA=division_66, FragmentB=",")  # -> flatten(Result)
concat_92 = Concatenate(FragmentA=division_68, FragmentB=",")  # -> flatten(Result)
concat_93 = Concatenate(FragmentA=division_70, FragmentB=",")  # -> flatten(Result)
concat_94 = Concatenate(FragmentA=division_69, FragmentB=",")  # -> flatten(Result)
concat_95 = Concatenate(FragmentA=division_67, FragmentB=",")  # -> flatten(Result)
concat_96 = Concatenate(FragmentA=division_71, FragmentB=",")  # -> flatten(Result)
concat_97 = Concatenate(FragmentA=division_73, FragmentB=",")  # -> flatten(Result)
concat_98 = Concatenate(FragmentA=division_75, FragmentB=",")  # -> flatten(Result)
division_82 = Division(A=ma_52.Result, B=number_slider_2)
concat_99 = Concatenate(FragmentA=division_74, FragmentB=",")  # -> flatten(Result)
concat_100 = Concatenate(FragmentA=division_72, FragmentB=",")  # -> flatten(Result)
division_83 = Division(A=ma_56.Result, B=number_slider_2)
concat_101 = Concatenate(FragmentA=division_76, FragmentB=",")  # -> flatten(Result)
concat_102 = Concatenate(FragmentA=division_79, FragmentB=",")  # -> flatten(Result)
division_84 = Division(A=ma_53.Result, B=number_slider_2)
concat_103 = Concatenate(FragmentA=division_81, FragmentB=",")  # -> flatten(Result)
division_85 = Division(A=ma_54.Result, B=number_slider_2)
concat_104 = Concatenate(FragmentA=division_80, FragmentB=",")  # -> flatten(Result)
division_86 = Division(A=ma_55.Result, B=number_slider_2)
concat_105 = Concatenate(FragmentA=division_78, FragmentB=",")  # -> flatten(Result)
concat_106 = Concatenate(FragmentA=division_77, FragmentB=",")  # -> flatten(Result)
concat_107 = Concatenate(FragmentA=division_82, FragmentB=",")  # -> flatten(Result)
concat_108 = Concatenate(FragmentA=division_86, FragmentB=",")  # -> flatten(Result)
concat_109 = Concatenate(FragmentA=division_85, FragmentB=",")  # -> flatten(Result)
concat_110 = Concatenate(FragmentA=division_83, FragmentB=",")  # -> flatten(Result)
concat_111 = Concatenate(FragmentA=division_84, FragmentB=",")  # -> flatten(Result)
ma_57 = MassAddition(Input=flatten([ma_2.Result, ma_3.Result, ma_4.Result, ma_5.Result, ma_6.Result]))  # -> Result, PartialResults
ma_58 = MassAddition(Input=flatten([ma_17.Result, ma_18.Result, ma_49.Result, ma_50.Result, ma_51.Result]))  # -> Result, PartialResults
ma_59 = MassAddition(Input=flatten([ma_7.Result, ma_8.Result, ma_9.Result, ma_10.Result, ma_11.Result]))  # -> Result, PartialResults
ma_60 = MassAddition(Input=flatten([ma_12.Result, ma_13.Result, ma_14.Result, ma_15.Result, ma_16.Result]))  # -> Result, PartialResults
ma_61 = MassAddition(Input=flatten([ma_57.Result, ma_59.Result, ma_60.Result, ma_58.Result]))  # -> Result, PartialResults
division_87 = Division(A=ma_61.Result, B=number_slider_2)
concat_112 = Concatenate(FragmentA=division_87, FragmentB=",")  # -> flatten(Result)
division_88 = Division(A=ma_58.Result, B=number_slider_2)
division_89 = Division(A=ma_57.Result, B=number_slider_2)
division_90 = Division(A=ma_60.Result, B=number_slider_2)
join_36 = TextJoin(Text=["Total EUI (kWh/year),", concat_107, concat_108, concat_109, concat_111, concat_110, concat_112])
division_91 = Division(A=ma_59.Result, B=number_slider_2)
concat_113 = Concatenate(FragmentA=division_88, FragmentB=",")  # -> flatten(Result)
concat_114 = Concatenate(FragmentA=division_89, FragmentB=",")  # -> flatten(Result)
join_37 = TextJoin(Text=["Cooling EUI (kWh/year),", concat_90, concat_89, concat_87, concat_88, concat_91, concat_114])
concat_115 = Concatenate(FragmentA=division_90, FragmentB=",")  # -> flatten(Result)
join_38 = TextJoin(Text=["Heating EUI (kWh/year),", concat_100, concat_99, concat_97, concat_98, concat_101, concat_115])
join_39 = TextJoin(Text=["Lighting EUI (kWh/year),", concat_105, concat_104, concat_102, concat_103, concat_106, concat_113])
concat_116 = Concatenate(FragmentA=division_91, FragmentB=",")  # -> flatten(Result)
join_40 = TextJoin(Text=["Equip EUI (kWh/year),", concat_95, concat_94, concat_92, concat_93, concat_96, concat_116])
number_slider_3 = Slider(8530, range=0..10000)
ma_62 = MassAddition(Input=bang_5.Branch2)  # -> Result, PartialResults
ma_63 = MassAddition(Input=bang_5.Branch3)  # -> Result, PartialResults
ma_64 = MassAddition(Input=bang_5.Branch4)  # -> Result, PartialResults
division_92 = Division(A=ma_4.Result, B=number_slider_3)
division_93 = Division(A=ma_3.Result, B=number_slider_3)
division_94 = Division(A=ma_2.Result, B=number_slider_3)
division_95 = Division(A=ma_5.Result, B=number_slider_3)
division_96 = Division(A=ma_6.Result, B=number_slider_3)
division_97 = Division(A=ma_7.Result, B=number_slider_3)
division_98 = Division(A=ma_9.Result, B=number_slider_3)
ma_65 = MassAddition(Input=flatten([ma_2.Result, ma_12.Result, ma_17.Result, ma_7.Result]))  # -> Result, PartialResults
division_99 = Division(A=ma_8.Result, B=number_slider_3)
ma_66 = MassAddition(Input=flatten([bang.Branch3, bang_4.Branch3, bang_3.Branch3]))  # -> Result, PartialResults
division_100 = Division(A=ma_10.Result, B=number_slider_3)
ma_67 = MassAddition(Input=flatten([ma_4.Result, bang_4.Branch2, bang_5.Branch2, bang_3.Branch2]))  # -> Result, PartialResults
division_101 = Division(A=ma_11.Result, B=number_slider_3)
division_102 = Division(A=ma_12.Result, B=number_slider_3)
division_103 = Division(A=ma_14.Result, B=number_slider_3)
division_104 = Division(A=ma_13.Result, B=number_slider_3)
ma_68 = MassAddition(Input=flatten([ma_3.Result, ma_13.Result, ma_18.Result, ma_8.Result]))  # -> Result, PartialResults
division_105 = Division(A=ma_15.Result, B=number_slider_3)
ma_69 = MassAddition(Input=flatten([bang.Branch4, bang_4.Branch4, bang_5.Branch4, bang_3.Branch4]))  # -> Result, PartialResults
division_106 = Division(A=ma_16.Result, B=number_slider_3)
division_107 = Division(A=ma_64.Result, B=number_slider_3)
division_108 = Division(A=ma_17.Result, B=number_slider_3)
division_109 = Division(A=ma_62.Result, B=number_slider_3)
division_110 = Division(A=ma_18.Result, B=number_slider_3)
division_111 = Division(A=ma_63.Result, B=number_slider_3)
concat_117 = Concatenate(FragmentA=division_92, FragmentB=",")  # -> flatten(Result)
concat_118 = Concatenate(FragmentA=division_95, FragmentB=",")  # -> flatten(Result)
concat_119 = Concatenate(FragmentA=division_93, FragmentB=",")  # -> flatten(Result)
concat_120 = Concatenate(FragmentA=division_94, FragmentB=",")  # -> flatten(Result)
concat_121 = Concatenate(FragmentA=division_96, FragmentB=",")  # -> flatten(Result)
concat_122 = Concatenate(FragmentA=division_98, FragmentB=",")  # -> flatten(Result)
concat_123 = Concatenate(FragmentA=division_100, FragmentB=",")  # -> flatten(Result)
concat_124 = Concatenate(FragmentA=division_99, FragmentB=",")  # -> flatten(Result)
concat_125 = Concatenate(FragmentA=division_97, FragmentB=",")  # -> flatten(Result)
concat_126 = Concatenate(FragmentA=division_101, FragmentB=",")  # -> flatten(Result)
concat_127 = Concatenate(FragmentA=division_103, FragmentB=",")  # -> flatten(Result)
concat_128 = Concatenate(FragmentA=division_105, FragmentB=",")  # -> flatten(Result)
division_112 = Division(A=ma_65.Result, B=number_slider_3)
concat_129 = Concatenate(FragmentA=division_104, FragmentB=",")  # -> flatten(Result)
concat_130 = Concatenate(FragmentA=division_102, FragmentB=",")  # -> flatten(Result)
division_113 = Division(A=ma_69.Result, B=number_slider_3)
concat_131 = Concatenate(FragmentA=division_106, FragmentB=",")  # -> flatten(Result)
concat_132 = Concatenate(FragmentA=division_109, FragmentB=",")  # -> flatten(Result)
division_114 = Division(A=ma_66.Result, B=number_slider_3)
concat_133 = Concatenate(FragmentA=division_111, FragmentB=",")  # -> flatten(Result)
division_115 = Division(A=ma_67.Result, B=number_slider_3)
concat_134 = Concatenate(FragmentA=division_110, FragmentB=",")  # -> flatten(Result)
division_116 = Division(A=ma_68.Result, B=number_slider_3)
concat_135 = Concatenate(FragmentA=division_108, FragmentB=",")  # -> flatten(Result)
concat_136 = Concatenate(FragmentA=division_107, FragmentB=",")  # -> flatten(Result)
concat_137 = Concatenate(FragmentA=division_112, FragmentB=",")  # -> flatten(Result)
concat_138 = Concatenate(FragmentA=division_116, FragmentB=",")  # -> flatten(Result)
concat_139 = Concatenate(FragmentA=division_115, FragmentB=",")  # -> flatten(Result)
concat_140 = Concatenate(FragmentA=division_113, FragmentB=",")  # -> flatten(Result)
concat_141 = Concatenate(FragmentA=division_114, FragmentB=",")  # -> flatten(Result)
ma_70 = MassAddition(Input=flatten([ma_2.Result, ma_3.Result, ma_4.Result, ma_5.Result, ma_6.Result]))  # -> Result, PartialResults
ma_71 = MassAddition(Input=flatten([ma_17.Result, ma_18.Result, ma_62.Result, ma_63.Result, ma_64.Result]))  # -> Result, PartialResults
ma_72 = MassAddition(Input=flatten([ma_7.Result, ma_8.Result, ma_9.Result, ma_10.Result, ma_11.Result]))  # -> Result, PartialResults
ma_73 = MassAddition(Input=flatten([ma_12.Result, ma_13.Result, ma_14.Result, ma_15.Result, ma_16.Result]))  # -> Result, PartialResults
ma_74 = MassAddition(Input=flatten([ma_70.Result, ma_72.Result, ma_73.Result, ma_71.Result]))  # -> Result, PartialResults
division_117 = Division(A=ma_74.Result, B=number_slider_3)
multiplication_3 = Multiplication(A=division_117, B=Slider(30, range=0..100))
addition = Addition(A=multiplication, B=multiplication_3)
join_41 = TextJoin(Text=[",", addition, ",,,,,,,,,,,,,,,,,,,,,,,,,,,,,,,,"])
panel_9 = Panel(join_41)
join_42 = TextJoin(Text=["Emissions Total 30 years (tons),", panel_5, multiplication_3, panel_9])
panel_10 = Panel(join_42)
concat_142 = Concatenate(FragmentA=division_117, FragmentB=",")  # -> flatten(Result)
division_118 = Division(A=ma_71.Result, B=number_slider_3)
division_119 = Division(A=ma_70.Result, B=number_slider_3)
division_120 = Division(A=ma_73.Result, B=number_slider_3)
join_43 = TextJoin(Text=["Total EUI (ton CO2/year),", concat_137, concat_138, concat_139, concat_141, concat_140, concat_142])
division_121 = Division(A=ma_72.Result, B=number_slider_3)
concat_143 = Concatenate(FragmentA=division_118, FragmentB=",")  # -> flatten(Result)
concat_144 = Concatenate(FragmentA=division_119, FragmentB=",")  # -> flatten(Result)
join_44 = TextJoin(Text=["Cooling EUI (ton CO2/year),", concat_120, concat_119, concat_117, concat_118, concat_121, concat_144])
concat_145 = Concatenate(FragmentA=division_120, FragmentB=",")  # -> flatten(Result)
join_45 = TextJoin(Text=["Heating EUI (ton CO2/year),", concat_130, concat_129, concat_127, concat_128, concat_131, concat_145])
join_46 = TextJoin(Text=["Lighting EUI (ton CO2/year),", concat_135, concat_134, concat_132, concat_133, concat_136, concat_143])
concat_146 = Concatenate(FragmentA=division_121, FragmentB=",")  # -> flatten(Result)
join_47 = TextJoin(Text=["Equip EUI (ton CO2/year),", concat_125, concat_124, concat_122, concat_123, concat_126, concat_146])
entwine_3 = Entwine(
    Branch00=join_11,
    Branch01=join_12,
    Branch02=panel_4,
    Branch03=join_7,
    Branch04=join_2,
    Branch05=join_3,
    Branch06=panel_4,
    Branch07=join_5,
    Branch08=join_6,
    Branch09=join_4,
    Branch010=join_9,
    Branch011=join_10,
    Branch012=join_8,
    Branch013=join_14,
    Branch014=join_15,
    Branch015=join_13,
    Branch016=join_18,
    Branch017=join_19,
    Branch018=join_17,
    Branch019=panel_4,
    Branch020=panel,
    Branch021=join_16,
    Branch022=panel_4,
    Branch023=panel_6,
    Branch024=join_20,
    Branch025=panel_4,
    Branch026=", Zone1, Zone2, Zone3, Zone4,Total,,,,,,,,,,,,,,,,,,",
    Branch027=join_30,
    Branch028=join_27,
    Branch029=join_24,
    Branch030=join_25,
    Branch031=panel_4,
    Branch032=panel_6,
    Branch033=join_22,
    Branch034=join_26,
    Branch035=join_28,
    Branch036=join_29,
    Branch037=join_21,
    Branch038=panel_4,
    Branch039=panel_6,
    Branch040=join_32,
    Branch041=join_33,
    Branch042=join_34,
    Branch043=join_35,
    Branch044=join_31,
    Branch045=panel_4,
    Branch046=panel_6,
    Branch047=join_37,
    Branch048=join_38,
    Branch049=join_39,
    Branch050=join_40,
    Branch051=join_36,
    Branch052=panel_4,
    Branch053=panel_6,
    Branch054=join_44,
    Branch055=join_45,
    Branch056=join_46,
    Branch057=join_47,
    Branch058=join_43,
    Branch059=panel_4,
    Branch060=panel_2,
    Branch061=panel_10,
    Branch062=panel_4,
    Branch063=panel_7,
    Branch064=join_23,
    FlattenInputs=True)  # -> flatten(Result)
c_script = CSharpScript(save=save, path=path, data=entwine_3)  # inputs save: Boolean, path: String, data: list of String
# ---------- c_script: C# ----------
    if(save){
      var fileinfo = new System.IO.FileInfo(path);
      if(!fileinfo.Directory.Exists){
        fileinfo.Directory.Create();
      }

      var sw = fileinfo.CreateText();
      for(int i = 0; i < data.Count; i++){
        string row = data[i];
        if(i < data.Count - 1){
          sw.WriteLine(row);
        }else{
          sw.Write(row);
        }
      }
      sw.Flush();
      sw.Close();
    }
# ---------- end c_script ----------
panel_11 = Panel(entwine_3)
