# Grasshopper definition 21_0228_TiME.gh (Grasshopper 1.0.7)
# plug-ins: Human

path = GhPythonScript()  # -> out, path
# ---------- path: Python ----------
__author__ = "tmendeze"


import studio2021

path = studio2021.TEMP + '/'
# ---------- end path ----------

# ----
# Simulation Inputs
# Simulation Folder Name:
# Run Simulation
# Simulation Name:
# .sql Filepath:
panel = Panel("1zone_run1")
panel_2 = Panel(path.path)
concat = Concatenate(FragmentA=panel_2, FragmentC=panel, FragmentD="\OpenStudio\run\eplusout.sql")
panel_3 = Panel(concat)
runsimulation = BooleanToggle(False)

# ----
# Glazing
north_shade_depth_in = Slider(27, range=0..100)
north_wwr = Slider(0.49, range=0..1)
south_wwr = Slider(0.51, range=0..1)
south_shade_depth_in = Slider(54, range=0..100)
east_wwr = Slider(0.39, range=0..1)
east_shade_depth_in = Slider(100, range=0..100)
west_wwr = Slider(0.21, range=0..1)
west_shade_depth_in = Slider(34, range=0..100)
glazing = ValueList({"Aluminum Double", "Aluminum Triple", "Wood Double", "Wood Triple"}, selected="Wood Double")
east_shgc = ValueList({"Low SHGC": 0.25, "High SHGC": 0.60}, selected="High SHGC")
north_shgc = ValueList({"Low SHGC": 0.25, "High SHGC": 0.60}, selected="Low SHGC")
south_shgc = ValueList({"Low SHGC": 0.25, "High SHGC": 0.60}, selected="High SHGC")
west_shgc = ValueList({"Low SHGC": 0.25, "High SHGC": 0.60}, selected="High SHGC")

# ----
# Weather File
panel_4 = Panel("http://climate.onebuilding.org/WMO_Region_4_North_and_Central_America/USA_United_States_of_America/WA_Washington/USA_WA_Seattle-King.County.Intl.AP-Boeing.Field.727935_TMY3.zip")
downloadepw = LBDownloadWeather(weather_URL=panel_4)  # -> epw_file, stat_file, ddy_file; plug-in component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

# ----
# Construction Options
insulation_thickness_in = Slider(8, range=0..12)
interior_finish = ValueList({"Gyp", "Exposed CLT", "CLT Gyp"}, selected="Gyp")
exterior_wall_framing = ValueList({"2x4 Metal Studs", "CLT", "Concrete", "2x4 Wood Studs"}, selected="CLT")
facade_cladding = ValueList({"Brick", "Fiber Cement", "Metal Panel", "Wood", "Stone"}, selected="Brick")
cont_ext_insulation = ValueList({"Rigid", "Fiberglass"}, selected="Rigid")

# ----
# Set Zone Program
bldgprograms = HBBuildingPrograms({"LargeOffice", "MediumOffice", "SmallOffice", "MidriseApartment", "HighriseApartment", "Retail", "StripMall", "PrimarySchool", "SecondarySchool", "SmallHotel", "LargeHotel", "Hospital", "Outpatient", "Laboratory", "Warehouse", "SuperMarket", "FullServiceRestaurant", "QuickServiceRestaurant", "Courthouse", "LargeDataCenterHighITE", "LargeDataCenterLowITE", "SmallDataCenterHighITE", "SmallDataCenterLowITE"}, selected="MidriseApartment")
searchprog = HBSearchPrograms(bldg_prog=bldgprograms)  # -> room_prog; plug-in component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
list = ItemSelector(
    searchprog,
    {"2013::MidriseApartment::Apartment", "2013::MidriseApartment::Corridor", "2013::MidriseApartment::Office"}, selected="2013::MidriseApartment::Apartment")

# ----
# Massing 2
# Retail
# Residential
adiabaticcrvfromrhino = Curve(<curve referenced from the Rhino model>)
adiabaticcrvfromrhino_2 = Curve(<curve referenced from the Rhino model>)
outsidecrvfromrhino = Curve([<curve referenced from the Rhino model> x4])
outsidecrvfromrhino_2 = Curve([<curve referenced from the Rhino model> x3])
outsidecrvfromrhino_3 = Curve([<curve referenced from the Rhino model> x4])
panel_5 = Panel("14")
panel_6 = Panel("11")

# ----
# Massing 1
# Retail
# Residential
adiabaticcrvfromrhino_3 = Curve(<curve referenced from the Rhino model>)
outsidecrvfromrhino_4 = Curve([<curve referenced from the Rhino model> x4])
adiabaticcrvfromrhino_4 = Curve(<curve referenced from the Rhino model>)
outsidecrvfromrhino_5 = Curve([<curve referenced from the Rhino model> x3])
outsidecrvfromrhino_6 = Curve([<curve referenced from the Rhino model> x4])

# ----
# Simulation Outputs
# Output Folder Name:
# Run Output:
savecsv = BooleanToggle(True)
concat_2 = Concatenate(FragmentA=panel_2, FragmentC=panel, FragmentD=".csv")
panel_7 = Panel(concat_2)

adiabaticcrvfromrhino_5 = Curve([<curve referenced from the Rhino model> x2])
outsidecrvfromrhino_7 = Curve([<curve referenced from the Rhino model> x2])

adiabaticcrvfromrhino_6 = Curve([<curve referenced from the Rhino model> x2])
outsidecrvfromrhino_8 = Curve([<curve referenced from the Rhino model> x2])

adiabaticcrvfromrhino_7 = Curve([<curve referenced from the Rhino model> x2])
outsidecrvfromrhino_9 = Curve([<curve referenced from the Rhino model> x2])

outsidecrvfromrhino_10 = Curve([<curve referenced from the Rhino model> x2])
adiabaticcrvfromrhino_8 = Curve([<curve referenced from the Rhino model> x2])

adiabaticcrvfromrhino_9 = Curve()

# ----
# Massing
# Geometry
height = Panel("14")

# ----
# Gathers all zone information
# to create massing
outsidecrv = Entwine(
    Branch00=outsidecrvfromrhino_7,
    Branch01=outsidecrvfromrhino_9,
    Branch02=outsidecrvfromrhino_8,
    Branch03=outsidecrvfromrhino_10,
    FlattenInputs=True)  # -> simplify(Result)
adiabaticcrv = Entwine(
    Branch00=adiabaticcrvfromrhino_5,
    Branch01=adiabaticcrvfromrhino_7,
    Branch02=adiabaticcrvfromrhino_6,
    Branch03=adiabaticcrvfromrhino_8,
    Branch04=adiabaticcrvfromrhino_9,
    FlattenInputs=True)  # -> simplify(Result)
wwr = Entwine(Branch00=north_wwr, Branch01=south_wwr, Branch02=east_wwr, Branch03=west_wwr, FlattenInputs=True)  # -> simplify(Result)
shgc = Entwine(Branch00=north_shgc, Branch01=south_shgc, Branch02=east_shgc, Branch03=west_shgc, FlattenInputs=True)  # -> simplify(Result)
shadedepth = Entwine(
    Branch00=north_shade_depth_in,
    Branch01=south_shade_depth_in,
    Branch02=east_shade_depth_in,
    Branch03=west_shade_depth_in,
    FlattenInputs=True)  # -> simplify(Result)
zone = Entwine(Branch00="ZONE1", Branch01="ZONE2", Branch02="ZONE3", Branch03="ZONE4", Branch04="ZONE5", FlattenInputs=True)  # -> simplify(Result)
convert_to_m = Multiplication(A=shadedepth, B=0.0254)

create_curves = Create_curves(
    floorcrvs=[outsidecrv, adiabaticcrv],
    outsidecrv=outsidecrv,
    adiabaticcrv=adiabaticcrv,
    C=[outsidecrv, adiabaticcrv],
    F=height)  # -> T_2, T_3, T_4, T_5, T, C_2, G
clean = CleanTree(RemoveNulls=True, RemoveInvalid=True, RemoveEmpty=False, Tree=create_curves.G)
crv = Curve(<curve referenced from the Rhino model>)
num_col_x = Slider(7, range=0..20)
num_col_y = Slider(2, range=0..20)
building_type = ValueList({"Type 3", "Type 4A", "Type 4B", "Type 4C", "Type 5"}, selected="Type 3")
num_floors_above = Slider(8, range=0..10)
composite_slab = BooleanToggle(False)
building_type_2 = ValueList({"Type 3", "Type 4A", "Type 4B", "Type 4C", "Type 5"}, selected="Type 4B")  # disabled
composite_slab_2 = BooleanToggle(False)  # disabled
crv_2 = Curve(<curve referenced from the Rhino model>)  # disabled
num_col_x_2 = Slider(8, range=0..20)  # disabled
num_col_x_3 = Slider(7, range=0..20)  # disabled
num_col_y_2 = Slider(3, range=0..20)  # disabled
num_col_y_3 = Slider(3, range=0..20)  # disabled
num_floors_above_2 = Slider(4, range=0..10)  # disabled
crv_3 = Curve(<curve referenced from the Rhino model>)  # disabled
frames = GhPythonScript(polyline=crv, numx=num_col_x, numy=num_col_y, height="14")  # -> out, cols, beams_x, beams_y; inputs numx: Int32, numy: Int32
# ---------- frames: Python ----------
__author__ = "tmendeze"
__version__ = "2020.11.05"

import rhinoscriptsyntax as rs


pts = rs.PolylineVertices(polyline)
srf = rs.AddSrfPt(pts[:4])

domu = rs.SurfaceDomain(srf, 0)
domv = rs.SurfaceDomain(srf, 1)
su = (domu[1] - domu[0]) / float(numx)
sv = (domv[1] - domv[0]) / float(numy)

a = []
cols = []
pts = []
for i in range(numx + 1):
    temp = []
    for j in range(numy + 1):
        u = su * i
        v = sv * j
        pt = rs.EvaluateSurface(srf, u, v)
        pt_ = [pt[0], pt[1], pt[2] + height]
        cols.append([pt, pt_])
        temp.append(pt_)
    pts.append(temp)
    
beams_x = []
for i in range(numx + 1):
    for j in range(numy):
        a = pts[i][j]
        b = pts[i][j + 1]
        beams_x.append([a, b])

beams_y = []
for i in range(numx):
    for j in range(numy + 1):
        a = pts[i][j]
        c = pts[i + 1][j]
        beams_y.append([a, c])
# ---------- end frames ----------
frames_2 = GhPythonScript(polyline=crv_3, numx=num_col_x_3, numy=num_col_y_2, height="14")  # -> out, cols, beams, span_x, span_y; inputs numx: Int32, numy: Int32; disabled
# ---------- frames_2: Python ----------
__author__ = "tmendeze"
__version__ = "2020.11.05"

import rhinoscriptsyntax as rs


pts = rs.PolylineVertices(polyline)
srf = rs.AddSrfPt(pts[:4])

domu = rs.SurfaceDomain(srf, 0)
domv = rs.SurfaceDomain(srf, 1)
su = (domu[1] - domu[0]) / float(numx)
sv = (domv[1] - domv[0]) / float(numy)

a = []
cols = []
pts = []
for i in range(numx + 1):
    temp = []
    for j in range(numy + 1):
        u = su * i
        v = sv * j
        pt = rs.EvaluateSurface(srf, u, v)
        pt_ = [pt[0], pt[1], pt[2] + height]
        cols.append(rs.AddLine(pt, pt_))
        temp.append(pt_)
    pts.append(temp)
    
beams = []
span_x = 0
for i in range(numx + 1):
    for j in range(numy):
        a = pts[i][j]
        b = pts[i][j + 1]
        beams.append(rs.AddLine(a, b))
        dx = rs.Distance(a, b)
        if dx > span_x:
            span_x = dx

span_y = 0
for i in range(numx):
    for j in range(numy + 1):
        a = pts[i][j]
        c = pts[i + 1][j]
        beams.append(rs.AddLine(a, c))
        dy = rs.Distance(a, c)
        if dy > span_y:
            span_y = dy
# ---------- end frames_2 ----------
frames_3 = GhPythonScript(polyline=crv_2, numx=num_col_x_2, numy=num_col_y_3, height="14")  # -> out, cols, beams, span_x, span_y; inputs numx: Int32, numy: Int32; disabled; same code as frames_2
len = Length(Curve=flatten([frames_2.beams, frames_3.beams]))  # disabled
len_2 = Length(Curve=flatten([frames_3.cols, frames_2.cols]))  # disabled
ma = MassAddition(Input=len)  # -> Result, PartialResults; disabled
ma_2 = MassAddition(Input=len_2)  # -> Result, PartialResults; disabled
building = GhPythonScript(
    znames=zone,
    wwr=wwr,
    shade_gc=shgc,
    shade_depth=convert_to_m,
    exterior_walls_n=create_curves.T_2,
    exterior_walls_s=create_curves.T_3,
    exterior_walls_e=create_curves.T_4,
    exterior_walls_w=create_curves.T_5,
    adiabatic_walls=create_curves.T,
    floor_surfaces=create_curves.C_2,
    ceiling_surfaces=clean,
    facade_cladding=facade_cladding,
    external_insulation=cont_ext_insulation,
    insulation_thickness=insulation_thickness_in,
    ewall_framing=exterior_wall_framing,
    int_finish=interior_finish,
    glazing_system=glazing,
    simulation_name=panel,
    zone_program=list,
    weather_file=downloadepw.epw_file,
    sql_path=panel_3,
    simulation_folder=panel_7,
    run_simulation=runsimulation,
    columns=frames.cols,
    beams_x=frames.beams_x,
    beams_y=frames.beams_y,
    building_type=building_type,
    num_floors_above=num_floors_above,
    composite_slab=composite_slab)  # -> out, building; inputs znames: tree, wwr: tree, shade_gc: tree, shade_depth: tree, exterior_walls_n: tree, exterior_walls_s: tree, exterior_walls_e: tree, exterior_walls_w: tree, adiabatic_walls: tree, floor_surfaces: tree, ceiling_surfaces: tree, columns: list, beams_x: list, beams_y: list
# ---------- building: Python ----------
from studio2021.datastructures import building
reload(building)
from studio2021.datastructures.building import Building
import rhinoscriptsyntax as rs


data = {'znames': znames,
        'exterior_walls_n': exterior_walls_n,
        'exterior_walls_s': exterior_walls_s,
        'exterior_walls_e': exterior_walls_e,
        'exterior_walls_w': exterior_walls_w,
        'adiabatic_walls': adiabatic_walls,
        'floor_surfaces': floor_surfaces,
        'ceiling_surfaces': ceiling_surfaces,
        'wwr':wwr,
        'shade_gc':shade_gc,
        'shade_depth':shade_depth,
        'facade_cladding':facade_cladding,
        'external_insulation':external_insulation,
        'insulation_thickness':insulation_thickness,
        'ewall_framing':ewall_framing,
        'int_finish':int_finish,
        'glazing_system':glazing_system,
        'simulation_name': simulation_name,
        'zone_program': zone_program,
        'weather_file': weather_file,
        'sql_path': sql_path,
        'simulation_folder': simulation_folder,
        'run_simulation': run_simulation,
        'columns': columns,
        'beams_x': beams_x,
        'beams_y': beams_y,
        'building_type':building_type,
        'num_floors_above':num_floors_above,
        'composite_slab':composite_slab
        }

building = Building.from_gh_data(data)
# ---------- end building ----------
embodied = GhPythonScript(building=building.building)  # -> out, slab, beam, column, envelope, building
# ---------- embodied: Python ----------
__author__ = "tmendeze"

import rhinoscriptsyntax as rs

building.compute_structure_embodied()

slab = building.structure.slab_embodied
beam = building.structure.beam_embodied
column = building.structure.column_embodied
envelope = building.envelope_embodied
# ---------- end embodied ----------
panel_9 = Panel(building.out)
panel_10 = Panel(embodied.out)
panel_11 = Panel([embodied.slab, embodied.beam, embodied.column])
draw_structure = GhPythonScript(building=embodied.building)  # -> out, slabs, columns, beams
# ---------- draw_structure: Python ----------
__author__ = "tmendeze"

import rhinoscriptsyntax as rs

slabs = building.draw_structure()
side = building.structure.col_side

columns = []
for sp, ep in building.columns:
    sp_ = rs.VectorAdd(sp, [-side/2., -side/2.,0])
    b = rs.VectorAdd(sp_, [1,0,0])
    c = rs.VectorAdd(sp_, [0,1,0])

    plane = rs.PlaneFromPoints(sp_, b, c)
    sec = rs.AddRectangle(plane, side, side)
    col = rs.AddLine(sp, ep)
    columns.append(rs.ExtrudeCurve(sec, col))

bw = building.structure.beam_width
bh = building.structure.beam_height
print('bw', bw)
print('bh', bh)
beams = []
for sp, ep in building.beams_x:
    x = rs.VectorCreate(ep, sp)
    z = [0,0,1]
    y = rs.VectorCrossProduct(x, z)
    
    b = rs.VectorAdd(sp, y)
    c = rs.VectorAdd(sp, z)
    
    plane = rs.PlaneFromPoints(sp, b, c)
    sec = rs.AddRectangle(plane, bw, bh)
    beam = rs.AddLine(sp, ep)
    beams.append(rs.ExtrudeCurve(sec, beam))
# ---------- end draw_structure ----------
panel_12 = Panel(draw_structure.out)
operational = Operational(building=embodied.building)  # -> mod_obj, cooling, heating, lighting, electric_equip; disabled
brep = Brep(draw_structure.slabs)
brep_2 = Brep(draw_structure.columns)
brep_3 = Brep(draw_structure.beams)
vizbytype = HBVisualizeByType(hb_objs=operational.mod_obj)  # -> walls, interior_walls, roofs, ceilings, exterior_floors, interior_floors, air_walls, apertures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; plug-in component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
toip = LBToIP(data_si=operational.heating)  # -> data_ip; plug-in component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
toip_2 = LBToIP(data_si=operational.electric_equip)  # -> data_ip; plug-in component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
toip_3 = LBToIP(data_si=operational.cooling)  # -> data_ip; plug-in component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
toip_4 = LBToIP(data_si=operational.lighting)  # -> data_ip; plug-in component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
xdata = LBDeconstructData(data=toip_3)  # -> header, values; plug-in component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
xdata_2 = LBDeconstructData(data=toip)  # -> header, values; plug-in component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
xdata_3 = LBDeconstructData(data=toip_4)  # -> header, values; plug-in component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
xdata_4 = LBDeconstructData(data=toip_2)  # -> header, values; plug-in component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
panel_13 = Panel(xdata.header)
panel_14 = Panel(xdata.values)
panel_15 = Panel(xdata_2.header)
panel_16 = Panel(xdata_2.values)
panel_17 = Panel(xdata_3.values)
panel_18 = Panel(xdata_3.header)
panel_19 = Panel(xdata_4.header)
panel_20 = Panel(xdata_4.values)

# ==== cluster Create_curves
floorcrvs = ClusterInput()
# Massing 1: Creates mass from rhino curves
# and floor to ceiling ht
boundary = BoundarySurfaces(FloorCrvs=floorcrvs)  # -> simplify(Surfaces)
outsidecrv = ClusterInput()
F = ClusterInput()
Z = UnitZ(Factor=F)
extr = Extrude(Base=boundary, Direction=Z)
extr_2 = Extrude(OutsideCrv=outsidecrv, Direction=Z)  # -> simplify(OutsideSrf)
debrep = DeconstructBrep(Brep=extr)  # -> simplify(Faces), Edges, Vertices
area = Area(Geometry=debrep.Faces)  # -> Area, Centroid
brep = Brep(debrep.Faces)

# ----
# Selects faces from Massing 2 that match Massing 1 for exterior walls
area_2 = Area(Geometry=extr_2)  # -> Area, Centroid
mindex = MemberIndex(Set=area.Centroid, Member=area_2.Centroid)  # -> Index, Count
srf = Surface([brep, extr_2])
trim = TrimTree(Tree=mindex.Index, Depth=1)
item = ListItem(List=srf, Index=trim, Wrap=True)

C = ClusterInput()
adiabaticcrv = ClusterInput()
join = JoinCurves(Curves=C, Preserve=False)  # -> simplify(Curves)
extr_3 = Extrude(AdiabaticCrv=adiabaticcrv, Direction=Z)  # -> simplify(AdiabaticSrf)
move = Move(Geometry=join, Motion=Z)  # -> Geometry, Transform

# ----
# Selects faces from Massing 2 that match Massing 1 for exterior walls
clean = CleanTree(RemoveNulls=True, RemoveInvalid=True, RemoveEmpty=True, Tree=item)  # -> simplify(Tree)
facen = FaceNormals(Mesh=clean)  # -> Centers, Normals
cullpt = CullDuplicates(Points=facen.Normals, Tolerance=0.1, CullMode=3)  # -> Points, Indices, Valence
devec = DeconstructVector(Vector=cullpt.Points)  # -> XComponent, YComponent, ZComponent

C_2 = ClusterOutput(join)
G = ClusterOutput(move.Geometry)
panel = Panel(move.Geometry)
debrep_2 = DeconstructBrep(Brep=extr_3)  # -> Faces, Edges, Vertices
join_2 = JoinCurves(Curves=debrep_2.Edges, Preserve=False)
trim_2 = TrimTree(Tree=join_2, Depth=Slider(2, range=0..10))
T = ClusterOutput(trim_2)
# Logic to allow facades to rotate up to
# 44.9 degrees from cardinal directions.
panel_2 = Panel("-0.707")
larger = LargerThan(FirstNumber=devec.XComponent, SecondNumber=panel_2)  # -> LargerThan, OrEqualTo
smaller = SmallerThan(FirstNumber=devec.YComponent, SecondNumber=panel_2)  # -> SmallerThan, OrEqualTo
larger_2 = LargerThan(FirstNumber=devec.YComponent, SecondNumber="-1")  # -> LargerThan, OrEqualTo
smaller_2 = SmallerThan(FirstNumber=devec.YComponent, SecondNumber="1")  # -> SmallerThan, OrEqualTo
larger_3 = LargerThan(FirstNumber=devec.YComponent, SecondNumber="0.707")  # -> LargerThan, OrEqualTo
smaller_3 = SmallerThan(FirstNumber=devec.XComponent, SecondNumber="1")  # -> SmallerThan, OrEqualTo
smaller_4 = SmallerThan(FirstNumber=devec.XComponent, SecondNumber="0.707")  # -> SmallerThan, OrEqualTo
smaller_5 = SmallerThan(FirstNumber=devec.YComponent, SecondNumber="0.707")  # -> SmallerThan, OrEqualTo
larger_4 = LargerThan(FirstNumber=devec.YComponent, SecondNumber=panel_2)  # -> LargerThan, OrEqualTo
larger_5 = LargerThan(FirstNumber=devec.XComponent, SecondNumber="0.707")  # -> LargerThan, OrEqualTo
larger_6 = LargerThan(FirstNumber=devec.XComponent, SecondNumber="-1")  # -> LargerThan, OrEqualTo
smaller_6 = SmallerThan(FirstNumber=devec.XComponent, SecondNumber=panel_2)  # -> SmallerThan, OrEqualTo
and = GateAnd(A=larger.LargerThan, B=smaller_4.SmallerThan)
and_2 = GateAnd(A=larger_2.OrEqualTo, B=smaller.SmallerThan)
and_3 = GateAnd(A=larger_3.LargerThan, B=smaller_2.OrEqualTo)
and_4 = GateAnd(A=larger_5.LargerThan, B=smaller_3.OrEqualTo)
and_5 = GateAnd(A=larger_4.OrEqualTo, B=smaller_5.SmallerThan)
and_6 = GateAnd(A=larger_6.OrEqualTo, B=smaller_6.SmallerThan)
and_7 = GateAnd(A=and, B=and_3)
and_8 = GateAnd(A=and, B=and_2)
and_9 = GateAnd(A=and_5, B=and_6)
and_10 = GateAnd(A=and_4, B=and_5)
# Create South exterior wall surface
cull = CullPattern(List=graft(clean), CullPattern=and_8)
# Create West exterior wall surface
cull_2 = CullPattern(List=graft(clean), CullPattern=and_9)
# Create East exterior wall surface
cull_3 = CullPattern(List=graft(clean), CullPattern=and_10)
# Creat North exterior wall surface
cull_4 = CullPattern(List=graft(clean), CullPattern=and_7)
pshift = ShiftPaths(Data=cull, Offset=-2)
pshift_2 = ShiftPaths(Data=cull_4, Offset=-2)
pshift_3 = ShiftPaths(Data=cull_2, Offset=-2)
pshift_4 = ShiftPaths(Data=cull_3, Offset=-2)
debrep_3 = DeconstructBrep(Brep=pshift_2)  # -> Faces, Edges, Vertices
debrep_4 = DeconstructBrep(Brep=pshift)  # -> Faces, Edges, Vertices
debrep_5 = DeconstructBrep(Brep=pshift_4)  # -> Faces, Edges, Vertices
debrep_6 = DeconstructBrep(Brep=pshift_3)  # -> Faces, Edges, Vertices
join_3 = JoinCurves(Curves=debrep_3.Edges, Preserve=False)
join_4 = JoinCurves(Curves=debrep_4.Edges, Preserve=False)
join_5 = JoinCurves(Curves=debrep_5.Edges, Preserve=False)
join_6 = JoinCurves(Curves=debrep_6.Edges, Preserve=False)
trim_3 = TrimTree(Tree=join_3, Depth=Slider(2, range=0..10))
trim_4 = TrimTree(Tree=join_4, Depth=Slider(2, range=0..10))
trim_5 = TrimTree(Tree=join_5, Depth=Slider(2, range=0..10))
trim_6 = TrimTree(Tree=join_6, Depth=Slider(2, range=0..10))
T_2 = ClusterOutput(trim_3)
T_3 = ClusterOutput(trim_4)
T_4 = ClusterOutput(trim_5)
T_5 = ClusterOutput(trim_6)

# ==== cluster Operational
building = ClusterInput()
trees_from_building = GhPythonScript(building=building)  # -> out, zones, facade_area_n, facade_area_s, facade_area_e, facade_area_w, window_areas_n, window_areas_s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
# ---------- trees_from_building: Python ----------
import rhinoscriptsyntax as rs
import ghpythonlib.treehelpers as th

data = building.to_gh_data()

zones                   = data['zones']
facade_area_n           = data['facade_areas']['n']
facade_area_s           = data['facade_areas']['s']
facade_area_e           = data['facade_areas']['e']
facade_area_w           = data['facade_areas']['w']
exterior_walls_n        = data['exterior_walls']['n']
exterior_walls_s        = data['exterior_walls']['s']
exterior_walls_e        = data['exterior_walls']['e']
exterior_walls_w        = data['exterior_walls']['w']
adiabatic_walls         = data['adiabatic_walls']
floor_surfaces          = data['floor_surfaces']
ceiling_surfaces        = data['ceiling_surfaces']
window_areas_n          = data['window_areas']['n']
window_areas_s          = data['window_areas']['s']
window_areas_e          = data['window_areas']['e']
window_areas_w          = data['window_areas']['w']
opaque_areas_n          = data['opaque_areas']['n']
opaque_areas_s          = data['opaque_areas']['s']
opaque_areas_e          = data['opaque_areas']['e']
opaque_areas_w          = data['opaque_areas']['w']
shade_gc                = data['shade_gc']
shade_depth             = data['shade_depth']
facade_cladding         = data['facade_cladding']
facade_cladding         = data['facade_cladding']
external_insulation     = data['external_insulation'] 
insulation_thickness    = data['insulation_thickness']
ewall_framing           = data['ewall_framing']
int_finish              = data['int_finish']
glazing_system          = data['glazing_system']
simulation_name         = data['simulation_name']
zone_program            = data['zone_program']
weather_file            = data['weather_file']
sql_path                = data['sql_path']
simulation_folder       = data['simulation_folder']
run_simulation          = data['run_simulation']
wwr                     = data['wwr']
# ---------- end trees_from_building ----------

importmaterial = GhPythonScript(material_name=trees_from_building.ewall_framing)  # -> r_per_in, embodied_carbon, type, thickness_in, thickness_m, conductivity, density, sp_heat, r_value
# ---------- importmaterial: Python ----------
__author__ = "preston"

import rhinoscriptsyntax as rs
import sys

studiopath = "/Users/preston/Documents/GitHub/studio2021/src"
sys.path.append(studiopath)
import studio2021

from studio2021.functions import read_materials

material = read_materials(material_name)

print(material.keys())

r_per_in = material["r_per_in"]
embodied_carbon = material["embodied_carbon"]
type = material["type"]
density = material["density"]
sp_heat = material["sp_heat"]
thickness_in = material["thickness_in"]
thickness_m = material["thickness_m"]
r_value = material["r_value"]
conductivity = material["conductivity"]
# ---------- end importmaterial ----------
importmaterial_2 = GhPythonScript(material_name=trees_from_building.external_insulation)  # -> r_per_in, embodied_carbon, type, thickness_in, thickness_m, conductivity, density, sp_heat, r_value; same code as importmaterial
importmaterial_3 = GhPythonScript(material_name=trees_from_building.int_finish)  # -> r_per_in, embodied_carbon, type, thickness_in, thickness_m, conductivity, density, sp_heat, r_value; same code as importmaterial
importmaterial_4 = GhPythonScript(material_name=trees_from_building.facade_cladding)  # -> r_per_in, embodied_carbon, type, thickness_in, thickness_m, conductivity, density, sp_heat, r_value; same code as importmaterial
multiplication = Multiplication(A="0.0254")
opaquematnomass = HBOpaqueMaterialNoMass(name="Exterior Air Film", r_value=Slider(0.17, range=0..1))  # -> mat; plug-in component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
opaquemat = HBOpaqueMaterial(
    name="Facade Cladding",
    thickness=importmaterial_4.thickness_m,
    conductivity=importmaterial_4.conductivity,
    density=importmaterial_4.density,
    spec_heat=importmaterial_4.sp_heat)  # -> mat; plug-in component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
opaquematnomass_2 = HBOpaqueMaterialNoMass(name="Air Gap", r_value=Slider(1, range=0..1))  # -> mat; plug-in component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
opaquemat_2 = HBOpaqueMaterial(
    name="Ext. Framing",
    thickness=importmaterial.thickness_m,
    conductivity=importmaterial.conductivity,
    density=importmaterial.density,
    spec_heat=importmaterial.sp_heat)  # -> mat; plug-in component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
opaquemat_3 = HBOpaqueMaterial(
    name="Cont. Ext. Insulation",
    thickness=multiplication,
    conductivity=importmaterial_2.conductivity,
    density=importmaterial_2.density,
    spec_heat=importmaterial_2.sp_heat)  # -> mat; plug-in component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
opaquematnomass_3 = HBOpaqueMaterialNoMass(name="Interior Air Film", r_value=Slider(0.68, range=0..1))  # -> mat; plug-in component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
opaquemat_4 = HBOpaqueMaterial(
    name="Interior Finish",
    thickness=importmaterial_3.thickness_m,
    conductivity=importmaterial_3.conductivity,
    density=importmaterial_3.density,
    spec_heat=importmaterial_3.sp_heat)  # -> mat; plug-in component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
txt = Text("Structural ")
concat = Concatenate(FragmentA=txt)
case = TextCase(Culture=127)  # -> UpperCase, LowerCase
concat_2 = Concatenate(JoinSeparator=" ")
concat_3 = Concatenate(FragmentA=concat, FragmentB=case.LowerCase, JoinSeparator=" with ")
opaqueconstr = HBOpaqueConstruction(
    name=concat_3,
    materials=[opaquematnomass, opaquemat, opaquematnomass_2, opaquemat_2, opaquemat_3, opaquemat_4, opaquematnomass_3])  # -> constr; plug-in component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
exteriorsubset = HBExteriorConstructionSubset(exterior_wall=opaqueconstr)  # -> exterior_set; plug-in component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
decnstrmat = HBDeconstructMaterial(mat=opaqueconstr)  # -> values, attr_names, r_val_si, r_val_ip; plug-in component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
pane_glazing_system = Text(" pane glazing system")
concat_4 = Concatenate(FragmentA=concat_3, FragmentC=concat_2, JoinSeparator=" + ")
concat_5 = Concatenate(FragmentA=concat_4, FragmentC=pane_glazing_system)
constructionset = HBConstructionSet(name=concat_5, exterior_subset=exteriorsubset)  # -> constr_set; plug-in component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

face = HBFace(geo=trees_from_building.adiabatic_walls, name="Adiabatic Wall", type="Wall", bc="Adiabatic")  # -> report, faces; plug-in component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
match = MatchTree(Tree=face.faces, Guide=trees_from_building.adiabatic_walls)

face_2 = HBFace(geo=trees_from_building.floor_surfaces, name="Floor", type="Floor", bc="Adiabatic")  # -> report, faces; plug-in component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
match_2 = MatchTree(Tree=face_2.faces, Guide=trees_from_building.floor_surfaces)

face_3 = HBFace(geo=trees_from_building.ceiling_surfaces, name="RoofCeiling", type="RoofCeiling", bc="Adiabatic")  # -> report, faces; plug-in component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
match_3 = MatchTree(Tree=face_3.faces, Guide=match_2)

importglazing = GhPythonScript(glazing_name=trees_from_building.glazing_system)  # -> frame_type, glass_type, u_value, t_vis, embodied_carbon_metric, embodied_carbon_imperial
# ---------- importglazing: Python ----------
__author__ = "preston"

import rhinoscriptsyntax as rs
import sys

studiopath = "/Users/preston/Documents/GitHub/studio2021/src"
sys.path.append(studiopath)
import studio2021

from studio2021.functions import read_glazing

glazing = read_glazing(glazing_name)

print(glazing.keys())

frame_type = glazing['frame_type']
glass_type = glazing['glass_type']
u_value = glazing['u_value']
t_vis = glazing['t_vis']
embodied_carbon_metric = glazing['embodied_carbon_metric']
embodied_carbon_imperial = glazing['embodied_carbon_imperial']
# ---------- end importglazing ----------
shgc_n_s_e_w = ExplodeTree(Data=trees_from_building.shade_gc)  # -> Branch0, Branch1, Branch2, Branch3
wwr_n_s_e_w = ExplodeTree(Data=trees_from_building.wwr)  # -> Branch0, Branch1, Branch2, Branch3
shade_depth_n_s_e_w = ExplodeTree(Data=trees_from_building.shade_depth)  # -> Branch0, Branch1, Branch2, Branch3

face_4 = HBFace(geo=trees_from_building.exterior_walls_w, name="Exposed Wall", type="Wall", bc="Outdoors")  # -> report, simplify(faces); plug-in component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
windowmat = HBWindowMaterial(
    name=importglazing.frame_type,
    u_factor=flatten(importglazing.u_value),
    shgc=flatten(shgc_n_s_e_w.Branch3),
    t_vis=flatten(importglazing.t_vis))  # -> mat; plug-in component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
windowconstr = HBWindowConstruction(name="WGlass", materials=windowmat)  # -> constr; plug-in component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

face_5 = HBFace(geo=trees_from_building.exterior_walls_e, name="Exposed Wall", type="Wall", bc="Outdoors")  # -> report, simplify(faces); plug-in component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
windowmat_2 = HBWindowMaterial(
    name=importglazing.frame_type,
    u_factor=flatten(importglazing.u_value),
    shgc=flatten(shgc_n_s_e_w.Branch2),
    t_vis=flatten(importglazing.t_vis))  # -> mat; plug-in component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
windowconstr_2 = HBWindowConstruction(name="EGlass", materials=windowmat_2)  # -> constr; plug-in component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

face_6 = HBFace(geo=trees_from_building.exterior_walls_s, name="Exposed Wall", type="Wall", bc="Outdoors")  # -> report, simplify(faces); plug-in component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
windowmat_3 = HBWindowMaterial(
    name=importglazing.frame_type,
    u_factor=flatten(importglazing.u_value),
    shgc=flatten(shgc_n_s_e_w.Branch1),
    t_vis=flatten(importglazing.t_vis))  # -> mat; plug-in component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
windowconstr_3 = HBWindowConstruction(name="SGlass", materials=windowmat_3)  # -> constr; plug-in component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

face_7 = HBFace(geo=trees_from_building.exterior_walls_n, name="Exposed Wall", type="Wall", bc="Outdoors")  # -> report, simplify(faces); plug-in component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
windowmat_4 = HBWindowMaterial(
    name=importglazing.frame_type,
    u_factor=flatten(importglazing.u_value),
    shgc=flatten(shgc_n_s_e_w.Branch0),
    t_vis=flatten(importglazing.t_vis))  # -> mat; plug-in component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
windowconstr_4 = HBWindowConstruction(name="NGlass", materials=windowmat_4)  # -> constr; plug-in component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

match_4 = MatchTree(Tree=face_4.faces, Guide=trees_from_building.exterior_walls_w)
match_5 = MatchTree(Tree=face_6.faces, Guide=trees_from_building.exterior_walls_s)
match_6 = MatchTree(Tree=face_5.faces, Guide=trees_from_building.exterior_walls_e)
match_7 = MatchTree(Tree=face_7.faces, Guide=trees_from_building.exterior_walls_n)

aperturesbyratio = HBAperturesByRatio(hb_objs=match_5, ratio=flatten(wwr_n_s_e_w.Branch1))  # -> report, hb_objs; plug-in component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
applywindowconstr = HBApplyWindowConstruction(hb_objs=aperturesbyratio.hb_objs, constr=windowconstr_3)  # -> hb_objs; plug-in component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
louvershades = HBLouverShades(hb_objs=applywindowconstr, depth=flatten(shade_depth_n_s_e_w.Branch1))  # -> report, hb_objs; plug-in component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

aperturesbyratio_2 = HBAperturesByRatio(hb_objs=match_4, ratio=flatten(wwr_n_s_e_w.Branch3))  # -> report, hb_objs; plug-in component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
applywindowconstr_2 = HBApplyWindowConstruction(hb_objs=aperturesbyratio_2.hb_objs, constr=windowconstr)  # -> hb_objs; plug-in component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
louvershades_2 = HBLouverShades(hb_objs=applywindowconstr_2, depth=flatten(shade_depth_n_s_e_w.Branch3), vertical=True)  # -> report, hb_objs; plug-in component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

aperturesbyratio_3 = HBAperturesByRatio(hb_objs=match_7, ratio=flatten(wwr_n_s_e_w.Branch0))  # -> report, hb_objs; plug-in component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
applywindowconstr_3 = HBApplyWindowConstruction(hb_objs=aperturesbyratio_3.hb_objs, constr=windowconstr_4)  # -> hb_objs; plug-in component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
louvershades_3 = HBLouverShades(hb_objs=applywindowconstr_3, depth=flatten(shade_depth_n_s_e_w.Branch0))  # -> report, hb_objs; plug-in component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

aperturesbyratio_4 = HBAperturesByRatio(hb_objs=match_6, ratio=flatten(wwr_n_s_e_w.Branch2))  # -> report, hb_objs; plug-in component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
applywindowconstr_4 = HBApplyWindowConstruction(hb_objs=aperturesbyratio_4.hb_objs, constr=windowconstr_2)  # -> hb_objs; plug-in component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
louvershades_4 = HBLouverShades(hb_objs=applywindowconstr_4, depth=flatten(shade_depth_n_s_e_w.Branch2), vertical=True)  # -> report, hb_objs; plug-in component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

n_s_e_w_exterior_walls = Merge(Data1=louvershades_3.hb_objs, Data2=louvershades.hb_objs, Data3=louvershades_4.hb_objs, Data4=louvershades_2.hb_objs)
remove_empy_zones = CleanTree(RemoveNulls=True, RemoveInvalid=True, RemoveEmpty=True, Tree=n_s_e_w_exterior_walls)

clean = CleanTree(RemoveNulls=True, RemoveInvalid=True, RemoveEmpty=True, Tree=[remove_empy_zones, match, match_2, match_3])
tstat = TreeStatistics(Tree=clean)  # -> Paths, Length, Count
zone_names = TreeBranch(Tree=simplify(trees_from_building.zones), Path=tstat.Paths, MaintainPaths=True)
room = HBRoom(faces=clean, name=zone_names, program=trees_from_building.zone_program, conditioned=True)  # -> report, room; plug-in component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

clean_2 = CleanTree(RemoveNulls=True, RemoveInvalid=True, RemoveEmpty=False, Tree=room.room)  # -> flatten(Tree)
applyconstrset = HBApplyConstructionSet(rooms=clean_2, constr_set=constructionset)  # -> rooms; plug-in component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

# ----
# Heating, Cooling, & Vent Set Points
applysetpointvals = HBApplySetpointValues(room_or_program=flatten(applyconstrset))  # -> report, mod_obj; plug-in component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
applyloadvals = HBApplyLoadValues(room_or_program=flatten(applysetpointvals.mod_obj))  # -> report, mod_obj; plug-in component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

model = HBModel(rooms=flatten(applyloadvals.mod_obj))  # -> report, model; plug-in component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

# ----
# Energy Simulation
toggle = BooleanToggle(True)
simoutput = HBSimulationOutput(zone_energy_use=toggle, hvac_energy_use=toggle, gains_and_losses=toggle)  # -> report, sim_output; plug-in component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
simpar = HBSimulationParameter(output=simoutput.sim_output, timestep=6)  # -> sim_par; plug-in component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
modeltoosm = HBModelToOSM(
    model=model.model,
    epw_file=trees_from_building.weather_file,
    sim_par=simpar,
    folder=trees_from_building.simulation_folder,
    write=trees_from_building.run_simulation,
    run=trees_from_building.run_simulation)  # -> report, jsons, osw, osm, idf, sql, zsz, rdd, html; plug-in component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
roomenergyresult = HBReadRoomEnergyResult(sql=trees_from_building.sql_path)  # -> cooling, heating, lighting, electric_equip, gas_equip, fan_electric, pump_electric, people_gain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; plug-in component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

cooling = ClusterOutput(roomenergyresult.cooling)
heating = ClusterOutput(roomenergyresult.heating)
lighting = ClusterOutput(roomenergyresult.lighting)
electric_equip = ClusterOutput(roomenergyresult.electric_equip)

# ----
# Chart Results
number_slider = Slider(1, range=0..100)
legendpar = LBLegendParameters(min=Slider(0, range=0..100), max=number_slider)  # -> leg_par; plug-in component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
monthlychart = LBMonthlyChart(data=roomenergyresult.lighting)  # -> report, data_mesh, data_lines, legend, borders, labels, y_title, title; plug-in component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
hourlyplot = LBHourlyPlot(data=flatten(roomenergyresult.solar_gain), legend_par=legendpar)  # -> report, mesh, legend, borders, labels, title; plug-in component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

# ----
# Zone Visualize Results
number_slider_2 = Slider(1, range=1..31)
number_slider_3 = Slider(1, range=1..12)
analysisperiod = LBAnalysisPeriod(
    start_month=number_slider_3,
    start_day=number_slider_2,
    start_hour=0,
    end_month=number_slider_3,
    end_day=Slider(31, range=1..31))  # -> period, hoys, dates; plug-in component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
colorrooms = HBColorRooms(
    data=flatten(roomenergyresult.solar_gain),
    rooms_model=flatten(applyloadvals.mod_obj),
    norm_by_flr=Toggle(True),
    period=analysisperiod.period,
    legend_par=legendpar)  # -> report, mesh, wire_frame, legend, title, rooms, colors, values; plug-in component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
vizquick = HBVizualizeQuick(hb_objs=flatten(colorrooms.rooms))  # -> geo; plug-in component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
preview = CustomPreview(Geometry=[colorrooms.legend, colorrooms.wire_frame], Material=ColourSwatch(SwatchColor=RGB(0, 0, 0)))
preview_2 = CustomPreview(Geometry=vizquick, Material=colorrooms.colors)

# ----
# Label Rooms
faceenergyattr = HBFaceEnergyAttributes({"Construction": "properties.energy.construction.display_name", "Materials": "properties.energy.construction.layers", "R-Value": "properties.energy.construction.r_value", "U-Value": "properties.energy.construction.u_value", "U-Factor": "properties.energy.construction.u_factor", "Solar Transmitance [Unshaded]": "properties.energy.construction.solar_transmittance", "Solar Reflectance [Outside]": "properties.energy.construction.outside_solar_reflectance", "Solar Reflectance [Inside]": "properties.energy.construction.inside_solar_reflectance", "Fraction Area Operable": "properties.energy.vent_opening.fraction_area_operable", "Fraction Height Operable": "properties.energy.vent_opening.fraction_height_operable", "Discharge Coefficient": "properties.energy.vent_opening.discharge_coefficient", "Cross Ventilation": "properties.energy.vent_opening.wind_cross_vent"}, selected="Construction")
roomenergyattr = HBRoomEnergyAttributes({"Program": "properties.energy.program_type.display_name", "Construction Set": "properties.energy.construction_set.display_name", "Is Conditioned": "properties.energy.is_conditioned", "People per Area [ppl/m2]": "properties.energy.people.people_per_area", "Area per Person [m2/ppl]": "properties.energy.people.area_per_person", "Lighting per Area [W/m2]": "properties.energy.lighting.watts_per_area", "Electric Equipment per Area [W/m2]": "properties.energy.electric_equipment.watts_per_area", "Gas Equipment per Area [W/m2]": "properties.energy.gas_equipment.watts_per_area", "Infiltration per Exterior Area [m3/s-m2]": "properties.energy.infiltration.flow_per_exterior_area", "Ventilation per Person [m3/s-ppl]": "properties.energy.ventilation.flow_per_person"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}, selected="Ventilation per Person [m3/s-ppl]")
list = ItemSelector(applyloadvals.mod_obj)
labelrooms = HBLabelRooms(rooms_model=flatten(list), attribute=roomenergyattr)  # -> label_text, base_pts, labels, wire_frame; plug-in component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
lablefaces = HBLabelFaces(hb_objs=flatten(list), attribute=faceenergyattr)  # -> label_text, base_pts, labels, wire_frame; plug-in component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

mod_obj = ClusterOutput(applyloadvals.mod_obj)
