# Grasshopper definition 21_0318_TiME.gh (Grasshopper 1.0.7)
# plug-ins: Human

# ----
# Weather File
panel = Panel("http://climate.onebuilding.org/WMO_Region_4_North_and_Central_America/USA_United_States_of_America/WA_Washington/USA_WA_Seattle-King.County.Intl.AP-Boeing.Field.727935_TMY3.zip")
downloadepw = LBDownloadWeather(weather_URL=panel)  # -> epw_file, stat_file, ddy_file; plug-in component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

# ----
# Massing
# Geometry
adiabaticcrvfromrhino = Curve()
adiabaticcrvfromrhino_2 = Curve(<curve referenced from the Rhino model>)
adiabaticcrvfromrhino_3 = Curve(<curve referenced from the Rhino model>)
outsidecrvfromrhino = Curve()
adiabaticcrvfromrhino_4 = Curve()
height_ft = Panel("13")
outsidecrvfromrhino_2 = Curve([<curve referenced from the Rhino model> x3])
outsidecrvfromrhino_3 = Curve()
outsidecrvfromrhino_4 = Curve([<curve referenced from the Rhino model> x3])
adiabaticcrvfromrhino_5 = Curve()
panel_2 = Panel("ZONE1")
panel_3 = Panel("ZONE4")
panel_4 = Panel("ZONE2")
panel_5 = Panel("ZONE3")
panel_6 = Panel("ZONE5")

# ----
# Massing
# Geometry
adiabaticcrvfromrhino_6 = Curve([<curve referenced from the Rhino model> x2])
adiabaticcrvfromrhino_7 = Curve([<curve referenced from the Rhino model> x2])
adiabaticcrvfromrhino_8 = Curve([<curve referenced from the Rhino model> x2])
outsidecrvfromrhino_5 = Curve([<curve referenced from the Rhino model> x2])
adiabaticcrvfromrhino_9 = Curve([<curve referenced from the Rhino model> x2])
height_ft_2 = Panel("13")
outsidecrvfromrhino_6 = Curve([<curve referenced from the Rhino model> x2])
outsidecrvfromrhino_7 = Curve([<curve referenced from the Rhino model> x2])
outsidecrvfromrhino_8 = Curve([<curve referenced from the Rhino model> x2])
adiabaticcrvfromrhino_10 = Curve()

# ----
# Massing
# Geometry
adiabaticcrvfromrhino_11 = Curve([<curve referenced from the Rhino model> x3])
adiabaticcrvfromrhino_12 = Curve([<curve referenced from the Rhino model> x3])
adiabaticcrvfromrhino_13 = Curve([<curve referenced from the Rhino model> x3])
outsidecrvfromrhino_9 = Curve(<curve referenced from the Rhino model>)
adiabaticcrvfromrhino_14 = Curve([<curve referenced from the Rhino model> x3])
height_ft_3 = Panel("13")
outsidecrvfromrhino_10 = Curve(<curve referenced from the Rhino model>)
outsidecrvfromrhino_11 = Curve(<curve referenced from the Rhino model>)
outsidecrvfromrhino_12 = Curve(<curve referenced from the Rhino model>)
adiabaticcrvfromrhino_15 = Curve([<curve referenced from the Rhino model> x4])

# ----
# Massing
# Geometry
adiabaticcrvfromrhino_16 = Curve()
adiabaticcrvfromrhino_17 = Curve()
adiabaticcrvfromrhino_18 = Curve()
outsidecrvfromrhino_13 = Curve()
adiabaticcrvfromrhino_19 = Curve()
height_ft_4 = Panel("13")
outsidecrvfromrhino_14 = Curve([<curve referenced from the Rhino model> x4])
outsidecrvfromrhino_15 = Curve()
outsidecrvfromrhino_16 = Curve()
adiabaticcrvfromrhino_20 = Curve()

# ----
# Massing
# Geometry
adiabaticcrvfromrhino_21 = Curve()
adiabaticcrvfromrhino_22 = Curve([<curve referenced from the Rhino model> x4])
adiabaticcrvfromrhino_23 = Curve()
height_ft_5 = Panel("13")
adiabaticcrvfromrhino_24 = Curve([<curve referenced from the Rhino model> x5])
outsidecrvfromrhino_17 = Curve()
outsidecrvfromrhino_18 = Curve([<curve referenced from the Rhino model> x3])
outsidecrvfromrhino_19 = Curve([<curve referenced from the Rhino model> x3])
outsidecrvfromrhino_20 = Curve()
adiabaticcrvfromrhino_25 = Curve([<curve referenced from the Rhino model> x5])

# ----
# Floor
# Condition
list = ValueList({"Adiabatic", "Ground"}, selected="Adiabatic")

# ----
# Set Zone Program
bldgprograms = HBBuildingPrograms({"LargeOffice", "MediumOffice", "SmallOffice", "MidriseApartment", "HighriseApartment", "Retail", "StripMall", "PrimarySchool", "SecondarySchool", "SmallHotel", "LargeHotel", "Hospital", "Outpatient", "Laboratory", "Warehouse", "SuperMarket", "FullServiceRestaurant", "QuickServiceRestaurant", "Courthouse", "LargeDataCenterHighITE", "LargeDataCenterLowITE", "SmallDataCenterHighITE", "SmallDataCenterLowITE"}, selected="MidriseApartment")
searchprog = HBSearchPrograms(bldg_prog=bldgprograms)  # -> room_prog; plug-in component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
list_2 = ItemSelector(
    searchprog,
    {"2013::MidriseApartment::Apartment", "2013::MidriseApartment::Corridor", "2013::MidriseApartment::Office"}, selected="2013::MidriseApartment::Apartment")

# ----
# Floor
# Condition
list_3 = ValueList({"Adiabatic", "Ground"}, selected="Adiabatic")

# ----
# Set Zone Program
bldgprograms_2 = HBBuildingPrograms({"LargeOffice", "MediumOffice", "SmallOffice", "MidriseApartment", "HighriseApartment", "Retail", "StripMall", "PrimarySchool", "SecondarySchool", "SmallHotel", "LargeHotel", "Hospital", "Outpatient", "Laboratory", "Warehouse", "SuperMarket", "FullServiceRestaurant", "QuickServiceRestaurant", "Courthouse", "LargeDataCenterHighITE", "LargeDataCenterLowITE", "SmallDataCenterHighITE", "SmallDataCenterLowITE"}, selected="MidriseApartment")
searchprog_2 = HBSearchPrograms(bldg_prog=bldgprograms_2)  # -> room_prog; plug-in component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
list_4 = ItemSelector(
    searchprog_2,
    {"2013::MidriseApartment::Apartment", "2013::MidriseApartment::Corridor", "2013::MidriseApartment::Office"}, selected="2013::MidriseApartment::Apartment")

# ----
# Ceiling
# Condition
list_5 = ValueList({"Outdoors", "Adiabatic"}, selected="Outdoors")

# ----
# Ceiling
# Condition
list_6 = ValueList({"Outdoors", "Adiabatic"}, selected="Outdoors")

# ----
# Floor
# Condition
list_7 = ValueList({"Adiabatic", "Ground"}, selected="Adiabatic")

# ----
# Set Zone Program
bldgprograms_3 = HBBuildingPrograms({"LargeOffice", "MediumOffice", "SmallOffice", "MidriseApartment", "HighriseApartment", "Retail", "StripMall", "PrimarySchool", "SecondarySchool", "SmallHotel", "LargeHotel", "Hospital", "Outpatient", "Laboratory", "Warehouse", "SuperMarket", "FullServiceRestaurant", "QuickServiceRestaurant", "Courthouse", "LargeDataCenterHighITE", "LargeDataCenterLowITE", "SmallDataCenterHighITE", "SmallDataCenterLowITE"}, selected="MidriseApartment")
searchprog_3 = HBSearchPrograms(bldg_prog=bldgprograms_3)  # -> room_prog; plug-in component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
list_8 = ItemSelector(
    searchprog_3,
    {"2013::MidriseApartment::Apartment", "2013::MidriseApartment::Corridor", "2013::MidriseApartment::Office"}, selected="2013::MidriseApartment::Apartment")

# ----
# Floor
# Condition
list_9 = ValueList({"Adiabatic", "Ground"}, selected="Adiabatic")

# ----
# Set Zone Program
bldgprograms_4 = HBBuildingPrograms({"LargeOffice", "MediumOffice", "SmallOffice", "MidriseApartment", "HighriseApartment", "Retail", "StripMall", "PrimarySchool", "SecondarySchool", "SmallHotel", "LargeHotel", "Hospital", "Outpatient", "Laboratory", "Warehouse", "SuperMarket", "FullServiceRestaurant", "QuickServiceRestaurant", "Courthouse", "LargeDataCenterHighITE", "LargeDataCenterLowITE", "SmallDataCenterHighITE", "SmallDataCenterLowITE"}, selected="MidriseApartment")
searchprog_4 = HBSearchPrograms(bldg_prog=bldgprograms_4)  # -> room_prog; plug-in component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
list_10 = ItemSelector(
    searchprog_4,
    {"2013::MidriseApartment::Apartment", "2013::MidriseApartment::Corridor", "2013::MidriseApartment::Office"}, selected="2013::MidriseApartment::Apartment")

# ----
# Ceiling
# Condition
list_11 = ValueList({"Outdoors", "Adiabatic"}, selected="Outdoors")

# ----
# Floor
# Condition
list_12 = ValueList({"Adiabatic", "Ground"}, selected="Adiabatic")

# ----
# Set Zone Program
bldgprograms_5 = HBBuildingPrograms({"LargeOffice", "MediumOffice", "SmallOffice", "MidriseApartment", "HighriseApartment", "Retail", "StripMall", "PrimarySchool", "SecondarySchool", "SmallHotel", "LargeHotel", "Hospital", "Outpatient", "Laboratory", "Warehouse", "SuperMarket", "FullServiceRestaurant", "QuickServiceRestaurant", "Courthouse", "LargeDataCenterHighITE", "LargeDataCenterLowITE", "SmallDataCenterHighITE", "SmallDataCenterLowITE"}, selected="MidriseApartment")
searchprog_5 = HBSearchPrograms(bldg_prog=bldgprograms_5)  # -> room_prog; plug-in component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
list_13 = ItemSelector(
    searchprog_5,
    {"2013::MidriseApartment::Apartment", "2013::MidriseApartment::Corridor", "2013::MidriseApartment::Office"}, selected="2013::MidriseApartment::Apartment")

# ----
# Ceiling
# Condition
list_14 = ValueList({"Outdoors", "Adiabatic"}, selected="Outdoors")

# ----
# Ceiling
# Condition
list_15 = ValueList({"Outdoors", "Adiabatic"}, selected="Outdoors")

# ----
# Construction Options
insulation_thickness_in = Slider(8, range=0..12)
interior_finish = ValueList({"Gyp", "Exposed CLT", "CLT Gyp"}, selected="Gyp")
facade_cladding = ValueList({"Brick", "Fiber Cement", "Metal Panel", "Wood", "Stone"}, selected="Brick")
cont_ext_insulation = ValueList({"Rigid", "Fiberglass"}, selected="Rigid")
exterior_wall_framing = ValueList({"2x4 Metal Studs", "CLT", "Concrete", "2x4 Wood Studs"}, selected="CLT")

# ----
# Construction Options
insulation_thickness_in_2 = Slider(8, range=0..12)
interior_finish_2 = ValueList({"Gyp", "Exposed CLT", "CLT Gyp"}, selected="Gyp")
facade_cladding_2 = ValueList({"Brick", "Fiber Cement", "Metal Panel", "Wood", "Stone"}, selected="Brick")
cont_ext_insulation_2 = ValueList({"Rigid", "Fiberglass"}, selected="Rigid")
exterior_wall_framing_2 = ValueList({"2x4 Metal Studs", "CLT", "Concrete", "2x4 Wood Studs"}, selected="CLT")

# ----
# Construction Options
insulation_thickness_in_3 = Slider(8, range=0..12)
interior_finish_3 = ValueList({"Gyp", "Exposed CLT", "CLT Gyp"}, selected="Gyp")
facade_cladding_3 = ValueList({"Brick", "Fiber Cement", "Metal Panel", "Wood", "Stone"}, selected="Brick")
cont_ext_insulation_3 = ValueList({"Rigid", "Fiberglass"}, selected="Rigid")
exterior_wall_framing_3 = ValueList({"2x4 Metal Studs", "CLT", "Concrete", "2x4 Wood Studs"}, selected="CLT")

# ----
# Construction Options
insulation_thickness_in_4 = Slider(8, range=0..12)
interior_finish_4 = ValueList({"Gyp", "Exposed CLT", "CLT Gyp"}, selected="Gyp")
facade_cladding_4 = ValueList({"Brick", "Fiber Cement", "Metal Panel", "Wood", "Stone"}, selected="Brick")
cont_ext_insulation_4 = ValueList({"Rigid", "Fiberglass"}, selected="Rigid")
exterior_wall_framing_4 = ValueList({"2x4 Metal Studs", "CLT", "Concrete", "2x4 Wood Studs"}, selected="CLT")

# ----
# Construction Options
insulation_thickness_in_5 = Slider(8, range=0..12)
interior_finish_5 = ValueList({"Gyp", "Exposed CLT", "CLT Gyp"}, selected="Gyp")
facade_cladding_5 = ValueList({"Brick", "Fiber Cement", "Metal Panel", "Wood", "Stone"}, selected="Brick")
cont_ext_insulation_5 = ValueList({"Rigid", "Fiberglass"}, selected="Rigid")
exterior_wall_framing_5 = ValueList({"2x4 Metal Studs", "CLT", "Concrete", "2x4 Wood Studs"}, selected="CLT")

# ----
# Glazing
west_s_vertical_shade_depth_in = Slider(47, range=0..600)
west_n_vertical_shade_depth_in = Slider(52, range=0..600)
west_shade_horizontal_depth_in = Slider(18, range=0..600)
north_wwr = Slider(0.7, range=0..1)
north_w_vertical_shade_depth_in = Slider(18, range=0..600)
north_e_vertical_shade_depth_in = Slider(60, range=0..600)
north_horizontal_shade_depth_in = Slider(42, range=0..600)
west_wwr = Slider(0.7, range=0..1)
east_n_vertical_shade_depth_in = Slider(76, range=0..600)
east_s_vertical_shade_depth_in = Slider(0, range=0..600)
south_wwr = Slider(0.7, range=0..1)
east_shade_horizontal_depth_in = Slider(0, range=0..600)
south_e_vertical_shade_depth_in = Slider(0, range=0..600)
east_wwr = Slider(0.7, range=0..1)
south_w_vertical_shade_depth_in = Slider(0, range=0..600)
south_horizontal_shade_depth_in = Slider(55, range=0..600)
glazing = ValueList({"Aluminum Double", "Aluminum Triple", "Wood Double", "Wood Triple"}, selected="Wood Triple")
west_shgc = ValueList({"Low SHGC": 0.25, "High SHGC": 0.60}, selected="High SHGC")
north_shgc = ValueList({"Low SHGC": 0.25, "High SHGC": 0.60}, selected="Low SHGC")
south_shgc = ValueList({"Low SHGC": 0.25, "High SHGC": 0.60}, selected="High SHGC")
east_shgc = ValueList({"Low SHGC": 0.25, "High SHGC": 0.60}, selected="High SHGC")

# ----
# Glazing
west_s_vertical_shade_depth_in_2 = Slider(0, range=0..600)
west_n_vertical_shade_depth_in_2 = Slider(0, range=0..600)
west_shade_horizontal_depth_in_2 = Slider(0, range=0..600)
west_wwr_2 = Slider(0.4, range=0..1)
north_wwr_2 = Slider(0.4, range=0..1)
north_horizontal_shade_depth_in_2 = Slider(36, range=0..600)
north_w_vertical_shade_depth_in_2 = Slider(36, range=0..600)
east_n_vertical_shade_depth_in_2 = Slider(0, range=0..600)
east_s_vertical_shade_depth_in_2 = Slider(0, range=0..600)
north_e_vertical_shade_depth_in_2 = Slider(36, range=0..600)
south_wwr_2 = Slider(0.4, range=0..1)
east_shade_horizontal_depth_in_2 = Slider(10, range=0..600)
glazing_2 = ValueList({"Aluminum Double", "Aluminum Triple", "Wood Double", "Wood Triple"}, selected="Wood Double")
south_e_vertical_shade_depth_in_2 = Slider(20, range=0..600)
east_wwr_2 = Slider(0.4, range=0..1)
south_horizontal_shade_depth_in_2 = Slider(36, range=0..600)
south_w_vertical_shade_depth_in_2 = Slider(0, range=0..600)
north_shgc_2 = ValueList({"Low SHGC": 0.25, "High SHGC": 0.60}, selected="Low SHGC")
west_shgc_2 = ValueList({"Low SHGC": 0.25, "High SHGC": 0.60}, selected="High SHGC")
east_shgc_2 = ValueList({"Low SHGC": 0.25, "High SHGC": 0.60}, selected="High SHGC")
south_shgc_2 = ValueList({"Low SHGC": 0.25, "High SHGC": 0.60}, selected="High SHGC")

# ----
# Glazing
west_s_vertical_shade_depth_in_3 = Slider(0, range=0..600)
west_n_vertical_shade_depth_in_3 = Slider(0, range=0..600)
west_shade_horizontal_depth_in_3 = Slider(0, range=0..600)
west_wwr_3 = Slider(0.4, range=0..1)
north_wwr_3 = Slider(0.4, range=0..1)
north_horizontal_shade_depth_in_3 = Slider(0, range=0..600)
north_w_vertical_shade_depth_in_3 = Slider(0, range=0..600)
east_n_vertical_shade_depth_in_3 = Slider(0, range=0..600)
east_s_vertical_shade_depth_in_3 = Slider(0, range=0..600)
north_e_vertical_shade_depth_in_3 = Slider(0, range=0..600)
south_wwr_3 = Slider(0.4, range=0..1)
east_shade_horizontal_depth_in_3 = Slider(0, range=0..600)
east_wwr_3 = Slider(0.4, range=0..1)
south_e_vertical_shade_depth_in_3 = Slider(0, range=0..600)
south_w_vertical_shade_depth_in_3 = Slider(0, range=0..600)
south_horizontal_shade_depth_in_3 = Slider(0, range=0..600)
glazing_3 = ValueList({"Aluminum Double", "Aluminum Triple", "Wood Double", "Wood Triple"}, selected="Wood Double")
north_shgc_3 = ValueList({"Low SHGC": 0.25, "High SHGC": 0.60}, selected="Low SHGC")
west_shgc_3 = ValueList({"Low SHGC": 0.25, "High SHGC": 0.60}, selected="High SHGC")
east_shgc_3 = ValueList({"Low SHGC": 0.25, "High SHGC": 0.60}, selected="High SHGC")
south_shgc_3 = ValueList({"Low SHGC": 0.25, "High SHGC": 0.60}, selected="High SHGC")

# ----
# Glazing
west_s_vertical_shade_depth_in_4 = Slider(0, range=0..600)
west_n_vertical_shade_depth_in_4 = Slider(0, range=0..600)
west_shade_horizontal_depth_in_4 = Slider(0, range=0..600)
west_wwr_4 = Slider(0.4, range=0..1)
north_wwr_4 = Slider(0.4, range=0..1)
north_horizontal_shade_depth_in_4 = Slider(0, range=0..600)
north_w_vertical_shade_depth_in_4 = Slider(0, range=0..600)
east_n_vertical_shade_depth_in_4 = Slider(0, range=0..600)
north_e_vertical_shade_depth_in_4 = Slider(0, range=0..600)
east_s_vertical_shade_depth_in_4 = Slider(0, range=0..600)
east_shade_horizontal_depth_in_4 = Slider(0, range=0..600)
south_wwr_4 = Slider(0.4, range=0..1)
south_e_vertical_shade_depth_in_4 = Slider(0, range=0..600)
east_wwr_4 = Slider(0.4, range=0..1)
south_horizontal_shade_depth_in_4 = Slider(0, range=0..600)
south_w_vertical_shade_depth_in_4 = Slider(0, range=0..600)
glazing_4 = ValueList({"Aluminum Double", "Aluminum Triple", "Wood Double", "Wood Triple"}, selected="Wood Double")
north_shgc_4 = ValueList({"Low SHGC": 0.25, "High SHGC": 0.60}, selected="Low SHGC")
west_shgc_4 = ValueList({"Low SHGC": 0.25, "High SHGC": 0.60}, selected="High SHGC")
east_shgc_4 = ValueList({"Low SHGC": 0.25, "High SHGC": 0.60}, selected="High SHGC")
south_shgc_4 = ValueList({"Low SHGC": 0.25, "High SHGC": 0.60}, selected="High SHGC")

# ----
# Glazing
west_s_vertical_shade_depth_in_5 = Slider(0, range=0..600)
west_shade_horizontal_depth_in_5 = Slider(0, range=0..600)
west_n_vertical_shade_depth_in_5 = Slider(0, range=0..600)
west_wwr_5 = Slider(0.4, range=0..1)
north_wwr_5 = Slider(0.4, range=0..1)
north_horizontal_shade_depth_in_5 = Slider(36, range=0..600)
north_w_vertical_shade_depth_in_5 = Slider(36, range=0..600)
east_n_vertical_shade_depth_in_5 = Slider(0, range=0..600)
east_s_vertical_shade_depth_in_5 = Slider(0, range=0..600)
north_e_vertical_shade_depth_in_5 = Slider(36, range=0..600)
south_wwr_5 = Slider(0.4, range=0..1)
east_shade_horizontal_depth_in_5 = Slider(0, range=0..600)
east_wwr_5 = Slider(0.4, range=0..1)
south_e_vertical_shade_depth_in_5 = Slider(0, range=0..600)
south_w_vertical_shade_depth_in_5 = Slider(0, range=0..600)
glazing_5 = ValueList({"Aluminum Double", "Aluminum Triple", "Wood Double", "Wood Triple"}, selected="Wood Double")
south_horizontal_shade_depth_in_5 = Slider(36, range=0..600)
north_shgc_5 = ValueList({"Low SHGC": 0.25, "High SHGC": 0.60}, selected="Low SHGC")
west_shgc_5 = ValueList({"Low SHGC": 0.25, "High SHGC": 0.60}, selected="High SHGC")
east_shgc_5 = ValueList({"Low SHGC": 0.25, "High SHGC": 0.60}, selected="High SHGC")
south_shgc_5 = ValueList({"Low SHGC": 0.25, "High SHGC": 0.60}, selected="High SHGC")

# ----
# Run
# Simulation
run_simulation = BooleanToggle(False)

num_col_x = Slider(3, range=0..20)
num_col_y = Slider(7, range=0..20)
genes = GenePool(Decimals=0, Maximum=50, Minimum=0, Value=[0, 29, 24, 24])
genes_2 = GenePool(Decimals=0, Maximum=50, Minimum=0, Value=[0, 35, 17, 25, 21, 26])
num_floors_above = Slider(10, range=0..10)
building_type = ValueList({"Type 3", "Type 4A", "Type 4B", "Type 4C", "Type 5"}, selected="Type 4C")
composite_slab = BooleanToggle(False)

# ----
# Simulation Inputs
# Simulation Folder Name:
# Simulation Name:
# .sql Filepath:
path = GhPythonScript()  # -> out, path
# ---------- path: Python ----------
__author__ = "tmendeze"


import studio2021

path = studio2021.TEMP
# ---------- end path ----------
panel_27 = Panel(path.path)

# ----
# Scenario:
panel_28 = Panel("2_zone_Rectangle")
gather_all_info_from_scenario = Entwine(
    Branch00=panel_28,
    Branch01=height_ft,
    Branch02=outsidecrvfromrhino_2,
    Branch03=adiabaticcrvfromrhino_2,
    Branch04=outsidecrvfromrhino_4,
    Branch05=adiabaticcrvfromrhino_3,
    Branch06=outsidecrvfromrhino_3,
    Branch07=adiabaticcrvfromrhino,
    Branch08=outsidecrvfromrhino,
    Branch09=adiabaticcrvfromrhino_4,
    Branch010=adiabaticcrvfromrhino_5,
    Branch011=list_5,
    Branch012=list,
    Branch013=north_wwr,
    Branch014=south_wwr,
    Branch015=east_wwr,
    Branch016=west_wwr,
    Branch017=north_horizontal_shade_depth_in,
    Branch018=south_horizontal_shade_depth_in,
    Branch019=east_shade_horizontal_depth_in,
    Branch020=west_shade_horizontal_depth_in,
    Branch021=north_w_vertical_shade_depth_in,
    Branch022=south_e_vertical_shade_depth_in,
    Branch023=east_n_vertical_shade_depth_in,
    Branch024=west_n_vertical_shade_depth_in,
    Branch025=north_e_vertical_shade_depth_in,
    Branch026=south_w_vertical_shade_depth_in,
    Branch027=east_s_vertical_shade_depth_in,
    Branch028=west_s_vertical_shade_depth_in,
    Branch029=north_shgc,
    Branch030=south_shgc,
    Branch031=east_shgc,
    Branch032=west_shgc,
    Branch033=list_2,
    Branch034=facade_cladding,
    Branch035=cont_ext_insulation,
    Branch036=insulation_thickness_in,
    Branch037=exterior_wall_framing,
    Branch038=interior_finish,
    FlattenInputs=True)  # -> simplify(Result)
branch = TreeBranch(Tree=gather_all_info_from_scenario, Path="{0}", MaintainPaths=True)  # -> flatten(ConnectToMassingOptions)

# ----
# Scenario:
panel_29 = Panel("4_zone")
gather_all_info_from_scenario_2 = Entwine(
    Branch00=panel_29,
    Branch01=height_ft_2,
    Branch02=outsidecrvfromrhino_6,
    Branch03=adiabaticcrvfromrhino_7,
    Branch04=outsidecrvfromrhino_8,
    Branch05=adiabaticcrvfromrhino_8,
    Branch06=outsidecrvfromrhino_7,
    Branch07=adiabaticcrvfromrhino_6,
    Branch08=outsidecrvfromrhino_5,
    Branch09=adiabaticcrvfromrhino_9,
    Branch010=adiabaticcrvfromrhino_10,
    Branch011=list_6,
    Branch012=list_3,
    Branch013=north_wwr_2,
    Branch014=south_wwr_2,
    Branch015=east_wwr_2,
    Branch016=west_wwr_2,
    Branch017=north_horizontal_shade_depth_in_2,
    Branch018=south_horizontal_shade_depth_in_2,
    Branch019=east_shade_horizontal_depth_in_2,
    Branch020=west_shade_horizontal_depth_in_2,
    Branch021=north_w_vertical_shade_depth_in_2,
    Branch022=south_e_vertical_shade_depth_in_2,
    Branch023=east_n_vertical_shade_depth_in_2,
    Branch024=west_n_vertical_shade_depth_in_2,
    Branch025=north_e_vertical_shade_depth_in_2,
    Branch026=south_w_vertical_shade_depth_in_2,
    Branch027=east_s_vertical_shade_depth_in_2,
    Branch028=west_s_vertical_shade_depth_in_2,
    Branch029=north_shgc_2,
    Branch030=south_shgc_2,
    Branch031=east_shgc_2,
    Branch032=west_shgc_2,
    Branch033=list_4,
    Branch034=facade_cladding_2,
    Branch035=cont_ext_insulation_2,
    Branch036=insulation_thickness_in_2,
    Branch037=exterior_wall_framing_2,
    Branch038=interior_finish_2,
    FlattenInputs=True)  # -> simplify(Result)
branch_2 = TreeBranch(Tree=gather_all_info_from_scenario_2, Path="{0}", MaintainPaths=True)  # -> flatten(ConnectToMassingOptions)

# ----
# Scenario:
panel_30 = Panel("5_zone_rectangle")
gather_all_info_from_scenario_3 = Entwine(
    Branch00=panel_30,
    Branch01=height_ft_3,
    Branch02=outsidecrvfromrhino_10,
    Branch03=adiabaticcrvfromrhino_12,
    Branch04=outsidecrvfromrhino_12,
    Branch05=adiabaticcrvfromrhino_13,
    Branch06=outsidecrvfromrhino_11,
    Branch07=adiabaticcrvfromrhino_11,
    Branch08=outsidecrvfromrhino_9,
    Branch09=adiabaticcrvfromrhino_14,
    Branch010=adiabaticcrvfromrhino_15,
    Branch011=list_11,
    Branch012=list_7,
    Branch013=north_wwr_3,
    Branch014=south_wwr_3,
    Branch015=east_wwr_3,
    Branch016=west_wwr_3,
    Branch017=north_horizontal_shade_depth_in_3,
    Branch018=south_horizontal_shade_depth_in_3,
    Branch019=east_shade_horizontal_depth_in_3,
    Branch020=west_shade_horizontal_depth_in_3,
    Branch021=north_w_vertical_shade_depth_in_3,
    Branch022=south_e_vertical_shade_depth_in_3,
    Branch023=east_n_vertical_shade_depth_in_3,
    Branch024=west_n_vertical_shade_depth_in_3,
    Branch025=north_e_vertical_shade_depth_in_3,
    Branch026=south_w_vertical_shade_depth_in_3,
    Branch027=east_s_vertical_shade_depth_in_3,
    Branch028=west_s_vertical_shade_depth_in_3,
    Branch029=north_shgc_3,
    Branch030=south_shgc_3,
    Branch031=east_shgc_3,
    Branch032=west_shgc_3,
    Branch033=list_8,
    Branch034=facade_cladding_3,
    Branch035=cont_ext_insulation_3,
    Branch036=insulation_thickness_in_3,
    Branch037=exterior_wall_framing_3,
    Branch038=interior_finish_3,
    FlattenInputs=True)  # -> simplify(Result)
branch_3 = TreeBranch(Tree=gather_all_info_from_scenario_3, Path="{0}", MaintainPaths=True)  # -> flatten(ConnectToMassingOptions)

# ----
# Scenario:
panel_31 = Panel("1_zone_rectangle")
gather_all_info_from_scenario_4 = Entwine(
    Branch00=panel_31,
    Branch01=height_ft_4,
    Branch02=outsidecrvfromrhino_14,
    Branch03=adiabaticcrvfromrhino_18,
    Branch04=outsidecrvfromrhino_16,
    Branch05=adiabaticcrvfromrhino_16,
    Branch06=outsidecrvfromrhino_15,
    Branch07=adiabaticcrvfromrhino_17,
    Branch08=outsidecrvfromrhino_13,
    Branch09=adiabaticcrvfromrhino_19,
    Branch010=adiabaticcrvfromrhino_20,
    Branch011=list_14,
    Branch012=list_9,
    Branch013=north_wwr_4,
    Branch014=south_wwr_4,
    Branch015=east_wwr_4,
    Branch016=west_wwr_4,
    Branch017=north_horizontal_shade_depth_in_4,
    Branch018=south_horizontal_shade_depth_in_4,
    Branch019=east_shade_horizontal_depth_in_4,
    Branch020=west_shade_horizontal_depth_in_4,
    Branch021=north_w_vertical_shade_depth_in_4,
    Branch022=south_e_vertical_shade_depth_in_4,
    Branch023=east_n_vertical_shade_depth_in_4,
    Branch024=west_n_vertical_shade_depth_in_4,
    Branch025=north_e_vertical_shade_depth_in_4,
    Branch026=south_w_vertical_shade_depth_in_4,
    Branch027=east_s_vertical_shade_depth_in_4,
    Branch028=west_s_vertical_shade_depth_in_4,
    Branch029=north_shgc_4,
    Branch030=south_shgc_4,
    Branch031=east_shgc_4,
    Branch032=west_shgc_4,
    Branch033=list_10,
    Branch034=facade_cladding_4,
    Branch035=cont_ext_insulation_4,
    Branch036=insulation_thickness_in_4,
    Branch037=exterior_wall_framing_4,
    Branch038=interior_finish_4,
    FlattenInputs=True)  # -> simplify(Result)
branch_4 = TreeBranch(Tree=gather_all_info_from_scenario_4, Path="{0}", MaintainPaths=True)  # -> flatten(ConnectToMassingOptions)

# ----
# Scenario:
panel_32 = Panel("3_zone")
gather_all_info_from_scenario_5 = Entwine(
    Branch00=panel_32,
    Branch01=height_ft_5,
    Branch02=outsidecrvfromrhino_18,
    Branch03=adiabaticcrvfromrhino_24,
    Branch04=outsidecrvfromrhino_19,
    Branch05=adiabaticcrvfromrhino_22,
    Branch06=outsidecrvfromrhino_20,
    Branch07=adiabaticcrvfromrhino_21,
    Branch08=outsidecrvfromrhino_17,
    Branch09=adiabaticcrvfromrhino_23,
    Branch010=adiabaticcrvfromrhino_25,
    Branch011=list_15,
    Branch012=list_12,
    Branch013=north_wwr_5,
    Branch014=south_wwr_5,
    Branch015=east_wwr_5,
    Branch016=west_wwr_5,
    Branch017=north_horizontal_shade_depth_in_5,
    Branch018=south_horizontal_shade_depth_in_5,
    Branch019=east_shade_horizontal_depth_in_5,
    Branch020=west_shade_horizontal_depth_in_5,
    Branch021=north_w_vertical_shade_depth_in_5,
    Branch022=south_e_vertical_shade_depth_in_5,
    Branch023=east_n_vertical_shade_depth_in_5,
    Branch024=west_n_vertical_shade_depth_in_5,
    Branch025=north_e_vertical_shade_depth_in_5,
    Branch026=south_w_vertical_shade_depth_in_5,
    Branch027=east_s_vertical_shade_depth_in_5,
    Branch028=west_s_vertical_shade_depth_in_5,
    Branch029=north_shgc_5,
    Branch030=south_shgc_5,
    Branch031=east_shgc_5,
    Branch032=west_shgc_5,
    Branch033=list_13,
    Branch034=facade_cladding_5,
    Branch035=cont_ext_insulation_5,
    Branch036=insulation_thickness_in_5,
    Branch037=exterior_wall_framing_5,
    Branch038=interior_finish_5,
    FlattenInputs=True)  # -> simplify(Result)
branch_5 = TreeBranch(Tree=gather_all_info_from_scenario_5, Path="{0}", MaintainPaths=True)  # -> flatten(ConnectToMassingOptions)

# ----
# Choose
# Scenario!
data = Data([branch, branch_3, branch_4, branch_5, branch_2])
list_16 = ItemSelector(data, {"2_zone_Rectangle", "5_zone_rectangle", "1_zone_rectangle", "3_zone", "4_zone"}, selected="2_zone_Rectangle")

subset = SubSet(SetA=branch, ConnectToMassingOptions=list_16)
filter = StreamFilter(Gate=subset, Stream1=gather_all_info_from_scenario)

subset_2 = SubSet(SetA=branch_2, ConnectToMassingOptions=list_16)
filter_2 = StreamFilter(Gate=subset_2, Stream1=gather_all_info_from_scenario_2)

subset_3 = SubSet(SetA=branch_3, ConnectToMassingOptions=list_16)
filter_3 = StreamFilter(Gate=subset_3, Stream1=gather_all_info_from_scenario_3)

subset_4 = SubSet(SetA=branch_4, ConnectToMassingOptions=list_16)
filter_4 = StreamFilter(Gate=subset_4, Stream1=gather_all_info_from_scenario_4)

subset_5 = SubSet(SetA=branch_5, ConnectToMassingOptions=list_16)
filter_5 = StreamFilter(Gate=subset_5, Stream1=gather_all_info_from_scenario_5)

merge = Merge(Data1=filter, Data2=filter_3, Data3=filter_4, Data4=filter_5, Data5=filter_2)
bang = ExplodeTree(Data=merge)  # -> Branch0, Branch1, Branch2, Branch3, Branch4, Branch5, Branch6, Branch7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

panel_33 = Panel(bang.Branch0)
time_stamp = GhPythonScript(name=panel_33)  # -> out, name
# ---------- time_stamp: Python ----------
__author__ = "tmendeze"

import rhinoscriptsyntax as rs

import datetime
time = datetime.datetime.now().strftime('%Y%m%d%H%M')
name_ = '{}_{}'.format(name, time)
print(name_)
# ---------- end time_stamp ----------
csv_path = GhPythonScript(path=path.path, sim_name=time_stamp.name)  # -> out, sql_path
# ---------- csv_path: Python ----------
__author__ = "tmendeze"
__version__ = "2021.03.02"

import rhinoscriptsyntax as rs
import os
sql = os.path.join('OpenStudio','run','eplusout.sql')
sql_path = os.path.join(path, sim_name, sql)
# ---------- end csv_path ----------
panel_34 = Panel(csv_path.sql_path)

# ----
# Simulation Outputs
# Output Folder Name:
csv_path_2 = GhPythonScript(path=path.path, sim_name=time_stamp.name)  # -> out, csv_path
# ---------- csv_path_2: Python ----------
__author__ = "tmendeze"
__version__ = "2021.03.02"

import rhinoscriptsyntax as rs
import os

csv_path = os.path.join(path, sim_name+".csv")
# ---------- end csv_path_2 ----------
panel_35 = Panel(csv_path_2.csv_path)

# ----
# Gathers all zone information
# to create massing
adiabaticcrv = Entwine(
    Branch00=bang.Branch3,
    Branch01=bang.Branch5,
    Branch02=bang.Branch7,
    Branch03=bang.Branch9,
    Branch04=bang.Branch10,
    FlattenInputs=True)  # -> simplify(Result)
outsidecrv = Entwine(Branch00=bang.Branch2, Branch01=bang.Branch4, Branch02=bang.Branch6, Branch03=bang.Branch8, FlattenInputs=True)  # -> simplify(Result)
zone = Entwine(Branch00="ZONE1", Branch01="ZONE2", Branch02="ZONE3", Branch03="ZONE4", Branch04="ZONE5", FlattenInputs=True)  # -> simplify(Result)
vertical_shade_depth_direction_1 = Entwine(Branch00=bang.Branch21, Branch01=bang.Branch22, Branch02=bang.Branch23, Branch03=bang.Branch24, FlattenInputs=True)  # -> simplify(Result)
wwr = Entwine(Branch00=bang.Branch13, Branch01=bang.Branch14, Branch02=bang.Branch15, Branch03=bang.Branch16, FlattenInputs=True)  # -> simplify(Result)
horizontal_shade_depth = Entwine(Branch00=bang.Branch17, Branch01=bang.Branch18, Branch02=bang.Branch19, Branch03=bang.Branch20, FlattenInputs=True)  # -> simplify(Result)
shgc = Entwine(Branch00=bang.Branch29, Branch01=bang.Branch30, Branch02=bang.Branch31, Branch03=bang.Branch32, FlattenInputs=True)  # -> simplify(Result)
vertical_shade_depth_direction_2 = Entwine(Branch00=bang.Branch25, Branch01=bang.Branch26, Branch02=bang.Branch27, Branch03=bang.Branch28, FlattenInputs=True)  # -> simplify(Result)
division = Division(A=horizontal_shade_depth, B=12)
division_2 = Division(A=vertical_shade_depth_direction_1, B=12)
division_3 = Division(A=vertical_shade_depth_direction_2, B=12)

join = JoinCurves(Curves=flatten(outsidecrv), Preserve=Toggle(True))
cluster = Cluster(
    floorcrvs=[outsidecrv, adiabaticcrv],
    outsidecrv=outsidecrv,
    adiabaticcrv=adiabaticcrv,
    F=bang.Branch1,
    C=[outsidecrv, adiabaticcrv])  # -> T_2, T_3, T_4, T_6, T_5, T, C_2
crv = Curve(join)
join_2 = JoinCurves(Curves=flatten(outsidecrv), Preserve=False)
redpline = Reduce(Polyline=crv, Tolerance=1)  # -> Polyline, Reduction
crv_2 = Curve(crv)
crv_3 = Curve(crv)
frames_spaced = GhPythonScript(polyline=redpline.Polyline, dist_x=genes, dist_y=genes_2, height=bang.Branch1)  # -> out, flatten(cols), flatten(beams_x), flatten(beams_y); inputs dist_x: list of Int32, dist_y: list of Int32
# ---------- frames_spaced: Python ----------
__author__ = "tmendeze"
__version__ = "2020.11.05"

import rhinoscriptsyntax as rs

from studio2021.functions import make_frames
reload(make_frames)
from studio2021.functions.make_frames import make_spaced_frames

cols, beams_x, beams_y = make_spaced_frames(polyline, dist_x, dist_y, height)
# ---------- end frames_spaced ----------
panel_36 = Panel(crv_2)
panel_37 = Panel(redpline.Polyline)
frames = GhPythonScript(polyline=redpline.Polyline, numx=num_col_x, numy=num_col_y, height=bang.Branch1)  # -> out, flatten(cols), flatten(beams_x), flatten(beams_y); inputs numx: Int32, numy: Int32
# ---------- frames: Python ----------
__author__ = "tmendeze"
__version__ = "2020.11.05"

import rhinoscriptsyntax as rs


pts = rs.PolylineVertices(polyline)
srf = rs.AddSrfPt(pts[:4])

domu = rs.SurfaceDomain(srf, 0)
domv = rs.SurfaceDomain(srf, 1)
su = (domu[1] - domu[0]) / float(numx)
sv = (domv[1] - domv[0]) / float(numy)

a = []
cols = []
pts = []
for i in range(numx + 1):
    temp = []
    for j in range(numy + 1):
        u = su * i
        v = sv * j
        pt = rs.EvaluateSurface(srf, u, v)
        pt_ = [pt[0], pt[1], pt[2] + height]
        #cols.append([pt, pt_])
        cols.append(rs.AddLine(pt, pt_))
        temp.append(pt_)
    pts.append(temp)
    
beams_x = []
for i in range(numx + 1):
    for j in range(numy):
        a = pts[i][j]
        b = pts[i][j + 1]
        # beams_x.append([a, b])
        beams_x.append(rs.AddLine(a, b))

beams_y = []
for i in range(numx):
    for j in range(numy + 1):
        a = pts[i][j]
        c = pts[i + 1][j]
        #beams_y.append([a, c])
        beams_y.append(rs.AddLine(a, c))
# ---------- end frames ----------
panel_38 = Panel(frames_spaced.out)
crv_4 = Curve([frames_spaced.beams_y, frames_spaced.beams_x, frames_spaced.cols])
building = GhPythonScript(
    znames=zone,
    wwr=wwr,
    height=bang.Branch1,
    shade_gc=shgc,
    shade_depth_h=division,
    shade_depth_v1=division_2,
    shade_depth_v2=division_3,
    exterior_walls_n=cluster.T_2,
    exterior_walls_s=cluster.T_3,
    exterior_walls_e=cluster.T_4,
    exterior_walls_w=cluster.T_5,
    adiabatic_walls=cluster.T,
    floor_surfaces=cluster.C_2,
    ceiling_surfaces=cluster.T_6,
    facade_cladding=bang.Branch34,
    external_insulation=bang.Branch35,
    insulation_thickness=bang.Branch36,
    ewall_framing=bang.Branch37,
    int_finish=bang.Branch38,
    glazing_system=glazing,
    simulation_name=panel_33,
    zone_program=bang.Branch33,
    weather_file=downloadepw.epw_file,
    sql_path=panel_34,
    simulation_folder=path.path,
    run_simulation=run_simulation,
    columns=frames_spaced.cols,
    beams_x=frames_spaced.beams_x,
    beams_y=frames_spaced.beams_y,
    building_type=building_type,
    num_floors_above=num_floors_above,
    composite_slab=composite_slab,
    ceiling_condition=bang.Branch11,
    floor_condition=bang.Branch12)  # -> out, building; inputs znames: tree, wwr: tree, shade_gc: tree, shade_depth_h: tree, shade_depth_v1: tree, shade_depth_v2: tree, exterior_walls_n: tree, exterior_walls_s: tree, exterior_walls_e: tree, exterior_walls_w: tree, adiabatic_walls: tree, floor_surfaces: tree, ceiling_surfaces: tree, columns: list, beams_x: list, beams_y: list
# ---------- building: Python ----------
from studio2021.datastructures import building
reload(building)
from studio2021.datastructures.building import Building
import rhinoscriptsyntax as rs


columns = [[rs.CurveStartPoint(c), rs.CurveEndPoint(c)] for c in columns]
beams_x = [[rs.CurveStartPoint(b), rs.CurveEndPoint(b)] for b in beams_x]
beams_y = [[rs.CurveStartPoint(b), rs.CurveEndPoint(b)] for b in beams_y]

data = {'znames': znames,
        'exterior_walls_n': exterior_walls_n,
        'exterior_walls_s': exterior_walls_s,
        'exterior_walls_e': exterior_walls_e,
        'exterior_walls_w': exterior_walls_w,
        'adiabatic_walls': adiabatic_walls,
        'floor_surfaces': floor_surfaces,
        'ceiling_surfaces': ceiling_surfaces,
        'wwr':wwr,
        'height': height,
        'shade_gc':shade_gc,
        'shade_depth_h':shade_depth_h,
        'shade_depth_v1':shade_depth_v1,
        'shade_depth_v2':shade_depth_v2,
        'facade_cladding':facade_cladding,
        'external_insulation':external_insulation,
        'insulation_thickness':insulation_thickness,
        'ewall_framing':ewall_framing,
        'int_finish':int_finish,
        'glazing_system':glazing_system,
        'simulation_name': simulation_name,
        'zone_program': zone_program,
        'weather_file': weather_file,
        'sql_path': sql_path,
        'simulation_folder': simulation_folder,
        'run_simulation': run_simulation,
        'columns': columns,
        'beams_x': beams_x,
        'beams_y': beams_y,
        'building_type':building_type,
        'num_floors_above':num_floors_above,
        'composite_slab':composite_slab,
        'ceiling_condition': ceiling_condition,
        'floor_condition': floor_condition
        }

building = Building.from_gh_data(data)
# ---------- end building ----------
embodied = GhPythonScript(building=building.building)  # -> out, slab, beam, column, window, wall, building
# ---------- embodied: Python ----------
__author__ = "tmendeze"

import rhinoscriptsyntax as rs

building.compute_structure_embodied()
building.compute_envelope_embodied()

slab = building.structure.slab_embodied
beam = building.structure.beam_embodied
column = building.structure.column_embodied
wall = building.envelope.wall_embodied
window = building.envelope.window_embodied

print(window)
# ---------- end embodied ----------
gwp_ft2 = GhPythonScript(building=embodied.building)  # -> out, gwp
# ---------- gwp_ft2: Python ----------
__author__ = "tmendeze"

import rhinoscriptsyntax as rs

slab = building.structure.slab_embodied
beam = building.structure.beam_embodied
column = building.structure.column_embodied
wall = building.envelope.wall_embodied
window = building.envelope.window_embodied

tot = slab + beam + column + window + wall
gwp = round(tot / building.floor_area, 2)
gwp = '{} kgCO2e/ft2'.format(gwp)
# ---------- end gwp_ft2 ----------
make_pie = GhPythonScript(slab=embodied.slab, beam=embodied.beam, column=embodied.column, window=embodied.window, wall=embodied.wall)  # -> out, string
# ---------- make_pie: Python ----------
__author__ = "tmendeze"

import rhinoscriptsyntax as rs

tot = slab + beam + column + window + wall
slab = round(100*(slab / tot), 1)
beam = round(100*(beam / tot), 1)
column = round(100*(column / tot), 1)
window = round(100*(window / tot), 1)
wall = round(100*(wall / tot), 1)

print('slab   = {}%'.format(slab))
print('beam   = {}%'.format(beam))
print('column = {}%'.format(column))
print('window = {}%'.format(window))
print('wall   = {}%'.format(wall))

s = ['slab {}%'.format(slab)] * int(slab)
b = ['beam {}%'.format(beam)] * int(beam)
c = ['column {}%'.format(column)] * int(column)
wi = ['window {}%'.format(window)] * int(window)
wa = ['wall {}%'.format(wall)] * int(wall)

string = s + b + c + wi + wa
# ---------- end make_pie ----------
operational = Operational(building=building.building)  # -> y, mod_obj, cooling, heating, lighting, electric_equip, i
pie = PieChart(make_pie.string)
panel_39 = Panel(gwp_ft2.gwp)
draw_structure = GhPythonScript(building=embodied.building)  # -> out, slabs, columns, beams
# ---------- draw_structure: Python ----------
__author__ = "tmendeze"

import rhinoscriptsyntax as rs

slabs, columns, beams = building.draw_structure()
# ---------- end draw_structure ----------
brep = Brep(draw_structure.slabs)
brep_2 = Brep(draw_structure.columns)
brep_3 = Brep(draw_structure.beams)

# ----
# Write to Excel
writetoexcel = WriteToExcel(
    T=height_ft,
    T_3=operational.y,
    T_2=operational.i,
    A_4=embodied.slab,
    A=embodied.beam,
    A_2=embodied.column,
    A_3=embodied.window,
    building=embodied.building,
    data_si_3=operational.cooling,
    data_si_4=operational.heating,
    data_si_2=operational.lighting,
    data_si=operational.electric_equip)

list_17 = ItemSelector(operational.mod_obj, {"Room: ZONE1", "Room: ZONE2"}, selected="Room: ZONE1")
# Creat North exterior wall surface
# Logic to allow facades to rotate up to
# 44.9 degrees from cardinal directions.
# Create South exterior wall surface
# Selects faces from Massing 2 that match Massing 1 for exterior walls
# Create East exterior wall surface
# Massing 1: Creates mass from rhino curves
# and floor to ceiling ht
# Selects faces from Massing 2 that match Massing 1 for exterior walls
# Create West exterior wall surface
vizbytype = HBVisualizeByType(hb_objs=operational.mod_obj)  # -> walls, interior_walls, roofs, ceilings, exterior_floors, interior_floors, air_walls, apertures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; plug-in component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

# ==== cluster Operational
building = ClusterInput()
trees_from_building = GhPythonScript(building=building)  # -> out, zones, facade_area_n, facade_area_s, facade_area_e, facade_area_w, window_areas_n, window_areas_s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
# ---------- trees_from_building: Python ----------
import rhinoscriptsyntax as rs
import ghpythonlib.treehelpers as th

data = building.to_gh_data()

zones                   = data['zones']
facade_area_n           = data['facade_areas']['n']
facade_area_s           = data['facade_areas']['s']
facade_area_e           = data['facade_areas']['e']
facade_area_w           = data['facade_areas']['w']
exterior_walls_n        = data['exterior_walls']['n']
exterior_walls_s        = data['exterior_walls']['s']
exterior_walls_e        = data['exterior_walls']['e']
exterior_walls_w        = data['exterior_walls']['w']
adiabatic_walls         = data['adiabatic_walls']
floor_surfaces          = data['floor_surfaces']
ceiling_surfaces        = data['ceiling_surfaces']
window_areas_n          = data['window_areas']['n']
window_areas_s          = data['window_areas']['s']
window_areas_e          = data['window_areas']['e']
window_areas_w          = data['window_areas']['w']
opaque_areas_n          = data['opaque_areas']['n']
opaque_areas_s          = data['opaque_areas']['s']
opaque_areas_e          = data['opaque_areas']['e']
opaque_areas_w          = data['opaque_areas']['w']
shade_gc                = data['shade_gc']
shade_depth_h           = data['shade_depth_h']
shade_depth_v1          = data['shade_depth_v1']
shade_depth_v2          = data['shade_depth_v2']
facade_cladding         = data['facade_cladding']
facade_cladding         = data['facade_cladding']
external_insulation     = data['external_insulation'] 
insulation_thickness    = data['insulation_thickness']
ewall_framing           = data['ewall_framing']
int_finish              = data['int_finish']
glazing_system          = data['glazing_system']
simulation_name         = data['simulation_name']
zone_program            = data['zone_program']
weather_file            = data['weather_file']
sql_path                = data['sql_path']
simulation_folder       = data['simulation_folder']
run_simulation          = data['run_simulation']
wwr                     = data['wwr'] 
ceiling_condition       = data['ceiling_condition']
floor_condition         = data['floor_condition']
height                  = data['height']
# ---------- end trees_from_building ----------
subtraction = Subtraction(A=trees_from_building.height, B=Slider(2, range=0..10))  # -> flatten(Result)
clean = CleanTree(RemoveNulls=True, RemoveInvalid=True, RemoveEmpty=True, Tree=trees_from_building.exterior_walls_n)
clean_2 = CleanTree(RemoveNulls=True, RemoveInvalid=True, RemoveEmpty=True, Tree=trees_from_building.exterior_walls_s)
clean_3 = CleanTree(RemoveNulls=True, RemoveInvalid=True, RemoveEmpty=True, Tree=trees_from_building.exterior_walls_e)
clean_4 = CleanTree(RemoveNulls=True, RemoveInvalid=True, RemoveEmpty=True, Tree=trees_from_building.exterior_walls_w)
item = ListItem(List=trees_from_building.shade_gc, Index=0, Wrap=True)
item_2 = ListItem(List=trees_from_building.shade_depth_h, Index=0, Wrap=True)
item_3 = ListItem(List=trees_from_building.wwr, Index=0, Wrap=True)
item_4 = ListItem(List=trees_from_building.shade_depth_v1, Index=0, Wrap=True)
item_5 = ListItem(List=trees_from_building.shade_depth_v2, Index=0, Wrap=True)
vertical_depth_n_s_e_w = ExplodeTree(Data=item_4)  # -> Branch0, Branch1, Branch2, Branch3
flip_vertical_n_s_e_w = ExplodeTree(Data=item_5)  # -> Branch0, Branch1, Branch2, Branch3
number_slider = Slider(1, range=0..10)

importmaterial = GhPythonScript(material_name=trees_from_building.ewall_framing)  # -> r_per_in, embodied_carbon, type, thickness_in, thickness_m, conductivity, density, sp_heat, r_value
# ---------- importmaterial: Python ----------
__author__ = "preston"

import rhinoscriptsyntax as rs
import sys

studiopath = "/Users/preston/Documents/GitHub/studio2021/src"
sys.path.append(studiopath)
import studio2021

from studio2021.functions import read_materials

material = read_materials(material_name)

print(material.keys())

r_per_in = material["r_per_in"]
embodied_carbon = material["embodied_carbon"]
type = material["mtype"]
density = material["density"]
sp_heat = material["sp_heat"]
thickness_in = material["thickness_in"]
thickness_m = material["thickness_m"]
r_value = material["r_value"]
conductivity = material["conductivity"]
# ---------- end importmaterial ----------
importmaterial_2 = GhPythonScript(material_name=trees_from_building.external_insulation)  # -> r_per_in, embodied_carbon, type, thickness_in, thickness_m, conductivity, density, sp_heat, r_value; same code as importmaterial
importmaterial_3 = GhPythonScript(material_name=trees_from_building.int_finish)  # -> r_per_in, embodied_carbon, type, thickness_in, thickness_m, conductivity, density, sp_heat, r_value; same code as importmaterial
importmaterial_4 = GhPythonScript(material_name=trees_from_building.facade_cladding)  # -> r_per_in, embodied_carbon, type, thickness_in, thickness_m, conductivity, density, sp_heat, r_value; same code as importmaterial
multiplication = Multiplication(A="0.0254")
opaquematnomass = HBOpaqueMaterialNoMass(name="Exterior Air Film", r_value=Slider(0.17, range=0..1))  # -> mat; plug-in component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
opaquemat = HBOpaqueMaterial(
    name="Facade Cladding",
    thickness=importmaterial_4.thickness_m,
    conductivity=importmaterial_4.conductivity,
    density=importmaterial_4.density,
    spec_heat=importmaterial_4.sp_heat)  # -> mat; plug-in component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
opaquematnomass_2 = HBOpaqueMaterialNoMass(name="Air Gap", r_value=Slider(1, range=0..1))  # -> mat; plug-in component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
opaquemat_2 = HBOpaqueMaterial(
    name="Ext. Framing",
    thickness=importmaterial.thickness_m,
    conductivity=importmaterial.conductivity,
    density=importmaterial.density,
    spec_heat=importmaterial.sp_heat)  # -> mat; plug-in component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
opaquemat_3 = HBOpaqueMaterial(
    name="Cont. Ext. Insulation",
    thickness=multiplication,
    conductivity=importmaterial_2.conductivity,
    density=importmaterial_2.density,
    spec_heat=importmaterial_2.sp_heat)  # -> mat; plug-in component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
opaquematnomass_3 = HBOpaqueMaterialNoMass(name="Interior Air Film", r_value=Slider(0.68, range=0..1))  # -> mat; plug-in component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
opaquemat_4 = HBOpaqueMaterial(
    name="Interior Finish",
    thickness=importmaterial_3.thickness_m,
    conductivity=importmaterial_3.conductivity,
    density=importmaterial_3.density,
    spec_heat=importmaterial_3.sp_heat)  # -> mat; plug-in component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
txt = Text("Structural ")
concat = Concatenate(FragmentA=txt)
case = TextCase(Culture=127)  # -> UpperCase, LowerCase
concat_2 = Concatenate(JoinSeparator=" ")
concat_3 = Concatenate(FragmentA=concat, FragmentB=case.LowerCase, JoinSeparator=" with ")
opaqueconstr = HBOpaqueConstruction(
    name=concat_3,
    materials=flatten([opaquematnomass, opaquemat, opaquematnomass_2, opaquemat_2, opaquemat_3, opaquemat_4, opaquematnomass_3]))  # -> constr; plug-in component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
exteriorsubset = HBExteriorConstructionSubset(exterior_wall=opaqueconstr)  # -> exterior_set; plug-in component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
decnstrmat = HBDeconstructMaterial(mat=opaqueconstr)  # -> values, attr_names, r_val_si, r_val_ip; plug-in component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
concat_4 = Concatenate(FragmentA=concat_3, FragmentC=concat_2, JoinSeparator=" + ")
pane_glazing_system = Text(" pane glazing system")
concat_5 = Concatenate(FragmentA=concat_4, FragmentC=pane_glazing_system)
constructionset = HBConstructionSet(name=concat_5, exterior_subset=exteriorsubset)  # -> constr_set; plug-in component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

face = HBFace(geo=trees_from_building.adiabatic_walls, name="Adiabatic Wall", type="Wall", bc="Adiabatic")  # -> report, faces; plug-in component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
match = MatchTree(Tree=face.faces, Guide=trees_from_building.adiabatic_walls)

face_2 = HBFace(geo=trees_from_building.floor_surfaces, name="Floor", type="Floor", bc=trees_from_building.floor_condition)  # -> report, faces; plug-in component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
match_2 = MatchTree(Tree=face_2.faces, Guide=trees_from_building.floor_surfaces)

face_3 = HBFace(
    geo=trees_from_building.ceiling_surfaces,
    name="RoofCeiling",
    type="RoofCeiling",
    bc=trees_from_building.ceiling_condition)  # -> report, faces; plug-in component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
match_3 = MatchTree(Tree=face_3.faces, Guide=match_2)

decnstrconstr = HBDeconstructConstruction(constr=opaqueconstr)  # -> materials, layers, r_val_si, r_val_ip, u_fac_si, u_fac_ip, t_sol, t_vis; plug-in component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
one_over_x = OneOverX(Value=decnstrconstr.u_fac_ip)
y = ClusterOutput(one_over_x)
larger = LargerThan(FirstNumber=vertical_depth_n_s_e_w.Branch1, SecondNumber=0)  # -> LargerThan, OrEqualTo
larger_2 = LargerThan(FirstNumber=vertical_depth_n_s_e_w.Branch2, SecondNumber=0)  # -> LargerThan, OrEqualTo
larger_3 = LargerThan(FirstNumber=vertical_depth_n_s_e_w.Branch0, SecondNumber=0)  # -> LargerThan, OrEqualTo
larger_4 = LargerThan(FirstNumber=vertical_depth_n_s_e_w.Branch3, SecondNumber=0)  # -> LargerThan, OrEqualTo
larger_5 = LargerThan(FirstNumber=flip_vertical_n_s_e_w.Branch0, SecondNumber=0)  # -> LargerThan, OrEqualTo
larger_6 = LargerThan(FirstNumber=flip_vertical_n_s_e_w.Branch1, SecondNumber=0)  # -> LargerThan, OrEqualTo
larger_7 = LargerThan(FirstNumber=flip_vertical_n_s_e_w.Branch2, SecondNumber=0)  # -> LargerThan, OrEqualTo
larger_8 = LargerThan(FirstNumber=flip_vertical_n_s_e_w.Branch3, SecondNumber=0)  # -> LargerThan, OrEqualTo
panel = Panel(trees_from_building.sql_path)
file = ReadFile(File=panel, PerLineParse=True)
null = NullItem(Item=file)  # -> flatten(NullFlags), InvalidFlags, Description
vizbytype = HBVisualizeByType()  # -> walls, interior_walls, roofs, ceilings, exterior_floors, interior_floors, air_walls, apertures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; plug-in component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
item_6 = ListItem(List=null.NullFlags, Index=0, Wrap=True)
gate = StreamGate(Stream=trees_from_building.sql_path, Gate=item_6)  # -> Target0, Target1

importglazing = GhPythonScript(glazing_name=trees_from_building.glazing_system)  # -> flatten(frame_type), glass_type, flatten(u_value), flatten(t_vis), embodied_carbon_metric, embodied_carbon_imperial
# ---------- importglazing: Python ----------
__author__ = "preston"

import rhinoscriptsyntax as rs
import sys

studiopath = "/Users/preston/Documents/GitHub/studio2021/src"
sys.path.append(studiopath)
import studio2021

from studio2021.functions import read_glazing

glazing = read_glazing(glazing_name)

print(glazing.keys())

frame_type = glazing['frame_type']
glass_type = glazing['glass_type']
u_value = glazing['u_value']
t_vis = glazing['t_vis']
embodied_carbon_metric = glazing['embodied_carbon_metric']
embodied_carbon_imperial = glazing['embodied_carbon_imperial']
# ---------- end importglazing ----------
shgc_n_s_e_w = ExplodeTree(Data=item)  # -> Branch0, Branch1, Branch2, Branch3
wwr_n_s_e_w = ExplodeTree(Data=item_3)  # -> Branch0, Branch1, Branch2, Branch3
shade_depth_n_s_e_w = ExplodeTree(Data=item_2)  # -> Branch0, Branch1, Branch2, Branch3

item_7 = ListItem(List=importglazing.u_value, Index=0, Wrap=True)
item_8 = ListItem(List=importglazing.t_vis, Index=0, Wrap=True)
item_9 = ListItem(List=importglazing.frame_type, Index=0, Wrap=True)
i = ClusterOutput(item_7)
larger_9 = LargerThan(FirstNumber=shade_depth_n_s_e_w.Branch1, SecondNumber=0)  # -> LargerThan, OrEqualTo
larger_10 = LargerThan(FirstNumber=shade_depth_n_s_e_w.Branch3, SecondNumber=0)  # -> LargerThan, OrEqualTo
larger_11 = LargerThan(FirstNumber=shade_depth_n_s_e_w.Branch2, SecondNumber=0)  # -> LargerThan, OrEqualTo
larger_12 = LargerThan(FirstNumber=shade_depth_n_s_e_w.Branch0, SecondNumber=0)  # -> LargerThan, OrEqualTo

face_4 = HBFace(geo=clean_4, name="Exposed Wall", type="Wall", bc="Outdoors")  # -> report, simplify(faces); plug-in component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
windowmat = HBWindowMaterial(name=item_9, u_factor=flatten(item_7), shgc=flatten(shgc_n_s_e_w.Branch3), t_vis=flatten(item_8))  # -> mat; plug-in component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
windowconstr = HBWindowConstruction(name="WGlass", materials=flatten(windowmat))  # -> constr; plug-in component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

face_5 = HBFace(geo=clean_3, name="Exposed Wall", type="Wall", bc="Outdoors")  # -> report, simplify(faces); plug-in component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
windowmat_2 = HBWindowMaterial(name=item_9, u_factor=flatten(item_7), shgc=flatten(shgc_n_s_e_w.Branch2), t_vis=flatten(item_8))  # -> mat; plug-in component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
windowconstr_2 = HBWindowConstruction(name="EGlass", materials=flatten(windowmat_2))  # -> constr; plug-in component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

face_6 = HBFace(geo=clean_2, name="Exposed Wall", type="Wall", bc="Outdoors")  # -> report, simplify(faces); plug-in component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
windowmat_3 = HBWindowMaterial(name=item_9, u_factor=flatten(item_7), shgc=flatten(shgc_n_s_e_w.Branch1), t_vis=flatten(item_8))  # -> mat; plug-in component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
windowconstr_3 = HBWindowConstruction(name="SGlass", materials=flatten(windowmat_3))  # -> constr; plug-in component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

face_7 = HBFace(geo=clean, name="Exposed Wall", type="Wall", bc="Outdoors")  # -> report, simplify(faces); plug-in component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
windowmat_4 = HBWindowMaterial(name=item_9, u_factor=flatten(item_7), shgc=flatten(shgc_n_s_e_w.Branch0), t_vis=flatten(item_8))  # -> mat; plug-in component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
windowconstr_4 = HBWindowConstruction(name="NGlass", materials=flatten(windowmat_4))  # -> constr; plug-in component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

match_4 = MatchTree(Tree=face_4.faces, Guide=clean_4)
match_5 = MatchTree(Tree=face_6.faces, Guide=clean_2)
match_6 = MatchTree(Tree=face_5.faces, Guide=clean_3)
match_7 = MatchTree(Tree=face_7.faces, Guide=clean)

aperturesbyratio = HBAperturesByRatio(hb_objs=match_4, ratio=flatten(wwr_n_s_e_w.Branch3), win_height=subtraction, sill_height=number_slider)  # -> report, hb_objs; plug-in component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
applywindowconstr = HBApplyWindowConstruction(hb_objs=aperturesbyratio.hb_objs, constr=windowconstr)  # -> hb_objs; plug-in component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
louvershades = HBLouverShades(hb_objs=applywindowconstr, depth=flatten(shade_depth_n_s_e_w.Branch3), vertical=False)  # -> report, hb_objs; plug-in component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

aperturesbyratio_2 = HBAperturesByRatio(hb_objs=match_6, ratio=flatten(wwr_n_s_e_w.Branch2), win_height=subtraction, sill_height=number_slider)  # -> report, hb_objs; plug-in component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
applywindowconstr_2 = HBApplyWindowConstruction(hb_objs=aperturesbyratio_2.hb_objs, constr=windowconstr_2)  # -> hb_objs; plug-in component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
louvershades_2 = HBLouverShades(hb_objs=applywindowconstr_2, depth=flatten(shade_depth_n_s_e_w.Branch2), vertical=False)  # -> report, hb_objs; plug-in component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

aperturesbyratio_3 = HBAperturesByRatio(hb_objs=match_7, ratio=flatten(wwr_n_s_e_w.Branch0), win_height=subtraction, sill_height=number_slider)  # -> report, hb_objs; plug-in component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
applywindowconstr_3 = HBApplyWindowConstruction(hb_objs=aperturesbyratio_3.hb_objs, constr=windowconstr_4)  # -> hb_objs; plug-in component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
louvershades_3 = HBLouverShades(hb_objs=applywindowconstr_3, depth=flatten(shade_depth_n_s_e_w.Branch0))  # -> report, hb_objs; plug-in component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

aperturesbyratio_4 = HBAperturesByRatio(hb_objs=match_5, ratio=flatten(wwr_n_s_e_w.Branch1), win_height=subtraction, sill_height=number_slider)  # -> report, hb_objs; plug-in component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
applywindowconstr_4 = HBApplyWindowConstruction(hb_objs=aperturesbyratio_4.hb_objs, constr=windowconstr_3)  # -> hb_objs; plug-in component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
louvershades_4 = HBLouverShades(hb_objs=applywindowconstr_4, depth=flatten(shade_depth_n_s_e_w.Branch1))  # -> report, hb_objs; plug-in component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

filter = StreamFilter(Gate=larger_10.LargerThan, Stream0=applywindowconstr, Stream1=louvershades.hb_objs)
filter_2 = StreamFilter(Gate=larger_9.LargerThan, Stream0=applywindowconstr_4, Stream1=louvershades_4.hb_objs)
filter_3 = StreamFilter(Gate=larger_11.LargerThan, Stream0=applywindowconstr_2, Stream1=louvershades_2.hb_objs)
filter_4 = StreamFilter(Gate=larger_12.LargerThan, Stream0=applywindowconstr_3, Stream1=louvershades_3.hb_objs)
louvershades_5 = HBLouverShades(hb_objs=filter_4, depth=flatten(vertical_depth_n_s_e_w.Branch0), vertical=True)  # -> report, hb_objs; plug-in component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
louvershades_6 = HBLouverShades(hb_objs=filter_2, depth=flatten(vertical_depth_n_s_e_w.Branch1), vertical=True)  # -> report, hb_objs; plug-in component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
louvershades_7 = HBLouverShades(hb_objs=filter_3, depth=flatten(vertical_depth_n_s_e_w.Branch2), vertical=True)  # -> report, hb_objs; plug-in component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
louvershades_8 = HBLouverShades(hb_objs=filter, depth=flatten(vertical_depth_n_s_e_w.Branch3), vertical=True)  # -> report, hb_objs; plug-in component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
filter_5 = StreamFilter(Gate=larger_3.LargerThan, Stream0=filter_4, Stream1=louvershades_5.hb_objs)
filter_6 = StreamFilter(Gate=larger.LargerThan, Stream0=filter_2, Stream1=louvershades_6.hb_objs)
filter_7 = StreamFilter(Gate=larger_2.LargerThan, Stream0=filter_3, Stream1=louvershades_7.hb_objs)
filter_8 = StreamFilter(Gate=larger_4.LargerThan, Stream0=filter, Stream1=louvershades_8.hb_objs)
louvershades_9 = HBLouverShades(hb_objs=filter_5, depth=flatten(flip_vertical_n_s_e_w.Branch0), vertical=True, flip_start=True)  # -> report, hb_objs; plug-in component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
louvershades_10 = HBLouverShades(hb_objs=filter_6, depth=flatten(flip_vertical_n_s_e_w.Branch1), vertical=True, flip_start=True)  # -> report, hb_objs; plug-in component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
louvershades_11 = HBLouverShades(hb_objs=filter_7, depth=flatten(flip_vertical_n_s_e_w.Branch2), vertical=True, flip_start=True)  # -> report, hb_objs; plug-in component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
louvershades_12 = HBLouverShades(hb_objs=filter_8, depth=flatten(flip_vertical_n_s_e_w.Branch3), vertical=True, flip_start=True)  # -> report, hb_objs; plug-in component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
filter_9 = StreamFilter(Gate=larger_5.LargerThan, Stream0=filter_5, Stream1=louvershades_9.hb_objs)
filter_10 = StreamFilter(Gate=larger_6.LargerThan, Stream0=filter_6, Stream1=louvershades_10.hb_objs)
filter_11 = StreamFilter(Gate=larger_7.LargerThan, Stream0=filter_7, Stream1=louvershades_11.hb_objs)
filter_12 = StreamFilter(Gate=larger_8.LargerThan, Stream0=filter_8, Stream1=louvershades_12.hb_objs)

n_s_e_w_exterior_walls = Merge(Data1=filter_9, Data2=filter_10, Data3=filter_11, Data4=filter_12)
remove_empy_zones = CleanTree(RemoveNulls=True, RemoveInvalid=True, RemoveEmpty=True, Tree=n_s_e_w_exterior_walls)

clean_5 = CleanTree(RemoveNulls=True, RemoveInvalid=True, RemoveEmpty=True, Tree=[remove_empy_zones, match, match_2, match_3])
tstat = TreeStatistics(Tree=clean_5)  # -> Paths, Length, Count
zone_names = TreeBranch(Tree=simplify(trees_from_building.zones), Path=tstat.Paths, MaintainPaths=True)
room = HBRoom(faces=clean_5, name=zone_names, program=trees_from_building.zone_program, conditioned=True)  # -> report, room; plug-in component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

clean_6 = CleanTree(RemoveNulls=True, RemoveInvalid=True, RemoveEmpty=False, Tree=room.room)  # -> flatten(Tree)
applyconstrset = HBApplyConstructionSet(rooms=clean_6, constr_set=constructionset)  # -> rooms; plug-in component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

# ----
# Heating, Cooling, & Vent Set Points
applysetpointvals = HBApplySetpointValues(room_or_program=applyconstrset)  # -> report, mod_obj; plug-in component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
applyloadvals = HBApplyLoadValues(room_or_program=applysetpointvals.mod_obj)  # -> report, mod_obj; plug-in component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

model = HBModel(rooms=flatten(applyloadvals.mod_obj), name=trees_from_building.simulation_name)  # -> report, model; plug-in component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

# ----
# Energy Simulation
toggle = BooleanToggle(True)
simoutput = HBSimulationOutput(zone_energy_use=toggle, hvac_energy_use=toggle, gains_and_losses=toggle)  # -> report, sim_output; plug-in component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
simpar = HBSimulationParameter(output=simoutput.sim_output, timestep=6)  # -> sim_par; plug-in component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
modeltoosm = HBModelToOSM(
    model=model.model,
    epw_file=trees_from_building.weather_file,
    sim_par=simpar,
    folder=trees_from_building.simulation_folder,
    write=trees_from_building.run_simulation,
    run=trees_from_building.run_simulation)  # -> report, jsons, osw, osm, idf, sql, zsz, rdd, html; plug-in component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
roomenergyresult = HBReadRoomEnergyResult(sql=modeltoosm.sql)  # -> cooling, heating, lighting, electric_equip, gas_equip, fan_electric, pump_electric, people_gain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; plug-in component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

cooling = ClusterOutput(roomenergyresult.cooling)
heating = ClusterOutput(roomenergyresult.heating)
lighting = ClusterOutput(roomenergyresult.lighting)
electric_equip = ClusterOutput(roomenergyresult.electric_equip)

# ----
# Chart Results
number_slider_2 = Slider(1, range=0..100)
legendpar = LBLegendParameters(min=Slider(0, range=0..100), max=number_slider_2)  # -> leg_par; plug-in component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
monthlychart = LBMonthlyChart(data=roomenergyresult.lighting)  # -> report, data_mesh, data_lines, legend, borders, labels, y_title, title; plug-in component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
hourlyplot = LBHourlyPlot(data=flatten(roomenergyresult.solar_gain), legend_par=legendpar)  # -> report, mesh, legend, borders, labels, title; plug-in component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

# ----
# Zone Visualize Results
number_slider_3 = Slider(1, range=1..31)
number_slider_4 = Slider(1, range=1..12)
analysisperiod = LBAnalysisPeriod(
    start_month=number_slider_4,
    start_day=number_slider_3,
    start_hour=0,
    end_month=number_slider_4,
    end_day=Slider(31, range=1..31))  # -> period, hoys, dates; plug-in component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
colorrooms = HBColorRooms(
    data=flatten(roomenergyresult.solar_gain),
    rooms_model=flatten(applyloadvals.mod_obj),
    norm_by_flr=Toggle(True),
    period=analysisperiod.period,
    legend_par=legendpar)  # -> report, mesh, wire_frame, legend, title, rooms, colors, values; plug-in component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
vizquick = HBVizualizeQuick(hb_objs=flatten(colorrooms.rooms))  # -> geo; plug-in component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
preview = CustomPreview(Geometry=[colorrooms.legend, colorrooms.wire_frame], Material=ColourSwatch(SwatchColor=RGB(0, 0, 0)))
preview_2 = CustomPreview(Geometry=vizquick, Material=colorrooms.colors)

# ----
# Label Rooms
faceenergyattr = HBFaceEnergyAttributes({"Construction": "properties.energy.construction.display_name", "Materials": "properties.energy.construction.layers", "R-Value": "properties.energy.construction.r_value", "U-Value": "properties.energy.construction.u_value", "U-Factor": "properties.energy.construction.u_factor", "Solar Transmitance [Unshaded]": "properties.energy.construction.solar_transmittance", "Solar Reflectance [Outside]": "properties.energy.construction.outside_solar_reflectance", "Solar Reflectance [Inside]": "properties.energy.construction.inside_solar_reflectance", "Fraction Area Operable": "properties.energy.vent_opening.fraction_area_operable", "Fraction Height Operable": "properties.energy.vent_opening.fraction_height_operable", "Discharge Coefficient": "properties.energy.vent_opening.discharge_coefficient", "Cross Ventilation": "properties.energy.vent_opening.wind_cross_vent"}, selected="Construction")
roomenergyattr = HBRoomEnergyAttributes({"Program": "properties.energy.program_type.display_name", "Construction Set": "properties.energy.construction_set.display_name", "Is Conditioned": "properties.energy.is_conditioned", "People per Area [ppl/m2]": "properties.energy.people.people_per_area", "Area per Person [m2/ppl]": "properties.energy.people.area_per_person", "Lighting per Area [W/m2]": "properties.energy.lighting.watts_per_area", "Electric Equipment per Area [W/m2]": "properties.energy.electric_equipment.watts_per_area", "Gas Equipment per Area [W/m2]": "properties.energy.gas_equipment.watts_per_area", "Infiltration per Exterior Area [m3/s-m2]": "properties.energy.infiltration.flow_per_exterior_area", "Ventilation per Person [m3/s-ppl]": "properties.energy.ventilation.flow_per_person"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}, selected="Ventilation per Person [m3/s-ppl]")
list = ItemSelector(applyloadvals.mod_obj, {"Room: ZONE1", "Room: ZONE2"}, selected="Room: ZONE1")
labelrooms = HBLabelRooms(rooms_model=flatten(list), attribute=roomenergyattr)  # -> label_text, base_pts, labels, wire_frame; plug-in component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
lablefaces = HBLabelFaces(hb_objs=flatten(list), attribute=faceenergyattr)  # -> label_text, base_pts, labels, wire_frame; plug-in component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

mod_obj = ClusterOutput(applyloadvals.mod_obj)

# ==== cluster WriteToExcel

building = ClusterInput()
trees_from_building = GhPythonScript(building=building)  # -> out, zones, facade_area_n, facade_area_s, facade_area_e, facade_area_w, window_areas_n, window_areas_s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
# ---------- trees_from_building: Python ----------
import rhinoscriptsyntax as rs
import ghpythonlib.treehelpers as th

data = building.to_gh_data()

zones                   = data['zones']
facade_area_n           = data['facade_areas']['n']
facade_area_s           = data['facade_areas']['s']
facade_area_e           = data['facade_areas']['e']
facade_area_w           = data['facade_areas']['w']
exterior_walls_n        = data['exterior_walls']['n']
exterior_walls_s        = data['exterior_walls']['s']
exterior_walls_e        = data['exterior_walls']['e']
exterior_walls_w        = data['exterior_walls']['w']
adiabatic_walls         = data['adiabatic_walls']
floor_surfaces          = data['floor_surfaces']
ceiling_surfaces        = data['ceiling_surfaces']
window_areas_n          = data['window_areas']['n']
window_areas_s          = data['window_areas']['s']
window_areas_e          = data['window_areas']['e']
window_areas_w          = data['window_areas']['w']
opaque_areas_n          = data['opaque_areas']['n']
opaque_areas_s          = data['opaque_areas']['s']
opaque_areas_e          = data['opaque_areas']['e']
opaque_areas_w          = data['opaque_areas']['w']
shade_gc                = data['shade_gc']
shade_depth             = data['shade_depth']
facade_cladding         = data['facade_cladding']
facade_cladding         = data['facade_cladding']
external_insulation     = data['external_insulation'] 
insulation_thickness    = data['insulation_thickness']
ewall_framing           = data['ewall_framing']
int_finish              = data['int_finish']
glazing_system          = data['glazing_system']
simulation_name         = data['simulation_name']
zone_program            = data['zone_program']
weather_file            = data['weather_file']
sql_path                = data['sql_path']
simulation_folder       = data['simulation_folder']
run_simulation          = data['run_simulation']
wwr                     = data['wwr']
# ---------- end trees_from_building ----------
shade_depth = ExplodeTree(Data=trees_from_building.shade_depth)  # -> flatten(Branch0), flatten(Branch1), flatten(Branch2), flatten(Branch3)
area = Area(Geometry=trees_from_building.floor_surfaces)  # -> Area, Centroid
wwr = ExplodeTree(Data=trees_from_building.wwr)  # -> flatten(Branch0), flatten(Branch1), flatten(Branch2), flatten(Branch3)
shgc = ExplodeTree(Data=trees_from_building.shade_gc)  # -> flatten(Branch0), flatten(Branch1), flatten(Branch2), flatten(Branch3)

data_si = ClusterInput()
data_si_2 = ClusterInput()
data_si_3 = ClusterInput()
data_si_4 = ClusterInput()
toip = LBToIP(data_si=data_si)  # -> data_ip; plug-in component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
toip_2 = LBToIP(data_si=data_si_3)  # -> data_ip; plug-in component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
toip_3 = LBToIP(data_si=data_si_2)  # -> data_ip; plug-in component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
toip_4 = LBToIP(data_si=data_si_4)  # -> data_ip; plug-in component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
xdata = LBDeconstructData(data=toip)  # -> flatten(header), values; plug-in component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
xdata_2 = LBDeconstructData(data=toip_2)  # -> flatten(header), values; plug-in component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
xdata_3 = LBDeconstructData(data=toip_3)  # -> flatten(header), values; plug-in component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
A = ClusterInput()
A_2 = ClusterInput()
A_3 = ClusterInput()
A_4 = ClusterInput()
# Zone 1 Window, Zone 1 Opaque, Zone 1 Total, Zone 2 Window, Zone 2 Opaque, Zone 2 Total, Zone 3 Window, Zone 3 Opaque, Zone 3 Total, Zone 4 Window, Zone 4 Opaque, Zone 4 Total, Total Window, Total Opaque, Total,,,,
panel = Panel(", Embodied, Operational, Total,,,,,,,,,,,,,,,,,,,,,,,,")
xdata_4 = LBDeconstructData(data=toip_4)  # -> flatten(header), values; plug-in component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
ma = MassAddition(Input=flatten(area.Area))  # -> Result, PartialResults
panel_2 = Panel(ma.Result)
panel_3 = Panel(",,,,,,,,,,,,,,,,,,,,,,,,,,,,,,,,")
T = ClusterInput()
T_2 = ClusterInput()
T_3 = ClusterInput()
concat = Concatenate(FragmentA=A_4, FragmentB=",")  # -> flatten(Result)
concat_2 = Concatenate(FragmentA=A, FragmentB=",")  # -> flatten(Result)
concat_3 = Concatenate(FragmentA=A_2, FragmentB=",")  # -> flatten(Result)
concat_4 = Concatenate(FragmentA=A_3, FragmentB=",")  # -> flatten(Result)
bang = ExplodeTree(Data=xdata_2.values)  # -> Branch0, Branch1, Branch2, Branch3, Branch4
bang_2 = ExplodeTree(Data=area.Area)  # -> Branch0, Branch1, Branch2, Branch3, Branch4
panel_4 = Panel(", Zone1, Zone2, Zone3, Zone4,Zone5,Total,,,,,,,,,,,,,,,,,,")
panel_5 = Panel("Time, Cooling Engery (kWh) Zone1, Cooling Engery (kBtu) Zone2, Cooling Engery (kBtu) Zone3, Cooling Engery (kBtu) Zone4, Cooling Engery (kBtu) Zone5, Heating Engery (kBtu) Zone1, Heating Engery (kBtu) Zone2, Heating Engery (kBtu) Zone3, Heating Engery (kBtu) Zone4, Heating Engery (kBtu) Zone5, Electric Light Engery (kBtu) Zone1, Electric Light (kBtu) Zone2, Electric Light Energy (kBtu) Zone3, Electric Light Energy (kBtu) Zone4, Electric Light Energy (kBtu) Zone5, Equipment Engery (kBtu) Zone1, Equipment Engery (kBtu) Zone2, Equipment Engery (kBtu) Zone3, Equipment Engery (kBtu) Zone4, Equipment Engery (kBtu) Zone5,")
bang_3 = ExplodeTree(Data=xdata.values)  # -> Branch0, Branch1, Branch2, Branch3, Branch4
bang_4 = ExplodeTree(Data=xdata_4.values)  # -> Branch0, Branch1, Branch2, Branch3, Branch4
join = TextJoin(Text=["Wall Assembly R Value,", T_3, ",,,,,,,,,,,,,,,,,,,,,,,,,,,,,,,,"])
join_2 = TextJoin(Text=["U Value window,", T_2, ",,,,,,,,,,,,,,,,,,,,,,,,,,,,,,,,"])
join_3 = TextJoin(Text=["N Shade depth,", shade_depth.Branch0, ",,,,,,,,,,,,,,,,,,,,,,,,,,,,,,,,"])
concat_5 = Concatenate(FragmentA=ma.Result, FragmentB=",")
join_4 = TextJoin(Text=["N WWR,", wwr.Branch0, ",,,,,,,,,,,,,,,,,,,,,,,,,,,,,,,,"])
join_5 = TextJoin(Text=["N SHGC,", shgc.Branch0, ",,,,,,,,,,,,,,,,,,,,,,,,,,,,,,,,"])
bang_5 = ExplodeTree(Data=xdata_3.values)  # -> Branch0, Branch1, Branch2, Branch3, Branch4
join_6 = TextJoin(Text=["Height (ft),", T, ",,,,,,,,,,,,,,,,,,,,,,,,,,,,,,,,"])
join_7 = TextJoin(Text=["S Shade depth,", shade_depth.Branch1, ",,,,,,,,,,,,,,,,,,,,,,,,,,,,,,,,"])
join_8 = TextJoin(Text=["S WWR,", wwr.Branch1, ",,,,,,,,,,,,,,,,,,,,,,,,,,,,,,,,"])
join_9 = TextJoin(Text=["S SHGC,", shgc.Branch1, ",,,,,,,,,,,,,,,,,,,,,,,,,,,,,,,,"])
join_10 = TextJoin(Text=[trees_from_building.simulation_name, panel_3])
join_11 = TextJoin(Text=["Seattle", panel_3])
join_12 = TextJoin(Text=["E Shade depth,", shade_depth.Branch2, ",,,,,,,,,,,,,,,,,,,,,,,,,,,,,,,,"])
join_13 = TextJoin(Text=["E WWR,", wwr.Branch2, ",,,,,,,,,,,,,,,,,,,,,,,,,,,,,,,,"])
join_14 = TextJoin(Text=["E SHGC,", shgc.Branch2, ",,,,,,,,,,,,,,,,,,,,,,,,,,,,,,,,"])
join_15 = TextJoin(Text=["W Shade depth,", shade_depth.Branch3, ",,,,,,,,,,,,,,,,,,,,,,,,,,,,,,,,"])
join_16 = TextJoin(Text=["W WWR,", wwr.Branch3, ",,,,,,,,,,,,,,,,,,,,,,,,,,,,,,,,"])
join_17 = TextJoin(Text=["W SHGC,", shgc.Branch3, ",,,,,,,,,,,,,,,,,,,,,,,,,,,,,,,,"])
concat_6 = Concatenate(FragmentA=bang_2.Branch0, FragmentB=",")
concat_7 = Concatenate(FragmentA=bang_2.Branch1, FragmentB=",")
concat_8 = Concatenate(FragmentA=bang_2.Branch2, FragmentB=",")
concat_9 = Concatenate(FragmentA=bang_2.Branch3, FragmentB=",")
concat_10 = Concatenate(FragmentA=bang_2.Branch4, FragmentB=",")
ma_2 = MassAddition(Input=[A_4, A, A_2, A_3])  # -> Result, PartialResults
multiplication = Multiplication(A=ma_2.Result, B=Slider(0.00110231, range=0..0.01))
join_18 = TextJoin(Text=[multiplication, ","])
panel_6 = Panel(join_18)
ma_3 = MassAddition(Input=bang.Branch0)  # -> Result, PartialResults
ma_4 = MassAddition(Input=bang.Branch1)  # -> Result, PartialResults
ma_5 = MassAddition(Input=bang.Branch2)  # -> Result, PartialResults
ma_6 = MassAddition(Input=bang.Branch3)  # -> Result, PartialResults
ma_7 = MassAddition(Input=bang.Branch4)  # -> Result, PartialResults
ma_8 = MassAddition(Input=bang_3.Branch0)  # -> Result, PartialResults
ma_9 = MassAddition(Input=bang_3.Branch1)  # -> Result, PartialResults
ma_10 = MassAddition(Input=bang_3.Branch2)  # -> Result, PartialResults
ma_11 = MassAddition(Input=bang_3.Branch3)  # -> Result, PartialResults
multiplication_2 = Multiplication(N=join_4)
ma_12 = MassAddition(Input=bang_3.Branch4)  # -> Result, PartialResults
ma_13 = MassAddition(Input=bang_4.Branch0)  # -> Result, PartialResults
ma_14 = MassAddition(Input=bang_4.Branch1)  # -> Result, PartialResults
analysisperiod = LBAnalysisPeriod(start_month=1, start_day=1, start_hour=0)  # -> period, hoys, flatten(dates); plug-in component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
ma_15 = MassAddition(Input=bang_4.Branch2)  # -> Result, PartialResults
ma_16 = MassAddition(Input=bang_4.Branch3)  # -> Result, PartialResults
ma_17 = MassAddition(Input=bang_4.Branch4)  # -> Result, PartialResults
ma_18 = MassAddition(Input=bang_5.Branch0)  # -> Result, PartialResults
ma_19 = MassAddition(Input=bang_5.Branch1)  # -> Result, PartialResults
ma_20 = MassAddition(Input=bang_5.Branch2)  # -> Result, PartialResults
panel_7 = Panel(trees_from_building.facade_area_n)
ma_21 = MassAddition(Input=bang_5.Branch3)  # -> Result, PartialResults
ma_22 = MassAddition(Input=bang_5.Branch4)  # -> Result, PartialResults
entwine = Entwine(
    Branch00=concat_6,
    Branch01=concat_7,
    Branch02=concat_8,
    Branch03=concat_9,
    Branch04=concat_10,
    Branch05=concat_5,
    FlattenInputs=True)  # -> flatten(Result)
bang_6 = ExplodeTree(Data=trees_from_building.facade_area_e)  # -> Branch0, Branch1, Branch2, Branch3
concat_11 = Concatenate(FragmentA=ma_2.Result, FragmentB=",")  # -> flatten(Result)
join_19 = TextJoin(Text=["Embodied (eq CO2 kg total),", concat, concat_2, concat_3, concat_4, concat_11, ",,,,,,,,,,,,,,,,,,,,,,,,,,,,,,,,"])
bang_7 = ExplodeTree(Data=trees_from_building.facade_area_s)  # -> Branch0, Branch1, Branch2, Branch3
bang_8 = ExplodeTree(Data=trees_from_building.facade_area_w)  # -> Branch0, Branch1, Branch2, Branch3
bang_9 = ExplodeTree(Data=trees_from_building.facade_area_n)  # -> Branch0, Branch1, Branch2, Branch3
division = Division(A=ma_3.Result, B=bang_2.Branch0)
division_2 = Division(A=ma_5.Result, B=bang_2.Branch2)
division_3 = Division(A=ma_4.Result, B=bang_2.Branch1)
division_4 = Division(A=ma_6.Result, B=bang_2.Branch3)
division_5 = Division(A=ma_7.Result, B=bang_2.Branch4)
ma_23 = MassAddition(Input=flatten([ma_3.Result, ma_13.Result, ma_18.Result, ma_8.Result]))  # -> Result, PartialResults
division_6 = Division(A=ma_8.Result, B=bang_2.Branch0)
division_7 = Division(A=ma_10.Result, B=bang_2.Branch2)
division_8 = Division(A=ma_9.Result, B=bang_2.Branch1)
ma_24 = MassAddition(Input=flatten([bang.Branch3, bang_4.Branch3, bang_3.Branch3]))  # -> Result, PartialResults
division_9 = Division(A=ma_11.Result, B=bang_2.Branch3)
ma_25 = MassAddition(Input=flatten([ma_5.Result, bang_4.Branch2, bang_5.Branch2, bang_3.Branch2]))  # -> Result, PartialResults
division_10 = Division(A=ma_12.Result, B=bang_2.Branch4)
division_11 = Division(A=ma_13.Result, B=bang_2.Branch0)
division_12 = Division(A=ma_15.Result, B=bang_2.Branch2)
division_13 = Division(A=ma_14.Result, B=bang_2.Branch1)
ma_26 = MassAddition(Input=flatten([bang.Branch4, bang_4.Branch4, bang_5.Branch4, bang_3.Branch4]))  # -> Result, PartialResults
ma_27 = MassAddition(Input=flatten([ma_4.Result, ma_14.Result, ma_19.Result, ma_9.Result]))  # -> Result, PartialResults
division_14 = Division(A=ma_16.Result, B=bang_2.Branch3)
division_15 = Division(A=ma_17.Result, B=bang_2.Branch4)
division_16 = Division(A=ma_22.Result, B=bang_2.Branch4)
division_17 = Division(A=ma_18.Result, B=bang_2.Branch0)
division_18 = Division(A=ma_20.Result, B=bang_2.Branch2)
division_19 = Division(A=ma_19.Result, B=bang_2.Branch1)
division_20 = Division(A=ma_21.Result, B=bang_2.Branch3)
concat_12 = Concatenate(FragmentA=division_2, FragmentB=",")  # -> flatten(Result)
concat_13 = Concatenate(FragmentA=division_4, FragmentB=",")  # -> flatten(Result)
concat_14 = Concatenate(FragmentA=division_3, FragmentB=",")  # -> flatten(Result)
concat_15 = Concatenate(FragmentA=division, FragmentB=",")  # -> flatten(Result)
concat_16 = Concatenate(FragmentA=division_5, FragmentB=",")  # -> flatten(Result)
join_20 = TextJoin(Text=["Floor Area (ft2),", entwine])
entwine_2 = Entwine(
    Branch00=analysisperiod.dates,
    Branch01=bang.Branch0,
    Branch02=bang.Branch1,
    Branch03=bang.Branch2,
    Branch04=bang.Branch3,
    Branch05=bang.Branch4,
    Branch06=bang_4.Branch0,
    Branch07=bang_4.Branch1,
    Branch08=bang_4.Branch2,
    Branch09=bang_4.Branch3,
    Branch010=bang_4.Branch4,
    Branch011=bang_5.Branch0,
    Branch012=bang_5.Branch1,
    Branch013=bang_5.Branch2,
    Branch014=bang_5.Branch3,
    Branch015=bang_5.Branch4,
    Branch016=bang_3.Branch0,
    Branch017=bang_3.Branch1,
    Branch018=bang_3.Branch2,
    Branch019=bang_3.Branch3,
    Branch020=bang_3.Branch4,
    FlattenInputs=True)  # -> simplify(Result)
concat_17 = Concatenate(FragmentA=bang_6.Branch1, FragmentB=",")  # -> flatten(Result)
concat_18 = Concatenate(FragmentA=bang_6.Branch0, FragmentB=",")  # -> flatten(Result)
concat_19 = Concatenate(FragmentA=bang_6.Branch3, FragmentB=",")  # -> flatten(Result)
concat_20 = Concatenate(FragmentA=bang_6.Branch2, FragmentB=",")  # -> flatten(Result)
concat_21 = Concatenate(FragmentA=bang_7.Branch1, FragmentB=",")  # -> flatten(Result)
concat_22 = Concatenate(FragmentA=bang_7.Branch0, FragmentB=",")  # -> flatten(Result)
concat_23 = Concatenate(FragmentA=division_7, FragmentB=",")  # -> flatten(Result)
concat_24 = Concatenate(FragmentA=bang_7.Branch3, FragmentB=",")  # -> flatten(Result)
concat_25 = Concatenate(FragmentA=bang_8.Branch1, FragmentB=",")  # -> flatten(Result)
concat_26 = Concatenate(FragmentA=bang_7.Branch2, FragmentB=",")  # -> flatten(Result)
concat_27 = Concatenate(FragmentA=bang_8.Branch0, FragmentB=",")  # -> flatten(Result)
concat_28 = Concatenate(FragmentA=bang_8.Branch3, FragmentB=",")  # -> flatten(Result)
concat_29 = Concatenate(FragmentA=division_9, FragmentB=",")  # -> flatten(Result)
concat_30 = Concatenate(FragmentA=bang_8.Branch2, FragmentB=",")  # -> flatten(Result)
concat_31 = Concatenate(FragmentA=division_8, FragmentB=",")  # -> flatten(Result)
concat_32 = Concatenate(FragmentA=division_6, FragmentB=",")  # -> flatten(Result)
concat_33 = Concatenate(FragmentA=division_10, FragmentB=",")  # -> flatten(Result)
concat_34 = Concatenate(FragmentA=division_12, FragmentB=",")  # -> flatten(Result)
concat_35 = Concatenate(FragmentA=bang_9.Branch1, FragmentB=",")  # -> flatten(Result)
concat_36 = Concatenate(FragmentA=bang_9.Branch2, FragmentB=",")  # -> flatten(Result)
concat_37 = Concatenate(FragmentA=bang_9.Branch0, FragmentB=",")  # -> flatten(Result)
concat_38 = Concatenate(FragmentA=bang_9.Branch3, FragmentB=",")  # -> flatten(Result)
concat_39 = Concatenate(FragmentA=division_14, FragmentB=",")  # -> flatten(Result)
division_21 = Division(A=ma_23.Result, B=bang_2.Branch0)
concat_40 = Concatenate(FragmentA=division_13, FragmentB=",")  # -> flatten(Result)
concat_41 = Concatenate(FragmentA=division_11, FragmentB=",")  # -> flatten(Result)
division_22 = Division(A=ma_26.Result, B=bang_2.Branch4)
concat_42 = Concatenate(FragmentA=division_15, FragmentB=",")  # -> flatten(Result)
concat_43 = Concatenate(FragmentA=division_18, FragmentB=",")  # -> flatten(Result)
division_23 = Division(A=ma_24.Result, B=bang_2.Branch3)
concat_44 = Concatenate(FragmentA=division_20, FragmentB=",")  # -> flatten(Result)
concat_45 = Concatenate(FragmentA=division_19, FragmentB=",")  # -> flatten(Result)
division_24 = Division(A=ma_25.Result, B=bang_2.Branch2)
division_25 = Division(A=ma_27.Result, B=bang_2.Branch1)
concat_46 = Concatenate(FragmentA=division_17, FragmentB=",")  # -> flatten(Result)
concat_47 = Concatenate(FragmentA=division_16, FragmentB=",")  # -> flatten(Result)
concat_48 = Concatenate(FragmentA=division_21, FragmentB=",")  # -> flatten(Result)
merge = Merge(Data1=panel_5, Data2=entwine_2)
concat_49 = Concatenate(FragmentA=division_25, FragmentB=",")  # -> flatten(Result)
concat_50 = Concatenate(FragmentA=division_24, FragmentB=",")  # -> flatten(Result)
concat_51 = Concatenate(FragmentA=division_22, FragmentB=",")  # -> flatten(Result)
concat_52 = Concatenate(FragmentA=division_23, FragmentB=",")  # -> flatten(Result)
ma_28 = MassAddition(Input=flatten([ma_3.Result, ma_4.Result, ma_5.Result, ma_6.Result, ma_7.Result]))  # -> Result, PartialResults
ma_29 = MassAddition(Input=flatten([ma_18.Result, ma_19.Result, ma_20.Result, ma_21.Result, ma_22.Result]))  # -> Result, PartialResults
ma_30 = MassAddition(Input=flatten([bang_7.Branch0, bang_7.Branch1, bang_7.Branch2, bang_7.Branch3]))  # -> Result, PartialResults
ma_31 = MassAddition(Input=flatten([bang_6.Branch0, bang_6.Branch1, bang_6.Branch2, bang_6.Branch3]))  # -> Result, PartialResults
ma_32 = MassAddition(Input=flatten([ma_8.Result, ma_9.Result, ma_10.Result, ma_11.Result, ma_12.Result]))  # -> Result, PartialResults
ma_33 = MassAddition(Input=flatten([bang_8.Branch0, bang_8.Branch1, bang_8.Branch2, bang_8.Branch3]))  # -> Result, PartialResults
ma_34 = MassAddition(Input=flatten([ma_13.Result, ma_14.Result, ma_15.Result, ma_16.Result, ma_17.Result]))  # -> Result, PartialResults
ma_35 = MassAddition(Input=flatten([ma_28.Result, ma_34.Result, ma_29.Result, ma_32.Result]))  # -> Result, PartialResults
division_26 = Division(A=ma_35.Result, B=ma.Result)
concat_53 = Concatenate(FragmentA=division_26, FragmentB=",")  # -> flatten(Result)
ma_36 = MassAddition(Input=flatten([bang_9.Branch0, bang_9.Branch1, bang_9.Branch2, bang_9.Branch3]))  # -> Result, PartialResults
flip = FlipMatrix(Data=entwine_2)
division_27 = Division(A=ma_29.Result, B=ma.Result)
division_28 = Division(A=ma_28.Result, B=ma.Result)
concat_54 = Concatenate(FragmentA=ma_31.Result, FragmentB=",")  # -> flatten(Result)
division_29 = Division(A=ma_34.Result, B=ma.Result)
concat_55 = Concatenate(FragmentA=ma_30.Result, FragmentB=",")  # -> flatten(Result)
concat_56 = Concatenate(FragmentA=ma_33.Result, FragmentB=",")  # -> flatten(Result)
join_21 = TextJoin(Text=["Total EUI (kBtu/sf/year),", concat_48, concat_49, concat_50, concat_52, concat_51, concat_53])
division_30 = Division(A=ma_32.Result, B=ma.Result)
concat_57 = Concatenate(FragmentA=ma_36.Result, FragmentB=",")  # -> flatten(Result)
concat_58 = Concatenate(FragmentA=division_27, FragmentB=",")  # -> flatten(Result)
concat_59 = Concatenate(FragmentA=division_28, FragmentB=",")  # -> flatten(Result)
join_22 = TextJoin(Text=["Cooling EUI (kBtu/sf/year),", concat_15, concat_14, concat_12, concat_13, concat_16, concat_59])
join_23 = TextJoin(Text=flip, Join=",")
concat_60 = Concatenate(FragmentA=division_29, FragmentB=",")  # -> flatten(Result)
join_24 = TextJoin(Text=["East Facade Area (ft2),", concat_18, concat_17, concat_20, concat_19, concat_54])
join_25 = TextJoin(Text=["West Facade Area (ft2),", concat_27, concat_25, concat_30, concat_28, concat_56])
join_26 = TextJoin(Text=["Heating EUI (kBtu/sf/year),", concat_41, concat_40, concat_34, concat_39, concat_42, concat_60])
join_27 = TextJoin(Text=["South Facade Area (ft2),", concat_22, concat_21, concat_26, concat_24, concat_55])
join_28 = TextJoin(Text=["Lighting EUI (kBtu/sf/year),", concat_46, concat_45, concat_43, concat_44, concat_47, concat_58])
concat_61 = Concatenate(FragmentA=division_30, FragmentB=",")  # -> flatten(Result)
join_29 = TextJoin(Text=["Equip EUI (kBtu/sf/year),", concat_32, concat_31, concat_23, concat_29, concat_33, concat_61])
join_30 = TextJoin(Text=["North Facade Area (ft2),", concat_37, concat_35, concat_36, concat_38, concat_57])
number_slider = Slider(1, range=0..1)
ma_37 = MassAddition(Input=bang_5.Branch2)  # -> Result, PartialResults
ma_38 = MassAddition(Input=bang_5.Branch3)  # -> Result, PartialResults
ma_39 = MassAddition(Input=bang_5.Branch4)  # -> Result, PartialResults
division_31 = Division(A=ma_5.Result, B=number_slider)
division_32 = Division(A=ma_4.Result, B=number_slider)
division_33 = Division(A=ma_3.Result, B=number_slider)
division_34 = Division(A=ma_6.Result, B=number_slider)
division_35 = Division(A=ma_7.Result, B=number_slider)
ma_40 = MassAddition(Input=flatten([ma_3.Result, ma_13.Result, ma_18.Result, ma_8.Result]))  # -> Result, PartialResults
division_36 = Division(A=ma_8.Result, B=number_slider)
division_37 = Division(A=ma_10.Result, B=number_slider)
ma_41 = MassAddition(Input=flatten([bang.Branch3, bang_4.Branch3, bang_3.Branch3]))  # -> Result, PartialResults
division_38 = Division(A=ma_9.Result, B=number_slider)
division_39 = Division(A=ma_11.Result, B=number_slider)
ma_42 = MassAddition(Input=flatten([ma_5.Result, bang_4.Branch2, bang_5.Branch2, bang_3.Branch2]))  # -> Result, PartialResults
division_40 = Division(A=ma_12.Result, B=number_slider)
division_41 = Division(A=ma_13.Result, B=number_slider)
division_42 = Division(A=ma_15.Result, B=number_slider)
ma_43 = MassAddition(Input=flatten([ma_4.Result, ma_14.Result, ma_19.Result, ma_9.Result]))  # -> Result, PartialResults
division_43 = Division(A=ma_14.Result, B=number_slider)
ma_44 = MassAddition(Input=flatten([bang.Branch4, bang_4.Branch4, bang_5.Branch4, bang_3.Branch4]))  # -> Result, PartialResults
division_44 = Division(A=ma_16.Result, B=number_slider)
division_45 = Division(A=ma_17.Result, B=number_slider)
division_46 = Division(A=ma_39.Result, B=number_slider)
division_47 = Division(A=ma_18.Result, B=number_slider)
division_48 = Division(A=ma_37.Result, B=number_slider)
division_49 = Division(A=ma_19.Result, B=number_slider)
division_50 = Division(A=ma_38.Result, B=number_slider)
concat_62 = Concatenate(FragmentA=division_31, FragmentB=",")  # -> flatten(Result)
concat_63 = Concatenate(FragmentA=division_34, FragmentB=",")  # -> flatten(Result)
concat_64 = Concatenate(FragmentA=division_32, FragmentB=",")  # -> flatten(Result)
concat_65 = Concatenate(FragmentA=division_33, FragmentB=",")  # -> flatten(Result)
concat_66 = Concatenate(FragmentA=division_35, FragmentB=",")  # -> flatten(Result)
concat_67 = Concatenate(FragmentA=division_37, FragmentB=",")  # -> flatten(Result)
concat_68 = Concatenate(FragmentA=division_39, FragmentB=",")  # -> flatten(Result)
concat_69 = Concatenate(FragmentA=division_38, FragmentB=",")  # -> flatten(Result)
concat_70 = Concatenate(FragmentA=division_36, FragmentB=",")  # -> flatten(Result)
concat_71 = Concatenate(FragmentA=division_40, FragmentB=",")  # -> flatten(Result)
concat_72 = Concatenate(FragmentA=division_42, FragmentB=",")  # -> flatten(Result)
concat_73 = Concatenate(FragmentA=division_44, FragmentB=",")  # -> flatten(Result)
division_51 = Division(A=ma_40.Result, B=number_slider)
concat_74 = Concatenate(FragmentA=division_43, FragmentB=",")  # -> flatten(Result)
concat_75 = Concatenate(FragmentA=division_41, FragmentB=",")  # -> flatten(Result)
division_52 = Division(A=ma_44.Result, B=number_slider)
concat_76 = Concatenate(FragmentA=division_45, FragmentB=",")  # -> flatten(Result)
concat_77 = Concatenate(FragmentA=division_48, FragmentB=",")  # -> flatten(Result)
division_53 = Division(A=ma_41.Result, B=number_slider)
concat_78 = Concatenate(FragmentA=division_50, FragmentB=",")  # -> flatten(Result)
division_54 = Division(A=ma_42.Result, B=number_slider)
concat_79 = Concatenate(FragmentA=division_49, FragmentB=",")  # -> flatten(Result)
division_55 = Division(A=ma_43.Result, B=number_slider)
concat_80 = Concatenate(FragmentA=division_47, FragmentB=",")  # -> flatten(Result)
concat_81 = Concatenate(FragmentA=division_46, FragmentB=",")  # -> flatten(Result)
concat_82 = Concatenate(FragmentA=division_51, FragmentB=",")  # -> flatten(Result)
concat_83 = Concatenate(FragmentA=division_55, FragmentB=",")  # -> flatten(Result)
concat_84 = Concatenate(FragmentA=division_54, FragmentB=",")  # -> flatten(Result)
concat_85 = Concatenate(FragmentA=division_52, FragmentB=",")  # -> flatten(Result)
concat_86 = Concatenate(FragmentA=division_53, FragmentB=",")  # -> flatten(Result)
ma_45 = MassAddition(Input=flatten([ma_3.Result, ma_4.Result, ma_5.Result, ma_6.Result, ma_7.Result]))  # -> Result, PartialResults
ma_46 = MassAddition(Input=flatten([ma_18.Result, ma_19.Result, ma_37.Result, ma_38.Result, ma_39.Result]))  # -> Result, PartialResults
ma_47 = MassAddition(Input=flatten([ma_8.Result, ma_9.Result, ma_10.Result, ma_11.Result, ma_12.Result]))  # -> Result, PartialResults
ma_48 = MassAddition(Input=flatten([ma_13.Result, ma_14.Result, ma_15.Result, ma_16.Result, ma_17.Result]))  # -> Result, PartialResults
ma_49 = MassAddition(Input=flatten([ma_45.Result, ma_47.Result, ma_48.Result, ma_46.Result]))  # -> Result, PartialResults
division_56 = Division(A=ma_49.Result, B=number_slider)
concat_87 = Concatenate(FragmentA=division_56, FragmentB=",")  # -> flatten(Result)
division_57 = Division(A=ma_46.Result, B=number_slider)
division_58 = Division(A=ma_45.Result, B=number_slider)
division_59 = Division(A=ma_48.Result, B=number_slider)
join_31 = TextJoin(Text=["Total EUI (kBtu/year),", concat_82, concat_83, concat_84, concat_86, concat_85, concat_87])
division_60 = Division(A=ma_47.Result, B=number_slider)
concat_88 = Concatenate(FragmentA=division_57, FragmentB=",")  # -> flatten(Result)
concat_89 = Concatenate(FragmentA=division_58, FragmentB=",")  # -> flatten(Result)
join_32 = TextJoin(Text=["Cooling EUI (kBtu/year),", concat_65, concat_64, concat_62, concat_63, concat_66, concat_89])
concat_90 = Concatenate(FragmentA=division_59, FragmentB=",")  # -> flatten(Result)
join_33 = TextJoin(Text=["Heating EUI (kBtu/year),", concat_75, concat_74, concat_72, concat_73, concat_76, concat_90])
join_34 = TextJoin(Text=["Lighting EUI (kBtu/year),", concat_80, concat_79, concat_77, concat_78, concat_81, concat_88])
concat_91 = Concatenate(FragmentA=division_60, FragmentB=",")  # -> flatten(Result)
join_35 = TextJoin(Text=["Equip EUI (kBtu/year),", concat_70, concat_69, concat_67, concat_68, concat_71, concat_91])
number_slider_2 = Slider(3.412, range=0..4)
ma_50 = MassAddition(Input=bang_5.Branch2)  # -> Result, PartialResults
ma_51 = MassAddition(Input=bang_5.Branch3)  # -> Result, PartialResults
ma_52 = MassAddition(Input=bang_5.Branch4)  # -> Result, PartialResults
division_61 = Division(A=ma_5.Result, B=number_slider_2)
division_62 = Division(A=ma_4.Result, B=number_slider_2)
division_63 = Division(A=ma_3.Result, B=number_slider_2)
division_64 = Division(A=ma_6.Result, B=number_slider_2)
division_65 = Division(A=ma_7.Result, B=number_slider_2)
ma_53 = MassAddition(Input=flatten([ma_3.Result, ma_13.Result, ma_18.Result, ma_8.Result]))  # -> Result, PartialResults
division_66 = Division(A=ma_8.Result, B=number_slider_2)
division_67 = Division(A=ma_10.Result, B=number_slider_2)
ma_54 = MassAddition(Input=flatten([bang.Branch3, bang_4.Branch3, bang_3.Branch3]))  # -> Result, PartialResults
division_68 = Division(A=ma_9.Result, B=number_slider_2)
division_69 = Division(A=ma_11.Result, B=number_slider_2)
ma_55 = MassAddition(Input=flatten([ma_5.Result, bang_4.Branch2, bang_5.Branch2, bang_3.Branch2]))  # -> Result, PartialResults
division_70 = Division(A=ma_12.Result, B=number_slider_2)
division_71 = Division(A=ma_13.Result, B=number_slider_2)
division_72 = Division(A=ma_15.Result, B=number_slider_2)
ma_56 = MassAddition(Input=flatten([ma_4.Result, ma_14.Result, ma_19.Result, ma_9.Result]))  # -> Result, PartialResults
division_73 = Division(A=ma_14.Result, B=number_slider_2)
ma_57 = MassAddition(Input=flatten([bang.Branch4, bang_4.Branch4, bang_5.Branch4, bang_3.Branch4]))  # -> Result, PartialResults
division_74 = Division(A=ma_16.Result, B=number_slider_2)
division_75 = Division(A=ma_17.Result, B=number_slider_2)
division_76 = Division(A=ma_52.Result, B=number_slider_2)
division_77 = Division(A=ma_18.Result, B=number_slider_2)
division_78 = Division(A=ma_50.Result, B=number_slider_2)
division_79 = Division(A=ma_19.Result, B=number_slider_2)
division_80 = Division(A=ma_51.Result, B=number_slider_2)
concat_92 = Concatenate(FragmentA=division_61, FragmentB=",")  # -> flatten(Result)
concat_93 = Concatenate(FragmentA=division_64, FragmentB=",")  # -> flatten(Result)
concat_94 = Concatenate(FragmentA=division_62, FragmentB=",")  # -> flatten(Result)
concat_95 = Concatenate(FragmentA=division_63, FragmentB=",")  # -> flatten(Result)
concat_96 = Concatenate(FragmentA=division_65, FragmentB=",")  # -> flatten(Result)
concat_97 = Concatenate(FragmentA=division_67, FragmentB=",")  # -> flatten(Result)
concat_98 = Concatenate(FragmentA=division_69, FragmentB=",")  # -> flatten(Result)
concat_99 = Concatenate(FragmentA=division_68, FragmentB=",")  # -> flatten(Result)
concat_100 = Concatenate(FragmentA=division_66, FragmentB=",")  # -> flatten(Result)
concat_101 = Concatenate(FragmentA=division_70, FragmentB=",")  # -> flatten(Result)
concat_102 = Concatenate(FragmentA=division_72, FragmentB=",")  # -> flatten(Result)
concat_103 = Concatenate(FragmentA=division_74, FragmentB=",")  # -> flatten(Result)
division_81 = Division(A=ma_53.Result, B=number_slider_2)
concat_104 = Concatenate(FragmentA=division_73, FragmentB=",")  # -> flatten(Result)
concat_105 = Concatenate(FragmentA=division_71, FragmentB=",")  # -> flatten(Result)
division_82 = Division(A=ma_57.Result, B=number_slider_2)
concat_106 = Concatenate(FragmentA=division_75, FragmentB=",")  # -> flatten(Result)
concat_107 = Concatenate(FragmentA=division_78, FragmentB=",")  # -> flatten(Result)
division_83 = Division(A=ma_54.Result, B=number_slider_2)
concat_108 = Concatenate(FragmentA=division_80, FragmentB=",")  # -> flatten(Result)
division_84 = Division(A=ma_55.Result, B=number_slider_2)
concat_109 = Concatenate(FragmentA=division_79, FragmentB=",")  # -> flatten(Result)
division_85 = Division(A=ma_56.Result, B=number_slider_2)
concat_110 = Concatenate(FragmentA=division_77, FragmentB=",")  # -> flatten(Result)
concat_111 = Concatenate(FragmentA=division_76, FragmentB=",")  # -> flatten(Result)
concat_112 = Concatenate(FragmentA=division_81, FragmentB=",")  # -> flatten(Result)
concat_113 = Concatenate(FragmentA=division_85, FragmentB=",")  # -> flatten(Result)
concat_114 = Concatenate(FragmentA=division_84, FragmentB=",")  # -> flatten(Result)
concat_115 = Concatenate(FragmentA=division_82, FragmentB=",")  # -> flatten(Result)
concat_116 = Concatenate(FragmentA=division_83, FragmentB=",")  # -> flatten(Result)
ma_58 = MassAddition(Input=flatten([ma_3.Result, ma_4.Result, ma_5.Result, ma_6.Result, ma_7.Result]))  # -> Result, PartialResults
ma_59 = MassAddition(Input=flatten([ma_18.Result, ma_19.Result, ma_50.Result, ma_51.Result, ma_52.Result]))  # -> Result, PartialResults
ma_60 = MassAddition(Input=flatten([ma_8.Result, ma_9.Result, ma_10.Result, ma_11.Result, ma_12.Result]))  # -> Result, PartialResults
ma_61 = MassAddition(Input=flatten([ma_13.Result, ma_14.Result, ma_15.Result, ma_16.Result, ma_17.Result]))  # -> Result, PartialResults
ma_62 = MassAddition(Input=flatten([ma_58.Result, ma_60.Result, ma_61.Result, ma_59.Result]))  # -> Result, PartialResults
division_86 = Division(A=ma_62.Result, B=number_slider_2)
concat_117 = Concatenate(FragmentA=division_86, FragmentB=",")  # -> flatten(Result)
division_87 = Division(A=ma_59.Result, B=number_slider_2)
division_88 = Division(A=ma_58.Result, B=number_slider_2)
division_89 = Division(A=ma_61.Result, B=number_slider_2)
join_36 = TextJoin(Text=["Total EUI (kWh/year),", concat_112, concat_113, concat_114, concat_116, concat_115, concat_117])
division_90 = Division(A=ma_60.Result, B=number_slider_2)
concat_118 = Concatenate(FragmentA=division_87, FragmentB=",")  # -> flatten(Result)
concat_119 = Concatenate(FragmentA=division_88, FragmentB=",")  # -> flatten(Result)
join_37 = TextJoin(Text=["Cooling EUI (kWh/year),", concat_95, concat_94, concat_92, concat_93, concat_96, concat_119])
concat_120 = Concatenate(FragmentA=division_89, FragmentB=",")  # -> flatten(Result)
join_38 = TextJoin(Text=["Heating EUI (kWh/year),", concat_105, concat_104, concat_102, concat_103, concat_106, concat_120])
join_39 = TextJoin(Text=["Lighting EUI (kWh/year),", concat_110, concat_109, concat_107, concat_108, concat_111, concat_118])
concat_121 = Concatenate(FragmentA=division_90, FragmentB=",")  # -> flatten(Result)
join_40 = TextJoin(Text=["Equip EUI (kWh/year),", concat_100, concat_99, concat_97, concat_98, concat_101, concat_121])
number_slider_3 = Slider(8530, range=0..10000)
ma_63 = MassAddition(Input=bang_5.Branch2)  # -> Result, PartialResults
ma_64 = MassAddition(Input=bang_5.Branch3)  # -> Result, PartialResults
ma_65 = MassAddition(Input=bang_5.Branch4)  # -> Result, PartialResults
division_91 = Division(A=ma_5.Result, B=number_slider_3)
division_92 = Division(A=ma_4.Result, B=number_slider_3)
division_93 = Division(A=ma_3.Result, B=number_slider_3)
division_94 = Division(A=ma_6.Result, B=number_slider_3)
division_95 = Division(A=ma_7.Result, B=number_slider_3)
ma_66 = MassAddition(Input=flatten([ma_3.Result, ma_13.Result, ma_18.Result, ma_8.Result]))  # -> Result, PartialResults
division_96 = Division(A=ma_8.Result, B=number_slider_3)
division_97 = Division(A=ma_10.Result, B=number_slider_3)
ma_67 = MassAddition(Input=flatten([bang.Branch3, bang_4.Branch3, bang_3.Branch3]))  # -> Result, PartialResults
division_98 = Division(A=ma_9.Result, B=number_slider_3)
division_99 = Division(A=ma_11.Result, B=number_slider_3)
ma_68 = MassAddition(Input=flatten([ma_5.Result, bang_4.Branch2, bang_5.Branch2, bang_3.Branch2]))  # -> Result, PartialResults
division_100 = Division(A=ma_12.Result, B=number_slider_3)
division_101 = Division(A=ma_13.Result, B=number_slider_3)
division_102 = Division(A=ma_15.Result, B=number_slider_3)
ma_69 = MassAddition(Input=flatten([ma_4.Result, ma_14.Result, ma_19.Result, ma_9.Result]))  # -> Result, PartialResults
division_103 = Division(A=ma_14.Result, B=number_slider_3)
ma_70 = MassAddition(Input=flatten([bang.Branch4, bang_4.Branch4, bang_5.Branch4, bang_3.Branch4]))  # -> Result, PartialResults
division_104 = Division(A=ma_16.Result, B=number_slider_3)
division_105 = Division(A=ma_17.Result, B=number_slider_3)
division_106 = Division(A=ma_65.Result, B=number_slider_3)
division_107 = Division(A=ma_18.Result, B=number_slider_3)
division_108 = Division(A=ma_63.Result, B=number_slider_3)
division_109 = Division(A=ma_19.Result, B=number_slider_3)
division_110 = Division(A=ma_64.Result, B=number_slider_3)
concat_122 = Concatenate(FragmentA=division_91, FragmentB=",")  # -> flatten(Result)
concat_123 = Concatenate(FragmentA=division_94, FragmentB=",")  # -> flatten(Result)
concat_124 = Concatenate(FragmentA=division_92, FragmentB=",")  # -> flatten(Result)
concat_125 = Concatenate(FragmentA=division_93, FragmentB=",")  # -> flatten(Result)
concat_126 = Concatenate(FragmentA=division_95, FragmentB=",")  # -> flatten(Result)
concat_127 = Concatenate(FragmentA=division_97, FragmentB=",")  # -> flatten(Result)
concat_128 = Concatenate(FragmentA=division_99, FragmentB=",")  # -> flatten(Result)
concat_129 = Concatenate(FragmentA=division_98, FragmentB=",")  # -> flatten(Result)
concat_130 = Concatenate(FragmentA=division_96, FragmentB=",")  # -> flatten(Result)
concat_131 = Concatenate(FragmentA=division_100, FragmentB=",")  # -> flatten(Result)
concat_132 = Concatenate(FragmentA=division_102, FragmentB=",")  # -> flatten(Result)
concat_133 = Concatenate(FragmentA=division_104, FragmentB=",")  # -> flatten(Result)
division_111 = Division(A=ma_66.Result, B=number_slider_3)
concat_134 = Concatenate(FragmentA=division_103, FragmentB=",")  # -> flatten(Result)
concat_135 = Concatenate(FragmentA=division_101, FragmentB=",")  # -> flatten(Result)
division_112 = Division(A=ma_70.Result, B=number_slider_3)
concat_136 = Concatenate(FragmentA=division_105, FragmentB=",")  # -> flatten(Result)
concat_137 = Concatenate(FragmentA=division_108, FragmentB=",")  # -> flatten(Result)
division_113 = Division(A=ma_67.Result, B=number_slider_3)
concat_138 = Concatenate(FragmentA=division_110, FragmentB=",")  # -> flatten(Result)
division_114 = Division(A=ma_68.Result, B=number_slider_3)
concat_139 = Concatenate(FragmentA=division_109, FragmentB=",")  # -> flatten(Result)
division_115 = Division(A=ma_69.Result, B=number_slider_3)
concat_140 = Concatenate(FragmentA=division_107, FragmentB=",")  # -> flatten(Result)
concat_141 = Concatenate(FragmentA=division_106, FragmentB=",")  # -> flatten(Result)
concat_142 = Concatenate(FragmentA=division_111, FragmentB=",")  # -> flatten(Result)
concat_143 = Concatenate(FragmentA=division_115, FragmentB=",")  # -> flatten(Result)
concat_144 = Concatenate(FragmentA=division_114, FragmentB=",")  # -> flatten(Result)
concat_145 = Concatenate(FragmentA=division_112, FragmentB=",")  # -> flatten(Result)
concat_146 = Concatenate(FragmentA=division_113, FragmentB=",")  # -> flatten(Result)
ma_71 = MassAddition(Input=flatten([ma_3.Result, ma_4.Result, ma_5.Result, ma_6.Result, ma_7.Result]))  # -> Result, PartialResults
ma_72 = MassAddition(Input=flatten([ma_18.Result, ma_19.Result, ma_63.Result, ma_64.Result, ma_65.Result]))  # -> Result, PartialResults
ma_73 = MassAddition(Input=flatten([ma_8.Result, ma_9.Result, ma_10.Result, ma_11.Result, ma_12.Result]))  # -> Result, PartialResults
ma_74 = MassAddition(Input=flatten([ma_13.Result, ma_14.Result, ma_15.Result, ma_16.Result, ma_17.Result]))  # -> Result, PartialResults
ma_75 = MassAddition(Input=flatten([ma_71.Result, ma_73.Result, ma_74.Result, ma_72.Result]))  # -> Result, PartialResults
division_116 = Division(A=ma_75.Result, B=number_slider_3)
multiplication_3 = Multiplication(A=division_116, B=Slider(30, range=0..100))
addition = Addition(A=multiplication, B=multiplication_3)
join_41 = TextJoin(Text=[",", addition, ",,,,,,,,,,,,,,,,,,,,,,,,,,,,,,,,"])
panel_8 = Panel(join_41)
join_42 = TextJoin(Text=["Emissions Total 30 years (tons),", panel_6, multiplication_3, panel_8])
panel_9 = Panel(join_42)
concat_147 = Concatenate(FragmentA=division_116, FragmentB=",")  # -> flatten(Result)
division_117 = Division(A=ma_72.Result, B=number_slider_3)
division_118 = Division(A=ma_71.Result, B=number_slider_3)
division_119 = Division(A=ma_74.Result, B=number_slider_3)
join_43 = TextJoin(Text=["Total EUI (ton CO2/year),", concat_142, concat_143, concat_144, concat_146, concat_145, concat_147])
division_120 = Division(A=ma_73.Result, B=number_slider_3)
concat_148 = Concatenate(FragmentA=division_117, FragmentB=",")  # -> flatten(Result)
concat_149 = Concatenate(FragmentA=division_118, FragmentB=",")  # -> flatten(Result)
join_44 = TextJoin(Text=["Cooling EUI (ton CO2/year),", concat_125, concat_124, concat_122, concat_123, concat_126, concat_149])
concat_150 = Concatenate(FragmentA=division_119, FragmentB=",")  # -> flatten(Result)
join_45 = TextJoin(Text=["Heating EUI (ton CO2/year),", concat_135, concat_134, concat_132, concat_133, concat_136, concat_150])
join_46 = TextJoin(Text=["Lighting EUI (ton CO2/year),", concat_140, concat_139, concat_137, concat_138, concat_141, concat_148])
concat_151 = Concatenate(FragmentA=division_120, FragmentB=",")  # -> flatten(Result)
join_47 = TextJoin(Text=["Equip EUI (ton CO2/year),", concat_130, concat_129, concat_127, concat_128, concat_131, concat_151])
entwine_3 = Entwine(
    Branch00=join_10,
    Branch01=join_11,
    Branch02=panel_3,
    Branch03=join_6,
    Branch04=join,
    Branch05=join_2,
    Branch06=panel_3,
    Branch07=join_4,
    Branch08=join_5,
    Branch09=join_3,
    Branch010=join_8,
    Branch011=join_9,
    Branch012=join_7,
    Branch013=join_13,
    Branch014=join_14,
    Branch015=join_12,
    Branch016=join_16,
    Branch017=join_17,
    Branch018=join_15,
    Branch019=panel_3,
    Branch020=", Slab, Beams, Columns, Envelope, Total,,,,,,,,,,,,,,",
    Branch021=join_19,
    Branch022=panel_3,
    Branch023=panel_4,
    Branch024=join_20,
    Branch025=panel_3,
    Branch026=", Zone1, Zone2, Zone3, Zone4,Total,,,,,,,,,,,,,,,,,,",
    Branch027=join_30,
    Branch028=join_27,
    Branch029=join_24,
    Branch030=join_25,
    Branch031=panel_3,
    Branch032=panel_4,
    Branch033=join_22,
    Branch034=join_26,
    Branch035=join_28,
    Branch036=join_29,
    Branch037=join_21,
    Branch038=panel_3,
    Branch039=panel_4,
    Branch040=join_32,
    Branch041=join_33,
    Branch042=join_34,
    Branch043=join_35,
    Branch044=join_31,
    Branch045=panel_3,
    Branch046=panel_4,
    Branch047=join_37,
    Branch048=join_38,
    Branch049=join_39,
    Branch050=join_40,
    Branch051=join_36,
    Branch052=panel_3,
    Branch053=panel_4,
    Branch054=join_44,
    Branch055=join_45,
    Branch056=join_46,
    Branch057=join_47,
    Branch058=join_43,
    Branch059=panel_3,
    Branch060=panel,
    Branch061=panel_9,
    Branch062=panel_3,
    Branch063=panel_5,
    Branch064=join_23,
    FlattenInputs=True)  # -> flatten(Result)
c_script = CSharpScript(save=trees_from_building.run_simulation, path=trees_from_building.simulation_folder, data=entwine_3)  # inputs save: Boolean, path: String, data: list of String
# ---------- c_script: C# ----------
    if(save){
      var fileinfo = new System.IO.FileInfo(path);
      if(!fileinfo.Directory.Exists){
        fileinfo.Directory.Create();
      }

      var sw = fileinfo.CreateText();
      for(int i = 0; i < data.Count; i++){
        string row = data[i];
        if(i < data.Count - 1){
          sw.WriteLine(row);
        }else{
          sw.Write(row);
        }
      }
      sw.Flush();
      sw.Close();
    }
# ---------- end c_script ----------
panel_10 = Panel(entwine_3)

# ==== cluster Cluster
floorcrvs = ClusterInput()
boundary = BoundarySurfaces(FloorCrvs=floorcrvs)  # -> simplify(Surfaces)
outsidecrv = ClusterInput()
F = ClusterInput()
Z = UnitZ(Factor=F)
extr = Extrude(Base=boundary, Direction=Z)
extr_2 = Extrude(OutsideCrv=outsidecrv, Direction=Z)  # -> simplify(OutsideSrf)
debrep = DeconstructBrep(Brep=extr)  # -> simplify(Faces), Edges, Vertices
area = Area(Geometry=debrep.Faces)  # -> Area, Centroid
brep = Brep(debrep.Faces)

area_2 = Area(Geometry=extr_2)  # -> Area, Centroid
mindex = MemberIndex(Set=area.Centroid, Member=area_2.Centroid)  # -> Index, Count
srf = Surface([brep, extr_2])
trim = TrimTree(Tree=mindex.Index, Depth=1)
item = ListItem(List=srf, Index=trim, Wrap=True)

C = ClusterInput()
adiabaticcrv = ClusterInput()
join = JoinCurves(Curves=C, Preserve=False)  # -> simplify(Curves)
extr_3 = Extrude(AdiabaticCrv=adiabaticcrv, Direction=Z)  # -> simplify(AdiabaticSrf)
move = Move(Geometry=join, Motion=Z)  # -> Geometry, Transform
C_2 = ClusterOutput(join)

clean = CleanTree(RemoveNulls=True, RemoveInvalid=True, RemoveEmpty=True, Tree=item)  # -> simplify(Tree)
facen = FaceNormals(Mesh=clean)  # -> Centers, Normals
cullpt = CullDuplicates(Points=facen.Normals, Tolerance=0.1, CullMode=3)  # -> Points, Indices, Valence
devec = DeconstructVector(Vector=cullpt.Points)  # -> XComponent, YComponent, ZComponent

panel = Panel(move.Geometry)
debrep_2 = DeconstructBrep(Brep=extr_3)  # -> Faces, Edges, Vertices
join_2 = JoinCurves(Curves=debrep_2.Edges, Preserve=False)
trim_2 = TrimTree(Tree=join_2, Depth=Slider(2, range=0..10))
T = ClusterOutput(trim_2)
larger = LargerThan(FirstNumber=devec.XComponent, SecondNumber="-0.707")  # -> LargerThan, OrEqualTo
smaller = SmallerThan(FirstNumber=devec.YComponent, SecondNumber="-0.707")  # -> SmallerThan, OrEqualTo
larger_2 = LargerThan(FirstNumber=devec.YComponent, SecondNumber="-1")  # -> LargerThan, OrEqualTo
smaller_2 = SmallerThan(FirstNumber=devec.YComponent, SecondNumber="1")  # -> SmallerThan, OrEqualTo
larger_3 = LargerThan(FirstNumber=devec.YComponent, SecondNumber="0.707")  # -> LargerThan, OrEqualTo
smaller_3 = SmallerThan(FirstNumber=devec.XComponent, SecondNumber="1")  # -> SmallerThan, OrEqualTo
smaller_4 = SmallerThan(FirstNumber=devec.XComponent, SecondNumber="0.707")  # -> SmallerThan, OrEqualTo
smaller_5 = SmallerThan(FirstNumber=devec.YComponent, SecondNumber="0.707")  # -> SmallerThan, OrEqualTo
larger_4 = LargerThan(FirstNumber=devec.YComponent, SecondNumber="-0.707")  # -> LargerThan, OrEqualTo
larger_5 = LargerThan(FirstNumber=devec.XComponent, SecondNumber="0.707")  # -> LargerThan, OrEqualTo
larger_6 = LargerThan(FirstNumber=devec.XComponent, SecondNumber="-1")  # -> LargerThan, OrEqualTo
smaller_6 = SmallerThan(FirstNumber=devec.XComponent, SecondNumber="-0.707")  # -> SmallerThan, OrEqualTo
and = GateAnd(A=larger.LargerThan, B=smaller_4.SmallerThan)
and_2 = GateAnd(A=larger_2.OrEqualTo, B=smaller.SmallerThan)
and_3 = GateAnd(A=larger_3.LargerThan, B=smaller_2.OrEqualTo)
and_4 = GateAnd(A=larger_5.LargerThan, B=smaller_3.OrEqualTo)
and_5 = GateAnd(A=larger_4.OrEqualTo, B=smaller_5.SmallerThan)
and_6 = GateAnd(A=larger_6.OrEqualTo, B=smaller_6.SmallerThan)
and_7 = GateAnd(A=and, B=and_3)
and_8 = GateAnd(A=and, B=and_2)
and_9 = GateAnd(A=and_5, B=and_6)
and_10 = GateAnd(A=and_4, B=and_5)
cull = CullPattern(List=graft(clean), CullPattern=and_8)
cull_2 = CullPattern(List=graft(clean), CullPattern=and_9)
cull_3 = CullPattern(List=graft(clean), CullPattern=and_10)
cull_4 = CullPattern(List=graft(clean), CullPattern=and_7)
pshift = ShiftPaths(Data=cull, Offset=-2)
pshift_2 = ShiftPaths(Data=cull_4, Offset=-2)
pshift_3 = ShiftPaths(Data=cull_2, Offset=-2)
pshift_4 = ShiftPaths(Data=cull_3, Offset=-2)
debrep_3 = DeconstructBrep(Brep=pshift_2)  # -> Faces, Edges, Vertices
debrep_4 = DeconstructBrep(Brep=pshift)  # -> Faces, Edges, Vertices
debrep_5 = DeconstructBrep(Brep=pshift_4)  # -> Faces, Edges, Vertices
debrep_6 = DeconstructBrep(Brep=pshift_3)  # -> Faces, Edges, Vertices
join_3 = JoinCurves(Curves=debrep_3.Edges, Preserve=False)
join_4 = JoinCurves(Curves=debrep_4.Edges, Preserve=False)
join_5 = JoinCurves(Curves=debrep_5.Edges, Preserve=False)
join_6 = JoinCurves(Curves=debrep_6.Edges, Preserve=False)
trim_3 = TrimTree(Tree=join_3, Depth=Slider(2, range=0..10))
trim_4 = TrimTree(Tree=join_4, Depth=Slider(2, range=0..10))
trim_5 = TrimTree(Tree=join_5, Depth=Slider(2, range=0..10))
trim_6 = TrimTree(Tree=join_6, Depth=Slider(2, range=0..10))
T_2 = ClusterOutput(trim_3)
T_3 = ClusterOutput(trim_4)
T_4 = ClusterOutput(trim_5)
T_5 = ClusterOutput(trim_6)
clean_2 = CleanTree(RemoveNulls=True, RemoveInvalid=True, RemoveEmpty=False, Tree=move.Geometry)
T_6 = ClusterOutput(clean_2)
