# Grasshopper definition 21_0127_StudioDefinition.gh (Grasshopper 1.0.7)
# plug-ins: Human

# ----
# Simulation Inputs
# Simulation Folder Name:
# Run Simulation
# Simulation Name:
# .sql Filepath:
panel = Panel("C:\IDL\StudioTool\Simulation\Results")
concat = Concatenate(FragmentA=panel, FragmentB="\", FragmentC="1zone_run1", FragmentD="\OpenStudio\run\eplusout.sql")
panel_2 = Panel(concat)
runsimulation = BooleanToggle(False)

# ----
# Glazing
north_shgc = ValueList({"Low SHGC": 0.25, "High SHGC": 0.60}, selected="High SHGC")
north_shade_depth_in = Slider(27, range=0..100)
south_shgc = ValueList({"Low SHGC": 0.25, "High SHGC": 0.60}, selected="High SHGC")
west_shgc = ValueList({"Low SHGC": 0.25, "High SHGC": 0.60}, selected="High SHGC")
glazing = ValueList({"Aluminum Double", "Aluminum Triple", "Wood Double", "Wood Triple"}, selected="Wood Double")
south_shade_depth_in = Slider(54, range=0..100)
east_shgc = ValueList({"Low SHGC": 0.25, "High SHGC": 0.60}, selected="High SHGC")
north_wwr = Slider(0.49, range=0..1)
east_shade_depth_in = Slider(100, range=0..100)
south_wwr = Slider(0.51, range=0..1)
west_wwr = Slider(0.21, range=0..1)
west_shade_depth_in = Slider(34, range=0..100)
east_wwr = Slider(0.39, range=0..1)

# ----
# Set Zone Program
bldgprograms = HBBuildingPrograms({"LargeOffice", "MediumOffice", "SmallOffice", "MidriseApartment", "HighriseApartment", "Retail", "StripMall", "PrimarySchool", "SecondarySchool", "SmallHotel", "LargeHotel", "Hospital", "Outpatient", "Laboratory", "Warehouse", "SuperMarket", "FullServiceRestaurant", "QuickServiceRestaurant", "Courthouse", "LargeDataCenterHighITE", "LargeDataCenterLowITE", "SmallDataCenterHighITE", "SmallDataCenterLowITE"}, selected="MidriseApartment")
searchprog = HBSearchPrograms(bldg_prog=bldgprograms)  # -> room_prog; plug-in component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
list = ItemSelector(
    searchprog,
    {"2013::MidriseApartment::Apartment", "2013::MidriseApartment::Corridor", "2013::MidriseApartment::Office"}, selected="2013::MidriseApartment::Apartment")

# ----
# Weather File
panel_3 = Panel("http://climate.onebuilding.org/WMO_Region_4_North_and_Central_America/USA_United_States_of_America/WA_Washington/USA_WA_Seattle-King.County.Intl.AP-Boeing.Field.727935_TMY3.zip")
downloadepw = LBDownloadWeather(weather_URL=panel_3)  # -> epw_file, stat_file, ddy_file; plug-in component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

# ----
# Simulation Outputs
# Output Folder Name:
# Run Output:
savecsv = BooleanToggle(False)
concat_2 = Concatenate(FragmentA=panel, FragmentB="\", FragmentC="1zone_run1", FragmentD=".csv")
panel_4 = Panel(concat_2)

adiabaticcrvfromrhino = Curve()
outsidecrvfromrhino = Curve()

adiabaticcrvfromrhino_2 = Curve(<curve referenced from the Rhino model>)
outsidecrvfromrhino_2 = Curve([<curve referenced from the Rhino model> x3])

adiabaticcrvfromrhino_3 = Curve(<curve referenced from the Rhino model>)
outsidecrvfromrhino_3 = Curve([<curve referenced from the Rhino model> x4])

outsidecrvfromrhino_4 = Curve()
adiabaticcrvfromrhino_4 = Curve()

adiabaticcrvfromrhino_5 = Curve()

# ----
# Massing
# Geometry
height = Panel("13")

# ----
# Gathers all zone information
# to create massing
shgc = Entwine(Branch00=north_shgc, Branch01=south_shgc, Branch02=east_shgc, Branch03=west_shgc, FlattenInputs=True)  # -> simplify(Result)
shadedepth = Entwine(
    Branch00=north_shade_depth_in,
    Branch01=south_shade_depth_in,
    Branch02=east_shade_depth_in,
    Branch03=west_shade_depth_in,
    FlattenInputs=True)  # -> simplify(Result)
outsidecrv = Entwine(
    Branch00=outsidecrvfromrhino_3,
    Branch01=outsidecrvfromrhino_2,
    Branch02=outsidecrvfromrhino,
    Branch03=outsidecrvfromrhino_4,
    FlattenInputs=True)  # -> simplify(Result)
adiabaticcrv = Entwine(
    Branch00=adiabaticcrvfromrhino_3,
    Branch01=adiabaticcrvfromrhino_2,
    Branch02=adiabaticcrvfromrhino,
    Branch03=adiabaticcrvfromrhino_4,
    Branch04=adiabaticcrvfromrhino_5,
    FlattenInputs=True)  # -> simplify(Result)
wwr = Entwine(Branch00=north_wwr, Branch01=south_wwr, Branch02=east_wwr, Branch03=west_wwr, FlattenInputs=True)  # -> simplify(Result)
zone = Entwine(Branch00="ZONE1", Branch01="ZONE2", Branch02="ZONE3", Branch03="ZONE4", Branch04="ZONE5", FlattenInputs=True)  # -> simplify(Result)

n_s_e_w_wwr = ExplodeTree(Data=wwr)  # -> Branch0, Branch1, Branch2, Branch3
n_s_e_w_shgc = ExplodeTree(Data=shgc)  # -> Branch0, Branch1, Branch2, Branch3
convert_shade_depth_from_ft_to_m = Multiplication(A=shadedepth, B=0.0254)
n_s_e_w_shade_depth_m = ExplodeTree(Data=convert_shade_depth_from_ft_to_m)  # -> Branch0, Branch1, Branch2, Branch3
panel_5 = Panel(n_s_e_w_shgc.Branch0)
panel_6 = Panel(n_s_e_w_wwr.Branch1)
panel_7 = Panel(n_s_e_w_wwr.Branch0)
panel_8 = Panel(n_s_e_w_wwr.Branch2)
panel_9 = Panel(n_s_e_w_shgc.Branch1)
panel_10 = Panel(n_s_e_w_wwr.Branch3)
panel_11 = Panel(n_s_e_w_shgc.Branch2)
panel_12 = Panel(n_s_e_w_shgc.Branch3)
panel_13 = Panel(n_s_e_w_shade_depth_m.Branch3)
panel_14 = Panel(n_s_e_w_shade_depth_m.Branch0)
panel_15 = Panel(n_s_e_w_shade_depth_m.Branch1)
panel_16 = Panel(n_s_e_w_shade_depth_m.Branch2)
crv = Curve(<curve referenced from the Rhino model>)
crv_2 = Curve(<curve referenced from the Rhino model>)
# Use Teresa's input for embodied carbon calcs
# You get:
# 
# - Transparent versus opaque areas
# -
north_wwr_2 = Slider(0.38, range=0..1)
span = Slider(10, range=0..10)
# Figure out the structure calcs
span_2 = Slider(10, range=0..10)
number_slider = Slider(10, range=0..10)
panel_17 = Panel("0")
frames = GhPythonScript(polyline=crv_2, span_x=span, span_y=span_2, h=number_slider)  # -> out, cols, beams
# ---------- frames: Python ----------
__author__ = "tmendeze"
__version__ = "2020.11.05"

import rhinoscriptsyntax as rs

a, b, c, d, _ = rs.PolylineVertices(polyline)
ab = rs.Distance(a, b)
ad = rs.Distance(a, d)


numx = int(ab/span_x) + 1
numy = int(ad/span_y) + 1

print(ab, ad)
print(numx, numy)


pts = []
pts_ = []
for i in range(numx):
    temp = []
    temp_ = []
    for j in range(numy):
        pt = rs.AddPoint(a[0] + (i * span_x), a[1] + (j * span_y), a[2])
        pt_ = rs.AddPoint(a[0] + (i * span_x), a[1] + (j * span_y), a[2] + h)
        temp.append(pt)
        temp_.append(pt_)
    pts.append(temp)
    pts_.append(temp_)

cols = []
beams = []
for i in range(numx):
    for j in range(numy):
        cols.append(rs.AddLine(pts[i][j], pts_[i][j]))
        beams.append(rs.AddLine(pts_[-i][-j], pts_[-i][-j - 1]))
        beams.append(rs.AddLine(pts_[-i][-j], pts_[-i - 1][-j]))
# ---------- end frames ----------
envelope = GhPythonScript(wwr=north_wwr_2, h=number_slider)  # -> out, e, geo
# ---------- envelope: Python ----------
__author__ = "tmendeze"
__version__ = "2020.11.05"

import rhinoscriptsyntax as rs
from studio2021.datastructures import BaseWall
from studio2021.datastructures import BaseWindow
from studio2021.datastructures import Envelope


# Plot envelope +++++++++++++++++++++++++++++++++++++++
a, b, c, d = rs.SurfacePoints(surface)

#a = pts[index]
#b = pts[index +1]
#c = (b[0], b[1], b[2] + h)
#d = (a[0], a[1], a[2] + h)

rec = rs.AddPolyline((a, b, c, d, a))

if wwr > 0:
    cpt = rs.CurveAreaCentroid(rec)[0]
    print(cpt)
    va = rs.VectorScale(rs.VectorCreate(cpt, a), 1 - wwr)
    vb = rs.VectorScale(rs.VectorCreate(cpt, b), 1 - wwr)
    vc = rs.VectorScale(rs.VectorCreate(cpt, c), 1 - wwr)
    vd = rs.VectorScale(rs.VectorCreate(cpt, d), 1 - wwr)
    a_ = rs.VectorAdd(a, va)
    b_ = rs.VectorAdd(b, vb)
    c_ = rs.VectorAdd(c, vc)
    d_ = rs.VectorAdd(d, vd)
    rec_ = rs.AddPolyline((a_, b_, c_, d_, a_))
    wall_guid = rs.AddPlanarSrf([rec, rec_])
    print(wall_guid)
    win_guid = rs.AddPlanarSrf(rec_)
    if wwr == 1.:
        wall_guid = None
        win_guid = rs.AddPlanarSrf(rec_)
else:
    wall_guid = rs.AddPlanarSrf(rec)
    win_guid = None
geo = wall_guid

# +++++++++++++++++++++++++++++++++++++++++++++++++++++

# Compute envelope kgco2e +++++++++++++++++++++++++++++

wall, window = None, None
if wall_guid:
    wall_area = rs.SurfaceArea(wall_guid)[0]
    wall = BaseWall(wall_area)
    wall.layers = {'finish':{'kgco2e_ft2': 2.},
                   'insulation':{'kgco2e_ft2': .3}
                  }
              
if win_guid:
    win_area = rs.SurfaceArea(win_guid)[0]
    win_perimeter = rs.CurveLength(rec_)
    window = BaseWindow(win_area, win_perimeter)
    window.layers = {'glass1': {'kgco2e_ft2': 3.},
                     'glass2': {'kgco2e_ft2': 3.}}
    window.profile_kgco2e_ft = 3.

e = Envelope(wwr, wall, window)

print(e.embodied)

# +++++++++++++++++++++++++++++++++++++++++++++++++++++
# ---------- end envelope ----------
envelope_2 = GhPythonScript(polyline=crv_2, index="2", wwr=Slider(0.87, range=0..1), h=number_slider)  # -> out, e, geo; inputs index: Int32
# ---------- envelope_2: Python ----------
__author__ = "tmendeze"
__version__ = "2020.11.05"

import rhinoscriptsyntax as rs
from studio2021.datastructures import BaseWall
from studio2021.datastructures import BaseWindow
from studio2021.datastructures import Envelope


# Plot envelope +++++++++++++++++++++++++++++++++++++++
pts = rs.PolylineVertices(polyline)
a = pts[index]
b = pts[index +1]
c = (b[0], b[1], b[2] + h)
d = (a[0], a[1], a[2] + h)

rec = rs.AddPolyline((a, b, c, d, a))
if wwr > 0:
    cpt = rs.CurveAreaCentroid(rec)[0]
    va = rs.VectorScale(rs.VectorCreate(cpt, a), 1 - wwr)
    vb = rs.VectorScale(rs.VectorCreate(cpt, b), 1 - wwr)
    vc = rs.VectorScale(rs.VectorCreate(cpt, c), 1 - wwr)
    vd = rs.VectorScale(rs.VectorCreate(cpt, d), 1 - wwr)
    a_ = rs.VectorAdd(a, va)
    b_ = rs.VectorAdd(b, vb)
    c_ = rs.VectorAdd(c, vc)
    d_ = rs.VectorAdd(d, vd)
    rec_ = rs.AddPolyline((a_, b_, c_, d_, a_))
    wall_guid = rs.AddPlanarSrf([rec, rec_])
    win_guid = rs.AddPlanarSrf(rec_)
    if wwr == 1.:
        wall_guid = None
        win_guid = rs.AddPlanarSrf(rec_)
else:
    wall_guid = rs.AddPlanarSrf(rec)
    win_guid = None
geo = wall_guid

# +++++++++++++++++++++++++++++++++++++++++++++++++++++

# Compute envelope kgco2e +++++++++++++++++++++++++++++

wall, window = None, None
if wall_guid:
    wall_area = rs.SurfaceArea(wall_guid)[0]
    wall = BaseWall(wall_area)
    wall.layers = {'finish':{'kgco2e_ft2': 2.},
                   'insulation':{'kgco2e_ft2': .3}
                  }
              
if win_guid:
    win_area = rs.SurfaceArea(win_guid)[0]
    win_perimeter = rs.CurveLength(rec_)
    window = BaseWindow(win_area, win_perimeter)
    window.layers = {'glass1': {'kgco2e_ft2': 3.},
                     'glass2': {'kgco2e_ft2': 3.}}
    window.profile_kgco2e_ft = 3.

e = Envelope(wwr, wall, window)

print(e.embodied)

# +++++++++++++++++++++++++++++++++++++++++++++++++++++
# ---------- end envelope_2 ----------
envelope_3 = GhPythonScript(polyline=crv_2, index="1", wwr=Slider(0.34, range=0..1), h=number_slider)  # -> out, e, geo; inputs index: Int32; same code as envelope_2
envelope_4 = GhPythonScript(polyline=crv_2, index="3", wwr=Slider(0.3, range=0..1), h=number_slider)  # -> out, e, geo; inputs index: Int32; same code as envelope_2
len = Length(Curve=frames.cols)
len_2 = Length(Curve=frames.beams)
geo = Geometry(envelope_2.geo)
geo_2 = Geometry(envelope_3.geo)
geo_3 = Geometry(envelope_4.geo)
# Outputs:
# - monthly energy data
# - envelope & struct & glazing embodied data (3 numbers)
# - operational + embodied over 50 years
geo_4 = Geometry(envelope.geo)
panel_18 = Panel(envelope_2.out)
panel_19 = Panel(envelope_4.out)
panel_20 = Panel(envelope_3.out)
ma = MassAddition(Input=len_2)  # -> Result, PartialResults
ma_2 = MassAddition(Input=len)  # -> Result, PartialResults
panel_21 = Panel(envelope.out)
structure = GhPythonScript(polyline=crv_2, span=span, col_length=ma_2.Result, beam_length=ma.Result)  # -> out, s, geo
# ---------- structure: Python ----------
__author__ = "tmendeze"
__version__ = "2020.11.05"

import rhinoscriptsyntax as rs
from studio2021.datastructures import Structure 


area = rs.CurveArea(polyline)[0]
s = Structure(area, span, col_length, beam_length)
print(s.embodied)
# ---------- end structure ----------
panel_22 = Panel(structure.out)
geo_5 = Geometry(structure.geo)
building = GhPythonScript(envelopes=[envelope.e, envelope_3.e, envelope_2.e, envelope_4.e], structure=structure.s, num=Slider(6, range=0..10))  # -> out, embodied; inputs envelopes: list
# ---------- building: Python ----------
__author__ = "tmendeze"
__version__ = "2020.11.05"

envelope_e = 0
for e in envelopes:
    envelope_e += e.embodied
    print(e.embodied)

structure_e = structure.embodied

embodied = envelope_e + structure_e
print(structure_e)
# ---------- end building ----------
panel_23 = Panel(building.embodied)

# ----
# Construction Options
# Construction Name:
facade_cladding = ValueList({"Brick", "Fiber Cement", "Metal Panel", "Wood", "Stone"}, selected="Fiber Cement")
cont_ext_insulation = ValueList({"Rigid", "Fiberglass"}, selected="Rigid")
exterior_wall_framing = ValueList({"2x4 Metal Studs", "CLT", "Concrete", "2x4 Wood Studs"}, selected="CLT")
interior_finish = ValueList({"Gyp", "Exposed CLT", "CLT Gyp"}, selected="Gyp")
insulation_thickness_in = Slider(1, range=0..12)

# ----
# Builds wall assembly by pulling from material database.
# Material database lives here:
# C:\Users\username\Documents\GitHub\studio2021
importmaterial = GhPythonScript(material_name=exterior_wall_framing)  # -> r_per_in, embodied_carbon, type, thickness_in, thickness_m, conductivity, density, sp_heat, r_value
# ---------- importmaterial: Python ----------
__author__ = "preston"

import rhinoscriptsyntax as rs
import sys

studiopath = "/Users/preston/Documents/GitHub/studio2021/src"
sys.path.append(studiopath)
import studio2021

from studio2021.functions import read_materials

material = read_materials(material_name)

print(material.keys())

r_per_in = material["r_per_in"]
embodied_carbon = material["embodied_carbon"]
type = material["type"]
density = material["density"]
sp_heat = material["sp_heat"]
thickness_in = material["thickness_in"]
thickness_m = material["thickness_m"]
r_value = material["r_value"]
conductivity = material["conductivity"]
# ---------- end importmaterial ----------
importmaterial_2 = GhPythonScript(material_name=facade_cladding)  # -> r_per_in, embodied_carbon, type, thickness_in, thickness_m, conductivity, density, sp_heat, r_value; same code as importmaterial
importmaterial_3 = GhPythonScript(material_name=cont_ext_insulation)  # -> r_per_in, embodied_carbon, type, thickness_in, thickness_m, conductivity, density, sp_heat, r_value; same code as importmaterial
importmaterial_4 = GhPythonScript(material_name=interior_finish)  # -> r_per_in, embodied_carbon, type, thickness_in, thickness_m, conductivity, density, sp_heat, r_value; same code as importmaterial
panel_24 = Panel("Ext. Framing")
panel_25 = Panel("Interior Finish")
panel_26 = Panel("Cont. Ext. Insulation")
panel_27 = Panel("Facade Cladding")
multiplication = Multiplication(A="0.0254", B=insulation_thickness_in)

# ----
# Creates facade system name
txt = Text("Structural ")
concat_3 = Concatenate(FragmentA=txt, FragmentB=exterior_wall_framing)
case = TextCase(Text=facade_cladding, Culture=127)  # -> UpperCase, LowerCase
concat_4 = Concatenate(JoinSeparator=" ")
concat_5 = Concatenate(FragmentA=concat_3, FragmentB=case.LowerCase, JoinSeparator=" with ")
pane_glazing_system = Text(" pane glazing system")
concat_6 = Concatenate(FragmentA=concat_5, FragmentC=concat_4, JoinSeparator=" + ")
concat_7 = Concatenate(FragmentA=concat_6, FragmentC=pane_glazing_system)

panel_28 = Panel(concat_7)

# ----
# Massing 1: Creates mass from rhino curves
# and floor to ceiling ht
Z = UnitZ(Factor=height)
extr = Extrude(AdiabaticCrv=adiabaticcrv, Direction=Z)  # -> simplify(AdiabaticSrf)
boundary = BoundarySurfaces(FloorCrvs=[outsidecrv, adiabaticcrv])  # -> simplify(Surfaces)
extr_2 = Extrude(OutsideCrv=outsidecrv, Direction=Z)  # -> simplify(OutsideSrf)
move = Move(Geometry=boundary, Motion=Z)  # -> simplify(CeilingSrf), Transform
area = Area(Geometry=boundary)  # -> ZoneFloorArea, Centroid

# ----
# Massing 2: Creates massing geometry where
# face normals are pointing out
extr_3 = Extrude(Base=boundary, Direction=Z)
debrep = DeconstructBrep(Brep=extr_3)  # -> simplify(Faces), Edges, Vertices
match = MatchTree(Tree=debrep.Faces, Guide=extr_2)
area_2 = Area(Geometry=match)  # -> Area, Centroid
brep = Brep(match)

# ----
# Selects faces from Massing 2 that match Massing 1 for exterior walls
area_3 = Area(Geometry=extr_2)  # -> Area, Centroid
mindex = MemberIndex(Set=area_2.Centroid, Member=area_3.Centroid)  # -> Index, Count
srf = Surface([brep, extr_2])
trim = TrimTree(Tree=mindex.Index, Depth=1)
item = ListItem(List=srf, Index=trim, Wrap=True)
clean = CleanTree(RemoveNulls=True, RemoveInvalid=True, RemoveEmpty=True, Tree=item)  # -> simplify(Tree)
facen = FaceNormals(Mesh=clean)  # -> Centers, Normals
cullpt = CullDuplicates(Points=facen.Normals, Tolerance=0.1, CullMode=3)  # -> Points, Indices, Valence
devec = DeconstructVector(Vector=cullpt.Points)  # -> XComponent, YComponent, ZComponent

# ----
# Selects faces from Massing 2 that match Massing 1 for ceiling
area_4 = Area(Geometry=move.CeilingSrf)  # -> Area, Centroid
mindex_2 = MemberIndex(Set=area_2.Centroid, Member=area_4.Centroid)  # -> Index, Count
srf_2 = Surface([brep, move.CeilingSrf])
trim_2 = TrimTree(Tree=mindex_2.Index, Depth=1)
item_2 = ListItem(List=srf_2, Index=trim_2, Wrap=True)
final_ceiling = CleanTree(RemoveNulls=True, RemoveInvalid=True, RemoveEmpty=False, Tree=item_2)  # -> simplify(Tree)

# ----
# Selects faces from Massing 2 that match Massing 1 for interior walls
area_5 = Area(Geometry=extr)  # -> Area, Centroid
srf_3 = Surface([brep, extr])
mindex_3 = MemberIndex(Set=area_2.Centroid, Member=area_5.Centroid)  # -> Index, Count
trim_3 = TrimTree(Tree=mindex_3.Index, Depth=1)
item_3 = ListItem(List=srf_3, Index=trim_3, Wrap=True)
final_interior_wall = CleanTree(RemoveNulls=True, RemoveInvalid=True, RemoveEmpty=False, Tree=item_3)  # -> simplify(Tree)

# ----
# Logic to allow facades to rotate up to
# 44.9 degrees from cardinal directions.
# Creat North exterior wall surface
# Create South exterior wall surface
# Create East exterior wall surface
# Create West exterior wall surface
panel_29 = Panel("1")
larger = LargerThan(FirstNumber=devec.XComponent, SecondNumber="-0.707")  # -> LargerThan, OrEqualTo
smaller = SmallerThan(FirstNumber=devec.YComponent, SecondNumber="-0.707")  # -> SmallerThan, OrEqualTo
larger_2 = LargerThan(FirstNumber=devec.YComponent, SecondNumber="-1")  # -> LargerThan, OrEqualTo
smaller_2 = SmallerThan(FirstNumber=devec.YComponent, SecondNumber=panel_29)  # -> SmallerThan, OrEqualTo
larger_3 = LargerThan(FirstNumber=devec.YComponent, SecondNumber="0.707")  # -> LargerThan, OrEqualTo
smaller_3 = SmallerThan(FirstNumber=devec.XComponent, SecondNumber=panel_29)  # -> SmallerThan, OrEqualTo
smaller_4 = SmallerThan(FirstNumber=devec.XComponent, SecondNumber="0.707")  # -> SmallerThan, OrEqualTo
smaller_5 = SmallerThan(FirstNumber=devec.YComponent, SecondNumber="0.707")  # -> SmallerThan, OrEqualTo
larger_4 = LargerThan(FirstNumber=devec.YComponent, SecondNumber="-0.707")  # -> LargerThan, OrEqualTo
larger_5 = LargerThan(FirstNumber=devec.XComponent, SecondNumber="0.707")  # -> LargerThan, OrEqualTo
larger_6 = LargerThan(FirstNumber=devec.XComponent, SecondNumber="-1")  # -> LargerThan, OrEqualTo
smaller_6 = SmallerThan(FirstNumber=devec.XComponent, SecondNumber="-0.707")  # -> SmallerThan, OrEqualTo
and = GateAnd(A=larger.LargerThan, B=smaller_4.SmallerThan)
and_2 = GateAnd(A=larger_2.OrEqualTo, B=smaller.SmallerThan)
and_3 = GateAnd(A=larger_3.LargerThan, B=smaller_2.OrEqualTo)
and_4 = GateAnd(A=larger_5.LargerThan, B=smaller_3.OrEqualTo)
and_5 = GateAnd(A=larger_4.OrEqualTo, B=smaller_5.SmallerThan)
and_6 = GateAnd(A=larger_6.OrEqualTo, B=smaller_6.SmallerThan)
and_7 = GateAnd(A=and, B=and_3)
and_8 = GateAnd(A=and, B=and_2)
and_9 = GateAnd(A=and_5, B=and_6)
and_10 = GateAnd(A=and_4, B=and_5)
cull = CullPattern(List=graft(clean), CullPattern=and_8)
cull_2 = CullPattern(List=graft(clean), CullPattern=and_9)
cull_3 = CullPattern(List=graft(clean), CullPattern=and_10)
cull_4 = CullPattern(List=graft(clean), CullPattern=and_7)
pshift = ShiftPaths(Data=cull, Offset=-2)
pshift_2 = ShiftPaths(Data=cull_2, Offset=-2)
pshift_3 = ShiftPaths(Data=cull_4, Offset=-2)
pshift_4 = ShiftPaths(Data=cull_3, Offset=-2)
south_exterior_wall_final = CleanTree(RemoveNulls=True, RemoveInvalid=True, RemoveEmpty=True, Tree=pshift)
north_exterior_wall_final = CleanTree(RemoveNulls=True, RemoveInvalid=True, RemoveEmpty=True, Tree=pshift_3)
east_exterior_wall_final = CleanTree(RemoveNulls=True, RemoveInvalid=True, RemoveEmpty=True, Tree=pshift_4)
west_exterior_wall_final = CleanTree(RemoveNulls=True, RemoveInvalid=True, RemoveEmpty=True, Tree=pshift_2)

# ----
# Extract N, S, E, and W
# facade areas
area_6 = Area(Geometry=south_exterior_wall_final)  # -> Area, Centroid
area_7 = Area(Geometry=east_exterior_wall_final)  # -> Area, Centroid
area_8 = Area(Geometry=pshift_3)  # -> Area, Centroid
area_9 = Area(Geometry=west_exterior_wall_final)  # -> Area, Centroid
ma_3 = MassAddition(Input=area_8.Area)  # -> NFacadeAreaCsv, PartialResults
ma_4 = MassAddition(Input=area_6.Area)  # -> SFacadeAreaCsv, PartialResults
ma_5 = MassAddition(Input=area_9.Area)  # -> WFacadeAreaCsv, PartialResults
ma_6 = MassAddition(Input=area_7.Area)  # -> EFacadeAreaCsv, PartialResults

panel_30 = Panel(ma_5.WFacadeAreaCsv)
panel_31 = Panel(ma_6.EFacadeAreaCsv)
panel_32 = Panel(ma_3.NFacadeAreaCsv)
panel_33 = Panel(ma_4.SFacadeAreaCsv)

# ----
# Selects faces from Massing 2 that match Massing 1 for floor
srf_4 = Surface([brep, boundary])
area_10 = Area(Geometry=boundary)  # -> Area, Centroid
mindex_4 = MemberIndex(Set=area_2.Centroid, Member=area_10.Centroid)  # -> Index, Count
trim_4 = TrimTree(Tree=mindex_4.Index, Depth=1)
item_4 = ListItem(List=srf_4, Index=trim_4, Wrap=True)
final_floor_surface = CleanTree(RemoveNulls=True, RemoveInvalid=True, RemoveEmpty=False, Tree=item_4)  # -> simplify(Tree)

panel_34 = Panel(final_interior_wall)
panel_35 = Panel(final_ceiling)
panel_36 = Panel(final_floor_surface)
panel_37 = Panel(south_exterior_wall_final)
panel_38 = Panel(east_exterior_wall_final)
panel_39 = Panel(west_exterior_wall_final)
panel_40 = Panel(north_exterior_wall_final)

# ----
# Hi Preston & Tomas,
# 
# These are the N,S,E,W total window areas and opaque wall areas (in ft2) for the embodied carbon calcs
clean_2 = CleanTree(RemoveNulls=True, RemoveInvalid=True, RemoveEmpty=True, Tree=flatten(ma_3.NFacadeAreaCsv))
clean_3 = CleanTree(RemoveNulls=True, RemoveInvalid=True, RemoveEmpty=True, Tree=flatten(ma_6.EFacadeAreaCsv))
clean_4 = CleanTree(RemoveNulls=True, RemoveInvalid=True, RemoveEmpty=True, Tree=flatten(ma_4.SFacadeAreaCsv))
clean_5 = CleanTree(RemoveNulls=True, RemoveInvalid=True, RemoveEmpty=True, Tree=flatten(ma_5.WFacadeAreaCsv))
n_total_facade = MassAddition(Input=flatten(clean_2))  # -> Result, PartialResults
s_total_facade = MassAddition(Input=flatten(clean_4))  # -> Result, PartialResults
w_total_facade = MassAddition(Input=flatten(clean_5))  # -> Result, PartialResults
e_total_facade = MassAddition(Input=flatten(clean_3))  # -> Result, PartialResults
e_window_area = Multiplication(A=w_total_facade.Result, B=n_s_e_w_wwr.Branch3)
s_window_area = Multiplication(A=s_total_facade.Result, B=n_s_e_w_wwr.Branch1)
n_window_area = Multiplication(A=n_total_facade.Result, B=n_s_e_w_wwr.Branch0)
e_window_area_2 = Multiplication(A=e_total_facade.Result, B=n_s_e_w_wwr.Branch2)
n_opaque_area = Subtraction(A=n_total_facade.Result, B=n_window_area)
n_opaque_area_2 = Subtraction(A=w_total_facade.Result, B=e_window_area)
n_opaque_area_3 = Subtraction(A=s_total_facade.Result, B=s_window_area)
n_opaque_area_4 = Subtraction(A=e_total_facade.Result, B=e_window_area_2)
window_area_n_s_e_w = Entwine(Branch00=n_window_area, Branch01=s_window_area, Branch02=e_window_area_2, Branch03=e_window_area, FlattenInputs=True)  # -> simplify(Result)
opaque_area_n_s_e_w = Entwine(Branch00=n_opaque_area, Branch01=n_opaque_area_3, Branch02=n_opaque_area_4, Branch03=n_opaque_area_2, FlattenInputs=True)  # -> simplify(Result)
panel_41 = Panel(window_area_n_s_e_w)
panel_42 = Panel(opaque_area_n_s_e_w)

# ----
# Create Honeybee ceiling
panel_43 = Panel("RoofCeiling")
face = HBFace(geo=final_ceiling, name=panel_43, type=panel_43, bc="Adiabatic")  # -> report, faces; plug-in component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
match_2 = MatchTree(Tree=face.faces, Guide=final_ceiling)

# ----
# Create internal wall
panel_44 = Panel("Adiabatic Wall")
face_2 = HBFace(geo=final_interior_wall, name=panel_44, type="Wall", bc="Adiabatic")  # -> report, faces; plug-in component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
match_3 = MatchTree(Tree=face_2.faces, Guide=final_interior_wall)

# ----
# Create Honeybee floor
panel_45 = Panel("Floor")
face_3 = HBFace(geo=final_floor_surface, name=panel_45, type=panel_45, bc="Adiabatic")  # -> report, faces; plug-in component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
match_4 = MatchTree(Tree=face_3.faces, Guide=final_floor_surface)

# ----
# Create East exterior wall
# & apply windows and shades
face_4 = HBFace(geo=east_exterior_wall_final, name="Exposed Wall", type="Wall", bc="Outdoors")  # -> report, simplify(faces); plug-in component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
match_5 = MatchTree(Tree=face_4.faces, Guide=east_exterior_wall_final)
aperturesbyratio = HBAperturesByRatio(hb_objs=match_5, ratio=flatten(n_s_e_w_wwr.Branch2))  # -> report, hb_objs; plug-in component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

# ----
# Create North exterior wall
# & apply windows and shades
face_5 = HBFace(geo=north_exterior_wall_final, name="Exposed Wall", type="Wall", bc="Outdoors")  # -> report, simplify(faces); plug-in component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
match_6 = MatchTree(Tree=face_5.faces, Guide=north_exterior_wall_final)
aperturesbyratio_2 = HBAperturesByRatio(hb_objs=match_6, ratio=flatten(n_s_e_w_wwr.Branch0))  # -> report, hb_objs; plug-in component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

# ----
# Create West exterior wall
# & apply windows and shades
face_6 = HBFace(geo=west_exterior_wall_final, name="Exposed Wall", type="Wall", bc="Outdoors")  # -> report, simplify(faces); plug-in component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
match_7 = MatchTree(Tree=face_6.faces, Guide=west_exterior_wall_final)
aperturesbyratio_3 = HBAperturesByRatio(hb_objs=match_7, ratio=flatten(n_s_e_w_wwr.Branch3))  # -> report, hb_objs; plug-in component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

# ----
# Create South exterior wall
# & apply windows and shades
face_7 = HBFace(geo=south_exterior_wall_final, name="Exposed Wall", type="Wall", bc="Outdoors")  # -> report, simplify(faces); plug-in component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
match_8 = MatchTree(Tree=face_7.faces, Guide=south_exterior_wall_final)
aperturesbyratio_4 = HBAperturesByRatio(hb_objs=match_8, ratio=flatten(n_s_e_w_wwr.Branch1))  # -> report, hb_objs; plug-in component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

# ----
# Document python code to include units of outputs, etc...
# Create one python component that creates class that passes
# material properties to embodied and operational computations.
# Export JSON file for every simulation
importglazing = GhPythonScript(glazing_name=glazing)  # -> frame_type, glass_type, u_value, t_vis, embodied_carbon_metric, embodied_carbon_imperial
# ---------- importglazing: Python ----------
__author__ = "preston"

import rhinoscriptsyntax as rs
import sys

studiopath = "/Users/preston/Documents/GitHub/studio2021/src"
sys.path.append(studiopath)
import studio2021

from studio2021.functions import read_glazing

glazing = read_glazing(glazing_name)

print(glazing.keys())

frame_type = glazing['frame_type']
glass_type = glazing['glass_type']
u_value = glazing['u_value']
t_vis = glazing['t_vis']
embodied_carbon_metric = glazing['embodied_carbon_metric']
embodied_carbon_imperial = glazing['embodied_carbon_imperial']
# ---------- end importglazing ----------
opaquematnomass = HBOpaqueMaterialNoMass(name="Exterior Air Film", r_value=Slider(0.17, range=0..1))  # -> mat; plug-in component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
opaquemat = HBOpaqueMaterial(
    name=facade_cladding,
    thickness=importmaterial_2.thickness_m,
    conductivity=importmaterial_2.conductivity,
    density=importmaterial_2.density,
    spec_heat=importmaterial_2.sp_heat)  # -> mat; plug-in component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
opaquematnomass_2 = HBOpaqueMaterialNoMass(name="Air Gap", r_value=Slider(1, range=0..1))  # -> mat; plug-in component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
opaquemat_2 = HBOpaqueMaterial(
    name=exterior_wall_framing,
    thickness=importmaterial.thickness_m,
    conductivity=importmaterial.conductivity,
    density=importmaterial.density,
    spec_heat=importmaterial.sp_heat)  # -> mat; plug-in component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
opaquemat_3 = HBOpaqueMaterial(
    name=cont_ext_insulation,
    thickness=multiplication,
    conductivity=importmaterial_3.conductivity,
    density=importmaterial_3.density,
    spec_heat=importmaterial_3.sp_heat)  # -> mat; plug-in component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
opaquematnomass_3 = HBOpaqueMaterialNoMass(name="Interior Air Film", r_value=Slider(0.68, range=0..1))  # -> mat; plug-in component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
opaquemat_4 = HBOpaqueMaterial(
    name=interior_finish,
    thickness=importmaterial_4.thickness_m,
    conductivity=importmaterial_4.conductivity,
    density=importmaterial_4.density,
    spec_heat=importmaterial_4.sp_heat)  # -> mat; plug-in component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
loadobjects = HBLoadObjects()  # -> report, hb_objs; plug-in component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

# ----
# U-Value
panel_46 = Panel(importglazing.u_value)

windowmat = HBWindowMaterial(
    name="AluminumDoublePane",
    u_factor=flatten(importglazing.u_value),
    shgc=flatten(n_s_e_w_shgc.Branch0),
    t_vis=flatten(importglazing.t_vis))  # -> mat; plug-in component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
windowconstr = HBWindowConstruction(name="NGlass", materials=windowmat)  # -> constr; plug-in component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
applywindowconstr = HBApplyWindowConstruction(hb_objs=aperturesbyratio_2.hb_objs, constr=windowconstr)  # -> hb_objs; plug-in component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
louvershades = HBLouverShades(hb_objs=applywindowconstr, depth=flatten(n_s_e_w_shade_depth_m.Branch0))  # -> report, hb_objs; plug-in component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

windowmat_2 = HBWindowMaterial(
    name="AluminumDoublePane",
    u_factor=flatten(importglazing.u_value),
    shgc=flatten(n_s_e_w_shgc.Branch1),
    t_vis=flatten(importglazing.t_vis))  # -> mat; plug-in component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
windowconstr_2 = HBWindowConstruction(name="SGlass", materials=windowmat_2)  # -> constr; plug-in component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
applywindowconstr_2 = HBApplyWindowConstruction(hb_objs=aperturesbyratio_4.hb_objs, constr=windowconstr_2)  # -> hb_objs; plug-in component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
louvershades_2 = HBLouverShades(hb_objs=applywindowconstr_2, depth=flatten(n_s_e_w_shade_depth_m.Branch1))  # -> report, hb_objs; plug-in component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

windowmat_3 = HBWindowMaterial(
    name="AluminumDoublePane",
    u_factor=flatten(importglazing.u_value),
    shgc=flatten(n_s_e_w_shgc.Branch2),
    t_vis=flatten(importglazing.t_vis))  # -> mat; plug-in component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
windowconstr_3 = HBWindowConstruction(name="EGlass", materials=windowmat_3)  # -> constr; plug-in component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
applywindowconstr_3 = HBApplyWindowConstruction(hb_objs=aperturesbyratio.hb_objs, constr=windowconstr_3)  # -> hb_objs; plug-in component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
louvershades_3 = HBLouverShades(hb_objs=applywindowconstr_3, depth=flatten(n_s_e_w_shade_depth_m.Branch2), vertical=True)  # -> report, hb_objs; plug-in component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

windowmat_4 = HBWindowMaterial(
    name="AluminumDoublePane",
    u_factor=flatten(importglazing.u_value),
    shgc=flatten(n_s_e_w_shgc.Branch3),
    t_vis=flatten(importglazing.t_vis))  # -> mat; plug-in component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
windowconstr_4 = HBWindowConstruction(name="WGlass", materials=windowmat_4)  # -> constr; plug-in component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
applywindowconstr_4 = HBApplyWindowConstruction(hb_objs=aperturesbyratio_3.hb_objs, constr=windowconstr_4)  # -> hb_objs; plug-in component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
louvershades_4 = HBLouverShades(hb_objs=applywindowconstr_4, depth=flatten(n_s_e_w_shade_depth_m.Branch3), vertical=True)  # -> report, hb_objs; plug-in component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

# ----
# Creates Honeybee wall assembly
# to apply to zones
opaqueconstr = HBOpaqueConstruction(
    name=concat_5,
    materials=[opaquematnomass, opaquemat, opaquematnomass_2, opaquemat_2, opaquemat_3, opaquemat_4, opaquematnomass_3])  # -> constr; plug-in component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
exteriorsubset = HBExteriorConstructionSubset(exterior_wall=opaqueconstr)  # -> exterior_set; plug-in component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
constructionset = HBConstructionSet(name=concat_7, exterior_subset=exteriorsubset)  # -> constr_set; plug-in component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

n_s_e_w_exterior_walls = Merge(Data1=louvershades.hb_objs, Data2=louvershades_2.hb_objs, Data3=louvershades_3.hb_objs, Data4=louvershades_4.hb_objs)
remove_empy_zones = CleanTree(RemoveNulls=True, RemoveInvalid=True, RemoveEmpty=True, Tree=n_s_e_w_exterior_walls)
decnstrmat = HBDeconstructMaterial(mat=opaqueconstr)  # -> values, attr_names, r_val_si, r_val_ip; plug-in component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

# ----
# Wall Assembly
# R-Value
panel_47 = Panel(decnstrmat.r_val_ip)

# ----
# Combine all zone boundaries
# to create zones
clean_6 = CleanTree(RemoveNulls=True, RemoveInvalid=True, RemoveEmpty=True, Tree=[remove_empy_zones, match_3, match_4, match_2])
tstat = TreeStatistics(Tree=clean_6)  # -> Paths, Length, Count
zone_names = TreeBranch(Tree=simplify(zone), Path=tstat.Paths, MaintainPaths=True)
room = HBRoom(faces=clean_6, name=zone_names, program=list, conditioned=True)  # -> report, room; plug-in component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

# ----
# Applies custom wall material to zones
clean_7 = CleanTree(RemoveNulls=True, RemoveInvalid=True, RemoveEmpty=False, Tree=room.room)  # -> flatten(Tree)
applyconstrset = HBApplyConstructionSet(rooms=clean_7, constr_set=constructionset)  # -> rooms; plug-in component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

# ----
# Heating, Cooling, & Vent Set Points
applysetpointvals = HBApplySetpointValues(room_or_program=flatten(applyconstrset))  # -> report, mod_obj; plug-in component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
applyloadvals = HBApplyLoadValues(room_or_program=flatten(applysetpointvals.mod_obj))  # -> report, mod_obj; plug-in component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

model = HBModel(rooms=flatten(applyloadvals.mod_obj), name="1zone_run1")  # -> report, model; plug-in component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

# ----
# Energy Simulation
toggle = BooleanToggle(True)
simoutput = HBSimulationOutput(zone_energy_use=toggle, hvac_energy_use=toggle, gains_and_losses=toggle)  # -> report, sim_output; plug-in component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
simpar = HBSimulationParameter(output=simoutput.sim_output, timestep=6)  # -> sim_par; plug-in component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
modeltoosm = HBModelToOSM(model=model.model, epw_file=downloadepw.epw_file, sim_par=simpar, folder=panel, write=runsimulation, run=runsimulation)  # -> report, jsons, osw, osm, idf, sql, zsz, rdd, html; plug-in component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
roomenergyresult = HBReadRoomEnergyResult(sql=panel_2)  # -> cooling, heating, lighting, electric_equip, gas_equip, fan_electric, pump_electric, people_gain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; plug-in component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

# ----
# Label Rooms
roomenergyattr = HBRoomEnergyAttributes({"Program": "properties.energy.program_type.display_name", "Construction Set": "properties.energy.construction_set.display_name", "Is Conditioned": "properties.energy.is_conditioned", "People per Area [ppl/m2]": "properties.energy.people.people_per_area", "Area per Person [m2/ppl]": "properties.energy.people.area_per_person", "Lighting per Area [W/m2]": "properties.energy.lighting.watts_per_area", "Electric Equipment per Area [W/m2]": "properties.energy.electric_equipment.watts_per_area", "Gas Equipment per Area [W/m2]": "properties.energy.gas_equipment.watts_per_area", "Infiltration per Exterior Area [m3/s-m2]": "properties.energy.infiltration.flow_per_exterior_area", "Ventilation per Person [m3/s-ppl]": "properties.energy.ventilation.flow_per_person"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}, selected="Ventilation per Person [m3/s-ppl]")
faceenergyattr = HBFaceEnergyAttributes({"Construction": "properties.energy.construction.display_name", "Materials": "properties.energy.construction.layers", "R-Value": "properties.energy.construction.r_value", "U-Value": "properties.energy.construction.u_value", "U-Factor": "properties.energy.construction.u_factor", "Solar Transmitance [Unshaded]": "properties.energy.construction.solar_transmittance", "Solar Reflectance [Outside]": "properties.energy.construction.outside_solar_reflectance", "Solar Reflectance [Inside]": "properties.energy.construction.inside_solar_reflectance", "Fraction Area Operable": "properties.energy.vent_opening.fraction_area_operable", "Fraction Height Operable": "properties.energy.vent_opening.fraction_height_operable", "Discharge Coefficient": "properties.energy.vent_opening.discharge_coefficient", "Cross Ventilation": "properties.energy.vent_opening.wind_cross_vent"}, selected="Construction")
list_2 = ItemSelector(applyloadvals.mod_obj, {"Room: ZONE1", "Room: ZONE2"}, selected="Room: ZONE1")
labelrooms = HBLabelRooms(rooms_model=flatten(list_2), attribute=roomenergyattr)  # -> label_text, base_pts, labels, wire_frame; plug-in component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
vizbytype = HBVisualizeByType(rooms=applyloadvals.mod_obj)  # -> walls, interior_walls, roofs, ceilings, exterior_floors, interior_floors, air_walls, apertures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; plug-in component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
lablefaces = HBLabelFaces(hb_objs=flatten(list_2), attribute=faceenergyattr)  # -> label_text, base_pts, labels, wire_frame; plug-in component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

# ----
# Chart Results
number_slider_2 = Slider(1, range=0..100)
legendpar = LBLegendParameters(min=Slider(0, range=0..100), max=number_slider_2)  # -> leg_par; plug-in component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
monthlychart = LBMonthlyChart(data=roomenergyresult.lighting)  # -> report, data_mesh, data_lines, legend, borders, labels, y_title, title; plug-in component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
hourlyplot = LBHourlyPlot(data=flatten(roomenergyresult.solar_gain), legend_par=legendpar)  # -> report, mesh, legend, borders, labels, title; plug-in component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

# ----
# Zone Visualize Results
number_slider_3 = Slider(1, range=1..31)
number_slider_4 = Slider(1, range=1..12)
analysisperiod = LBAnalysisPeriod(
    start_month=number_slider_4,
    start_day=number_slider_3,
    start_hour=0,
    end_month=number_slider_4,
    end_day=Slider(31, range=1..31))  # -> period, hoys, dates; plug-in component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
colorrooms = HBColorRooms(
    data=flatten(roomenergyresult.solar_gain),
    rooms_model=flatten(applyloadvals.mod_obj),
    norm_by_flr=Toggle(True),
    period=analysisperiod.period,
    legend_par=legendpar)  # -> report, mesh, wire_frame, legend, title, rooms, colors, values; plug-in component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
vizquick = HBVizualizeQuick(hb_objs=flatten(colorrooms.rooms))  # -> geo; plug-in component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
preview = CustomPreview(Geometry=[colorrooms.legend, colorrooms.wire_frame], Material=ColourSwatch(SwatchColor=RGB(0, 0, 0)))
preview_2 = CustomPreview(Geometry=vizquick, Material=colorrooms.colors)

# ----
# Write to Excel
writetoexcel = WriteToExcel(
    T_10="1zone_run1",
    T=height,
    T_6=decnstrmat.r_val_ip,
    T_3=importglazing.u_value,
    T_2=north_wwr,
    T_4=north_shgc,
    T_5=north_shade_depth_in,
    T_8=south_wwr,
    T_9=south_shgc,
    T_7=south_shade_depth_in,
    T_13=east_wwr,
    T_11=east_shgc,
    T_12=east_shade_depth_in,
    T_15=west_wwr,
    T_16=west_shgc,
    T_14=west_shade_depth_in,
    D=area.ZoneFloorArea,
    data_si_3=roomenergyresult.cooling,
    data_si_4=roomenergyresult.heating,
    data_si_2=roomenergyresult.lighting,
    data_si=roomenergyresult.electric_equip,
    D_5=ma_3.NFacadeAreaCsv,
    D_3=ma_4.SFacadeAreaCsv,
    D_2=ma_6.EFacadeAreaCsv,
    D_4=ma_5.WFacadeAreaCsv,
    save=savecsv,
    path=panel_4)

# ==== cluster WriteToExcel
data_si = ClusterInput()
data_si_2 = ClusterInput()
data_si_3 = ClusterInput()
data_si_4 = ClusterInput()
toip = LBToIP(data_si=data_si)  # -> data_ip; plug-in component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
toip_2 = LBToIP(data_si=data_si_3)  # -> data_ip; plug-in component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
toip_3 = LBToIP(data_si=data_si_2)  # -> data_ip; plug-in component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
toip_4 = LBToIP(data_si=data_si_4)  # -> data_ip; plug-in component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
xdata = LBDeconstructData(data=toip)  # -> flatten(header), values; plug-in component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
xdata_2 = LBDeconstructData(data=toip_2)  # -> flatten(header), values; plug-in component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
xdata_3 = LBDeconstructData(data=toip_3)  # -> flatten(header), values; plug-in component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
D = ClusterInput()
xdata_4 = LBDeconstructData(data=toip_4)  # -> flatten(header), values; plug-in component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
ma = MassAddition(Input=flatten(D))  # -> Result, PartialResults
bang = ExplodeTree(Data=xdata_2.values)  # -> Branch0, Branch1, Branch2, Branch3, Branch4
bang_2 = ExplodeTree(Data=D)  # -> Branch0, Branch1, Branch2, Branch3, Branch4
input = ClusterInput()
bang_3 = ExplodeTree(Data=xdata.values)  # -> Branch0, Branch1, Branch2, Branch3, Branch4
panel = Panel(",,,,,,,,,,,,,,,,,,,,,,,,,,,,,,,,")
T = ClusterInput()
T_2 = ClusterInput()
T_3 = ClusterInput()
T_4 = ClusterInput()
T_5 = ClusterInput()
T_6 = ClusterInput()
T_7 = ClusterInput()
T_8 = ClusterInput()
bang_4 = ExplodeTree(Data=xdata_4.values)  # -> Branch0, Branch1, Branch2, Branch3, Branch4
T_9 = ClusterInput()
T_10 = ClusterInput()
concat = Concatenate(FragmentA=ma.Result, FragmentB=",")
T_11 = ClusterInput()
bang_5 = ExplodeTree(Data=xdata_3.values)  # -> Branch0, Branch1, Branch2, Branch3, Branch4
T_12 = ClusterInput()
T_13 = ClusterInput()
T_14 = ClusterInput()
T_15 = ClusterInput()
T_16 = ClusterInput()
concat_2 = Concatenate(FragmentA=bang_2.Branch0, FragmentB=",")
concat_3 = Concatenate(FragmentA=bang_2.Branch1, FragmentB=",")
concat_4 = Concatenate(FragmentA=bang_2.Branch2, FragmentB=",")
D_2 = ClusterInput()
join = TextJoin(Text=["Wall Assembly R Value,", T_6, ",,,,,,,,,,,,,,,,,,,,,,,,,,,,,,,,"])
join_2 = TextJoin(Text=["U Value window,", T_3, ",,,,,,,,,,,,,,,,,,,,,,,,,,,,,,,,"])
join_3 = TextJoin(Text=["N Shade depth,", T_5, ",,,,,,,,,,,,,,,,,,,,,,,,,,,,,,,,"])
concat_5 = Concatenate(FragmentA=bang_2.Branch3, FragmentB=",")
join_4 = TextJoin(Text=["N WWR,", T_2, ",,,,,,,,,,,,,,,,,,,,,,,,,,,,,,,,"])
concat_6 = Concatenate(FragmentA=bang_2.Branch4, FragmentB=",")
join_5 = TextJoin(Text=["N SHGC,", T_4, ",,,,,,,,,,,,,,,,,,,,,,,,,,,,,,,,"])
D_3 = ClusterInput()
join_6 = TextJoin(Text=["Height (ft),", T, ",,,,,,,,,,,,,,,,,,,,,,,,,,,,,,,,"])
D_4 = ClusterInput()
join_7 = TextJoin(Text=["S Shade depth,", T_7, ",,,,,,,,,,,,,,,,,,,,,,,,,,,,,,,,"])
join_8 = TextJoin(Text=["S WWR,", T_8, ",,,,,,,,,,,,,,,,,,,,,,,,,,,,,,,,"])
join_9 = TextJoin(Text=["S SHGC,", T_9, ",,,,,,,,,,,,,,,,,,,,,,,,,,,,,,,,"])
join_10 = TextJoin(Text=[T_10, panel])
D_5 = ClusterInput()
join_11 = TextJoin(Text=["Seattle", panel])
join_12 = TextJoin(Text=["E Shade depth,", T_12, ",,,,,,,,,,,,,,,,,,,,,,,,,,,,,,,,"])
join_13 = TextJoin(Text=["E WWR,", T_13, ",,,,,,,,,,,,,,,,,,,,,,,,,,,,,,,,"])
panel_2 = Panel("Time, Cooling Engery (kWh) Zone1, Cooling Engery (kBtu) Zone2, Cooling Engery (kBtu) Zone3, Cooling Engery (kBtu) Zone4, Cooling Engery (kBtu) Zone5, Heating Engery (kBtu) Zone1, Heating Engery (kBtu) Zone2, Heating Engery (kBtu) Zone3, Heating Engery (kBtu) Zone4, Heating Engery (kBtu) Zone5, Electric Light Engery (kBtu) Zone1, Electric Light (kBtu) Zone2, Electric Light Energy (kBtu) Zone3, Electric Light Energy (kBtu) Zone4, Electric Light Energy (kBtu) Zone5, Equipment Engery (kBtu) Zone1, Equipment Engery (kBtu) Zone2, Equipment Engery (kBtu) Zone3, Equipment Engery (kBtu) Zone4, Equipment Engery (kBtu) Zone5,")
join_14 = TextJoin(Text=["E SHGC,", T_11, ",,,,,,,,,,,,,,,,,,,,,,,,,,,,,,,,"])
ma_2 = MassAddition(Input=bang.Branch0)  # -> Result, PartialResults
ma_3 = MassAddition(Input=bang.Branch1)  # -> Result, PartialResults
join_15 = TextJoin(Text=["W Shade depth,", T_14, ",,,,,,,,,,,,,,,,,,,,,,,,,,,,,,,,"])
join_16 = TextJoin(Text=["W WWR,", T_15, ",,,,,,,,,,,,,,,,,,,,,,,,,,,,,,,,"])
ma_4 = MassAddition(Input=bang.Branch2)  # -> Result, PartialResults
ma_5 = MassAddition(Input=bang.Branch3)  # -> Result, PartialResults
ma_6 = MassAddition(Input=bang.Branch4)  # -> Result, PartialResults
join_17 = TextJoin(Text=["W SHGC,", T_16, ",,,,,,,,,,,,,,,,,,,,,,,,,,,,,,,,"])
ma_7 = MassAddition(Input=bang_3.Branch0)  # -> Result, PartialResults
ma_8 = MassAddition(Input=bang_3.Branch1)  # -> Result, PartialResults
ma_9 = MassAddition(Input=bang_3.Branch2)  # -> Result, PartialResults
analysisperiod = LBAnalysisPeriod(start_month=1, start_day=1, start_hour=0)  # -> period, hoys, flatten(dates); plug-in component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
ma_10 = MassAddition(Input=bang_3.Branch3)  # -> Result, PartialResults
ma_11 = MassAddition(Input=bang_3.Branch4)  # -> Result, PartialResults
ma_12 = MassAddition(Input=bang_4.Branch0)  # -> Result, PartialResults
ma_13 = MassAddition(Input=bang_4.Branch1)  # -> Result, PartialResults
ma_14 = MassAddition(Input=bang_4.Branch2)  # -> Result, PartialResults
ma_15 = MassAddition(Input=bang_4.Branch3)  # -> Result, PartialResults
ma_16 = MassAddition(Input=bang_4.Branch4)  # -> Result, PartialResults
ma_17 = MassAddition(Input=bang_5.Branch0)  # -> Result, PartialResults
ma_18 = MassAddition(Input=bang_5.Branch1)  # -> Result, PartialResults
ma_19 = MassAddition(Input=bang_5.Branch2)  # -> Result, PartialResults
panel_3 = Panel(D_5)
ma_20 = MassAddition(Input=bang_5.Branch3)  # -> Result, PartialResults
ma_21 = MassAddition(Input=bang_5.Branch4)  # -> Result, PartialResults
entwine = Entwine(
    Branch00=concat_2,
    Branch01=concat_3,
    Branch02=concat_4,
    Branch03=concat_5,
    Branch04=concat_6,
    Branch05=concat,
    FlattenInputs=True)  # -> flatten(Result)
bang_6 = ExplodeTree(Data=D_2)  # -> Branch0, Branch1, Branch2, Branch3
bang_7 = ExplodeTree(Data=D_3)  # -> Branch0, Branch1, Branch2, Branch3
bang_8 = ExplodeTree(Data=D_4)  # -> Branch0, Branch1, Branch2, Branch3
bang_9 = ExplodeTree(Data=D_5)  # -> Branch0, Branch1, Branch2, Branch3
division = Division(A=ma_2.Result, B=bang_2.Branch0)
division_2 = Division(A=ma_4.Result, B=bang_2.Branch2)
division_3 = Division(A=ma_3.Result, B=bang_2.Branch1)
division_4 = Division(A=ma_5.Result, B=bang_2.Branch3)
division_5 = Division(A=ma_6.Result, B=bang_2.Branch4)
division_6 = Division(A=ma_7.Result, B=bang_2.Branch0)
division_7 = Division(A=ma_9.Result, B=bang_2.Branch2)
ma_22 = MassAddition(Input=flatten([ma_2.Result, ma_12.Result, ma_17.Result, ma_7.Result]))  # -> Result, PartialResults
division_8 = Division(A=ma_8.Result, B=bang_2.Branch1)
division_9 = Division(A=ma_10.Result, B=bang_2.Branch3)
ma_23 = MassAddition(Input=flatten([bang.Branch3, bang_4.Branch3, bang_3.Branch3]))  # -> Result, PartialResults
ma_24 = MassAddition(Input=flatten([ma_4.Result, bang_4.Branch2, bang_5.Branch2, bang_3.Branch2]))  # -> Result, PartialResults
division_10 = Division(A=ma_11.Result, B=bang_2.Branch4)
division_11 = Division(A=ma_12.Result, B=bang_2.Branch0)
division_12 = Division(A=ma_14.Result, B=bang_2.Branch2)
division_13 = Division(A=ma_13.Result, B=bang_2.Branch1)
division_14 = Division(A=ma_15.Result, B=bang_2.Branch3)
ma_25 = MassAddition(Input=flatten([bang.Branch4, bang_4.Branch4, bang_5.Branch4, bang_3.Branch4]))  # -> Result, PartialResults
division_15 = Division(A=ma_16.Result, B=bang_2.Branch4)
ma_26 = MassAddition(Input=flatten([ma_3.Result, ma_13.Result, ma_18.Result, ma_8.Result]))  # -> Result, PartialResults
division_16 = Division(A=ma_21.Result, B=bang_2.Branch4)
division_17 = Division(A=ma_17.Result, B=bang_2.Branch0)
division_18 = Division(A=ma_19.Result, B=bang_2.Branch2)
division_19 = Division(A=ma_18.Result, B=bang_2.Branch1)
division_20 = Division(A=ma_20.Result, B=bang_2.Branch3)
concat_7 = Concatenate(FragmentA=division_2, FragmentB=",")  # -> flatten(Result)
concat_8 = Concatenate(FragmentA=division_4, FragmentB=",")  # -> flatten(Result)
concat_9 = Concatenate(FragmentA=division_3, FragmentB=",")  # -> flatten(Result)
concat_10 = Concatenate(FragmentA=division, FragmentB=",")  # -> flatten(Result)
concat_11 = Concatenate(FragmentA=division_5, FragmentB=",")  # -> flatten(Result)
join_18 = TextJoin(Text=["Floor Area (ft2),", entwine])
entwine_2 = Entwine(
    Branch00=analysisperiod.dates,
    Branch01=bang.Branch0,
    Branch02=bang.Branch1,
    Branch03=bang.Branch2,
    Branch04=bang.Branch3,
    Branch05=bang.Branch4,
    Branch06=bang_4.Branch0,
    Branch07=bang_4.Branch1,
    Branch08=bang_4.Branch2,
    Branch09=bang_4.Branch3,
    Branch010=bang_4.Branch4,
    Branch011=bang_5.Branch0,
    Branch012=bang_5.Branch1,
    Branch013=bang_5.Branch2,
    Branch014=bang_5.Branch3,
    Branch015=bang_5.Branch4,
    Branch016=bang_3.Branch0,
    Branch017=bang_3.Branch1,
    Branch018=bang_3.Branch2,
    Branch019=bang_3.Branch3,
    Branch020=bang_3.Branch4,
    FlattenInputs=True)  # -> simplify(Result)
concat_12 = Concatenate(FragmentA=bang_6.Branch1, FragmentB=",")  # -> flatten(Result)
concat_13 = Concatenate(FragmentA=bang_6.Branch0, FragmentB=",")  # -> flatten(Result)
concat_14 = Concatenate(FragmentA=bang_6.Branch3, FragmentB=",")  # -> flatten(Result)
concat_15 = Concatenate(FragmentA=bang_6.Branch2, FragmentB=",")  # -> flatten(Result)
concat_16 = Concatenate(FragmentA=bang_7.Branch1, FragmentB=",")  # -> flatten(Result)
concat_17 = Concatenate(FragmentA=bang_7.Branch0, FragmentB=",")  # -> flatten(Result)
concat_18 = Concatenate(FragmentA=division_7, FragmentB=",")  # -> flatten(Result)
concat_19 = Concatenate(FragmentA=bang_7.Branch3, FragmentB=",")  # -> flatten(Result)
concat_20 = Concatenate(FragmentA=bang_8.Branch1, FragmentB=",")  # -> flatten(Result)
concat_21 = Concatenate(FragmentA=bang_7.Branch2, FragmentB=",")  # -> flatten(Result)
concat_22 = Concatenate(FragmentA=bang_8.Branch0, FragmentB=",")  # -> flatten(Result)
concat_23 = Concatenate(FragmentA=bang_8.Branch3, FragmentB=",")  # -> flatten(Result)
concat_24 = Concatenate(FragmentA=division_9, FragmentB=",")  # -> flatten(Result)
concat_25 = Concatenate(FragmentA=bang_8.Branch2, FragmentB=",")  # -> flatten(Result)
concat_26 = Concatenate(FragmentA=division_8, FragmentB=",")  # -> flatten(Result)
concat_27 = Concatenate(FragmentA=division_6, FragmentB=",")  # -> flatten(Result)
concat_28 = Concatenate(FragmentA=division_10, FragmentB=",")  # -> flatten(Result)
concat_29 = Concatenate(FragmentA=division_12, FragmentB=",")  # -> flatten(Result)
concat_30 = Concatenate(FragmentA=bang_9.Branch1, FragmentB=",")  # -> flatten(Result)
concat_31 = Concatenate(FragmentA=bang_9.Branch0, FragmentB=",")  # -> flatten(Result)
concat_32 = Concatenate(FragmentA=bang_9.Branch3, FragmentB=",")  # -> flatten(Result)
concat_33 = Concatenate(FragmentA=division_14, FragmentB=",")  # -> flatten(Result)
concat_34 = Concatenate(FragmentA=bang_9.Branch2, FragmentB=",")  # -> flatten(Result)
division_21 = Division(A=ma_22.Result, B=bang_2.Branch0)
concat_35 = Concatenate(FragmentA=division_13, FragmentB=",")  # -> flatten(Result)
concat_36 = Concatenate(FragmentA=division_11, FragmentB=",")  # -> flatten(Result)
division_22 = Division(A=ma_25.Result, B=bang_2.Branch4)
concat_37 = Concatenate(FragmentA=division_15, FragmentB=",")  # -> flatten(Result)
concat_38 = Concatenate(FragmentA=division_18, FragmentB=",")  # -> flatten(Result)
division_23 = Division(A=ma_23.Result, B=bang_2.Branch3)
concat_39 = Concatenate(FragmentA=division_20, FragmentB=",")  # -> flatten(Result)
concat_40 = Concatenate(FragmentA=division_19, FragmentB=",")  # -> flatten(Result)
division_24 = Division(A=ma_24.Result, B=bang_2.Branch2)
division_25 = Division(A=ma_26.Result, B=bang_2.Branch1)
concat_41 = Concatenate(FragmentA=division_17, FragmentB=",")  # -> flatten(Result)
concat_42 = Concatenate(FragmentA=division_16, FragmentB=",")  # -> flatten(Result)
concat_43 = Concatenate(FragmentA=division_21, FragmentB=",")  # -> flatten(Result)
merge = Merge(Data1=panel_2, Data2=entwine_2)
concat_44 = Concatenate(FragmentA=division_25, FragmentB=",")  # -> flatten(Result)
concat_45 = Concatenate(FragmentA=division_24, FragmentB=",")  # -> flatten(Result)
concat_46 = Concatenate(FragmentA=division_22, FragmentB=",")  # -> flatten(Result)
concat_47 = Concatenate(FragmentA=division_23, FragmentB=",")  # -> flatten(Result)
ma_27 = MassAddition(Input=flatten([bang_6.Branch0, bang_6.Branch1, bang_6.Branch2, bang_6.Branch3]))  # -> Result, PartialResults
ma_28 = MassAddition(Input=flatten([ma_2.Result, ma_3.Result, ma_4.Result, ma_5.Result, ma_6.Result]))  # -> Result, PartialResults
ma_29 = MassAddition(Input=flatten([ma_17.Result, ma_18.Result, ma_19.Result, ma_20.Result, ma_21.Result]))  # -> Result, PartialResults
ma_30 = MassAddition(Input=flatten([bang_7.Branch0, bang_7.Branch1, bang_7.Branch2, bang_7.Branch3]))  # -> Result, PartialResults
ma_31 = MassAddition(Input=flatten([ma_7.Result, ma_8.Result, ma_9.Result, ma_10.Result, ma_11.Result]))  # -> Result, PartialResults
ma_32 = MassAddition(Input=flatten([bang_8.Branch0, bang_8.Branch1, bang_8.Branch2, bang_8.Branch3]))  # -> Result, PartialResults
ma_33 = MassAddition(Input=flatten([ma_12.Result, ma_13.Result, ma_14.Result, ma_15.Result, ma_16.Result]))  # -> Result, PartialResults
ma_34 = MassAddition(Input=flatten([ma_28.Result, ma_33.Result, ma_29.Result, ma_31.Result]))  # -> Result, PartialResults
division_26 = Division(A=ma_34.Result, B=ma.Result)
concat_48 = Concatenate(FragmentA=division_26, FragmentB=",")  # -> flatten(Result)
ma_35 = MassAddition(Input=flatten([bang_9.Branch0, bang_9.Branch1, bang_9.Branch2, bang_9.Branch3]))  # -> Result, PartialResults
flip = FlipMatrix(Data=entwine_2)
division_27 = Division(A=ma_29.Result, B=ma.Result)
concat_49 = Concatenate(FragmentA=ma_27.Result, FragmentB=",")  # -> flatten(Result)
division_28 = Division(A=ma_28.Result, B=ma.Result)
division_29 = Division(A=ma_33.Result, B=ma.Result)
concat_50 = Concatenate(FragmentA=ma_30.Result, FragmentB=",")  # -> flatten(Result)
concat_51 = Concatenate(FragmentA=ma_32.Result, FragmentB=",")  # -> flatten(Result)
concat_52 = Concatenate(FragmentA=ma_35.Result, FragmentB=",")  # -> flatten(Result)
join_19 = TextJoin(Text=["Total EUI (kBtu/sf/year),", concat_43, concat_44, concat_45, concat_47, concat_46, concat_48])
division_30 = Division(A=ma_31.Result, B=ma.Result)
concat_53 = Concatenate(FragmentA=division_27, FragmentB=",")  # -> flatten(Result)
concat_54 = Concatenate(FragmentA=division_28, FragmentB=",")  # -> flatten(Result)
join_20 = TextJoin(Text=["Cooling EUI (kBtu/sf/year),", concat_10, concat_9, concat_7, concat_8, concat_11, concat_54])
join_21 = TextJoin(Text=flip, Join=",")
concat_55 = Concatenate(FragmentA=division_29, FragmentB=",")  # -> flatten(Result)
join_22 = TextJoin(Text=["East Facade Area (ft2),", concat_13, concat_12, concat_15, concat_14, concat_49])
join_23 = TextJoin(Text=["Heating EUI (kBtu/sf/year),", concat_36, concat_35, concat_29, concat_33, concat_37, concat_55])
join_24 = TextJoin(Text=["South Facade Area (ft2),", concat_17, concat_16, concat_21, concat_19, concat_50])
join_25 = TextJoin(Text=["West Facade Area (ft2),", concat_22, concat_20, concat_25, concat_23, concat_51])
join_26 = TextJoin(Text=["Lighting EUI (kBtu/sf/year),", concat_41, concat_40, concat_38, concat_39, concat_42, concat_53])
join_27 = TextJoin(Text=["North Facade Area (ft2),", concat_31, concat_30, concat_34, concat_32, concat_52])
concat_56 = Concatenate(FragmentA=division_30, FragmentB=",")  # -> flatten(Result)
join_28 = TextJoin(Text=["Equip EUI (kBtu/sf/year),", concat_27, concat_26, concat_18, concat_24, concat_28, concat_56])
save = ClusterInput()
path = ClusterInput()
entwine_3 = Entwine(
    Branch00=join_10,
    Branch01=join_11,
    Branch02=panel,
    Branch03=join_6,
    Branch04=join,
    Branch05=join_2,
    Branch06=panel,
    Branch07=join_4,
    Branch08=join_5,
    Branch09=join_3,
    Branch010=join_8,
    Branch011=join_9,
    Branch012=join_7,
    Branch013=join_13,
    Branch014=join_14,
    Branch015=join_12,
    Branch016=join_16,
    Branch017=join_17,
    Branch018=join_15,
    Branch019=panel,
    Branch020=", Zone1, Zone2, Zone3, Zone4,Zone5,Total,,,,,,,,,,,,,,,,,,",
    Branch021=join_18,
    Branch022=join_20,
    Branch023=join_23,
    Branch024=join_26,
    Branch025=join_28,
    Branch026=join_19,
    Branch027=panel,
    Branch028=", Zone1, Zone2, Zone3, Zone4,Total,,,,,,,,,,,,,,,,,,",
    Branch029=join_27,
    Branch030=join_24,
    Branch031=join_22,
    Branch032=join_25,
    Branch033=panel,
    Branch034=panel_2,
    Branch035=join_21,
    FlattenInputs=True)  # -> flatten(Result)
c_script = CSharpScript(save=save, path=path, data=entwine_3)  # inputs save: Boolean, path: String, data: list of String
# ---------- c_script: C# ----------
    if(save){
      var fileinfo = new System.IO.FileInfo(path);
      if(!fileinfo.Directory.Exists){
        fileinfo.Directory.Create();
      }

      var sw = fileinfo.CreateText();
      for(int i = 0; i < data.Count; i++){
        string row = data[i];
        if(i < data.Count - 1){
          sw.WriteLine(row);
        }else{
          sw.Write(row);
        }
      }
      sw.Flush();
      sw.Close();
    }
# ---------- end c_script ----------
panel_4 = Panel(entwine_3)
