# Grasshopper definition exhaustive.gh (Grasshopper 1.0.7)

number_slider = Slider(6, range=0..10)
number_slider_2 = Slider(1, range=0..10)
panel = Panel("""0
15
15
15
15
15
15
15
15
15
15""")
panel_2 = Panel("""0
25
15
22
20
15
20
20
15""")
line = Line()
line_2 = Line()
pt = Point(Point(0, 0, 0))

# ----
# Choose
# Location!
list = ValueList({"Seattle, WA": 0, "Milwaukee, WI": 1, "San Antonio, TX": 2}, selected="Milwaukee, WI")

make_grid = GhPythonScript(
    sp=pt,
    span_x=panel,
    span_y=panel_2,
    xaxis=line,
    yaxis=line_2,
    height=Slider(10, range=0..10),
    core=[Slider(0, range=0..10), Slider(0, range=0..10)])  # -> out, columns, beams_x, beams_y, cores; inputs span_x: list, span_y: list, core: list of Int32
# ---------- make_grid: Python ----------
import rhinoscriptsyntax as rs

from studio2021.functions import make_grid
reload(make_grid)
from studio2021.functions.make_grid import make_grid_structure


columns, beams_x, beams_y, cores = make_grid_structure(sp,
                                                       span_x,
                                                       span_y,
                                                       xaxis,
                                                       yaxis,
                                                       height,
                                                       core)
# ---------- end make_grid ----------
residential_20_glazing = Brep(<brep referenced from the Rhino model>)
adiabaticcrvfromrhino = Curve([<curve referenced from the Rhino model> x3])
program = Panel("2013::MedriseApartment::Apartment")
outsidecrvfromrhino = Curve(<curve referenced from the Rhino model>)
residential_40_glazing = Brep(<brep referenced from the Rhino model>)
residential_60_glazing = Brep(<brep referenced from the Rhino model>)
residential_80_glazing = Brep(<brep referenced from the Rhino model>)
residential_horizontal_fins = Brep(<brep referenced from the Rhino model>)
residential_vert_fins = Brep([<brep referenced from the Rhino model> x7])
office_20_glazing = Brep(<brep referenced from the Rhino model>)
program_2 = Panel("2013::MediumOffice::OpenOffice")
office_40_glazing = Brep(<brep referenced from the Rhino model>)
office_60_glazing = Brep(<brep referenced from the Rhino model>)
office_80_glazing = Brep(<brep referenced from the Rhino model>)
outsidecrvfromrhino_2 = Curve(<curve referenced from the Rhino model>)
adiabaticcrvfromrhino_2 = Curve([<curve referenced from the Rhino model> x3])
office_vert_fins = Brep([<brep referenced from the Rhino model> x30])
crv = Curve([<curve referenced from the Rhino model> x4])
office_horizontal_fins = Brep(<brep referenced from the Rhino model>)
cities = GhPythonScript(city=list)  # -> out, city, weather_file, kgCo2e_kwh
# ---------- cities: Python ----------
__author__ = "tmendeze"

import rhinoscriptsyntax as rs

from studio2021.functions import city_carbon
reload(city_carbon)
from studio2021.functions.city_carbon import city_EUI
from studio2021.functions.city_carbon import weather

cities = {0: 'Seattle',
          1: 'Milwaukee',
          2: 'San Antonio'}

city = cities[city]
kgCo2e_kwh = city_EUI(city)['kg/kWh']
weather_file = weather(city)
# ---------- end cities ----------
num_floors_above = Slider(10, range=0..10)
trim_grid = GhPythonScript(polyline=crv, columns=make_grid.columns, beams_x=make_grid.beams_x, beams_y=make_grid.beams_y, cores=make_grid.cores)  # -> out, columns, beams_x, beams_y, cores; inputs polyline: list, columns: list, beams_x: list, beams_y: list, cores: list
# ---------- trim_grid: Python ----------
import rhinoscriptsyntax as rs

from studio2021.functions import make_grid
reload(make_grid)
from studio2021.functions.make_grid import trim_structure


columns, beams_x, beams_y, cores = trim_structure(polyline,
                                                  columns,
                                                  beams_x,
                                                  beams_y,
                                                  cores)
# ---------- end trim_grid ----------
building_type = ValueList({"Type 3", "Type 4A", "Type 4B", "Type 4C", "Type 5"}, selected="Type 4A")
composite_slab = BooleanToggle(False)
beams_x = Curve(trim_grid.beams_x)
beams_y = Curve(trim_grid.beams_y)
columns = Curve(trim_grid.columns)
cores = Curve(trim_grid.cores)

# ----
# Run Energy
# Simulation
run_energy_simulation = BooleanToggle(True)

panel_3 = Panel(trim_grid.out)
beams_x_2 = Curve(flatten(beams_x))
beams_y_2 = Curve(flatten(beams_y))
columns_2 = Curve(flatten(columns))
core = Curve(flatten(cores))
number_slider_3 = Slider(0, range=0..15)
list_2 = ValueList({"North": 1, "South": 2, "East": 3, "West": 4}, selected="South")
subtraction = Subtraction(A=list_2, B=1)
filter = StreamFilter(Gate=subtraction, Stream1=residential_horizontal_fins, Stream2=residential_vert_fins, Stream3=residential_vert_fins)
filter_2 = StreamFilter(Gate=subtraction, Stream1=office_horizontal_fins, Stream2=office_vert_fins, Stream3=office_vert_fins)
list_3 = ValueList({"Residential": 0, "Office": 1}, selected="Residential")
zone_name = StreamFilter(Gate=list_3, Stream0="residential_zone", Stream1="office_zone")
zone_height = StreamFilter(Gate=list_3, Stream0="10", Stream1="9")
outside_crv = StreamFilter(Gate=list_3, Stream0=outsidecrvfromrhino, Stream1=outsidecrvfromrhino_2)
adiabatic_crv = StreamFilter(Gate=list_3, Stream0=adiabaticcrvfromrhino, Stream1=adiabaticcrvfromrhino_2)
parameter_generator = GhPythonScript()  # -> out, param
# ---------- parameter_generator: Python ----------
__author__ = "tmendeze"

import rhinoscriptsyntax as rs

shading         = [0, 30]
wwr             = [0, 20, 40, 60, 80]
glazing         = [2, 3]
shgc            = [0, 1]
ext_ins_mat     = [0, 1]
ext_ins_t       = [0, 4, 8]
int_ins_mat     = [0, 1]
int_ins_t       = [6, 8, 10]

param = []
for s in shading:
    for w in wwr:
        for g in glazing:
            for shg in shgc:
                for eim in ext_ins_mat:
                    for eit in ext_ins_t:
                        for iim in int_ins_mat:
                            for iit in int_ins_t:
                                param.append([s, w, g, shg, eim, eit, iim, iit])
# ---------- end parameter_generator ----------
program_3 = StreamFilter(Gate=list_3, Stream0=program, Stream1=program_2)
parameters = GhPythonScript(param=parameter_generator.param, i=Slider(1283, range=0..1439), city=cities.city, orientation=list_2)  # -> out, shading, wwr, glazing, shgc, ext_ins_mat, ext_ins_t, int_ins_mat, int_ins_t, filename; inputs param: list, i: Int32
# ---------- parameters: Python ----------
__author__ = "tmendeze"

import rhinoscriptsyntax as rs

gld = {2: 'Aluminum Double', 3: 'Aluminum Triple'}
shgcd = {0: .2, 1: .6}
exm_d = {0: 'EPS', 1:'Polyiso'}
inm_d = {0: 'Fiberglass', 1:'Cellulose'}
int_d = {6:'2x6 Wood Studs',8:'2x8 Wood Studs', 10:'2x10 Wood Studs'}

p = param[i]

shading         = p[0]
wwr             = p[1] / 100.
glazing         = gld[p[2]]
shgc            = shgcd[p[3]]
ext_ins_mat     = exm_d[p[4]]
ext_ins_t       = p[5]
int_ins_mat     = inm_d[p[6]]
int_ins_t       = int_d[p[7]]

cdict = {'San Antonio'  : 'sa',
         'Seattle'      : 'se',
         'Milwaukee'    : 'mi',
         }

odict = {1:'n', 2:'s', 3:'w', 4:'e'}


filename = '{}_{}_'.format(cdict[city], odict[orientation])
for n in p:
    filename += str(n) +'_'
filename = filename[:-1]
# ---------- end parameters ----------

# ----
# Simulation Inputs
# Simulation Folder Name:
# Simulation Name:
# .sql Filepath:
path = GhPythonScript()  # -> out, path
# ---------- path: Python ----------
__author__ = "tmendeze"


import studio2021

path = studio2021.TEMP
# ---------- end path ----------
panel_4 = Panel(parameters.filename)
csv_path = GhPythonScript(path=path.path, sim_name=parameters.filename)  # -> out, sql_path
# ---------- csv_path: Python ----------
__author__ = "tmendeze"
__version__ = "2021.03.02"

import rhinoscriptsyntax as rs
import os
sql = os.path.join('OpenStudio','run','eplusout.sql')
sql_path = os.path.join(path, sim_name, sql)
# ---------- end csv_path ----------
panel_5 = Panel(path.path)
panel_6 = Panel(csv_path.sql_path)

equals = Equality(FirstNumber=parameters.shading, SecondNumber=30)  # -> Equality, Inequality
filter_3 = StreamFilter(Gate=equals.Equality, Stream1=filter)
filter_4 = StreamFilter(Gate=equals.Equality, Stream1=filter_2)

# ----
# Simulation Outputs
# Output Folder Name:
csv_path_2 = GhPythonScript(path=path.path, sim_name=parameters.filename)  # -> out, csv_path
# ---------- csv_path_2: Python ----------
__author__ = "tmendeze"
__version__ = "2021.03.02"

import rhinoscriptsyntax as rs
import os
csv_path = os.path.join(path, sim_name+".csv")
# ---------- end csv_path_2 ----------
panel_7 = Panel(csv_path_2.csv_path)

shading = StreamFilter(Gate=list_3, Stream0=filter_3, Stream1=filter_4)

# ----
# Add Context
pipeline = GeometryPipeline(
    GroupByLayer=False,
    GroupByType=False,
    IncludeHidden=True,
    IncludeLocked=True,
    LayerFilter="context",
    NameFilter="*",
    SublayerFiltering=True,
    TypeFilter=1073741848)
context_geometry = Brep()
clean = CleanTree(RemoveNulls=True, RemoveInvalid=True, RemoveEmpty=False, Tree=[pipeline, shading])
context_and_shades = Data(clean)

panel_8 = Panel(parameters.filename)
check_previous = GhPythonScript(filename=parameters.filename, run=run_energy_simulation)  # -> out, run
# ---------- check_previous: Python ----------
__author__ = "tmendeze"

import rhinoscriptsyntax as rs

import studio2021
import os


files = []
for f in os.listdir(os.path.join(studio2021.TEMP)):
    if f.endswith('.csv'):
        files.append(f)

fn = filename + '.csv'

if fn in files:
    run = False
# ---------- end check_previous ----------
facade_cladding = ValueList({"Brick", "Fiber Cement", "Metal Panel": "Steel Panel"}, selected="Metal Panel")
interior_finish = ValueList({"Gyp", "None"}, selected="Gyp")
list_4 = ValueList({"Adiabatic", "Ground"}, selected="Adiabatic")
list_5 = ValueList({"Outdoors", "Adiabatic"}, selected="Adiabatic")
black_box = BlackBox(
    city=cities.city,
    _0_0_2=zone_name,
    _0_1_2="ZONE2",
    _0_2_2="ZONE3",
    _0_3_2="ZONE4",
    _0_0=panel_4,
    _0_1=zone_height,
    _0_4_2="ZONE5",
    _0_2=outside_crv,
    _0_3=adiabatic_crv,
    interior_insul_mat=parameters.int_ins_mat,
    _0_11=list_5,
    glazing_system=parameters.glazing,
    _0_12=list_4,
    simulation_name=parameters.filename,
    _0_13=parameters.wwr,
    weather_file=cities.weather_file,
    _0_14=parameters.wwr,
    csv=panel_7,
    _0_15=parameters.wwr,
    sql_path=panel_6,
    _0_16=parameters.wwr,
    simulation_folder=path.path,
    _0_17=parameters.shading,
    run_simulation=check_previous.run,
    _0_18=parameters.shading,
    columns=columns_2,
    _0_19=parameters.shading,
    beams_x=beams_x_2,
    _0_20=parameters.shading,
    beams_y=beams_y_2,
    _0_21=parameters.shading,
    _0_22=parameters.shading,
    cores=core,
    _0_23=parameters.shading,
    building_type=building_type,
    _0_24=parameters.shading,
    num_floors_above=num_floors_above,
    _0_25=parameters.shading,
    composite_slab=composite_slab,
    _0_26=parameters.shading,
    _0_27=parameters.shading,
    kgco2e_kwh=cities.kgCo2e_kwh,
    _0_28=parameters.shading,
    _0_29=parameters.shgc,
    _0_30=parameters.shgc,
    context=context_and_shades,
    _0_31=parameters.shgc,
    _0_32=parameters.shgc,
    _0_33=program_3,
    _0_34=facade_cladding,
    _0_35=parameters.ext_ins_mat,
    _0_36=parameters.ext_ins_t,
    _0_37=parameters.int_ins_t,
    _0_38=interior_finish)  # -> out, building_2
embodied = GhPythonScript(building=black_box.building_2)  # -> out, embodied_pie, total_embodied, embodied_ft2, building, envelope_report, slab_report, str_report
# ---------- embodied: Python ----------
__author__ = "tmendeze"

import rhinoscriptsyntax as rs

building.compute_structure_embodied()
building.compute_envelope_embodied()
# ---------- end embodied ----------

trees_from_building = GhPythonScript(building=embodied.building)  # -> out, zones, facade_area_n, facade_area_s, facade_area_e, facade_area_w, window_areas_n, window_areas_s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
# ---------- trees_from_building: Python ----------
import rhinoscriptsyntax as rs
import ghpythonlib.treehelpers as th

data = building.to_gh_data()

zones                   = data['zones']
facade_area_n           = data['facade_areas']['n']
facade_area_s           = data['facade_areas']['s']
facade_area_e           = data['facade_areas']['e']
facade_area_w           = data['facade_areas']['w']
exterior_walls_n        = data['exterior_walls']['n']
exterior_walls_s        = data['exterior_walls']['s']
exterior_walls_e        = data['exterior_walls']['e']
exterior_walls_w        = data['exterior_walls']['w']
adiabatic_walls         = data['adiabatic_walls']
floor_surfaces          = data['floor_surfaces']
ceiling_surfaces        = data['ceiling_surfaces']
window_areas_n          = data['window_areas']['n']
window_areas_s          = data['window_areas']['s']
window_areas_e          = data['window_areas']['e']
window_areas_w          = data['window_areas']['w']
opaque_areas_n          = data['opaque_areas']['n']
opaque_areas_s          = data['opaque_areas']['s']
opaque_areas_e          = data['opaque_areas']['e']
opaque_areas_w          = data['opaque_areas']['w']
shade_gc                = data['shade_gc']
shade_depth_h           = data['shade_depth_h']
shade_depth_v1          = data['shade_depth_v1']
shade_depth_v2          = data['shade_depth_v2']
facade_cladding         = data['facade_cladding']
facade_cladding         = data['facade_cladding']
external_insulation     = data['external_insulation'] 
insulation_thickness    = data['insulation_thickness']
ewall_framing           = data['ewall_framing']
int_finish              = data['int_finish']
glazing_system          = data['glazing_system']
simulation_name         = data['simulation_name']
zone_program            = data['zone_program']
weather_file            = data['weather_file']
sql_path                = data['sql_path']
simulation_folder       = data['simulation_folder']
run_simulation          = data['run_simulation']
wwr                     = data['wwr'] 
ceiling_condition       = data['ceiling_condition']
floor_condition         = data['floor_condition']
height                  = data['height']
interior_insul_mat      = data['interior_insul_mat']
int_ins_thick           = data['int_ins_thick']
context                 = data['context']
# ---------- end trees_from_building ----------
clean_2 = CleanTree(
    RemoveNulls=True,
    RemoveInvalid=True,
    RemoveEmpty=True,
    Tree=[trees_from_building.exterior_walls_s, trees_from_building.exterior_walls_n, trees_from_building.exterior_walls_e, trees_from_building.exterior_walls_w])
subtraction_2 = Subtraction(A=trees_from_building.height, B=Slider(2, range=0..10))  # -> flatten(Result)

bang = ExplodeTree(Data=trees_from_building.wwr)  # -> flatten(Branch0), Branch1, Branch2, Branch3
bang_2 = ExplodeTree(Data=trees_from_building.zones)  # -> flatten(Branch0), Branch1, Branch2, Branch3
exterior_insulation_r_f_ft2_hr_btu_in = Panel("5")
exterior_insulation_thickness_in = Panel("1")
multiplication = Multiplication(A=bang.Branch0, B=100)
interior_insulation_r_f_ft2_hr_btu = Panel("25")
subtraction_3 = Subtraction(A=multiplication, B=20)
multiplication_2 = Multiplication(A=exterior_insulation_r_f_ft2_hr_btu_in, B=exterior_insulation_thickness_in)
division = Division(A=subtraction_3, B=20)
filter_5 = StreamFilter(
    Gate=division,
    Stream0=residential_20_glazing,
    Stream1=residential_40_glazing,
    Stream2=residential_60_glazing,
    Stream3=residential_80_glazing)
filter_6 = StreamFilter(
    Gate=division,
    Stream0=office_20_glazing,
    Stream1=office_40_glazing,
    Stream2=office_60_glazing,
    Stream3=office_80_glazing)
window = StreamFilter(Gate=list_3, Stream0=filter_5, Stream1=filter_6)
division_2 = Division(A=multiplication_2, B=5.678)
division_3 = Division(A=interior_insulation_r_f_ft2_hr_btu, B=5.678)
equals_2 = Equality(FirstNumber=exterior_insulation_thickness_in, SecondNumber=0)  # -> Equality, Inequality
searchmats = HBSearchMaterials(keywords="Wall Air Gap")  # -> flatten(opaque_mats), window_mats; plug-in component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
searchmats_2 = HBSearchMaterials(keywords="Wood Siding")  # -> flatten(opaque_mats), window_mats; plug-in component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
searchmats_3 = HBSearchMaterials(keywords="1/2IN Gypsum")  # -> flatten(opaque_mats), window_mats; plug-in component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
opaquematnomass = HBOpaqueMaterialNoMass(r_value=division_2)  # -> flatten(mat); plug-in component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
opaquematnomass_2 = HBOpaqueMaterialNoMass(r_value=division_3)  # -> flatten(mat); plug-in component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
filter_7 = StreamFilter(Gate=equals_2.Equality, Stream0=opaquematnomass)
importglazing = GhPythonScript(glazing_name=trees_from_building.glazing_system)  # -> flatten(frame_type), glass_type, flatten(u_value), flatten(t_vis), embodied_carbon_metric, embodied_carbon_imperial
# ---------- importglazing: Python ----------
__author__ = "preston"

import rhinoscriptsyntax as rs
import sys

studiopath = "/Users/preston/Documents/GitHub/studio2021/src"
sys.path.append(studiopath)
import studio2021

from studio2021.functions import read_glazing

glazing = read_glazing(glazing_name)

print(glazing.keys())

frame_type = glazing['frame_type']
glass_type = glazing['glass_type']
u_value = glazing['u_value']
t_vis = glazing['t_vis']
embodied_carbon_metric = glazing['embodied_carbon_metric']
embodied_carbon_imperial = glazing['embodied_carbon_imperial']
# ---------- end importglazing ----------
clean_3 = CleanTree(
    RemoveNulls=True,
    RemoveInvalid=True,
    RemoveEmpty=False,
    Tree=[searchmats_2.opaque_mats, searchmats.opaque_mats, filter_7, opaquematnomass_2, searchmats_3.opaque_mats])
opaqueconstr = HBOpaqueConstruction(name="ExteriorWall", materials=clean_3)  # -> constr; plug-in component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
item = ListItem(List=importglazing.u_value, Index=0, Wrap=True)
item_2 = ListItem(List=importglazing.frame_type, Index=0, Wrap=True)
item_3 = ListItem(List=importglazing.t_vis, Index=0, Wrap=True)
equals_3 = Equality(FirstNumber=division, SecondNumber=-1)  # -> Equality, Inequality
multiplication_3 = Multiplication(A=item, B=Slider(5.678, range=0..10))
decnstrconstr = HBDeconstructConstruction(constr=opaqueconstr)  # -> materials, layers, r_val_si, r_val_ip, u_fac_si, u_fac_ip, t_sol, t_vis; plug-in component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
windowmat = HBWindowMaterial(name=item_2, u_factor=flatten(multiplication_3), t_vis=flatten(item_3))  # -> mat; plug-in component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
exteriorsubset = HBExteriorConstructionSubset(exterior_wall=opaqueconstr)  # -> exterior_set; plug-in component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
decnstrmat = HBDeconstructMaterial(mat=opaqueconstr)  # -> values, attr_names, r_val_si, r_val_ip; plug-in component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
one_over_x = OneOverX(Value=decnstrconstr.u_fac_ip)
r_value_of_wall_construction = Panel(one_over_x)
constructionset = HBConstructionSet(name="CustomConstructionSet", exterior_subset=exteriorsubset)  # -> constr_set; plug-in component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
windowconstr = HBWindowConstruction(name="NGlass", materials=flatten(windowmat))  # -> constr; plug-in component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

face = HBFace(
    geo=trees_from_building.ceiling_surfaces,
    name="RoofCeiling",
    type="RoofCeiling",
    bc=trees_from_building.ceiling_condition)  # -> report, flatten(faces); plug-in component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

face_2 = HBFace(geo=trees_from_building.adiabatic_walls, name="Adiabatic Wall", type="Wall", bc="Adiabatic")  # -> report, flatten(faces); plug-in component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

face_3 = HBFace(geo=trees_from_building.floor_surfaces, name="Floor", type="Floor", bc=trees_from_building.floor_condition)  # -> report, flatten(faces); plug-in component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

aperture = HBAperture(geo=window, ep_constr=windowconstr)  # -> report, apertures; plug-in component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
face_4 = HBFace(geo=clean_2, name="ExWall", type="Wall", bc="Outdoors")  # -> report, flatten(faces); plug-in component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
roomattr = HBRoomAttributes({"Display Name": "display_name", "Simulation Name (Identifier)": "identifier", "Multiplier": "multiplier", "Story": "story", "Volume": "volume", "Gross Floor Area": "floor_area", "Exposed Area": "exposed_area", "Exterior Wall Area": "exterior_wall_area", "Exterior Aperture Area": "exterior_aperture_area", "Average Floor Elevation": "average_floor_height"}, selected="Simulation Name (Identifier)")
area = Area(Geometry=trees_from_building.floor_surfaces)  # -> Area, Centroid
room = HBRoom(
    faces=[face_2.faces, face_3.faces, face.faces, face_4.faces],
    name=bang_2.Branch0,
    program=trees_from_building.zone_program,
    conditioned=True)  # -> report, room; plug-in component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
panel_9 = Panel("""  Daylighting:Controls,
  Test,     		   !- Name
  Zone_Name,               !- Zone Name
  SplitFlux,               !- Daylighting Method
  ,                        !- Availability Schedule Name
  Continuous,              !- Lighting Control Type
  0.3,                     !- Minimum Input Power Fraction for Continuous or ContinuousOff Dimming Control
  0.2,                     !- Minimum Light Output Fraction for Continuous or ContinuousOff Dimming Control
  ,                        !- Number of Stepped Control Steps
  1.0,                     !- Probability Lighting will be Reset When Needed in Manual Stepped Control
  DaylRefPt1,              !- Glare Calculation Daylighting Reference Point Name
  180.0,                   !- Glare Calculation Azimuth Angle of View Direction Clockwise from Zone y-Axis {deg}
  20.0,                    !- Maximum Allowable Discomfort Glare Index
  ,                        !- DElight Gridding Resolution {m2}
  DaylRefPt1,              !- Daylighting Reference Point 1 Name
  1.0,                     !- Fraction of Zone Controlled by Reference Point 1
  500.;                    !- Illuminance Setpoint at Reference Point 1 {lux}""")
addsubface = HBAddSubface(hb_obj=flatten(room.room), sub_faces=flatten(aperture.apertures))  # -> hb_obj; plug-in component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
move = Move(Geometry=area.Centroid, Motion="{0,0,3}")  # -> Geometry, Transform
shade = HBShade(geo=trees_from_building.context)  # -> report, shades; plug-in component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
pdecon = Deconstruct(Point=move.Geometry)  # -> XComponent, YComponent, ZComponent
filter_8 = StreamFilter(Gate=equals_3.Equality, Stream0=addsubface, Stream1=room.room)
clean_4 = CleanTree(RemoveNulls=True, RemoveInvalid=True, RemoveEmpty=True, Tree=pdecon.XComponent)
clean_5 = CleanTree(RemoveNulls=True, RemoveInvalid=True, RemoveEmpty=False, Tree=shade.shades)

clean_6 = CleanTree(RemoveNulls=True, RemoveInvalid=True, RemoveEmpty=False, Tree=filter_8)  # -> flatten(Tree)
applyconstrset = HBApplyConstructionSet(rooms=clean_6, constr_set=constructionset)  # -> rooms; plug-in component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

labelrooms = HBLabelRooms(rooms_model=flatten(applyconstrset), attribute=roomattr)  # -> graft(label_text), base_pts, labels, wire_frame; plug-in component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
lng = ListLength(List=flatten(labelrooms.label_text))
clean_7 = CleanTree(RemoveNulls=True, RemoveInvalid=True, RemoveEmpty=True, Tree=pdecon.ZComponent)
panel_10 = Panel("""  Daylighting:ReferencePoint,
  DaylRefPt1,              !- Name
  Zone_Name,               !- Zone Name
  point1_x,                !- X-Coordinate of Reference Point {m}
  point1_y,                !- Y-Coordinate of Reference Point {m}
  point1_z;                !- Z-Coordinate of Reference Point {m}""")
panel_11 = Panel(lng)
clean_8 = CleanTree(RemoveNulls=True, RemoveInvalid=True, RemoveEmpty=True, Tree=pdecon.YComponent)
panel_12 = Panel("""Run1
Run2
Run3
Run4
Run5""")
split = SplitList(List=panel_12, Index=panel_11)  # -> ListA, ListB
panel_13 = Panel("""Point1
Point2
Point3
Point4
Point5""")
rep = ReplaceText(Text=panel_9, Find="Zone_Name", Replace=simplify(labelrooms.label_text), RecursiveReplace=False)
rep_2 = ReplaceText(Text=rep, Find="Test", Replace=graft(split.ListA), RecursiveReplace=False)
split_2 = SplitList(List=panel_13, Index=panel_11)  # -> ListA, ListB
model = HBModel(rooms=flatten(applyconstrset), shades=flatten(clean_5), name=trees_from_building.simulation_name)  # -> report, model; plug-in component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
rep_3 = ReplaceText(Text=panel_10, Find="Zone_Name", Replace=simplify(labelrooms.label_text), RecursiveReplace=False)
rep_4 = ReplaceText(Text=rep_2, Find="DaylRefPt1", Replace=graft(split_2.ListA), RecursiveReplace=False)  # -> flatten(Result)
rep_5 = ReplaceText(Text=rep_3, Find="DaylRefPt1", Replace=graft(split_2.ListA), RecursiveReplace=False)
rep_6 = ReplaceText(Text=rep_5, Find="point1_x", Replace=clean_4, RecursiveReplace=False)
rep_7 = ReplaceText(Text=rep_6, Find="point1_y", Replace=clean_8, RecursiveReplace=False)
rep_8 = ReplaceText(Text=rep_7, Find="point1_z", Replace=clean_7, RecursiveReplace=False)  # -> flatten(Result)
join = TextJoin(Text=rep_4)
join_2 = TextJoin(Text=rep_8)
join_3 = TextJoin(Text=[join, join_2])
orientation = Panel("0")
simpar = HBSimulationParameter(north=orientation, timestep=6)  # -> sim_par; plug-in component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
modeltoosm = HBModelToOSM(
    model=model.model,
    epw_file=trees_from_building.weather_file,
    sim_par=simpar,
    add_str=join_3,
    folder=trees_from_building.simulation_folder,
    write=trees_from_building.run_simulation,
    run=trees_from_building.run_simulation)  # -> report, jsons, osw, osm, idf, sql, zsz, rdd, html; plug-in component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
roomenergyresult = HBReadRoomEnergyResult(sql=modeltoosm.sql)  # -> cooling, heating, lighting, electric_equip, gas_equip, hot_water, fan_electric, pump_electric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; plug-in component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
panel_14 = Panel(roomenergyresult.hot_water)
add_euis = GhPythonScript(
    building=trees_from_building.building,
    cooling=roomenergyresult.cooling,
    heating=roomenergyresult.heating,
    lighting=roomenergyresult.lighting,
    equipment=roomenergyresult.electric_equip,
    hot_water=roomenergyresult.hot_water,
    wall_r=one_over_x,
    window_u=item)  # -> out, building; inputs cooling: list, heating: list, lighting: list, equipment: list, hot_water: list
# ---------- add_euis: Python ----------
__author__ = "tmendeze"

building.add_eui_results(cooling,
                         heating,
                         lighting,
                         equipment,
                         hot_water,
                         wall_r,
                         window_u)
# ---------- end add_euis ----------
panel_15 = Panel(add_euis.out)

# ----
# Write To Excel
write_results = GhPythonScript(building=add_euis.building)  # -> out
# ---------- write_results: Python ----------
__author__ = "tmendeze"

building.write_results()
# ---------- end write_results ----------
panel_16 = Panel(write_results)

# ----
# View Zones
vizbytype = HBVisualizeByType(hb_objs=model.model)  # -> walls, interior_walls, roofs, ceilings, exterior_floors, interior_floors, air_walls, apertures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; plug-in component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

# ==== cluster BlackBox
_0_0 = ClusterInput()
_0_1 = ClusterInput()
_0_2 = ClusterInput()
_0_3 = ClusterInput()
_0_4 = ClusterInput()
_0_5 = ClusterInput()
_0_6 = ClusterInput()
_0_7 = ClusterInput()
_0_8 = ClusterInput()
_0_9 = ClusterInput()
_0_10 = ClusterInput()
_0_11 = ClusterInput()
_0_12 = ClusterInput()
_0_13 = ClusterInput()
_0_14 = ClusterInput()
_0_15 = ClusterInput()
_0_16 = ClusterInput()
_0_17 = ClusterInput()
_0_18 = ClusterInput()
_0_19 = ClusterInput()
_0_20 = ClusterInput()
_0_21 = ClusterInput()
_0_22 = ClusterInput()
_0_23 = ClusterInput()
_0_24 = ClusterInput()
_0_25 = ClusterInput()
_0_26 = ClusterInput()
_0_27 = ClusterInput()
_0_28 = ClusterInput()
_0_29 = ClusterInput()
_0_30 = ClusterInput()
_0_31 = ClusterInput()
_0_32 = ClusterInput()
_0_33 = ClusterInput()
_0_34 = ClusterInput()
_0_35 = ClusterInput()
_0_36 = ClusterInput()
_0_37 = ClusterInput()
_0_38 = ClusterInput()
gather_all_info_from_scenario = Entwine(
    Branch00=_0_0,
    Branch01=_0_1,
    Branch02=_0_2,
    Branch03=_0_3,
    Branch04=_0_4,
    Branch05=_0_5,
    Branch06=_0_6,
    Branch07=_0_7,
    Branch08=_0_8,
    Branch09=_0_9,
    Branch010=_0_10,
    Branch011=_0_11,
    Branch012=_0_12,
    Branch013=_0_13,
    Branch014=_0_14,
    Branch015=_0_15,
    Branch016=_0_16,
    Branch017=_0_17,
    Branch018=_0_18,
    Branch019=_0_19,
    Branch020=_0_20,
    Branch021=_0_21,
    Branch022=_0_22,
    Branch023=_0_23,
    Branch024=_0_24,
    Branch025=_0_25,
    Branch026=_0_26,
    Branch027=_0_27,
    Branch028=_0_28,
    Branch029=_0_29,
    Branch030=_0_30,
    Branch031=_0_31,
    Branch032=_0_32,
    Branch033=_0_33,
    Branch034=_0_34,
    Branch035=_0_35,
    Branch036=_0_36,
    Branch037=_0_37,
    Branch038=_0_38,
    FlattenInputs=True)  # -> simplify(Result)
branch = TreeBranch(Tree=gather_all_info_from_scenario, Path="{0}", MaintainPaths=True)  # -> flatten(ConnectToMassingOptions)
subset = SubSet(SetA=branch)
filter = StreamFilter(Gate=Toggle(True), Stream1=gather_all_info_from_scenario)
_0_0_2 = ClusterInput()
_0_1_2 = ClusterInput()
_0_2_2 = ClusterInput()
_0_3_2 = ClusterInput()
_0_4_2 = ClusterInput()

merge = Merge(Data2=filter)
bang = ExplodeTree(Data=merge)  # -> Branch0, Branch1, Branch2, Branch3, Branch4, Branch5, Branch6, Branch7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
adiabaticcrv = Entwine(
    Branch00=bang.Branch3,
    Branch01=bang.Branch5,
    Branch02=bang.Branch7,
    Branch03=bang.Branch9,
    Branch04=bang.Branch10,
    FlattenInputs=True)  # -> simplify(Result)
outsidecrv = Entwine(Branch00=bang.Branch2, Branch01=bang.Branch4, Branch02=bang.Branch6, Branch03=bang.Branch8, FlattenInputs=True)  # -> simplify(Result)
zone = Entwine(Branch00=_0_0_2, Branch01=_0_1_2, Branch02=_0_2_2, Branch03=_0_3_2, Branch04=_0_4_2, FlattenInputs=True)  # -> simplify(Result)
vertical_shade_depth_direction_1 = Entwine(Branch00=bang.Branch21, Branch01=bang.Branch22, Branch02=bang.Branch23, Branch03=bang.Branch24, FlattenInputs=True)  # -> simplify(Result)
wwr = Entwine(Branch00=bang.Branch13, Branch01=bang.Branch14, Branch02=bang.Branch15, Branch03=bang.Branch16, FlattenInputs=True)  # -> simplify(Result)
horizontal_shade_depth = Entwine(Branch00=bang.Branch17, Branch01=bang.Branch18, Branch02=bang.Branch19, Branch03=bang.Branch20, FlattenInputs=True)  # -> simplify(Result)
shgc = Entwine(Branch00=bang.Branch29, Branch01=bang.Branch30, Branch02=bang.Branch31, Branch03=bang.Branch32, FlattenInputs=True)  # -> simplify(Result)
vertical_shade_depth_direction_2 = Entwine(Branch00=bang.Branch25, Branch01=bang.Branch26, Branch02=bang.Branch27, Branch03=bang.Branch28, FlattenInputs=True)  # -> simplify(Result)
division = Division(A=horizontal_shade_depth, B=12)
division_2 = Division(A=vertical_shade_depth_direction_1, B=12)
division_3 = Division(A=vertical_shade_depth_direction_2, B=12)

boundary = BoundarySurfaces(FloorCrvs=[outsidecrv, adiabaticcrv])  # -> simplify(Surfaces)
Z = UnitZ(Factor=bang.Branch1)
extr = Extrude(Base=boundary, Direction=Z)
extr_2 = Extrude(OutsideCrv=outsidecrv, Direction=Z)  # -> simplify(OutsideSrf)
debrep = DeconstructBrep(Brep=extr)  # -> simplify(Faces), Edges, Vertices
area = Area(Geometry=debrep.Faces)  # -> Area, Centroid
brep = Brep(debrep.Faces)
area_2 = Area(Geometry=extr_2)  # -> Area, Centroid
mindex = MemberIndex(Set=area.Centroid, Member=area_2.Centroid)  # -> Index, Count
srf = Surface([brep, extr_2])
trim = TrimTree(Tree=mindex.Index, Depth=1)
join = JoinCurves(Curves=[outsidecrv, adiabaticcrv], Preserve=False)  # -> simplify(Curves)
item = ListItem(List=srf, Index=trim, Wrap=True)
extr_3 = Extrude(AdiabaticCrv=adiabaticcrv, Direction=Z)  # -> simplify(AdiabaticSrf)
move = Move(Geometry=join, Motion=Z)  # -> Geometry, Transform
clean = CleanTree(RemoveNulls=True, RemoveInvalid=True, RemoveEmpty=True, Tree=item)  # -> simplify(Tree)
facen = FaceNormals(Mesh=clean)  # -> Centers, Normals
debrep_2 = DeconstructBrep(Brep=extr_3)  # -> Faces, Edges, Vertices
cullpt = CullDuplicates(Points=facen.Normals, Tolerance=0.1, CullMode=3)  # -> Points, Indices, Valence
join_2 = JoinCurves(Curves=debrep_2.Edges, Preserve=False)
devec = DeconstructVector(Vector=cullpt.Points)  # -> XComponent, YComponent, ZComponent
trim_2 = TrimTree(Tree=join_2, Depth=Slider(2, range=0..10))
larger = LargerThan(FirstNumber=devec.XComponent, SecondNumber="-0.707")  # -> LargerThan, OrEqualTo
smaller = SmallerThan(FirstNumber=devec.YComponent, SecondNumber="-0.707")  # -> SmallerThan, OrEqualTo
larger_2 = LargerThan(FirstNumber=devec.YComponent, SecondNumber="-1")  # -> LargerThan, OrEqualTo
smaller_2 = SmallerThan(FirstNumber=devec.YComponent, SecondNumber="1")  # -> SmallerThan, OrEqualTo
larger_3 = LargerThan(FirstNumber=devec.YComponent, SecondNumber="0.707")  # -> LargerThan, OrEqualTo
smaller_3 = SmallerThan(FirstNumber=devec.XComponent, SecondNumber="1")  # -> SmallerThan, OrEqualTo
smaller_4 = SmallerThan(FirstNumber=devec.XComponent, SecondNumber="0.707")  # -> SmallerThan, OrEqualTo
smaller_5 = SmallerThan(FirstNumber=devec.YComponent, SecondNumber="0.707")  # -> SmallerThan, OrEqualTo
larger_4 = LargerThan(FirstNumber=devec.YComponent, SecondNumber="-0.707")  # -> LargerThan, OrEqualTo
larger_5 = LargerThan(FirstNumber=devec.XComponent, SecondNumber="0.707")  # -> LargerThan, OrEqualTo
larger_6 = LargerThan(FirstNumber=devec.XComponent, SecondNumber="-1")  # -> LargerThan, OrEqualTo
smaller_6 = SmallerThan(FirstNumber=devec.XComponent, SecondNumber="-0.707")  # -> SmallerThan, OrEqualTo
and = GateAnd(A=larger.LargerThan, B=smaller_4.SmallerThan)
and_2 = GateAnd(A=larger_2.OrEqualTo, B=smaller.SmallerThan)
and_3 = GateAnd(A=larger_3.LargerThan, B=smaller_2.OrEqualTo)
and_4 = GateAnd(A=larger_5.LargerThan, B=smaller_3.OrEqualTo)
and_5 = GateAnd(A=larger_4.OrEqualTo, B=smaller_5.SmallerThan)
and_6 = GateAnd(A=larger_6.OrEqualTo, B=smaller_6.SmallerThan)
and_7 = GateAnd(A=and, B=and_3)
and_8 = GateAnd(A=and, B=and_2)
and_9 = GateAnd(A=and_5, B=and_6)
and_10 = GateAnd(A=and_4, B=and_5)
cull = CullPattern(List=graft(clean), CullPattern=and_8)
cull_2 = CullPattern(List=graft(clean), CullPattern=and_9)
cull_3 = CullPattern(List=graft(clean), CullPattern=and_10)
cull_4 = CullPattern(List=graft(clean), CullPattern=and_7)
pshift = ShiftPaths(Data=cull, Offset=-2)
pshift_2 = ShiftPaths(Data=cull_4, Offset=-2)
pshift_3 = ShiftPaths(Data=cull_2, Offset=-2)
pshift_4 = ShiftPaths(Data=cull_3, Offset=-2)
debrep_3 = DeconstructBrep(Brep=pshift_2)  # -> Faces, Edges, Vertices
debrep_4 = DeconstructBrep(Brep=pshift)  # -> Faces, Edges, Vertices
debrep_5 = DeconstructBrep(Brep=pshift_4)  # -> Faces, Edges, Vertices
debrep_6 = DeconstructBrep(Brep=pshift_3)  # -> Faces, Edges, Vertices
join_3 = JoinCurves(Curves=debrep_3.Edges, Preserve=False)
join_4 = JoinCurves(Curves=debrep_4.Edges, Preserve=False)
join_5 = JoinCurves(Curves=debrep_5.Edges, Preserve=False)
join_6 = JoinCurves(Curves=debrep_6.Edges, Preserve=False)
trim_3 = TrimTree(Tree=join_3, Depth=Slider(2, range=0..10))
trim_4 = TrimTree(Tree=join_4, Depth=Slider(2, range=0..10))
trim_5 = TrimTree(Tree=join_5, Depth=Slider(2, range=0..10))
trim_6 = TrimTree(Tree=join_6, Depth=Slider(2, range=0..10))
clean_2 = CleanTree(RemoveNulls=True, RemoveInvalid=True, RemoveEmpty=False, Tree=move.Geometry)
interior_insul_mat = ClusterInput()
building_type = ClusterInput()
num_floors_above = ClusterInput()
composite_slab = ClusterInput()
cores = ClusterInput()
glazing_system = ClusterInput()
city = ClusterInput()
simulation_name = ClusterInput()
weather_file = ClusterInput()
csv = ClusterInput()
sql_path = ClusterInput()
simulation_folder = ClusterInput()
run_simulation = ClusterInput()
columns = ClusterInput()
beams_x = ClusterInput()
beams_y = ClusterInput()
kgco2e_kwh = ClusterInput()
context = ClusterInput()
building = GhPythonScript(
    city=city,
    znames=zone,
    wwr=wwr,
    height=bang.Branch1,
    shade_gc=shgc,
    shade_depth_h=division,
    shade_depth_v1=division_2,
    shade_depth_v2=division_3,
    exterior_walls_n=trim_3,
    exterior_walls_s=trim_4,
    exterior_walls_e=trim_5,
    exterior_walls_w=trim_6,
    adiabatic_walls=trim_2,
    floor_surfaces=join,
    ceiling_surfaces=clean_2,
    facade_cladding=bang.Branch34,
    external_insulation=bang.Branch35,
    insulation_thickness=bang.Branch36,
    interior_insul_mat=interior_insul_mat,
    ewall_framing=bang.Branch37,
    int_finish=bang.Branch38,
    glazing_system=glazing_system,
    simulation_name=simulation_name,
    zone_program=bang.Branch33,
    weather_file=weather_file,
    csv=csv,
    sql_path=sql_path,
    simulation_folder=simulation_folder,
    run_simulation=run_simulation,
    columns=columns,
    beams_x=beams_x,
    beams_y=beams_y,
    cores=cores,
    building_type=building_type,
    num_floors_above=num_floors_above,
    composite_slab=composite_slab,
    ceiling_condition=bang.Branch11,
    floor_condition=bang.Branch12,
    kgco2e_kwh=kgco2e_kwh,
    context=context)  # -> out, building; inputs znames: tree, wwr: tree, shade_gc: tree, shade_depth_h: tree, shade_depth_v1: tree, shade_depth_v2: tree, exterior_walls_n: tree, exterior_walls_s: tree, exterior_walls_e: tree, exterior_walls_w: tree, adiabatic_walls: tree, floor_surfaces: tree, ceiling_surfaces: tree, columns: list, beams_x: list, beams_y: list, cores: list, context: list
# ---------- building: Python ----------
from studio2021.datastructures import building
reload(building)
from studio2021.datastructures.building import Building
import rhinoscriptsyntax as rs


columns = [[rs.CurveStartPoint(c), rs.CurveEndPoint(c)] for c in columns]
beams_x = [[rs.CurveStartPoint(b), rs.CurveEndPoint(b)] for b in beams_x]
beams_y = [[rs.CurveStartPoint(b), rs.CurveEndPoint(b)] for b in beams_y]
cores   = [rs.PolylineVertices(core) for core in cores]

context_ = []
for guid in context:
    if rs.IsSurface(guid):
        pt = [list(p) for p in rs.SurfacePoints(guid)]
        context_.append((pt[0], pt[1], pt[3], pt[2]))
    elif rs.IsBrep(guid):
        srfs = rs.ExplodePolysurfaces(guid)
        for srf in srfs:
            pt = [list(p) for p in rs.SurfacePoints(srf)]
            context_.append((pt[0], pt[1], pt[3], pt[2]))

data = {'city': city,
        'znames': znames,
        'exterior_walls_n': exterior_walls_n,
        'exterior_walls_s': exterior_walls_s,
        'exterior_walls_e': exterior_walls_e,
        'exterior_walls_w': exterior_walls_w,
        'adiabatic_walls': adiabatic_walls,
        'floor_surfaces': floor_surfaces,
        'ceiling_surfaces': ceiling_surfaces,
        'wwr':wwr,
        'height': height,
        'shade_gc':shade_gc,
        'shade_depth_h':shade_depth_h,
        'shade_depth_v1':shade_depth_v1,
        'shade_depth_v2':shade_depth_v2,
        'facade_cladding':facade_cladding,
        'external_insulation':external_insulation,
        'insulation_thickness':insulation_thickness,
        'interior_insul_mat':interior_insul_mat,
        'ewall_framing':ewall_framing,
        'int_finish':int_finish,
        'glazing_system':glazing_system,
        'simulation_name': simulation_name,
        'zone_program': zone_program,
        'weather_file': weather_file,
        'csv':csv,
        'sql_path': sql_path,
        'simulation_folder': simulation_folder,
        'run_simulation': run_simulation,
        'columns': columns,
        'beams_x': beams_x,
        'beams_y': beams_y,
        'cores':cores,
        'building_type':building_type,
        'num_floors_above':num_floors_above,
        'composite_slab':composite_slab,
        'ceiling_condition': ceiling_condition,
        'floor_condition': floor_condition,
        'kgco2e_kwh': kgco2e_kwh,
        'context':context_,
        }

building = Building.from_gh_data(data)
# ---------- end building ----------
out = ClusterOutput(building.out)
panel = Panel(building.out)
building_2 = ClusterOutput(building.building)
