# Grasshopper definition exhaustive_6.gh (Grasshopper 1.0.7)
# plug-ins: Human

assemblies = GhPythonScript()  # -> out, assemblies
# ---------- assemblies: Python ----------
__author__ = "tmendeze"

import rhinoscriptsyntax as rs


assemblies = {'residential':{
    0: {'frame':'2x4',  'cellulose':0.00, 'polyiso':0.},
    1: {'frame':'2x4',  'cellulose':0.00, 'polyiso':1.},
    2: {'frame':'2x4',  'cellulose':3.50, 'polyiso':0.},
    3: {'frame':'2x6',  'cellulose':5.50, 'polyiso':0.},
    4: {'frame':'2x8',  'cellulose':7.25, 'polyiso':0.},
    5: {'frame':'2x10', 'cellulose':9.25, 'polyiso':0.},
    6: {'frame':'2x6',  'cellulose':5.50, 'polyiso':1.},
    7: {'frame':'2x8',  'cellulose':7.25, 'polyiso':1.},
    8: {'frame':'2x10', 'cellulose':9.25, 'polyiso':1.},
    9: {'frame':'2x6',  'cellulose':5.50, 'polyiso':2.},
    10:{'frame':'2x8',  'cellulose':7.25, 'polyiso':2.},
    11:{'frame':'2x10', 'cellulose':9.25, 'polyiso':2.},
    12:{'frame':'2x6',  'cellulose':5.50, 'polyiso':3.},
    13:{'frame':'2x8',  'cellulose':7.25, 'polyiso':3.},
    14:{'frame':'2x10', 'cellulose':9.25, 'polyiso':3.},
    15:{'frame':'2x6',  'cellulose':5.50, 'polyiso':4.},
    16:{'frame':'2x8',  'cellulose':7.25, 'polyiso':4.},
    17:{'frame':'2x10', 'cellulose':9.25, 'polyiso':4.},
    18:{'frame':'2x6',  'cellulose':5.50, 'polyiso':5.},
    19:{'frame':'2x8',  'cellulose':7.25, 'polyiso':5.},
    20:{'frame':'2x10', 'cellulose':9.25, 'polyiso':5.},
    },'office':{
    0:  {'frame':'4',  'cellulose':0.00, 'polyiso':0.},
    1:  {'frame':'4',  'cellulose':1.00, 'polyiso':1.},
    2:  {'frame':'4',  'cellulose':4.00, 'polyiso':0.},
    3:  {'frame':'6',  'cellulose':6.00, 'polyiso':0.},
    4:  {'frame':'8',  'cellulose':8.00, 'polyiso':0.},
    5:  {'frame':'4',  'cellulose':4.00, 'polyiso':1.},
    6:  {'frame':'6',  'cellulose':6.00, 'polyiso':1.},
    7:  {'frame':'8',  'cellulose':8.00, 'polyiso':1.},
    8:  {'frame':'4',  'cellulose':4.00, 'polyiso':2.},
    9:  {'frame':'6',  'cellulose':6.00, 'polyiso':2.},
    10: {'frame':'8',  'cellulose':8.00, 'polyiso':2.},
    11: {'frame':'4',  'cellulose':4.00, 'polyiso':3.},
    12: {'frame':'6',  'cellulose':6.00, 'polyiso':3.},
    13: {'frame':'8',  'cellulose':8.00, 'polyiso':3.},
    14: {'frame':'4',  'cellulose':4.00, 'polyiso':4.},
    15: {'frame':'6',  'cellulose':6.00, 'polyiso':4.},
    16: {'frame':'8',  'cellulose':8.00, 'polyiso':4.},
    17: {'frame':'4',  'cellulose':4.00, 'polyiso':5.},
    18: {'frame':'6',  'cellulose':6.00, 'polyiso':5.},
    19: {'frame':'8',  'cellulose':8.00, 'polyiso':5.},
    }}
# ---------- end assemblies ----------
panel = Panel(assemblies.out)
parameter_generator = GhPythonScript()  # -> out, param
# ---------- parameter_generator: Python ----------
__author__ = "tmendeze"

import rhinoscriptsyntax as rs

cities          = [0, 1, 2, 3, 4, 5]
orientation     = [1, 2, 3, 4]
wwr             = [0, 20, 40, 60, 80]
assemblies      = range(21)
infiltration    = [0, 1, 2]
program         = [0, 1]

param = []
for c in cities:
    for o in orientation:
        for w in wwr:
            for a in assemblies:
                for i in infiltration:
                    for p in program:
                        param.append([c, o, w, a, i, p])
print(len(param))
# ---------- end parameter_generator ----------
number_slider = Slider(10, range=0..10)
number_slider_2 = Slider(6, range=0..10)
number_slider_3 = Slider(1, range=0..10)
panel_2 = Panel("""0
15
15
15
15
15
15
15
15
15
15""")
panel_3 = Panel("""0
25
15
22
20
15
20
20
15""")
panel_4 = Panel(parameter_generator.out)
line = Line()
line_2 = Line()
pt = Point(Point(0, 0, 0))
make_grid = GhPythonScript(
    sp=pt,
    span_x=panel_2,
    span_y=panel_3,
    xaxis=line,
    yaxis=line_2,
    height=Slider(10, range=0..10),
    core=[Slider(0, range=0..10), Slider(0, range=0..10)])  # -> out, columns, beams_x, beams_y, cores; inputs span_x: list, span_y: list, core: list of Int32
# ---------- make_grid: Python ----------
import rhinoscriptsyntax as rs

from studio2021.functions import make_grid
reload(make_grid)
from studio2021.functions.make_grid import make_grid_structure


columns, beams_x, beams_y, cores = make_grid_structure(sp,
                                                       span_x,
                                                       span_y,
                                                       xaxis,
                                                       yaxis,
                                                       height,
                                                       core)
# ---------- end make_grid ----------
parameters = GhPythonScript(param=parameter_generator.param, i=Slider(1190, range=0..7199))  # -> out, orientation, shading, wwr, glazing, shgc, ext_ins_mat, ext_ins_t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; inputs param: list, i: Int32
# ---------- parameters: Python ----------
__author__ = "tmendeze"


assemblies = {'residential':{
    0: {'frame':'2x4 Wood Studs',  'cellulose':0.00, 'polyiso':0.},
    1: {'frame':'2x4 Wood Studs',  'cellulose':0.00, 'polyiso':1.},
    2: {'frame':'2x4 Wood Studs',  'cellulose':3.50, 'polyiso':0.},
    3: {'frame':'2x6 Wood Studs',  'cellulose':5.50, 'polyiso':0.},
    4: {'frame':'2x8 Wood Studs',  'cellulose':7.25, 'polyiso':0.},
    5: {'frame':'2x10 Wood Studs', 'cellulose':9.25, 'polyiso':0.},
    6: {'frame':'2x6 Wood Studs',  'cellulose':5.50, 'polyiso':1.},
    7: {'frame':'2x8 Wood Studs',  'cellulose':7.25, 'polyiso':1.},
    8: {'frame':'2x10 Wood Studs', 'cellulose':9.25, 'polyiso':1.},
    9: {'frame':'2x6 Wood Studs',  'cellulose':5.50, 'polyiso':2.},
    10:{'frame':'2x8 Wood Studs',  'cellulose':7.25, 'polyiso':2.},
    11:{'frame':'2x10 Wood Studs', 'cellulose':9.25, 'polyiso':2.},
    12:{'frame':'2x6 Wood Studs',  'cellulose':5.50, 'polyiso':3.},
    13:{'frame':'2x8 Wood Studs',  'cellulose':7.25, 'polyiso':3.},
    14:{'frame':'2x10 Wood Studs', 'cellulose':9.25, 'polyiso':3.},
    15:{'frame':'2x6 Wood Studs',  'cellulose':5.50, 'polyiso':4.},
    16:{'frame':'2x8 Wood Studs',  'cellulose':7.25, 'polyiso':4.},
    17:{'frame':'2x10 Wood Studs', 'cellulose':9.25, 'polyiso':4.},
    18:{'frame':'2x6 Wood Studs',  'cellulose':5.50, 'polyiso':5.},
    19:{'frame':'2x8 Wood Studs',  'cellulose':7.25, 'polyiso':5.},
    20:{'frame':'2x10 Wood Studs', 'cellulose':9.25, 'polyiso':5.},},
    'office':{
    0: {'frame':'s4',  'cellulose':0.00, 'polyiso':0.},
    1: {'frame':'s4',  'cellulose':1.00, 'polyiso':1.},
    2: {'frame':'s4',  'cellulose':4.00, 'polyiso':0.},
    3: {'frame':'s6',  'cellulose':6.00, 'polyiso':0.},
    4: {'frame':'s8',  'cellulose':8.00, 'polyiso':0.},
    5: {'frame':'s4',  'cellulose':4.00, 'polyiso':1.},
    6: {'frame':'s6',  'cellulose':6.00, 'polyiso':1.},
    7: {'frame':'s8',  'cellulose':8.00, 'polyiso':1.},
    8: {'frame':'s4',  'cellulose':4.00, 'polyiso':2.},
    9: {'frame':'s6',  'cellulose':6.00, 'polyiso':2.},
    10:{'frame':'s8',  'cellulose':8.00, 'polyiso':2.},
    11:{'frame':'s4',  'cellulose':4.00, 'polyiso':3.},
    12:{'frame':'s6',  'cellulose':6.00, 'polyiso':3.},
    13:{'frame':'s8',  'cellulose':8.00, 'polyiso':3.},
    14:{'frame':'s4',  'cellulose':4.00, 'polyiso':4.},
    15:{'frame':'s6',  'cellulose':6.00, 'polyiso':4.},
    16:{'frame':'s8',  'cellulose':8.00, 'polyiso':4.},
    17:{'frame':'s4',  'cellulose':4.00, 'polyiso':5.},
    18:{'frame':'s6',  'cellulose':6.00, 'polyiso':5.},
    19:{'frame':'s8',  'cellulose':8.00, 'polyiso':5.},
    }}



infd = {0:.00059, 1:.0003, 2:.00015}
pdict = {0: 'residential', 1: 'office'}
p = param[i]



city            = p[0]
orientation     = p[1]
wwr             = p[2] / 100.
assembly        = assemblies[pdict[p[5]]][p[3]]
inf_rate        = infd[p[4]] 
program         = p[5]



shading = 0
glazing = 'Aluminum Double'
shgc = .25
ext_ins_mat = 'Polyiso'
ext_ins_t = assembly['polyiso']
int_ins_mat = 'Cellulose'
int_ins_t = assembly['cellulose']
frame  =assembly['frame']


cdict = {0: 'se',1: 'mi',2: 'sa',3 : 'la',4 : 'ny',5 : 'at'}
odict = {1:'n', 2:'s', 3:'e', 4:'w'}


filename = '{}_{}_'.format(cdict[city], odict[orientation])
for n in p[2:-1]:
    filename += str(n) +'_'
filename = filename[:-1]
filename += '_{}'.format(pdict[program])

print 'city',cdict[city] 
print 'orientation', odict[orientation]
print 'wwr', wwr 
print 'assembly',assembly 
print 'inf_rate',inf_rate 
print 'program', pdict[p[5]]
# ---------- end parameters ----------
bang = ExplodeTree(Data=parameters.wwr)  # -> flatten(Branch0), Branch1, Branch2, Branch3

# ----
# Simulation Inputs
# Simulation Folder Name:
# Simulation Name:
# .sql Filepath:
path = GhPythonScript()  # -> out, path
# ---------- path: Python ----------
__author__ = "tmendeze"


import studio2021

path = studio2021.TEMP
# ---------- end path ----------
panel_5 = Panel(parameters.filename)
csv_path = GhPythonScript(path=path.path, sim_name=parameters.filename)  # -> out, sql_path
# ---------- csv_path: Python ----------
__author__ = "tmendeze"
__version__ = "2021.03.02"

import rhinoscriptsyntax as rs
import os
sql = os.path.join('OpenStudio','run','eplusout.sql')
sql_path = os.path.join(path, sim_name, sql)
# ---------- end csv_path ----------
panel_6 = Panel(path.path)
panel_7 = Panel(csv_path.sql_path)

multiplication = Multiplication(A=bang.Branch0, B=100)
subtraction = Subtraction(A=multiplication, B=20)

# ----
# Add Context
pipeline = GeometryPipeline(
    GroupByLayer=False,
    GroupByType=False,
    IncludeHidden=True,
    IncludeLocked=True,
    LayerFilter="context",
    NameFilter="*",
    SublayerFiltering=True,
    TypeFilter=1073741848)
context_geometry = Brep()
clean = CleanTree(RemoveNulls=True, RemoveInvalid=True, RemoveEmpty=False, Tree=pipeline)
context_and_shades = Data(clean)

division = Division(A=subtraction, B=20)
program = Panel("2013::MidriseApartment::Apartment")
residential_20_glazing = Brep([<brep referenced from the Rhino model> x2])
adiabaticcrvfromrhino = Curve([<curve referenced from the Rhino model> x3])
outsidecrvfromrhino = Curve(<curve referenced from the Rhino model>)
residential_40_glazing = Brep([<brep referenced from the Rhino model> x4])
residential_60_glazing = Brep([<brep referenced from the Rhino model> x6])
residential_80_glazing = Brep([<brep referenced from the Rhino model> x8])
program_2 = Panel("2013::MediumOffice::OpenOffice")
office_20_glazing = Brep([<brep referenced from the Rhino model> x8])
office_40_glazing = Brep([<brep referenced from the Rhino model> x16])
office_60_glazing = Brep([<brep referenced from the Rhino model> x24])
office_80_glazing = Brep([<brep referenced from the Rhino model> x31])
outsidecrvfromrhino_2 = Curve(<curve referenced from the Rhino model>)
adiabaticcrvfromrhino_2 = Curve([<curve referenced from the Rhino model> x3])
crv = Curve([<curve referenced from the Rhino model> x4])
num_floors_above = Slider(10, range=0..10)
panel_8 = Panel(parameters.filename)
searchmats = HBSearchMaterials(keywords="tile")  # -> opaque_mats, window_mats; plug-in component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
searchmats_2 = HBSearchMaterials(keywords="carpet")  # -> opaque_mats, window_mats; plug-in component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
trim_grid = GhPythonScript(polyline=crv, columns=make_grid.columns, beams_x=make_grid.beams_x, beams_y=make_grid.beams_y, cores=make_grid.cores)  # -> out, columns, beams_x, beams_y, cores; inputs polyline: list, columns: list, beams_x: list, beams_y: list, cores: list
# ---------- trim_grid: Python ----------
import rhinoscriptsyntax as rs

from studio2021.functions import make_grid
reload(make_grid)
from studio2021.functions.make_grid import trim_structure


columns, beams_x, beams_y, cores = trim_structure(polyline,
                                                  columns,
                                                  beams_x,
                                                  beams_y,
                                                  cores)
# ---------- end trim_grid ----------
searchmats_3 = HBSearchMaterials(keywords="gypsum")  # -> opaque_mats, window_mats; plug-in component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
searchmats_4 = HBSearchMaterials(keywords="air")  # -> opaque_mats, window_mats; plug-in component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
cities = GhPythonScript(city=parameters.city)  # -> out, city, weather_file, kgCo2e_kwh
# ---------- cities: Python ----------
__author__ = "tmendeze"

import rhinoscriptsyntax as rs

from studio2021.functions import city_carbon
reload(city_carbon)
from studio2021.functions.city_carbon import city_EUI
from studio2021.functions.city_carbon import weather

cities = {0: 'Seattle',
          1: 'Milwaukee',
          2: 'San Antonio',
          3: 'Los Angeles',
          4: 'New York',
          5: 'Atlanta'}

city = cities[city]
kgCo2e_kwh = city_EUI(city)['kg/kWh']
weather_file = weather(city)
# ---------- end cities ----------
building_type = ValueList({"Type 3", "Type 4A", "Type 4B", "Type 4C", "Type 5"}, selected="Type 4A")
composite_slab = BooleanToggle(False)
filter = StreamFilter(
    Gate=division,
    Stream0=residential_20_glazing,
    Stream1=residential_40_glazing,
    Stream2=residential_60_glazing,
    Stream3=residential_80_glazing)
filter_2 = StreamFilter(
    Gate=division,
    Stream0=office_20_glazing,
    Stream1=office_40_glazing,
    Stream2=office_60_glazing,
    Stream3=office_80_glazing)
columns = Curve(trim_grid.columns)
beams_x = Curve(trim_grid.beams_x)
beams_y = Curve(trim_grid.beams_y)
cores = Curve(trim_grid.cores)

# ----
# Run Energy
# Simulation
run_energy_simulation = BooleanToggle(False)

list = ItemSelector(
    searchmats_4.opaque_mats,
    {"F04 Wall air space resistance", "F05 Ceiling air space resistance", "Generic Ceiling Air Gap", "Generic Wall Air Gap", "Typical Air Wall"}, selected="Generic Ceiling Air Gap")
panel_9 = Panel(cities.city)
list_2 = ItemSelector(
    searchmats_2.opaque_mats,
    {"CP02 CARPET PAD", "Carpet - 3/4 in. CBES", "NACM_Carpet 3/4in", "Typical Carpet Pad"}, selected="Typical Carpet Pad")
list_3 = ItemSelector(
    searchmats_3.opaque_mats,
    {"1/2 in. Gypsum Board", "1/2IN Gypsum", "5/8 in. Gypsum Board", "G01 13mm gypsum board", "G01a 19mm gypsum board", "Generic Gypsum Board", "Gypsum Board - 1/2 in. CBES", "Gypsum Or Plaster Board - 3/8 in.", "NACM_Gypsum Board 5/8in"}, selected="1/2IN Gypsum")
list_4 = ItemSelector(searchmats.opaque_mats, {"F16 Acoustic tile", "Generic Acoustic Tile"}, selected="Generic Acoustic Tile")

# ----
# Simulation Outputs
# Output Folder Name:
csv_path_2 = GhPythonScript(path=path.path, sim_name=parameters.filename)  # -> out, csv_path
# ---------- csv_path_2: Python ----------
__author__ = "tmendeze"
__version__ = "2021.03.02"

import rhinoscriptsyntax as rs
import os
csv_path = os.path.join(path, sim_name+".csv")
# ---------- end csv_path_2 ----------
panel_10 = Panel(csv_path_2.csv_path)

filter_3 = StreamFilter(
    Gate=parameters.orientation,
    Stream1=Slider(180, range=0..1000),
    Stream2=Slider(0, range=0..100),
    Stream3=Slider(90, range=0..100),
    Stream4=Slider(270, range=0..1000))
panel_11 = Panel(trim_grid.out)
core = Curve(flatten(cores))
columns_2 = Curve(flatten(columns))
beams_x_2 = Curve(flatten(beams_x))
beams_y_2 = Curve(flatten(beams_y))
rad = Radians(Degrees=filter_3)
zone_name = StreamFilter(Gate=parameters.program, Stream0="residential_zone", Stream1="office_zone")
zone_height = StreamFilter(Gate=parameters.program, Stream0="10", Stream1="9")
window = StreamFilter(Gate=parameters.program, Stream0=filter, Stream1=filter_2)
outside_crv = StreamFilter(Gate=parameters.program, Stream0=outsidecrvfromrhino, Stream1=outsidecrvfromrhino_2)
adiabatic_crv = StreamFilter(Gate=parameters.program, Stream0=adiabaticcrvfromrhino, Stream1=adiabaticcrvfromrhino_2)
program_3 = StreamFilter(Gate=parameters.program, Stream0=program, Stream1=program_2)
opaqueconstr = HBOpaqueConstruction(name="Ceiling_Residential", materials=[list, list_3])  # -> constr; plug-in component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
opaqueconstr_2 = HBOpaqueConstruction(name="Floor_Residential", materials=[list, list_2])  # -> constr; plug-in component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
opaqueconstr_3 = HBOpaqueConstruction(name="Ceiling_Office", materials=[list, list_4])  # -> constr; plug-in component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
opaqueconstr_4 = HBOpaqueConstruction(name="Floor_Office", materials=[list, list_2])  # -> constr; plug-in component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
rotate = Rotate(Geometry=outside_crv, Angle=rad, Plane=PlaneXY(0, 0, 0))  # -> Geometry, Transform
rotate_2 = Rotate(Geometry=adiabatic_crv, Angle=rad, Plane=PlaneXY(0, 0, 0))  # -> Geometry, Transform
rotate_3 = Rotate(Geometry=window, Angle=rad, Plane=PlaneXY(0, 0, 0))  # -> Geometry, Transform
area = Area(Geometry=window)  # -> Area, Centroid
check_previous = GhPythonScript(filename=parameters.filename, run=run_energy_simulation)  # -> out, run
# ---------- check_previous: Python ----------
__author__ = "tmendeze"

import rhinoscriptsyntax as rs

import studio2021
import os


files = []
for f in os.listdir(os.path.join(studio2021.TEMP)):
    if f.endswith('.json'):
        files.append(f)

fn = filename + '.json'

if fn in files:
    run = False
# ---------- end check_previous ----------
item = ListItem(List=area.Area, Index=0, Wrap=True)
floor = StreamFilter(Gate=parameters.program, Stream0=opaqueconstr_2, Stream1=opaqueconstr_4)
subtraction_2 = Subtraction(A=zone_height, B=1)
ma = MassAddition(Input=area.Area)  # -> Result, PartialResults
ceiling = StreamFilter(Gate=parameters.program, Stream0=opaqueconstr, Stream1=opaqueconstr_3)
division_2 = Division(A=item, B=subtraction_2)
facade_cladding = ValueList({"Brick", "Fiber Cement", "Metal Panel": "Steel Panel"}, selected="Metal Panel")
interior_finish = ValueList({"Gyp", "None"}, selected="Gyp")
list_5 = ValueList({"Adiabatic", "Ground"}, selected="Adiabatic")
list_6 = ValueList({"Outdoors", "Adiabatic"}, selected="Adiabatic")
division_3 = Division(A=ma.Result, B=subtraction_2)
division_4 = Division(A=ma.Result, B=division_2)
panel_12 = Panel(division_3)
panel_13 = Panel(division_4)
total_shade_len = GhPythonScript(orientation=parameters.orientation, vertical=division_4, horizontal=division_3)  # -> out, tsl
# ---------- total_shade_len: Python ----------
__author__ = "tmendeze"

import rhinoscriptsyntax as rs

North = 1
South = 2
East  = 3
West  = 4

if not horizontal:
    horizontal = 0
if not vertical:
    vertical = 0

if orientation == 1:
    tsl = 0
elif orientation == 2:
    tsl = horizontal
elif orientation == 3 or orientation == 4:
    tsl = vertical
# ---------- end total_shade_len ----------
black_box = BlackBox(
    city=cities.city,
    _0_0_2=zone_name,
    _0_1_2="ZONE2",
    _0_2_2="ZONE3",
    _0_3_2="ZONE4",
    _0_0=panel_5,
    _0_1=zone_height,
    _0_4_2="ZONE5",
    _0_2=rotate.Geometry,
    _0_3=rotate_2.Geometry,
    ewall_framing=parameters.frame,
    interior_insul_mat=parameters.int_ins_mat,
    _0_11=list_6,
    glazing_system=parameters.glazing,
    _0_12=list_5,
    simulation_name=parameters.filename,
    _0_13=parameters.wwr,
    weather_file=cities.weather_file,
    _0_14=parameters.wwr,
    csv=panel_10,
    _0_15=parameters.wwr,
    sql_path=panel_7,
    _0_16=parameters.wwr,
    simulation_folder=path.path,
    _0_17=parameters.shading,
    run_simulation=check_previous.run,
    _0_18=parameters.shading,
    columns=columns_2,
    _0_19=parameters.shading,
    beams_x=beams_x_2,
    _0_20=parameters.shading,
    beams_y=beams_y_2,
    _0_21=parameters.shading,
    _0_22=parameters.shading,
    cores=core,
    _0_23=parameters.shading,
    building_type=building_type,
    _0_24=parameters.shading,
    num_floors_above=num_floors_above,
    _0_25=parameters.shading,
    composite_slab=composite_slab,
    _0_26=parameters.shading,
    _0_27=parameters.shading,
    kgco2e_kwh=cities.kgCo2e_kwh,
    _0_28=parameters.shading,
    _0_29=parameters.shgc,
    context=context_and_shades,
    _0_30=parameters.shgc,
    _0_31=parameters.shgc,
    win_geometry=rotate_3.Geometry,
    _0_32=parameters.shgc,
    _0_33=program_3,
    total_shade_len=total_shade_len.tsl,
    _0_34=facade_cladding,
    _0_35=parameters.ext_ins_mat,
    inf_rate=parameters.inf_rate,
    _0_36=parameters.ext_ins_t,
    int_ins_th=parameters.int_ins_t,
    _0_38=interior_finish)  # -> out, building_2
panel_14 = Panel(black_box.out)
panel_15 = Panel(parameters.out)
embodied = GhPythonScript(building=black_box.building_2)  # -> out, building, envelope_report
# ---------- embodied: Python ----------
__author__ = "tmendeze"

import rhinoscriptsyntax as rs

building.compute_structure_embodied()
building.compute_envelope_embodied()

envelope_report = building.envelope.env_strings

area = building.floor_area
win  = building.envelope.window_embodied
wall = building.envelope.wall_embodied
win /= area
wall/= area

print('insulation thickness', building.insulation_thickness)
print('Embodied (kg CO2e / ft2)', win + wall)
print('Win Embodied (kg CO2e / ft2)', win)
print('Wall Embodied (kg CO2e / ft2)', wall)
# ---------- end embodied ----------
panel_16 = Panel(embodied.out)
panel_17 = Panel(embodied.envelope_report)
trees_from_building = GhPythonScript(building=embodied.building)  # -> out, zones, facade_area_n, facade_area_s, facade_area_e, facade_area_w, window_areas_n, window_areas_s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
# ---------- trees_from_building: Python ----------
import rhinoscriptsyntax as rs
import ghpythonlib.treehelpers as th

data = building.to_gh_data()

zones                   = data['zones']
facade_area_n           = data['facade_areas']['n']
facade_area_s           = data['facade_areas']['s']
facade_area_e           = data['facade_areas']['e']
facade_area_w           = data['facade_areas']['w']
exterior_walls_n        = data['exterior_walls']['n']
exterior_walls_s        = data['exterior_walls']['s']
exterior_walls_e        = data['exterior_walls']['e']
exterior_walls_w        = data['exterior_walls']['w']
adiabatic_walls         = data['adiabatic_walls']
floor_surfaces          = data['floor_surfaces']
ceiling_surfaces        = data['ceiling_surfaces']
window_areas_n          = data['window_areas']['n']
window_areas_s          = data['window_areas']['s']
window_areas_e          = data['window_areas']['e']
window_areas_w          = data['window_areas']['w']
opaque_areas_n          = data['opaque_areas']['n']
opaque_areas_s          = data['opaque_areas']['s']
opaque_areas_e          = data['opaque_areas']['e']
opaque_areas_w          = data['opaque_areas']['w']
shade_gc                = data['shade_gc']
shade_depth_h           = data['shade_depth_h']
shade_depth_v1          = data['shade_depth_v1']
shade_depth_v2          = data['shade_depth_v2']
facade_cladding         = data['facade_cladding']
facade_cladding         = data['facade_cladding']
external_insulation     = data['external_insulation'] 
insulation_thickness    = data['insulation_thickness']
ewall_framing           = data['ewall_framing']
int_finish              = data['int_finish']
glazing_system          = data['glazing_system']
simulation_name         = data['simulation_name']
zone_program            = data['zone_program']
weather_file            = data['weather_file']
sql_path                = data['sql_path']
simulation_folder       = data['simulation_folder']
run_simulation          = data['run_simulation']
wwr                     = data['wwr'] 
ceiling_condition       = data['ceiling_condition']
floor_condition         = data['floor_condition']
height                  = data['height']
interior_insul_mat      = data['interior_insul_mat']
int_ins_thick           = data['int_ins_thickness']
context                 = data['context']
inf_rate                = data['inf_rate']
# ---------- end trees_from_building ----------
python = GhPythonScript(material_name=trees_from_building.external_insulation)  # -> out, a
# ---------- python: Python ----------
__author__ = "preston"

import rhinoscriptsyntax as rs
import sys

studiopath = "/Users/preston/Documents/GitHub/studio2021/src"
sys.path.append(studiopath)
import studio2021

from studio2021.functions import read_materials

material = read_materials(material_name)

print(material.keys())

r_per_in = material["r_per_in"]
embodied_carbon = material["embodied_carbon"]
type = material["mtype"]
density = material["density"]
sp_heat = material["sp_heat"]
thickness_in = material["thickness_in"]
thickness_m = material["thickness_m"]
r_value = material["r_value"]
conductivity = material["conductivity"]
# ---------- end python ----------
panel_18 = Panel(trees_from_building.out)
panel_19 = Panel(python.out)
importmaterial = GhPythonScript(material_name=trees_from_building.external_insulation)  # -> r_per_in, embodied_carbon, type, thickness_in, thickness_m, conductivity, density, sp_heat, r_value; same code as python
importmaterial_2 = GhPythonScript(material_name=trees_from_building.interior_insul_mat)  # -> r_per_in, embodied_carbon, type, thickness_in, thickness_m, conductivity, density, sp_heat, r_value; same code as python
searchmats_5 = HBSearchMaterials(keywords="plywood")  # -> opaque_mats, window_mats; plug-in component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
bang_2 = ExplodeTree(Data=trees_from_building.shade_gc)  # -> flatten(Branch0), Branch1, Branch2, Branch3
clean_2 = CleanTree(
    RemoveNulls=True,
    RemoveInvalid=True,
    RemoveEmpty=True,
    Tree=[trees_from_building.exterior_walls_s, trees_from_building.exterior_walls_n, trees_from_building.exterior_walls_e, trees_from_building.exterior_walls_w])
bang_3 = ExplodeTree(Data=trees_from_building.zones)  # -> flatten(Branch0), Branch1, Branch2, Branch3
bang_4 = ExplodeTree(Data=trees_from_building.wwr)  # -> flatten(Branch0), Branch1, Branch2, Branch3
subtraction_3 = Subtraction(A=trees_from_building.height, B=Slider(2, range=0..10))  # -> flatten(Result)
multiplication_2 = Multiplication(A=bang_4.Branch0, B=100)
importmaterial_3 = GhPythonScript(material_name=trees_from_building.int_finish)  # -> r_per_in, embodied_carbon, type, thickness_in, thickness_m, conductivity, density, sp_heat, r_value; same code as python
list_7 = ItemSelector(searchmats_5.opaque_mats, {"5/8 in. Plywood", "Plywood - 5/8 in. CBES"}, selected="5/8 in. Plywood")
subtraction_4 = Subtraction(A=multiplication_2, B=20)
importmaterial_4 = GhPythonScript(material_name=trees_from_building.facade_cladding)  # -> r_per_in, embodied_carbon, type, thickness_in, thickness_m, conductivity, density, sp_heat, r_value; same code as python
multiplication_3 = Multiplication(A=importmaterial.r_per_in, B=trees_from_building.insulation_thickness)
multiplication_4 = Multiplication(A=importmaterial_2.r_per_in, B=trees_from_building.int_ins_thick)
deconstrprogram = HBDeconstructProgramType(program=trees_from_building.zone_program)  # -> people, lighting, electric_equip, gas_equip, hot_water, infiltration, ventilation, setpoint; plug-in component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
division_5 = Division(A=subtraction_4, B=20)
equals = Equality(FirstNumber=trees_from_building.insulation_thickness, SecondNumber=0)  # -> Equality, Inequality
division_6 = Division(A=multiplication_3, B=5.67826)
division_7 = Division(A=Slider(1, range=0..1), B=5.67826)
division_8 = Division(A=multiplication_4, B=5.67826)
decnstrmat = HBDeconstructMaterial(mat=list_7)  # -> values, attr_names, r_val_si, r_val_ip; plug-in component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
decnstrinfiltration = HBDeconstructInfiltration(infil=deconstrprogram.infiltration)  # -> name, flow_per_ext_area, schedule; plug-in component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
opaquematnomass = HBOpaqueMaterialNoMass(name="ContExtInsulation", r_value=division_6)  # -> mat; plug-in component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
opaquematnomass_2 = HBOpaqueMaterialNoMass(name="IntInsulation", r_value=division_8)  # -> mat; plug-in component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
opaquemat = HBOpaqueMaterial(
    name="InteriorFinish",
    thickness=importmaterial_3.thickness_m,
    conductivity=importmaterial_3.conductivity,
    density=importmaterial_3.density,
    spec_heat=importmaterial_3.sp_heat)  # -> mat; plug-in component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
opaquematnomass_3 = HBOpaqueMaterialNoMass(name="AirGap", r_value=division_7)  # -> flatten(mat); plug-in component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
opaquemat_2 = HBOpaqueMaterial(
    name="FacadeCladding",
    thickness=importmaterial_4.thickness_m,
    conductivity=importmaterial_4.conductivity,
    density=importmaterial_4.density,
    spec_heat=importmaterial_4.sp_heat)  # -> flatten(mat); plug-in component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
filter_4 = StreamFilter(Gate=equals.Equality, Stream0=opaquematnomass)
importglazing = GhPythonScript(glazing_name=trees_from_building.glazing_system)  # -> flatten(frame_type), glass_type, flatten(u_value), flatten(t_vis), embodied_carbon_metric, embodied_carbon_imperial
# ---------- importglazing: Python ----------
__author__ = "preston"

import rhinoscriptsyntax as rs
import sys

studiopath = "/Users/preston/Documents/GitHub/studio2021/src"
sys.path.append(studiopath)
import studio2021

from studio2021.functions import read_glazing

glazing = read_glazing(glazing_name)

print(glazing.keys())

frame_type = glazing['frame_type']
glass_type = glazing['glass_type']
u_value = glazing['u_value']
t_vis = glazing['t_vis']
embodied_carbon_metric = glazing['embodied_carbon_metric']
embodied_carbon_imperial = glazing['embodied_carbon_imperial']
# ---------- end importglazing ----------
clean_3 = CleanTree(
    RemoveNulls=True,
    RemoveInvalid=True,
    RemoveEmpty=False,
    Tree=flatten([opaquemat_2, opaquematnomass_3, filter_4, opaquemat]))
item_2 = ListItem(List=importglazing.u_value, Index=0, Wrap=True)
item_3 = ListItem(List=importglazing.frame_type, Index=0, Wrap=True)
item_4 = ListItem(List=importglazing.t_vis, Index=0, Wrap=True)
opaqueconstr_5 = HBOpaqueConstruction(name="ExteriorWall", materials=clean_3)  # -> constr; plug-in component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
equals_2 = Equality(FirstNumber=division_5, SecondNumber=-1)  # -> Equality, Inequality
multiplication_5 = Multiplication(A=item_2, B=Slider(5.678, range=0..10))
decnstrconstr = HBDeconstructConstruction(constr=opaqueconstr_5)  # -> materials, layers, r_val_si, r_val_ip, u_fac_si, u_fac_ip, t_sol, t_vis; plug-in component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
decnstrmat_2 = HBDeconstructMaterial(mat=opaqueconstr_5)  # -> values, attr_names, r_val_si, r_val_ip; plug-in component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
windowmat = HBWindowMaterial(name=item_3, u_factor=flatten(multiplication_5), shgc=flatten(bang_2.Branch0), t_vis=flatten(item_4))  # -> mat; plug-in component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
one_over_x = OneOverX(Value=decnstrconstr.u_fac_ip)
r_value_of_wall_construction = Panel(one_over_x)
windowconstr = HBWindowConstruction(name="NGlass", materials=flatten(windowmat))  # -> constr; plug-in component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

face = HBFace(
    geo=trees_from_building.ceiling_surfaces,
    name="RoofCeiling",
    type="RoofCeiling",
    bc=trees_from_building.ceiling_condition,
    ep_constr=ceiling)  # -> report, flatten(faces); plug-in component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

face_2 = HBFace(geo=trees_from_building.adiabatic_walls, name="Adiabatic Wall", type="Wall", bc="Adiabatic")  # -> report, flatten(faces); plug-in component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

face_3 = HBFace(
    geo=trees_from_building.floor_surfaces,
    name="Floor",
    type="Floor",
    bc=trees_from_building.floor_condition,
    ep_constr=floor)  # -> report, flatten(faces); plug-in component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

aperture = HBAperture(geo=rotate_3.Geometry, ep_constr=windowconstr)  # -> report, apertures; plug-in component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
face_4 = HBFace(geo=clean_2, name="ExWall", type="Wall", bc="Outdoors", ep_constr=opaqueconstr_5)  # -> report, flatten(faces); plug-in component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
room = HBRoom(
    faces=[face_2.faces, face_3.faces, face.faces, face_4.faces],
    name=bang_3.Branch0,
    program=trees_from_building.zone_program,
    conditioned=True)  # -> report, room; plug-in component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
panel_20 = Panel("""False
False""")
panel_21 = Panel("""True
True""")
panel_22 = Panel("""True
True""")
roomattr = HBRoomAttributes({"Display Name": "display_name", "Simulation Name (Identifier)": "identifier", "Multiplier": "multiplier", "Story": "story", "Volume": "volume", "Gross Floor Area": "floor_area", "Exposed Area": "exposed_area", "Exterior Wall Area": "exterior_wall_area", "Exterior Aperture Area": "exterior_aperture_area", "Average Floor Elevation": "average_floor_height"}, selected="Simulation Name (Identifier)")
division_9 = Division(A=parameters.shading, B=12)
area_2 = Area(Geometry=trees_from_building.floor_surfaces)  # -> Area, Centroid
addsubface = HBAddSubface(hb_obj=flatten(room.room), sub_faces=flatten(aperture.apertures))  # -> hb_obj; plug-in component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
filter_5 = StreamFilter(Gate=parameters.orientation, Stream2=panel_20, Stream3=panel_21, Stream4=panel_22)
panel_23 = Panel("""  Daylighting:Controls,
  Test,     		   !- Name
  Zone_Name,               !- Zone Name
  SplitFlux,               !- Daylighting Method
  ,                        !- Availability Schedule Name
  Continuous,              !- Lighting Control Type
  0.3,                     !- Minimum Input Power Fraction for Continuous or ContinuousOff Dimming Control
  0.2,                     !- Minimum Light Output Fraction for Continuous or ContinuousOff Dimming Control
  ,                        !- Number of Stepped Control Steps
  1.0,                     !- Probability Lighting will be Reset When Needed in Manual Stepped Control
  DaylRefPt1,              !- Glare Calculation Daylighting Reference Point Name
  180.0,                   !- Glare Calculation Azimuth Angle of View Direction Clockwise from Zone y-Axis {deg}
  20.0,                    !- Maximum Allowable Discomfort Glare Index
  ,                        !- DElight Gridding Resolution {m2}
  DaylRefPt1,              !- Daylighting Reference Point 1 Name
  1.0,                     !- Fraction of Zone Controlled by Reference Point 1
  500.;                    !- Illuminance Setpoint at Reference Point 1 {lux}""")
split = SplitList(List=filter_5, Index=1)  # -> ListA, ListB
equals_3 = Equality(FirstNumber=division_9, SecondNumber=0)  # -> Equality, Inequality
move = Move(Geometry=area_2.Centroid, Motion="{0,0,3}")  # -> Geometry, Transform
louvershades = HBLouverShades(hb_objs=flatten(addsubface), depth=division_9, vertical=split.ListA, flip_start=split.ListB)  # -> report, hb_objs; plug-in component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
shade = HBShade(geo=trees_from_building.context)  # -> report, shades; plug-in component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
filter_6 = StreamFilter(Gate=equals_3.Equality, Stream0=louvershades.hb_objs, Stream1=addsubface)
pdecon = Deconstruct(Point=move.Geometry)  # -> XComponent, YComponent, ZComponent
filter_7 = StreamFilter(Gate=equals_2.Equality, Stream0=filter_6, Stream1=room.room)
clean_4 = CleanTree(RemoveNulls=True, RemoveInvalid=True, RemoveEmpty=True, Tree=pdecon.XComponent)
clean_5 = CleanTree(RemoveNulls=True, RemoveInvalid=True, RemoveEmpty=False, Tree=shade.shades)
clean_6 = CleanTree(RemoveNulls=True, RemoveInvalid=True, RemoveEmpty=True, Tree=pdecon.ZComponent)
panel_24 = Panel("""  Daylighting:ReferencePoint,
  DaylRefPt1,              !- Name
  Zone_Name,               !- Zone Name
  point1_x,                !- X-Coordinate of Reference Point {m}
  point1_y,                !- Y-Coordinate of Reference Point {m}
  point1_z;                !- Z-Coordinate of Reference Point {m}""")
clean_7 = CleanTree(RemoveNulls=True, RemoveInvalid=True, RemoveEmpty=True, Tree=pdecon.YComponent)
clean_8 = CleanTree(RemoveNulls=True, RemoveInvalid=True, RemoveEmpty=False, Tree=filter_7)  # -> flatten(Tree)
labelrooms = HBLabelRooms(rooms_model=flatten(clean_8), attribute=roomattr)  # -> graft(label_text), base_pts, labels, wire_frame; plug-in component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
lng = ListLength(List=flatten(labelrooms.label_text))
panel_25 = Panel(lng)
panel_26 = Panel("""Run1
Run2
Run3
Run4
Run5""")
split_2 = SplitList(List=panel_26, Index=panel_25)  # -> ListA, ListB
panel_27 = Panel("""Point1
Point2
Point3
Point4
Point5""")
rep = ReplaceText(Text=panel_23, Find="Zone_Name", Replace=simplify(labelrooms.label_text), RecursiveReplace=False)
rep_2 = ReplaceText(Text=rep, Find="Test", Replace=graft(split_2.ListA), RecursiveReplace=False)
split_3 = SplitList(List=panel_27, Index=panel_25)  # -> ListA, ListB
applyloadvals = HBApplyLoadValues(room_or_program=flatten(clean_8), infilt_per_exterior=trees_from_building.inf_rate)  # -> report, mod_obj; plug-in component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
rep_3 = ReplaceText(Text=panel_24, Find="Zone_Name", Replace=simplify(labelrooms.label_text), RecursiveReplace=False)
rep_4 = ReplaceText(Text=rep_2, Find="DaylRefPt1", Replace=graft(split_3.ListA), RecursiveReplace=False)  # -> flatten(Result)
rep_5 = ReplaceText(Text=rep_3, Find="DaylRefPt1", Replace=graft(split_3.ListA), RecursiveReplace=False)
rep_6 = ReplaceText(Text=rep_5, Find="point1_x", Replace=clean_4, RecursiveReplace=False)
rep_7 = ReplaceText(Text=rep_6, Find="point1_y", Replace=clean_7, RecursiveReplace=False)
rep_8 = ReplaceText(Text=rep_7, Find="point1_z", Replace=clean_6, RecursiveReplace=False)  # -> flatten(Result)
model = HBModel(rooms=flatten(applyloadvals.mod_obj), shades=flatten(clean_5), name=trees_from_building.simulation_name)  # -> report, model; plug-in component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
join = TextJoin(Text=rep_4)
join_2 = TextJoin(Text=rep_8)

# ----
# View Zones
vizbytype = HBVisualizeByType(hb_objs=filter_7)  # -> walls, interior_walls, roofs, ceilings, exterior_floors, interior_floors, air_walls, apertures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; plug-in component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

simoutput = HBSimulationOutput(zone_energy_use=Toggle(True), gains_and_losses=Toggle(True))  # -> report, sim_output; plug-in component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
join_3 = TextJoin(Text=[join, join_2])
faceenergyattr = HBFaceEnergyAttributes({"Construction": "properties.energy.construction.display_name", "Materials": "properties.energy.construction.layers", "R-Value": "properties.energy.construction.r_value", "U-Value": "properties.energy.construction.u_value", "U-Factor": "properties.energy.construction.u_factor", "Solar Transmitance [Unshaded]": "properties.energy.construction.solar_transmittance", "Solar Reflectance [Outside]": "properties.energy.construction.outside_solar_reflectance", "Solar Reflectance [Inside]": "properties.energy.construction.inside_solar_reflectance", "Fraction Area Operable": "properties.energy.vent_opening.fraction_area_operable", "Fraction Height Operable": "properties.energy.vent_opening.fraction_height_operable", "Discharge Coefficient": "properties.energy.vent_opening.discharge_coefficient", "Cross Ventilation": "properties.energy.vent_opening.wind_cross_vent"}, selected="Construction")
simpar = HBSimulationParameter(output=simoutput.sim_output, timestep=6)  # -> sim_par; plug-in component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
lablefaces = HBLabelFaces(hb_objs=flatten(clean_8), attribute=faceenergyattr)  # -> label_text, base_pts, labels, wire_frame; plug-in component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
modeltoosm = HBModelToOSM(
    model=model.model,
    epw_file=trees_from_building.weather_file,
    sim_par=simpar,
    add_str=join_3,
    folder=trees_from_building.simulation_folder,
    write=trees_from_building.run_simulation,
    run=trees_from_building.run_simulation)  # -> report, jsons, osw, osm, idf, sql, zsz, rdd, html; plug-in component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
list_8 = ItemSelector(
    lablefaces.label_text,
    {"Generic Interior Wall", "Generic Interior Wall", "Generic Interior Wall", "Floor_Residential", "Ceiling_Residential", "ExteriorWall"}, selected="Generic Interior Wall")
decnstrconstr_2 = HBDeconstructConstruction(constr=list_8)  # -> materials, layers, r_val_si, r_val_ip, u_fac_si, u_fac_ip, t_sol, t_vis; plug-in component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
roomenergyresult = HBReadRoomEnergyResult(sql=modeltoosm.sql)  # -> cooling, heating, lighting, electric_equip, gas_equip, hot_water, fan_electric, pump_electric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; plug-in component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
add_euis = GhPythonScript(
    building=trees_from_building.building,
    cooling=roomenergyresult.cooling,
    heating=roomenergyresult.heating,
    lighting=roomenergyresult.lighting,
    equipment=roomenergyresult.electric_equip,
    hot_water=roomenergyresult.hot_water,
    solar_gain=roomenergyresult.solar_gain,
    wall_r=one_over_x,
    window_u=item_2)  # -> out, building; inputs cooling: list, heating: list, lighting: list, equipment: list, hot_water: list
# ---------- add_euis: Python ----------
__author__ = "tmendeze"

building.add_eui_results(cooling,
                         heating,
                         lighting,
                         equipment,
                         hot_water,
                         solar_gain,
                         wall_r,
                         window_u,
                         hourly=False)
# ---------- end add_euis ----------
panel_28 = Panel(add_euis.out)
write_results = GhPythonScript(building=add_euis.building)  # -> out
# ---------- write_results: Python ----------
__author__ = "tmendeze"

building.write_results(csv=False, delete=True)
# ---------- end write_results ----------
panel_29 = Panel(write_results)

# ==== cluster BlackBox
_0_0 = ClusterInput()
_0_1 = ClusterInput()
_0_2 = ClusterInput()
_0_3 = ClusterInput()
_0_4 = ClusterInput()
_0_5 = ClusterInput()
_0_6 = ClusterInput()
_0_7 = ClusterInput()
_0_8 = ClusterInput()
_0_9 = ClusterInput()
_0_10 = ClusterInput()
_0_11 = ClusterInput()
_0_12 = ClusterInput()
_0_13 = ClusterInput()
_0_14 = ClusterInput()
_0_15 = ClusterInput()
_0_16 = ClusterInput()
_0_17 = ClusterInput()
_0_18 = ClusterInput()
_0_19 = ClusterInput()
_0_20 = ClusterInput()
_0_21 = ClusterInput()
_0_22 = ClusterInput()
_0_23 = ClusterInput()
_0_24 = ClusterInput()
_0_25 = ClusterInput()
_0_26 = ClusterInput()
_0_27 = ClusterInput()
_0_28 = ClusterInput()
_0_29 = ClusterInput()
_0_30 = ClusterInput()
_0_31 = ClusterInput()
_0_32 = ClusterInput()
_0_33 = ClusterInput()
_0_34 = ClusterInput()
_0_35 = ClusterInput()
_0_36 = ClusterInput()
int_ins_th = ClusterInput()  # int_ins_th
_0_38 = ClusterInput()
gather_all_info_from_scenario = Entwine(
    Branch00=_0_0,
    Branch01=_0_1,
    Branch02=_0_2,
    Branch03=_0_3,
    Branch04=_0_4,
    Branch05=_0_5,
    Branch06=_0_6,
    Branch07=_0_7,
    Branch08=_0_8,
    Branch09=_0_9,
    Branch010=_0_10,
    Branch011=_0_11,
    Branch012=_0_12,
    Branch013=_0_13,
    Branch014=_0_14,
    Branch015=_0_15,
    Branch016=_0_16,
    Branch017=_0_17,
    Branch018=_0_18,
    Branch019=_0_19,
    Branch020=_0_20,
    Branch021=_0_21,
    Branch022=_0_22,
    Branch023=_0_23,
    Branch024=_0_24,
    Branch025=_0_25,
    Branch026=_0_26,
    Branch027=_0_27,
    Branch028=_0_28,
    Branch029=_0_29,
    Branch030=_0_30,
    Branch031=_0_31,
    Branch032=_0_32,
    Branch033=_0_33,
    Branch034=_0_34,
    Branch035=_0_35,
    Branch036=_0_36,
    Branch037=int_ins_th,
    Branch038=_0_38,
    FlattenInputs=True)  # -> simplify(Result)
branch = TreeBranch(Tree=gather_all_info_from_scenario, Path="{0}", MaintainPaths=True)  # -> flatten(ConnectToMassingOptions)
subset = SubSet(SetA=branch)
filter = StreamFilter(Gate=Toggle(True), Stream1=gather_all_info_from_scenario)
_0_0_2 = ClusterInput()
_0_1_2 = ClusterInput()
_0_2_2 = ClusterInput()
_0_3_2 = ClusterInput()
_0_4_2 = ClusterInput()

merge = Merge(Data2=filter)
bang = ExplodeTree(Data=merge)  # -> Branch0, Branch1, Branch2, Branch3, Branch4, Branch5, Branch6, Branch7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
adiabaticcrv = Entwine(
    Branch00=bang.Branch3,
    Branch01=bang.Branch5,
    Branch02=bang.Branch7,
    Branch03=bang.Branch9,
    Branch04=bang.Branch10,
    FlattenInputs=True)  # -> simplify(Result)
outsidecrv = Entwine(Branch00=bang.Branch2, Branch01=bang.Branch4, Branch02=bang.Branch6, Branch03=bang.Branch8, FlattenInputs=True)  # -> simplify(Result)
zone = Entwine(Branch00=_0_0_2, Branch01=_0_1_2, Branch02=_0_2_2, Branch03=_0_3_2, Branch04=_0_4_2, FlattenInputs=True)  # -> simplify(Result)
vertical_shade_depth_direction_1 = Entwine(Branch00=bang.Branch21, Branch01=bang.Branch22, Branch02=bang.Branch23, Branch03=bang.Branch24, FlattenInputs=True)  # -> simplify(Result)
wwr = Entwine(Branch00=bang.Branch13, Branch01=bang.Branch14, Branch02=bang.Branch15, Branch03=bang.Branch16, FlattenInputs=True)  # -> simplify(Result)
horizontal_shade_depth = Entwine(Branch00=bang.Branch17, Branch01=bang.Branch18, Branch02=bang.Branch19, Branch03=bang.Branch20, FlattenInputs=True)  # -> simplify(Result)
shgc = Entwine(Branch00=bang.Branch29, Branch01=bang.Branch30, Branch02=bang.Branch31, Branch03=bang.Branch32, FlattenInputs=True)  # -> simplify(Result)
vertical_shade_depth_direction_2 = Entwine(Branch00=bang.Branch25, Branch01=bang.Branch26, Branch02=bang.Branch27, Branch03=bang.Branch28, FlattenInputs=True)  # -> simplify(Result)
division = Division(A=horizontal_shade_depth, B=12)
division_2 = Division(A=vertical_shade_depth_direction_1, B=12)
division_3 = Division(A=vertical_shade_depth_direction_2, B=12)

boundary = BoundarySurfaces(FloorCrvs=[outsidecrv, adiabaticcrv])  # -> simplify(Surfaces)
Z = UnitZ(Factor=bang.Branch1)
extr = Extrude(Base=boundary, Direction=Z)
extr_2 = Extrude(OutsideCrv=outsidecrv, Direction=Z)  # -> simplify(OutsideSrf)
debrep = DeconstructBrep(Brep=extr)  # -> simplify(Faces), Edges, Vertices
area = Area(Geometry=debrep.Faces)  # -> Area, Centroid
brep = Brep(debrep.Faces)
area_2 = Area(Geometry=extr_2)  # -> Area, Centroid
mindex = MemberIndex(Set=area.Centroid, Member=area_2.Centroid)  # -> Index, Count
srf = Surface([brep, extr_2])
trim = TrimTree(Tree=mindex.Index, Depth=1)
join = JoinCurves(Curves=[outsidecrv, adiabaticcrv], Preserve=False)  # -> simplify(Curves)
item = ListItem(List=srf, Index=trim, Wrap=True)
extr_3 = Extrude(AdiabaticCrv=adiabaticcrv, Direction=Z)  # -> simplify(AdiabaticSrf)
move = Move(Geometry=join, Motion=Z)  # -> Geometry, Transform
clean = CleanTree(RemoveNulls=True, RemoveInvalid=True, RemoveEmpty=True, Tree=item)  # -> simplify(Tree)
facen = FaceNormals(Mesh=clean)  # -> Centers, Normals
debrep_2 = DeconstructBrep(Brep=extr_3)  # -> Faces, Edges, Vertices
cullpt = CullDuplicates(Points=facen.Normals, Tolerance=0.1, CullMode=3)  # -> Points, Indices, Valence
join_2 = JoinCurves(Curves=debrep_2.Edges, Preserve=False)
devec = DeconstructVector(Vector=cullpt.Points)  # -> XComponent, YComponent, ZComponent
trim_2 = TrimTree(Tree=join_2, Depth=Slider(2, range=0..10))
larger = LargerThan(FirstNumber=devec.XComponent, SecondNumber="-0.707")  # -> LargerThan, OrEqualTo
smaller = SmallerThan(FirstNumber=devec.YComponent, SecondNumber="-0.707")  # -> SmallerThan, OrEqualTo
larger_2 = LargerThan(FirstNumber=devec.YComponent, SecondNumber="-1")  # -> LargerThan, OrEqualTo
smaller_2 = SmallerThan(FirstNumber=devec.YComponent, SecondNumber="1")  # -> SmallerThan, OrEqualTo
larger_3 = LargerThan(FirstNumber=devec.YComponent, SecondNumber="0.707")  # -> LargerThan, OrEqualTo
smaller_3 = SmallerThan(FirstNumber=devec.XComponent, SecondNumber="1")  # -> SmallerThan, OrEqualTo
smaller_4 = SmallerThan(FirstNumber=devec.XComponent, SecondNumber="0.707")  # -> SmallerThan, OrEqualTo
smaller_5 = SmallerThan(FirstNumber=devec.YComponent, SecondNumber="0.707")  # -> SmallerThan, OrEqualTo
larger_4 = LargerThan(FirstNumber=devec.YComponent, SecondNumber="-0.707")  # -> LargerThan, OrEqualTo
larger_5 = LargerThan(FirstNumber=devec.XComponent, SecondNumber="0.707")  # -> LargerThan, OrEqualTo
larger_6 = LargerThan(FirstNumber=devec.XComponent, SecondNumber="-1")  # -> LargerThan, OrEqualTo
smaller_6 = SmallerThan(FirstNumber=devec.XComponent, SecondNumber="-0.707")  # -> SmallerThan, OrEqualTo
and = GateAnd(A=larger.LargerThan, B=smaller_4.SmallerThan)
and_2 = GateAnd(A=larger_2.OrEqualTo, B=smaller.SmallerThan)
and_3 = GateAnd(A=larger_3.LargerThan, B=smaller_2.OrEqualTo)
and_4 = GateAnd(A=larger_5.LargerThan, B=smaller_3.OrEqualTo)
and_5 = GateAnd(A=larger_4.OrEqualTo, B=smaller_5.SmallerThan)
and_6 = GateAnd(A=larger_6.OrEqualTo, B=smaller_6.SmallerThan)
and_7 = GateAnd(A=and, B=and_3)
and_8 = GateAnd(A=and, B=and_2)
and_9 = GateAnd(A=and_5, B=and_6)
and_10 = GateAnd(A=and_4, B=and_5)
cull = CullPattern(List=graft(clean), CullPattern=and_8)
cull_2 = CullPattern(List=graft(clean), CullPattern=and_9)
cull_3 = CullPattern(List=graft(clean), CullPattern=and_10)
cull_4 = CullPattern(List=graft(clean), CullPattern=and_7)
pshift = ShiftPaths(Data=cull, Offset=-2)
pshift_2 = ShiftPaths(Data=cull_4, Offset=-2)
pshift_3 = ShiftPaths(Data=cull_2, Offset=-2)
pshift_4 = ShiftPaths(Data=cull_3, Offset=-2)
debrep_3 = DeconstructBrep(Brep=pshift_2)  # -> Faces, Edges, Vertices
debrep_4 = DeconstructBrep(Brep=pshift)  # -> Faces, Edges, Vertices
debrep_5 = DeconstructBrep(Brep=pshift_4)  # -> Faces, Edges, Vertices
debrep_6 = DeconstructBrep(Brep=pshift_3)  # -> Faces, Edges, Vertices
join_3 = JoinCurves(Curves=debrep_3.Edges, Preserve=False)
join_4 = JoinCurves(Curves=debrep_4.Edges, Preserve=False)
join_5 = JoinCurves(Curves=debrep_5.Edges, Preserve=False)
join_6 = JoinCurves(Curves=debrep_6.Edges, Preserve=False)
trim_3 = TrimTree(Tree=join_3, Depth=Slider(2, range=0..10))
trim_4 = TrimTree(Tree=join_4, Depth=Slider(2, range=0..10))
trim_5 = TrimTree(Tree=join_5, Depth=Slider(2, range=0..10))
trim_6 = TrimTree(Tree=join_6, Depth=Slider(2, range=0..10))
clean_2 = CleanTree(RemoveNulls=True, RemoveInvalid=True, RemoveEmpty=False, Tree=move.Geometry)
interior_insul_mat = ClusterInput()
building_type = ClusterInput()
num_floors_above = ClusterInput()
composite_slab = ClusterInput()
ewall_framing = ClusterInput()
cores = ClusterInput()
glazing_system = ClusterInput()
city = ClusterInput()
simulation_name = ClusterInput()
win_geometry = ClusterInput()
total_shade_len = ClusterInput()
context = ClusterInput()
kgco2e_kwh = ClusterInput()
inf_rate = ClusterInput()
weather_file = ClusterInput()
csv = ClusterInput()
sql_path = ClusterInput()
simulation_folder = ClusterInput()
run_simulation = ClusterInput()
columns = ClusterInput()
beams_x = ClusterInput()
beams_y = ClusterInput()
building = GhPythonScript(
    city=city,
    znames=zone,
    wwr=wwr,
    height=bang.Branch1,
    shade_gc=shgc,
    shade_depth_h=division,
    shade_depth_v1=division_2,
    shade_depth_v2=division_3,
    exterior_walls_n=trim_3,
    exterior_walls_s=trim_4,
    exterior_walls_e=trim_5,
    exterior_walls_w=trim_6,
    adiabatic_walls=trim_2,
    floor_surfaces=join,
    ceiling_surfaces=clean_2,
    facade_cladding=bang.Branch34,
    external_insulation=bang.Branch35,
    insulation_thickness=bang.Branch36,
    interior_insul_mat=interior_insul_mat,
    int_ins_thickness=int_ins_th,
    ewall_framing=ewall_framing,
    int_finish=bang.Branch38,
    glazing_system=glazing_system,
    simulation_name=simulation_name,
    zone_program=bang.Branch33,
    weather_file=weather_file,
    csv=csv,
    sql_path=sql_path,
    simulation_folder=simulation_folder,
    run_simulation=run_simulation,
    columns=columns,
    beams_x=beams_x,
    beams_y=beams_y,
    cores=cores,
    building_type=building_type,
    num_floors_above=num_floors_above,
    composite_slab=composite_slab,
    ceiling_condition=bang.Branch11,
    floor_condition=bang.Branch12,
    kgco2e_kwh=kgco2e_kwh,
    context=context,
    win_geometry=win_geometry,
    total_shade_len=total_shade_len,
    inf_rate=inf_rate)  # -> out, building; inputs znames: tree, wwr: tree, shade_gc: tree, shade_depth_h: tree, shade_depth_v1: tree, shade_depth_v2: tree, exterior_walls_n: tree, exterior_walls_s: tree, exterior_walls_e: tree, exterior_walls_w: tree, adiabatic_walls: tree, floor_surfaces: tree, ceiling_surfaces: tree, columns: list, beams_x: list, beams_y: list, cores: list, context: list, win_geometry: list
# ---------- building: Python ----------
from studio2021.datastructures import building
reload(building)
from studio2021.datastructures.building import Building
import rhinoscriptsyntax as rs


columns = [[rs.CurveStartPoint(c), rs.CurveEndPoint(c)] for c in columns]
beams_x = [[rs.CurveStartPoint(b), rs.CurveEndPoint(b)] for b in beams_x]
beams_y = [[rs.CurveStartPoint(b), rs.CurveEndPoint(b)] for b in beams_y]
cores   = [rs.PolylineVertices(core) for core in cores]

context_ = []
for guid in context:
    if rs.IsSurface(guid):
        pt = [list(p) for p in rs.SurfacePoints(guid)]
        context_.append((pt[0], pt[1], pt[3], pt[2]))
    elif rs.IsBrep(guid):
        srfs = rs.ExplodePolysurfaces(guid)
        for srf in srfs:
            pt = [list(p) for p in rs.SurfacePoints(srf)]
            context_.append((pt[0], pt[1], pt[3], pt[2]))

if win_geometry[0]:
    win_geometry_ = []
    for guid in win_geometry:
        if rs.IsSurface(guid):
            pt = [list(p) for p in rs.SurfacePoints(guid)]
            win_geometry_.append((pt[0], pt[1], pt[3], pt[2]))
else:
    win_geometry_ = []


data = {'city': city,
        'znames': znames,
        'exterior_walls_n': exterior_walls_n,
        'exterior_walls_s': exterior_walls_s,
        'exterior_walls_e': exterior_walls_e,
        'exterior_walls_w': exterior_walls_w,
        'adiabatic_walls': adiabatic_walls,
        'floor_surfaces': floor_surfaces,
        'ceiling_surfaces': ceiling_surfaces,
        'wwr':wwr,
        'height': height,
        'shade_gc':shade_gc,
        'shade_depth_h':shade_depth_h,
        'shade_depth_v1':shade_depth_v1,
        'shade_depth_v2':shade_depth_v2,
        'facade_cladding':facade_cladding,
        'external_insulation':external_insulation,
        'insulation_thickness':insulation_thickness,
        'interior_insul_mat':interior_insul_mat,
        'int_ins_thickness':int_ins_thickness,
        'ewall_framing':ewall_framing,
        'int_finish':int_finish,
        'glazing_system':glazing_system,
        'simulation_name': simulation_name,
        'zone_program': zone_program,
        'weather_file': weather_file,
        'csv':csv,
        'sql_path': sql_path,
        'simulation_folder': simulation_folder,
        'run_simulation': run_simulation,
        'columns': columns,
        'beams_x': beams_x,
        'beams_y': beams_y,
        'cores':cores,
        'building_type':building_type,
        'num_floors_above':num_floors_above,
        'composite_slab':composite_slab,
        'ceiling_condition': ceiling_condition,
        'floor_condition': floor_condition,
        'kgco2e_kwh': kgco2e_kwh,
        'context':context_,
        'win_geometry': win_geometry_,
        'total_shade_len':total_shade_len,
        'inf_rate':inf_rate,
        }

building = Building.from_gh_data(data)
# ---------- end building ----------
out = ClusterOutput(building.out)
panel = Panel(building.out)
building_2 = ClusterOutput(building.building)
