# Grasshopper definition pie_makergh.gh (Grasshopper 1.0.7)

pie_maker = GhPythonScript(filename="5_zone_rectangle_202103301746.csv", num_years=Slider(50, range=0..100))  # -> out, embodied, operational, emb_v_op
# ---------- pie_maker: Python ----------
__author__ = "tmendeze"

import os
import studio2021

path = studio2021.TEMP

filepath = os.path.join(path, filename)
fh = open(filepath, 'r')
lines = fh.readlines()
fh.close()

# embodied - - - -

emb = lines[29].split(',')
slab, beam, col, win, wall, tot = emb[1:7]

slab = float(slab)
beam = float(beam)
col = float(col)
win = float(win)
wall = float(wall)
tot = float(tot)

slab = round(100*(slab / tot), 1)
beam = round(100*(beam / tot), 1)
col = round(100*(col / tot), 1)
win = round(100*(win / tot), 1)
wall = round(100*(wall / tot), 1)

s = ['slab {}%'.format(slab)] * int(slab)
b = ['beam {}%'.format(beam)] * int(beam)
c = ['column {}%'.format(col)] * int(col)
wi = ['window {}%'.format(win)] * int(win)
wa = ['wall {}%'.format(wall)] * int(wall)

embodied = s + b + c + wi + wa

# operational - - - -

cool = float(lines[65].split(',')[6])
heat = float(lines[66].split(',')[6])
li = float(lines[67].split(',')[6])
eq = float(lines[68].split(',')[6])
wat = float(lines[69].split(',')[6])
tot_ = float(lines[70].split(',')[6])

cool = round(100*(cool / tot_), 1)
heat = round(100*(heat / tot_), 1)
li = round(100*(li / tot_), 1)
eq = round(100*(eq / tot_), 1)
wat = round(100*(wat / tot_), 1)

s = ['cooling {}%'.format(cool)] * int(cool)
b = ['heating {}%'.format(heat)] * int(heat)
c = ['lighting {}%'.format(li)] * int(li)
wi = ['equipment {}%'.format(eq)] * int(eq)
wa = ['hot water {}%'.format(wat)] * int(wat)

operational = s + b + c + wi + wa

# operational vs embodied  - - - 

tot_ *= num_years

t = tot + tot_
e = round(100*(tot / t), 1)
o = round(100*(tot_ / t), 1)

print(tot, tot_)

e = ['embodied {}%'.format(e)] * int(e)
o = ['operational {}%'.format(o)] * int(o)



emb_v_op = e + o
# ---------- end pie_maker ----------
pie = PieChart(pie_maker.operational)
pie_2 = PieChart(pie_maker.embodied)
pie_3 = PieChart(pie_maker.emb_v_op)
