# Grasshopper definition wall_r_fix.gh (Grasshopper 1.0.7)

number_slider = Slider(20234, range=13125..23125)
panel = Panel("/Users/tmendeze/Documents/UW/03_publications/studio2021/envelope_paper/all_data_")
all_files = GhPythonScript(path=panel, i=Slider(25529, range=20234..30234))  # -> out, file; inputs i: Int32
# ---------- all_files: Python ----------
__author__ = "tmendeze"

import os

files = os.listdir(path)
file = files[i]
print(len(files))
# ---------- end all_files ----------
panel_2 = Panel(all_files.file)
panel_3 = Panel(all_files.out)
read_json = GhPythonScript(path=panel, file=panel_2)  # -> out, facade_cladding, external_insulation, interior_insul_mat, ewall_framing, int_finish, insulation_thickness
# ---------- read_json: Python ----------
__author__ = "tmendeze"

import json
import os

filepath = os.path.join(path, file)

with open(filepath, 'r') as fp:
    data = json.load(fp)
    
facade_cladding = data['facade_cladding']
external_insulation = data['external_insulation']
interior_insul_mat = data['interior_insul_mat']
ewall_framing = data['ewall_framing']
int_finish = data['int_finish']
insulation_thickness = data['insulation_thickness']
# ---------- end read_json ----------
panel_4 = Panel(read_json.out)
join = TextJoin(Text=[read_json.interior_insul_mat, read_json.ewall_framing], Join=" ")
importmaterial = GhPythonScript(material_name=read_json.external_insulation)  # -> r_per_in, embodied_carbon, type, thickness_in, thickness_m, conductivity, density, sp_heat, r_value
# ---------- importmaterial: Python ----------
__author__ = "preston"

import rhinoscriptsyntax as rs
import sys

studiopath = "/Users/preston/Documents/GitHub/studio2021/src"
sys.path.append(studiopath)
import studio2021

from studio2021.functions import read_materials

material = read_materials(material_name)

print(material.keys())

r_per_in = material["r_per_in"]
embodied_carbon = material["embodied_carbon"]
type = material["mtype"]
density = material["density"]
sp_heat = material["sp_heat"]
thickness_in = material["thickness_in"]
thickness_m = material["thickness_m"]
r_value = material["r_value"]
conductivity = material["conductivity"]
# ---------- end importmaterial ----------
importmaterial_2 = GhPythonScript(material_name=read_json.facade_cladding)  # -> r_per_in, embodied_carbon, type, thickness_in, thickness_m, conductivity, density, sp_heat, r_value; same code as importmaterial
importmaterial_3 = GhPythonScript(material_name=join)  # -> r_per_in, embodied_carbon, type, thickness_in, thickness_m, conductivity, density, sp_heat, r_value; same code as importmaterial
importmaterial_4 = GhPythonScript(material_name=read_json.int_finish)  # -> r_per_in, embodied_carbon, type, thickness_in, thickness_m, conductivity, density, sp_heat, r_value; same code as importmaterial
multiplication = Multiplication(A=importmaterial.r_per_in, B=read_json.insulation_thickness)
division = Division(A=importmaterial_3.r_value, B=5.67826)
division_2 = Division(A=multiplication, B=5.67826)
equals = Equality(FirstNumber=read_json.insulation_thickness, SecondNumber=0)  # -> Equality, Inequality
opaquematnomass = HBOpaqueMaterialNoMass(name="ContExtInsulation", r_value=division_2)  # -> mat; plug-in component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
opaquemat = HBOpaqueMaterial(
    name="InteriorFinish",
    thickness=importmaterial_4.thickness_m,
    conductivity=importmaterial_4.conductivity,
    density=importmaterial_4.density,
    spec_heat=importmaterial_4.sp_heat)  # -> mat; plug-in component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
opaquematnomass_2 = HBOpaqueMaterialNoMass(name="ExtFraming", r_value=division)  # -> mat; plug-in component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
opaquematnomass_3 = HBOpaqueMaterialNoMass(name="AirGap", r_value=Slider(1, range=0..1))  # -> flatten(mat); plug-in component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
opaquemat_2 = HBOpaqueMaterial(
    name="FacadeCladding",
    thickness=importmaterial_2.thickness_m,
    conductivity=importmaterial_2.conductivity,
    density=importmaterial_2.density,
    spec_heat=importmaterial_2.sp_heat)  # -> flatten(mat); plug-in component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
filter = StreamFilter(Gate=equals.Equality, Stream0=opaquematnomass)
clean = CleanTree(
    RemoveNulls=True,
    RemoveInvalid=True,
    RemoveEmpty=False,
    Tree=flatten([opaquemat_2, opaquematnomass_3, filter, opaquematnomass_2, opaquemat]))
opaqueconstr = HBOpaqueConstruction(name="ExteriorWall", materials=clean)  # -> constr; plug-in component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
join_2 = TextJoin(Join=" ")
decnstrmat = HBDeconstructMaterial(mat=opaqueconstr)  # -> values, attr_names, r_val_si, r_val_ip; plug-in component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
decnstrconstr = HBDeconstructConstruction(constr=opaqueconstr)  # -> materials, layers, r_val_si, r_val_ip, u_fac_si, u_fac_ip, t_sol, t_vis; plug-in component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
one_over_x = OneOverX(Value=decnstrconstr.u_fac_ip)
r_value_of_wall_construction = Panel(one_over_x)
update_json = GhPythonScript(path=panel, file=panel_2, wall_r=one_over_x)  # -> out
# ---------- update_json: Python ----------
__author__ = "tmendeze"

import json
import os

filepath = os.path.join(path, file)

with open(filepath, 'r') as fp:
    data = json.load(fp)
    
data['wall_r'] = wall_r

filepath = os.path.join(path, file)

with open(filepath, 'w+') as fp:
    json.dump(data, fp)
    
print(filepath)
# ---------- end update_json ----------
panel_5 = Panel(update_json)
